# Grasshopper definition CSharpWIP (2).gh (Grasshopper 0.9.76)
# plug-ins: ClipperComponents, Kangaroo Components

format = Format(Culture=127)
number_slider = Slider(2, range=0..10)
number_slider_2 = Slider(1, range=0..1, expression="-x")
curve = Curve([<curve referenced from the Rhino model> x2])
curve_2 = Curve(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)
curve_3 = Curve(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)
number_slider_3 = Slider(180, range=0..360)
number_slider_4 = Slider(9, range=0..19)
number_slider_5 = Slider(17, range=0..19)
discontinuity = Discontinuity(Curve=curve, Level=1)  # -> Points, Parameters
curve_4 = Curve([<curve referenced from the Rhino model> x2])
c_script = CSharpScript(x=curve_4, y=Slider(9, range=0..100), z=Slider(50, range=0..100), u=Slider(100, range=0..100))  # -> out, A, B, C, D, E, F; inputs x: list of Curve, y: Int32, z: Int32, u: Int32
# ---------- c_script: C# ----------
    List<Curve> cur = x;

    Curve c = cur[0];
    Curve cO = cur[1];

    Point3d[] pointsA;
    Point3d[] pointsB;

    if(y == 0 || y == 1)
    {

      y = 2;

    }

    c.DivideByCount(y, true, out pointsA);
    cO.DivideByCount(y, true, out pointsB);

    if(z > y - 1)
    {

      z = y - 1;

    }

    if(z == 0)
    {

      z = 1;

    }

    if(u > y - 1)
    {

      u = y - 1;

    }

    Vector3d referencePoint = new Vector3d(pointsA[0]);
    Vector3d vO = new Vector3d(pointsA[u]);
    Point3d p = new Point3d(pointsB[z]);
    Vector3d vT = new Vector3d(p);

    vT -= vO;
    c.Translate(vT);

    Rhino.Geometry.Intersect.CurveIntersections ci;
    ci = Rhino.Geometry.Intersect.Intersection.CurveCurve(c, cO, 0.001, 0.001);
    Point3d[] intPtsO = new Point3d[ci.Count];

    for(int i = 0; i < ci.Count; i++)
    {

      intPtsO[i] = ci[i].PointA;

    }

    //List<Point3d> pt = new List<Point3d>();

    for( int i = 0; i < y; i++ )
    {

      //pt.Add(pointsA[i]);

      if(ci.Count > 1)
      {

        vO = new Vector3d(intPtsO[0]);
        p = pointsB[i];
        vT = new Vector3d(p);

        vT -= vO;
        c.Translate(vT);

        ci = Rhino.Geometry.Intersect.Intersection.CurveCurve(c, cO, 0.001, 0.001);
        intPtsO = new Rhino.Geometry.Point3d[ci.Count];

        for(int j = 0; j < ci.Count; j++)
        {

          intPtsO[j] = ci[j].PointA;

        }

      }

    }

    A = c;
    B = cO;
    C = p;
    D = intPtsO;
    E = pointsA;
# ---------- end c_script ----------
c_script_2 = CSharpScript(
    A=curve_2,
    B=curve_3,
    x=Slider(20, range=0..50),
    l=Slider(0, range=0..100),
    y=number_slider_4,
    z=number_slider_5,
    u=number_slider_3)  # -> out, AOut, APoints, BPoints, End, CurveA, CurveB, Intersect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; inputs A: Curve, B: Curve, x: Int32, l: Int32, y: Int32, z: Int32, u: Double
# ---------- c_script_2: C# ----------
    Curve a = A;
    Point3d[] pointsA;
    a.DivideByCount(x, true, out pointsA);

    Curve b = B;
    Point3d[] pointsB;
    b.DivideByCount(x, true, out pointsB);

    //End = b.PointAtEnd;


    if(l > x - 1)
    {

      l = (x - 1);
      outs = String.Format("l index is bigger than the size of the x collection");

    }

    /*
    List<Point3d> pointList = new List<Point3d>();
    for( int i = 0; i < pointsA.Length; i++ )
    {
      pointList.Add(pointsA[i]);
    }
    //foreach(Point3d point in pointList){}
    */

    Vector3d vec = new Vector3d(pointsB[l]);
    Vector3d one = new Vector3d(a.PointAtEnd);
    vec -= one;

    a.Translate(vec);

    CurveA = a;
    CurveB = b;

    Rhino.Geometry.Intersect.CurveIntersections ci;
    ci = Rhino.Geometry.Intersect.Intersection.CurveCurve(a, b, 0.001, 0.001);
    Point3d[] intPts = new Rhino.Geometry.Point3d[ci.Count];

    Point3d[] ptsA;
    a.DivideByCount(x, true, out ptsA);
    two = ptsA;

    End = a.PointAtEnd;

    for(int i = 0; i < ci.Count; i++)
    {

      intPts[i] = ci[i].PointA;

    }
    Intersect = intPts;

    if(ci.Count > 1)
    {


      Vector3d vO = new Vector3d(ptsA[z]);
      three = vO;
      Vector3d vT = new Vector3d(pointsB[y]);
      three = vT;
      vT -= vO;
      a.Translate(vT);

      /*
      Random r = new Random();
      foreach (int i in Enumerable.Range(0, 9).OrderBy(t => r.Next()))
      {
        four = i;
      }
      */

      /*
      List<Vector3d> pAList = new List<Vector3d>();
      Vector3d pA;
      List<Vector3d> pBList = new List<Vector3d>();
      Vector3d pB;
      */
      /*
      for(int i = 0; i < x; ++i)
      {

        //Vector3d[] p = new Vector3d[](ptsA[i]);
        //Vector3d[] pO = new Vector3d[](pointsB[j]);
        //p -= pO;
        //three = p;
        //a.Translate(p[1]);
        pA = new Vector3d(ptsA[i]);
        pB = new Vector3d(pointsB[i]);
        pAList.Add(pA);
        pBList.Add(pB);
        three = pAList;
        four = pBList;

      }
      */

      //a.Rotate(u * (Math.PI / 180), Vector3d.ZAxis, pointsB[y]);

      Rhino.Geometry.Intersect.CurveIntersections c;
      c = Rhino.Geometry.Intersect.Intersection.CurveCurve(a, b, 0.001, 0.001);
      Point3d[] intPtsO = new Rhino.Geometry.Point3d[c.Count];

      for(int i = 0; i < c.Count; i++)
      {

        intPtsO[i] = c[i].PointA;

      }
      IntersectTwo = intPtsO;
      four = c.Count;

      //Point3d p = new Point3d(ci[0].PointA);

      //Vector3d v = new Vector3d(p);

      /*
      Vector3d vO = new Vector3d(pointsA[l]);
      vec += vO;
      a.Translate(vec);
      */

      //Transform trans = Transform.Rotation(u, vec, ci[0].PointA);

      outs = String.Format("More than one collision");
      //oner = v;

    }

    else if( ci.Count == 1 )
    {

      outs = String.Format("Only one collision");

    }

    APoints = pointsA;
    BPoints = pointsB;
    AOut = String.Format(a + "\n" + b);
    //End = Counter();
# ---------- c_script_2: C# additional code ----------
  public Point3d Counter()
  {

    Point3d pt = new Point3d(1, 1, 1);
    return pt;

  }
# ---------- end c_script_2 ----------
c_script_3 = CSharpScript(x=curve, y=Slider(65.184, range=0..100), z=Slider(3, range=0..5))  # -> out, A, B, C, D, E; inputs x: list of Polyline, y: Double, z: Int32
# ---------- c_script_3: C# ----------
    List<Polyline> poly = x;

    var ptsA = new List<Point3d>();
    Polyline one = poly[1];
    ptsA = one.ToList();
    A = ptsA;

    var ptsB = new List<Point3d>();
    Polyline two = poly[0];
    ptsB = two.ToList();
    B = ptsB;

    Point3d ptA = ptsA[0];
    Point3d ptB = ptsB[z];

    Curve oneN = one.ToNurbsCurve();
    Vector3d vecA = new Vector3d(ptA);
    Vector3d vecB = new Vector3d(ptB);
    Vector3d fin = vecB - vecA;
    oneN.Translate(fin);
    C = oneN;

    Curve twoN = two.ToNurbsCurve();

    Rhino.Geometry.Intersect.CurveIntersections ci;
    ci = Rhino.Geometry.Intersect.Intersection.CurveCurve(oneN, twoN, 0.001, 0.001);
    Point3d[] intPtsO = new Rhino.Geometry.Point3d[ci.Count];

    for(int i = 0; i < ci.Count; i++)
    {

      intPtsO[i] = ci[i].PointA;

    }

    D = intPtsO;

    if(ci.Count > 1)
    {

      //oneN.DivideByCount();

      /*ptA = ptsA[1];
      vecA = new Vector3d(ptA);
      fin = vecB - vecA;
      oneN.Translate(fin);
      C = oneN;
      E = fin;
      */
    }
# ---------- end c_script_3 ----------
panel = Panel(c_script.F)
curve_5 = Curve(c_script_3.C)
point = Point(c_script_3.D)
point_2 = Point(c_script_3.A)
cull_index = CullIndex(List=point_2, Indices=number_slider_2, Wrap=True)
point_list = PointList(Points=cull_index)
panel_2 = Panel(cull_index)
partition_list = PartitionList(List=panel_2, Size=number_slider)  # -> simplify(Chunks)
partition_list_2 = PartitionList(List=panel_2, Size=number_slider)  # -> reverse(simplify(Chunks))
partition_list_3 = PartitionList(List=panel_2, Size=Slider(2, range=0..10))  # -> simplify(Chunks)
split_list = SplitList(List=cull_index, Index=Slider(2, range=0..10))  # -> ListA, ListB
panel_3 = Panel(partition_list)
explode_tree = ExplodeTree(Data=panel_3)  # -> Branch0, Branch1
panel_4 = Panel(partition_list_2)
explode_tree_2 = ExplodeTree(Data=panel_4)  # -> Branch0, Branch1
point_3 = Point(split_list.ListB)
point_4 = Point(split_list.ListA)
panel_5 = Panel(partition_list_3)
list_item = ListItem(List=explode_tree_2.Branch0, Index=Slider(1, range=0..100), Wrap=True)
list_item_2 = ListItem(List=partition_list_3, Index=Slider(0, range=0..100), Wrap=True)
list_item_3 = ListItem(List=explode_tree.Branch0, Index=Slider(1, range=0..100), Wrap=True)
list_item_4 = ListItem(List=explode_tree_2.Branch1, Index=Slider(0, range=0..1), Wrap=True)
list_item_5 = ListItem(List=partition_list_3, Index=Slider(1, range=0..1), Wrap=True)
list_item_6 = ListItem(List=explode_tree.Branch1, Index=Slider(0, range=0..1), Wrap=True)
list_item_7 = ListItem(List=split_list.ListA, Index=Slider(0, range=0..1), Wrap=True)
list_item_8 = ListItem(List=explode_tree_2.Branch0, Index=Slider(0, range=0..100), Wrap=True)
list_item_9 = ListItem(List=split_list.ListA, Index=Slider(1, range=0..1), Wrap=True)
list_item_10 = ListItem(List=split_list.ListB, Index=Slider(1, range=0..1), Wrap=True)
list_item_11 = ListItem(List=split_list.ListB, Index=Slider(0, range=0..1), Wrap=True)
list_item_12 = ListItem(List=explode_tree_2.Branch1, Index=Slider(1, range=0..1), Wrap=True)
panel_6 = Panel(point_2)
point_5 = Point(list_item_2)
point_6 = Point(list_item_5)
point_7 = Point(list_item_4)
point_8 = Point(list_item)
point_9 = Point(list_item_3)
point_10 = Point(list_item_6)
point_11 = Point(list_item_8)
point_12 = Point(list_item_12)
vector_2pt = Vector2Pt(PointA=list_item_10, PointB=list_item_7, Unitize=False)  # -> Vector, Length
vector_2pt_2 = Vector2Pt(PointA=list_item_9, PointB=list_item_11, Unitize=False)  # -> Vector, Length
vector_2pt_3 = Vector2Pt(PointA=list_item_2, PointB=list_item_5, Unitize=False)  # -> Vector, Length
vector_2pt_4 = Vector2Pt(PointA=list_item_4, PointB=list_item, Unitize=False)  # -> Vector, Length
vector_2pt_5 = Vector2Pt(PointA=list_item_3, PointB=list_item_6, Unitize=False)  # -> Vector, Length
vector_2pt_6 = Vector2Pt(PointA=list_item_12, PointB=list_item_8, Unitize=False)  # -> Vector, Length
shift_list = ShiftList(List=panel_5, Shift=number_slider_2, Wrap=False)
vector_display = VectorDisplay(Anchor=list_item_10, Vector=vector_2pt.Vector)
vector_display_2 = VectorDisplay(Anchor=list_item_9, Vector=vector_2pt_2.Vector)
vector_display_3 = VectorDisplay(Anchor=list_item_2, Vector=vector_2pt_3.Vector)
vector_display_4 = VectorDisplay(Anchor=list_item_4, Vector=vector_2pt_4.Vector)
vector_display_5 = VectorDisplay(Anchor=list_item_3, Vector=vector_2pt_5.Vector)
vector_display_6 = VectorDisplay(Anchor=list_item_12, Vector=vector_2pt_6.Vector)
panel_8 = Panel(shift_list)
point_13 = Point(c_script_3.B)
list_length = ListLength(List=point_13)
panel_9 = Panel(list_length)
list_item_13 = ListItem(List=point_13, Index=Slider(0, range=0..7), Wrap=True)
list_item_14 = ListItem(List=point_13, Index=Slider(1, range=0..7), Wrap=True)
list_item_15 = ListItem(List=point_13, Index=Slider(2, range=0..7), Wrap=True)
list_item_16 = ListItem(List=point_13, Index=Slider(1, range=0..7), Wrap=True)
list_item_17 = ListItem(List=point_13, Index=Slider(3, range=0..7), Wrap=True)
list_item_18 = ListItem(List=point_13, Index=Slider(2, range=0..7), Wrap=True)
list_item_19 = ListItem(List=point_13, Index=Slider(3, range=0..7), Wrap=True)
list_item_20 = ListItem(List=point_13, Index=Slider(4, range=0..7), Wrap=True)
list_item_21 = ListItem(List=point_13, Index=Slider(5, range=0..7), Wrap=True)
list_item_22 = ListItem(List=point_13, Index=Slider(4, range=0..7), Wrap=True)
list_item_23 = ListItem(List=point_13, Index=Slider(5, range=0..7), Wrap=True)
list_item_24 = ListItem(List=point_13, Index=Slider(6, range=0..7), Wrap=True)
point_14 = Point(c_script_3.E)
aoriginalpoints = Point(c_script_2.APoints)
boriginalpoints = Point(c_script_2.BPoints)
intersecttwo = Point(c_script_2.IntersectTwo)
intersectone = Point(c_script_2.Intersect)
pointanew = Point(c_script_2.two)
endpoints = Point(c_script_2.End)
curvea = Curve(c_script_2.CurveA)
panel_10 = Panel(c_script_2.oner)
curveb = Curve(c_script_2.CurveB)
point_15 = Point(c_script_2.three)
panel_11 = Panel(c_script_2.outs)
vector_2pt_7 = Vector2Pt(PointA=list_item_13, PointB=list_item_14, Unitize=False)  # -> Vector, Length
vector_2pt_8 = Vector2Pt(PointA=list_item_15, PointB=list_item_17, Unitize=False)  # -> Vector, Length
vector_2pt_9 = Vector2Pt(PointA=list_item_16, PointB=list_item_18, Unitize=False)  # -> Vector, Length
vector_2pt_10 = Vector2Pt(PointA=list_item_19, PointB=list_item_22, Unitize=False)  # -> Vector, Length
vector_2pt_11 = Vector2Pt(PointA=list_item_20, PointB=list_item_23, Unitize=False)  # -> Vector, Length
vector_2pt_12 = Vector2Pt(PointA=list_item_21, PointB=list_item_24, Unitize=False)  # -> Vector, Length
vector = Vector(c_script_2.oner)
panel_12 = Panel(endpoints)
panel_13 = Panel(intersectone)
panel_14 = Panel(intersecttwo)
panel_15 = Panel(c_script_2.three)
panel_16 = Panel(c_script_2.four)
panel_17 = Panel(pointanew)
B = Curve(c_script.B)
C = Point(c_script.C)
E = Point(c_script.E)
A = Curve(c_script.A)
D = Point(c_script.D)
partition_list_4 = PartitionList(List=point_2, Size="4")
panel_18 = Panel(partition_list_4)
vector_display_7 = VectorDisplay(Anchor=list_item_13, Vector=vector_2pt_7.Vector)
vector_display_8 = VectorDisplay(Anchor=list_item_15, Vector=vector_2pt_8.Vector)
vector_display_9 = VectorDisplay(Anchor=list_item_16, Vector=vector_2pt_9.Vector)
vector_display_10 = VectorDisplay(Anchor=list_item_19, Vector=vector_2pt_10.Vector)
vector_display_11 = VectorDisplay(Anchor=list_item_20, Vector=vector_2pt_11.Vector)
vector_display_12 = VectorDisplay(Anchor=list_item_21, Vector=vector_2pt_12.Vector)
point_list_2 = PointList(Points=point_2, Size=Slider(95.76, range=0..200))
bounding_box = BoundingBox(Content=curveb, Plane=PlaneXY(0, 0, 0))  # -> Box, Box_2
bounding_box_2 = BoundingBox(Content=curvea, Plane=PlaneXY(0, 0, 0))  # -> Box, Box_2
brep = Brep(curvea)
brep_2 = Brep(curveb)
number = Number(panel_16)
galapagos = Galapagos(fitness=addition, gene=[number_slider_4, number_slider_5, number_slider_3])
tree_branch = TreeBranch(Tree=partition_list_4, Path="{0;0;0}", MaintainPaths=True)
reverse_list = ReverseList(List=tree_branch)
panel_19 = Panel(reverse_list)
divide_curve = DivideCurve(Curve=curvea, Count=Slider(40, range=0..100), Kinks=False)  # -> Points, Tangents, Parameters
curve_6 = Curve([<curve referenced from the Rhino model> x3])
discontinuity_2 = Discontinuity(Curve=curve_6, Level=1)  # -> Points, Parameters
panel_20 = Panel(discontinuity_2.Points)
shatter = Shatter()
multiple_curves = MultipleCurves(Curves=curve_6)  # -> Points, IndexA, IndexB, ParamA, ParamB
perp_frame = PerpFrame(Curve=curvea, Parameter=divide_curve.Parameters)
curve_7 = Curve([<curve referenced from the Rhino model> x4])
point_list_3 = PointList(Points=discontinuity_2.Points, Size=Slider(200, range=0..200))
deconstruct_plane = DeconstructPlane(Plane=perp_frame)  # -> Origin, XAxis, YAxis, ZAxis
area = Area(Geometry=[bounding_box.Box, bounding_box_2.Box])  # -> Area, Centroid
number_slider_6 = Slider(0, range=0..10)
curve_8 = Curve([<curve referenced from the Rhino model> x4])
curve_9 = Curve([<curve referenced from the Rhino model> x2])
curve_10 = Curve([<curve referenced from the Rhino model> x8])
curve_11 = Curve(<curve referenced from the Rhino model>)
curve_12 = Curve(<curve referenced from the Rhino model>)
line_sdl = LineSDL(Start=perp_frame, Direction=deconstruct_plane.YAxis, Length=Slider(100, range=0..100))
list_item_25 = ListItem(List=curve_9, Index=Slider(0, range=0..1), Wrap=True)
deconstruct_brep = DeconstructBrep(Brep=curve_11)  # -> Faces, Edges, Vertices
list_item_26 = ListItem(List=curve_9, Index=Slider(1, range=0..1), Wrap=True)
number_slider_7 = Slider(2, range=0..4)
mass_addition = MassAddition(Input=area.Area)  # -> Result, PartialResults
c_script_4 = CSharpScript(
    x=curve_10,
    y=number_slider_6,
    Reference="C:\PROGRAM FILES\COMMON FILES\MCNEEL\RHINOCEROS\5.0\PLUG-INS\CLIPPERPLUGIN (BAE0724C-D28B-4D54-9B02-806B19D157C2)\0.0.2.1\CLIPPER-0.2.2\ClipperTools.dll")  # -> out, A, B, C; inputs x: list of Polyline, y: Int32
# ---------- c_script_4: C# ----------
    Polyline[] one = new Polyline[x.Count];
    Curve[] two = new Curve[x.Count];
    double[] areas = new Double[x.Count];
    var curves = new List<KeyValuePair<Curve, double>>();

    for(int i = 0; i < x.Count; ++i)
    {

      one[i] = new Polyline(x[i]);
      two[i] = one[i].ToNurbsCurve();
      areas[i] = AreaMassProperties.Compute(two[i]).Area;
      curves.Add(new KeyValuePair<Curve, double>(two[i], areas[i]));

    }

    curves.Sort(Compare1);
    curves.Reverse();
    List<Curve> curve = (from kvp in curves select kvp.Key).Distinct().ToList();
    curve.Reverse();

    Curve[] curvesOne = curve.ToArray();
    Polyline[] poly = new Polyline[curve.Count];
    var poi = new List<Point3d>();
    //List<Point3d>[] pts = new List<Point3d>[curvesOne.Length];
    List<List<Point3d>> pts = new List<List<Point3d>>();
    for(int i = 0; i < curve.Count; ++i)
    {

      curvesOne[i].TryGetPolyline(out poly[i]);
      pts.Add(poly[i].ToList());
      pts[i].RemoveAt(pts[i].Count - 1);
      //pts[i] = poly[i].ToList();

    }

    /*
    A = pts[0][pts[0].Count - 1];

    Point3d center = pts[0][pts[0].Count - 1];
    Vector3d zAxis = Vector3d.ZAxis;
    Plane p = new Rhino.Geometry.Plane(center, zAxis);
    */

    Point3d[] points = new Point3d[curve.Count];
    for(int i = 0; i < points.Length; ++i)
    {

      points[i] = new Point3d(pts[i][0]);

    }

    A = poly;

    B = points;
    
    C = points;

    Point3d centerOne = points[1];
    Vector3d zAxis = Vector3d.ZAxis;
    Plane pO = new Rhino.Geometry.Plane(centerOne, zAxis);

    double tolerance = 0.001;
    List<Polyline> outCurvesOne = new List<Polyline>();
    List<Polyline> outDisplacedCurvesOne = new List<Polyline>();
    foreach(List<IntPoint> path in ClipperLib.Clipper.MinkowskiDiff(poly[1].ToPath2D(pO, tolerance), poly[points.Length - 1].ToPath2D(pO, tolerance)))
    {

      Polyline plSum = path.ToPolyline(pO, tolerance, true);
      outCurvesOne.Add(plSum);

    }
    Polyline bin = outCurvesOne[1];

    //C = bin;


    /*
    // No Fit Polygon One
    double tolerance = 0.001;
    List<Polyline> outCurves = new List<Polyline>();
    List<Polyline> outDisplacedCurves = new List<Polyline>();
    foreach(List<IntPoint> path in ClipperLib.Clipper.MinkowskiDiff(two.ToPath2D(p, tolerance), one.ToPath2D(p, tolerance)))
    {

    Polyline plSum = path.ToPolyline(p, tolerance, true);
    outCurves.Add(plSum);

    }

    Polyline NFP = outCurves[0];

    A = curve;
    */
# ---------- c_script_4: C# additional code ----------
  static int Compare1(KeyValuePair<Curve, double> a, KeyValuePair<Curve, double> b)
  {
    return a.Value.CompareTo(b.Value);
  }
# ---------- end c_script_4 ----------
list_length_2 = ListLength(List=c_script_4.B)
list_length_3 = ListLength(List=c_script_4.A)
subtraction = Subtraction(A=list_length_2, B=1)
subtraction_2 = Subtraction(A=list_length_3, B=1)
cull_index_2 = CullIndex(List=c_script_4.B, Indices=subtraction, Wrap=True)
cull_index_3 = CullIndex(List=c_script_4.A, Indices=subtraction_2, Wrap=True)
panel_21 = Panel(cull_index_3)
cull_index_4 = CullIndex(List=cull_index_2, Indices=0, Wrap=True)
cull_index_5 = CullIndex(List=cull_index_3, Indices=0, Wrap=True)
area_2 = Area(Geometry=curve_10)  # -> Area, Centroid
difference = CSharpScript(
    z=Slider(2, range=0..10),
    u=curve_7,
    w=Slider(8, range=0..10),
    Reference=["C:\PROGRAM FILES\COMMON FILES\MCNEEL\RHINOCEROS\5.0\PLUG-INS\CLIPPERPLUGIN (BAE0724C-D28B-4D54-9B02-806B19D157C2)\0.0.2.1\CLIPPER-0.2.2\ClipperTools.dll", "C:\Users\Paula\AppData\Roaming\Grasshopper\Libraries\PlanktonGh.dll", "C:\Users\Paula\AppData\Roaming\Grasshopper\Libraries\Plankton.dll"])  # -> out, A, B, C, D, E, F, AA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; inputs z: Int32, u: list of Polyline, w: Int32
# ---------- difference: C# ----------
    Polyline four = u[3];
    Polyline one = u[2];
    Polyline two = u[1];
    Polyline three = u[0];

    List<Point3d> ptA;
    ptA = one.ToList();
    ptA.RemoveAt(0);

    List<Point3d> ptB;
    ptB = two.ToList();
    ptB.RemoveAt(0);

    List<Point3d> ptC;
    ptC = three.ToList();
    ptC.RemoveAt(0);

    Point3d center = ptB[ptB.Count - 1];
    Vector3d zAxis = Vector3d.ZAxis;
    Plane p = new Rhino.Geometry.Plane(center, zAxis);

    // No Fit Polygon One
    double tolerance = 0.001;
    List<Polyline> outCurves = new List<Polyline>();
    List<Polyline> outDisplacedCurves = new List<Polyline>();
    foreach(List<IntPoint> path in ClipperLib.Clipper.MinkowskiDiff(two.ToPath2D(p, tolerance), one.ToPath2D(p, tolerance)))
    {

      Polyline plSum = path.ToPolyline(p, tolerance, true);
      outCurves.Add(plSum);

    }

    Polyline NFP = outCurves[0];

    List<Point3d> ptNFP;
    ptNFP = NFP.ToList();
    ptNFP.RemoveAt(0);

    // Inner Fit Polygon
    Point3d centerOne = ptB[ptB.Count - 1];
    Plane pO = new Rhino.Geometry.Plane(centerOne, zAxis);

    List<Polyline> outCurvesOne = new List<Polyline>();
    List<Polyline> outDisplacedCurvesOne = new List<Polyline>();
    foreach(List<IntPoint> path in ClipperLib.Clipper.MinkowskiDiff(two.ToPath2D(pO, tolerance), three.ToPath2D(pO, tolerance)))
    {

      Polyline plSum = path.ToPolyline(pO, tolerance, true);
      outCurvesOne.Add(plSum);

    }

    Polyline bin = outCurvesOne[1];

    // No Fit Polygon Two
    List<Polyline> outCurvesTwo = new List<Polyline>();
    List<Polyline> outDisplacedCurvesTwo = new List<Polyline>();
    foreach(List<IntPoint> path in ClipperLib.Clipper.MinkowskiDiff(two.ToPath2D(p, tolerance), four.ToPath2D(p, tolerance)))
    {

      Polyline plSum = path.ToPolyline(p, tolerance, true);
      outCurvesTwo.Add(plSum);

    }

    Polyline NFPOne = outCurvesTwo[0];


    Curve b = two.ToNurbsCurve();
    int[] iter = new int[5];
    int[] iterOne = new int[5];
    int[] iterTwo = new int[5];
    Vector3d[] vec = new Vector3d[ptA.Count];
    for(int i = 0; i < 5; ++i)
      for(int j = 0; j < 5 - 1; ++j)
      {

        iter[i] = i;
        iterOne[j] = j;
        //vec[i] = new Vector3d(i,i,i);

        if(iter[i] < iterOne[j])
        {

          iterTwo[i] = i;

        }
        else
        {

          iterTwo[j] = j;

        }

        AD = iter;
        AE = iterOne;
        AF = iterTwo;

      }

    //AD = vec;

    /*
    Vector3d[] vecOne = new Vector3d[ptB.Count];
    for(int i = 0; i < ptB.Count; ++i)
    {

    vecOne[i] = new Vector3d(ptB[i]);

    }
    //vec[0] = new Vector3d(ptA[1]) - new Vector3d(ptB[1]);
    //b.Translate(vec[0]);
    */
    /*for(int i = 0; i < ptA.Count; i++)
    for(int j = 0; j < ptB.Count; j++)
    {

    vec[0] = new Vector3d(ptA[0]) - new Vector3d(ptB[0]);
    b.Translate(vec[0]);

    }
    */

    A = one;

    B = two;

    C = outCurves;

    D = ptA;

    E = ptB;

    F = ptA.Count + ptB.Count;

    AA = ptNFP;

    AB = bin;

    AC = NFPOne;

    /*
    List<Polyline> outCurves = ClipperLib.Clipper.MinkowskiSum(

      u[0].ToPath2D(p, tolerance),
      u[1].ToPath2D(p, tolerance),
      true)
      .Select(path => path.ToPolyline(p, tolerance, true))
      .ToList();

    A = outCurves[0];

    B = pt[z];

    //C = ptO[w];

    AA = planeList;
    */
# ---------- end difference ----------
point_list_4 = PointList(Points=c_script_4.B, Size=Slider(500, range=0..1000))
c_script_5 = CSharpScript(x=curve_9)  # -> out, A, B, C, D, E, F, AA; inputs x: list of Polyline
# ---------- c_script_5: C# ----------
    List<Polyline> poly = x;
    Polyline one = poly[0];
    List<Point3d> pts;
    pts = one.ToList();
    pts.RemoveAt(0);
    Point3d[] poi = pts.ToArray();
    
    Vector3d[] vecOne = new Vector3d[poi.Length];
    
    Polyline two = poly[1];
    List<Point3d> ptsOne;
    ptsOne = two.ToList();
    ptsOne.RemoveAt(0);
    Point3d[] poiOne = ptsOne.ToArray();
    
    Vector3d[] vecTwo = new Vector3d[poiOne.Length];

    A = poi;
    B = vecOne;
    
    C = poiOne;
    D = vecTwo;

    for(int z = 0; z < poi.Length; z++)
    {

      Point3d[] pointOne = shiftLeft(poi);
      vecOne[z] = new Vector3d(pointOne[z]) - new Vector3d(poi[z]);

    }
    
    for(int z = 0; z < poiOne.Length; z++)
    {

      Point3d[] pointOne = shiftLeft(poiOne);
      vecTwo[z] = new Vector3d(pointOne[z]) - new Vector3d(poiOne[z]);

    }
# ---------- c_script_5: C# additional code ----------
  //private Rhino.Display.CustomDisplay m_display = new Rhino.Display.CustomDisplay(true);
  // https://stackoverflow.com/questions/21385066/shifting-array-elements-to-right/21385610#21385610
  // updated so that instead of shifting integers it shifts the Point3d[] list
  public Point3d[] shiftLeft(Point3d[] arr)
  {
    Point3d[] demo = new Point3d[arr.Length];

    for (int i = 0; i < arr.Length - 1; i++)
    {
      demo[i] = arr[i + 1];
    }

    demo[demo.Length - 1] = arr[0];

    return demo;
  }
# ---------- end c_script_5 ----------
curve_13 = Curve(<curve referenced from the Rhino model>)
list_item_27 = ListItem(List=deconstruct_brep.Vertices, Index=0, Wrap=True)
areasorting = CSharpScript(x=curve_10)  # -> out, A, B; inputs x: list of Polyline
# ---------- areasorting: C# ----------
    Polyline[] one = new Polyline[x.Count];
    Curve[] two = new Curve[x.Count];
    double[] areas = new Double[x.Count];
    var curves = new List<KeyValuePair<Curve, double>>();

    for(int i = 0; i < x.Count; ++i)
    {

      one[i] = new Polyline(x[i]);
      two[i] = one[i].ToNurbsCurve();
      areas[i] = AreaMassProperties.Compute(two[i]).Area;
      curves.Add(new KeyValuePair<Curve, double>(two[i], areas[i]));

    }

    curves.Sort(Compare1);
    List<Curve> curve = (from kvp in curves select kvp.Key).Distinct().ToList();
    curve.Reverse();
    A = curve;
# ---------- areasorting: C# additional code ----------
  static int Compare1(KeyValuePair<Curve, double> a, KeyValuePair<Curve, double> b)
  {
    return a.Value.CompareTo(b.Value);
  }
# ---------- end areasorting ----------
sort_list = SortList(Keys=area_2.Area, ValuesValuesA=curve_10)  # -> Keys, ValuesValuesA
discontinuity_3 = Discontinuity(Curve=sort_list.ValuesValuesA, Level=1)  # -> Points, Parameters
number_slider_8 = Slider(200, range=0..1000)
curve_14 = Curve(difference.AC)
A_2 = Curve(difference.A)
B_2 = Curve(difference.B)
nfp = Curve(difference.C)
panel_22 = Panel(c_script_4.B)
number_2 = Number(mass_addition.Result)
curvetopolyline = CSharpScript(x=curve_13, y=Toggle(False))  # -> out, A; inputs x: Curve, y: Boolean
# ---------- curvetopolyline: C# ----------
    if(y == true)
    {

      // Method number One
      Polyline one = new Polyline();
      x.TryGetPolyline(out one);
      List<Point3d> pts = new List<Point3d>();
      pts = one.ToList();

      A = pts;

    }

    else
    {

      // Method number two
      PolylineCurve one = new PolylineCurve();
      one = x.ToPolyline(0, 1, 0.001, 0.0, 0.0, 0.001, 0.0, 0.0, true);

      PolyCurve polyCrv = x as PolyCurve;
      //polyCrv.RemoveNesting();

      //Curve[] oner = polyCrv.Explode();

      A = one;

    }
# ---------- end curvetopolyline ----------
reverse_list_2 = ReverseList(List=sort_list.ValuesValuesA)
point_16 = Point(c_script_5.A)
vector_2 = Vector(c_script_5.B)
point_17 = Point(c_script_5.C)
vector_3 = Vector(c_script_5.D)
deconstruct_brep_2 = DeconstructBrep(Brep=list_item_25)  # -> Faces, Edges, Vertices
minkowski_sum = MinkowskiSum(A=list_item_26, B=list_item_25, Plane=deconstruct_brep_2.Vertices, Tolerance=0.001)  # -> Sum, DisplacedSum
partition_list_5 = PartitionList(List=minkowski_sum.Sum, Size=Slider(2, range=0..10))
curve_15 = Curve(areasorting.A)
minkowski_difference = MinkowskiDifference(A=curve_11, B=curve_12, Plane=list_item_27, Tolerance=0.001)
c_script_6 = CSharpScript(
    z=number_slider_7,
    Reference=["C:\Program Files\Common Files\McNeel\Rhinoceros\5.0\Plug-ins\ClipperPlugin (bae0724c-d28b-4d54-9b02-806b19d157c2)\0.0.2.1\clipper-0.2.2\ClipperTools.dll", "C:\Users\Paula\AppData\Roaming\Grasshopper\Libraries\PlanktonGh.dll", "C:\Users\Paula\AppData\Roaming\Grasshopper\Libraries\Plankton.dll"])  # -> out, A, B, C, D, E, F, AA; inputs z: Int32, u: list of Polyline
# ---------- c_script_6: C# ----------
    List<Point3d> pt;
    pt = u[0].ToList();

    int[] arr = new int[pt.Count];

    for(int i = 0; i < arr.Length; ++i)
    {

      arr[i] = i;

      Point3d[] array = new Point3d[pt.Count];

      array = pt.ToArray();

      List<Plane> planeList = new List<Plane>();
      for(int x = 0; x < pt.Count; ++x)
      {

        Point3d center = pt[z];
        Vector3d zAxis = Vector3d.ZAxis;
        Plane p = new Rhino.Geometry.Plane(center, zAxis);

        planeList.Add(new Rhino.Geometry.Plane(pt[x], zAxis));

        double tolerance = 0.001;
        List<Polyline> outCurves = ClipperLib.Clipper.MinkowskiSum(

          u[1].ToPath2D(planeList[x], tolerance),
          u[0].ToPath2D(planeList[x], tolerance),
          true)
          .Select(path => path.ToPolyline(planeList[x], tolerance, true))
          .ToList();

        AA = planeList;

        A = outCurves;

        Polyline one = outCurves[0];

        B = one;
        Curve oner = one.ToNurbsCurve();

        C = u[1];
        Curve xer = u[1].ToNurbsCurve();

        D = u[0];

        Rhino.Geometry.Intersect.CurveIntersections ci;
        ci = Rhino.Geometry.Intersect.Intersection.CurveCurve(oner, xer, 0.001, 0.001);
        Point3d[] intPtsO = new Point3d[ci.Count];

        for(int j = 0; j < ci.Count; j++)
        {

          intPtsO[j] = ci[j].PointA;

        }

        E = intPtsO;

        F = intPtsO.Length;

      }

      /*
      Point3d center = pt[z];
      Vector3d zAxis = Vector3d.ZAxis;
      Plane p = new Rhino.Geometry.Plane(center, zAxis);


      double tolerance = 0.001;
      List<Polyline> outCurves = ClipperLib.Clipper.MinkowskiSum(

        u[1].ToPath2D(plarray[i], tolerance),
        u[0].ToPath2D(plarray[i], tolerance),
        true)
        .Select(path => path.ToPolyline(plarray[i], tolerance, true))
        .ToList();

      A = outCurves;

      Polyline one = outCurves[0];

      B = one;
      Curve oner = one.ToNurbsCurve();

      C = u[1];
      Curve xer = u[1].ToNurbsCurve();

      D = u[0];

      AA = plarray[i];


      Rhino.Geometry.Intersect.CurveIntersections ci;
      ci = Rhino.Geometry.Intersect.Intersection.CurveCurve(oner, xer, 0.001, 0.001);
      Point3d[] intPtsO = new Point3d[ci.Count];

      for(int j = 0; j < ci.Count; j++)
      {

        intPtsO[j] = ci[j].PointA;

      }

      E = intPtsO;

      F = intPtsO.Length;
      */

    }
# ---------- end c_script_6 ----------
list_item_28 = ListItem(List=nfp, Index=0, Wrap=True)
point_18 = Point(difference.AA)
point_list_5 = PointList(Points=point_16)
list_item_29 = ListItem(List=partition_list_5, Index=Slider(0, range=0..1), Wrap=True)
point_list_6 = PointList(Points=point_17)
addition = Addition(A=number_2, B=number)
partition_list_6 = PartitionList(List=cull_index_5, Size=Slider(2, range=0..10))  # -> simplify(Chunks)
panel_23 = Panel(sort_list.ValuesValuesA)
list_item_30 = ListItem(List=curve_15, Index=Slider(0, range=0..10), Wrap=True)
number_slider_9 = Slider(0, range=0..3)
number_slider_10 = Slider(100, range=0..100)
panel_24 = Panel(c_script_6.AA)
curve_16 = Curve(c_script_6.D)
panel_25 = Panel(c_script_6.F)
curve_17 = Curve(c_script_6.B)
curve_18 = Curve(c_script_6.C)
point_19 = Point(c_script_6.E)
integer = Integer(c_script_6.F)
point_20 = Point(c_script_4.C)
curve_19 = Curve([<curve referenced from the Rhino model> x3])
plane = Plane(c_script_6.AA)
panel_26 = Panel(addition)
vector_display_13 = VectorDisplay(Anchor=point_16, Vector=vector_2)
vector_display_14 = VectorDisplay(Anchor=point_17, Vector=vector_3)
curve_20 = Curve(<curve referenced from the Rhino model>)
curve_21 = Curve(<curve referenced from the Rhino model>)
panel_27 = Panel(c_script_6.out)
curve_22 = Curve(c_script_6.A)
panel_28 = Panel(partition_list_6)
intersection = CSharpScript(x=curve_19)  # -> out, A; inputs x: list of Polyline
# ---------- intersection: C# ----------
    //Curve[] curves = new Curve[x.Count];
    List<Curve> curves = new List<Curve>();

    for(int i = 0; i < x.Count; ++i)
    {

      //curves[i] = x[i].ToNurbsCurve();
      //curves.Remove(x.Count);
      curves.Add(x[i].ToNurbsCurve());

    }

    Curve one = curves[x.Count-1];

    curves.RemoveAt(x.Count-1);

    //A = curves;
    Curve[] two = Curve.CreateBooleanUnion(curves);
    Curve three = two[0];
    A = Curve.CreateBooleanIntersection(three, one);
    //A = two.Length;
# ---------- end intersection ----------
rectangle = Rectangle(Plane=plane, XSize=number_slider_10, YSize=number_slider_10, Radius=0)  # -> Rectangle, Length
tree_branch_2 = TreeBranch(Tree=partition_list_6, Path="{1}", MaintainPaths=True)
tree_branch_3 = TreeBranch(Tree=partition_list_6, Path="{0}", MaintainPaths=True)
deconstruct_brep_3 = DeconstructBrep(Brep=[curve_20, curve_21])  # -> Faces, Edges, flatten(Vertices)
list_item_31 = ListItem(List=deconstruct_brep_2.Vertices, Index=number_slider_7, Wrap=True)
lowerleftpoint = CSharpScript(
    x=curve_10,
    y=number_slider_6,
    Reference="C:\PROGRAM FILES\COMMON FILES\MCNEEL\RHINOCEROS\5.0\PLUG-INS\CLIPPERPLUGIN (BAE0724C-D28B-4D54-9B02-806B19D157C2)\0.0.2.1\CLIPPER-0.2.2\ClipperTools.dll")  # -> out, A, B, C; inputs x: list of Polyline, y: Int32
# ---------- lowerleftpoint: C# ----------
    Polyline[] one = new Polyline[x.Count];
    Curve[] two = new Curve[x.Count];
    double[] areas = new Double[x.Count];
    var curves = new List<KeyValuePair<Curve, double>>();

    for(int i = 0; i < x.Count; ++i)
    {

      one[i] = new Polyline(x[i]);
      two[i] = one[i].ToNurbsCurve();
      areas[i] = AreaMassProperties.Compute(two[i]).Area;
      curves.Add(new KeyValuePair<Curve, double>(two[i], areas[i]));

    }

    curves.Sort(Compare1);
    curves.Reverse();
    List<Curve> curve = (from kvp in curves select kvp.Key).Distinct().ToList();
    curve.Reverse();

    Curve[] curvesOne = curve.ToArray();
    Polyline[] poly = new Polyline[curve.Count];
    List<List<Point3d>> pts = new List<List<Point3d>>();
    DataTree<Point3d> tree = new DataTree<Point3d>();
    DataTree<double> treeSum = new DataTree<double>();
    var points = new DataTree<KeyValuePair<Point3d, double>>();
    var point = new List<Point3d>[curve.Count];
    DataTree<Point3d> treeLowerLeft = new DataTree<Point3d>();

    for(int i = 0; i < curve.Count; ++i)
    {

      curvesOne[i].TryGetPolyline(out poly[i]);
      pts.Add(poly[i].ToList());
      pts[i].RemoveAt(pts[i].Count - 1);
      GH_Path path = new GH_Path(i);

      for(int j = 0; j < pts[i].Count; ++j)
      {

        tree.Add(pts[i][j], path);
        treeSum.Add(pts[i][j].X + pts[i][j].Y, path);

        points.Add(new KeyValuePair<Point3d, double>(tree.Branch(i)[j], treeSum.Branch(i)[j]), path);

        points.Branch(i).Sort(Compare2);
        points.Branch(i).Reverse();
        point[i] = (from kvp in points.Branch(i) select kvp.Key).Distinct().ToList();
        point[i].Reverse();

        //p[i] = point[i].ToArray();

        //pointArray[i] = tree.Branch(i).ToArray();

        //treeLowerLeft.Insert(pointer, path, pts[i].Count);

        //treeLowerLeft.Insert(point[i][j], new GH_Path(i, j), point[i].Count);

        //treeLowerLeft.Add(point[i][j], path);

        //threer.Sort(Compare2);
        //threer.Reverse();
        //List<Point3d> point = (from kvp in threer select kvp.Key).Distinct().ToList();
        //point.Reverse();

        //insideDouble.Add(pts[i][j].X + pts[i][j].Y);
        //insidePoint.Add(pts[i][j]);

      }

    }

    for(int i = 0; i < tree.BranchCount; ++i)
      for(int j = 0; j < tree.Branch(i).Count; ++j)
      {

        treeLowerLeft.Add(point[i][j], new GH_Path(i));

      }

    /*
    var oner = new List<List<Point3d>>();
    //oner = tree.Branch(0).ToList();

    var twoer = new List<List<double>>();
    //twoer = treeSum.Branch(0).ToList();

    var threer = new List<KeyValuePair<List<Point3d>, List<double>>>();

    for(int i = 0; i < tree.BranchCount; ++i)
      for(int j = 0; j < tree.Branch(i).Count; ++j)
      {

        var onerSize = new List<Point3d>(i);
        onerSize = tree.Branch(i).ToList();
        //oner = tree.Branch(i).ToList();
        oner.Add(onerSize);

        var twoerSize = new List<double>(i);
        twoerSize = treeSum.Branch(i).ToList();
        twoer.Add(twoerSize);

        threer.Add(new KeyValuePair<List<Point3d>, List<double>>(oner[i], twoer[i]));
        //threer.Sort(Compare2);
        //threer.Reverse();
        //List<Point3d> point = (from kvp in threer select kvp.Key).Distinct().ToList();
        //point.Reverse();

        A = threer[1];

      }

    */
    //threer.Add(new KeyValuePair<Point3d, double>(oner[0], twoer[0]));

    /*
    pointsy.Sort(Compare2);
    pointsy.Reverse();
    List<Point3d> point = (from kvp in pointsy select kvp.Key).Distinct().ToList();
    point.Reverse();
    */

    //A = oner;

    //B = poi[1];

    //B = treeSum;

    /*

    var oner = new DataTree<List<Point3d>>();//tree.Branch(1).ToArray();
    var twoer = new Double[tree.BranchCount][];//treeSum.Branch(1).ToArray();

    for(int i = 0; i < tree.BranchCount; ++i)
      for(int j = 0; j < tree.Branch(i).Count; ++j)
      {

        GH_Path pth = new GH_Path(i);
        oner.Add(tree.Branch(i), pth);
        //oner[i] = tree.Branch(i).ToArray();
        twoer[i] = treeSum.Branch(i).ToArray();

      }

    */

    /*
    var pointArray = new Point3d[tree.BranchCount][];
    var sumArray = new Double[treeSum.BranchCount][];
    var pointDict = new List<KeyValuePair<Point3d, double>>();
    var pointDictate = new List<KeyValuePair<Point3d, double>>[tree.BranchCount];
    var treer = new DataTree<List<KeyValuePair<Point3d, double>>>();

    for(int i = 0; i < tree.BranchCount; ++i)
    {

      pointArray[i] = tree.Branch(i).ToArray();
      sumArray[i] = treeSum.Branch(i).ToArray();
      var pathy = new GH_Path(i);

      for(int j = 0; j < tree.Branch(i).Count; ++j)
      {

        //pointDict.Add(new KeyValuePair<Point3d, double>(pointArray[i][j], sumArray[i][j]));
        pointDict.Add(new KeyValuePair<Point3d, double>(pointArray[i][j], sumArray[i][j]));
        treer.Add(pointDict, pathy);
        pointDictate[i] = new List<KeyValuePair<Point3d, double>>(pointDict);
        //a[i] = new List<int>();

      }

    }

    var pointy = new List<Point3d>[pointDictate.Length];
    var treePoint = new List<Point3d>[pointDictate.Length];

    for(int i = 0; i < pointDictate.Length; ++i)
    {

      //treer.Branch(i).Sort();
      //treer.Branch(i).Reverse();
      pointDictate[i].Sort(Compare2);
      pointDictate[i].Reverse();
      pointy[i] = (from kvp in pointDictate[i] select kvp.Key).Distinct().ToList();
      pointy[i].Reverse();

    }
    */
    /*
    pointDict.Sort(Compare2);
    pointDict.Reverse();
    List<Point3d> pointy = (from kvp in pointDict select kvp.Key).Distinct().ToList();
    pointy.Reverse();
    */

    /*
    var threer = new List<KeyValuePair<Point3d, double>>();
    for(int i = 0; i < oner.Length; ++i)
    {

      threer.Add(new KeyValuePair<Point3d, double>(oner[i], twoer[i]));

    }
    threer.Sort(Compare2);
    threer.Reverse();
    List<Point3d> point = (from kvp in threer select kvp.Key).Distinct().ToList();
    point.Reverse();


    A = point;
    */
    //B = point;

    //A = pointArray[1];

    A = point[0];

    var treeOut = new DataTree<Point3d>();
    
    for(int i = 0; i < treeLowerLeft.BranchCount; ++i)
      for(int j = 0; j < treeLowerLeft.Branch(i).Count; ++j)
      {
    
        treeOut.Add(treeLowerLeft.Branch(i)[0], new GH_Path(i));

      }
    
    B = treeOut;
      
    C = tree;
# ---------- lowerleftpoint: C# additional code ----------
  static int Compare1(KeyValuePair<Curve, double> a, KeyValuePair<Curve, double> b)
  {

    return a.Value.CompareTo(b.Value);

  }

  static int Compare2(KeyValuePair<Point3d, double> a, KeyValuePair<Point3d, double> b)
  {

    return a.Value.CompareTo(b.Value);

  }
# ---------- end lowerleftpoint ----------
point_21 = Point(lowerleftpoint.C)
panel_29 = Panel(point_21)
curve_23 = Curve(<curve referenced from the Rhino model>)
deconstruct = Deconstruct(Point=discontinuity_3.Points)  # -> XComponent, YComponent, ZComponent
point_22 = Point(lowerleftpoint.B)
galapagos_2 = Galapagos(fitness=c_script_6, gene=number_slider_7)
point_23 = Point(simplify(discontinuity_3.Points))
region_union = RegionUnion(Curves=[curve_20, curve_21])
path_mapper = PathMapper(region_union, source="{A;B}", target="{path_index}")
point_list_7 = PointList(Points=lowerleftpoint.B, Size=number_slider_8)
point_list_8 = PointList(Points=point_22, Size=number_slider_8)
point_list_9 = PointList(Points=lowerleftpoint.C, Size=number_slider_8)
polyline = PolyLine(Vertices=point_16, Closed=Toggle(True))
polyline_2 = PolyLine(Vertices=point_17, Closed=Toggle(True))
plane_2 = Plane(list_item_31)
entwine = Entwine(FlattenInputs=True)
shift_list_2 = ShiftList(List=cull_index_5, Shift=Slider(1, range=0..10), Wrap=True)
panel_30 = Panel(lowerleftpoint.B)
panel_31 = Panel(region_union)
addition_2 = Addition(A=deconstruct.XComponent, B=deconstruct.YComponent)
panel_32 = Panel(point_22)
sort_list_2 = SortList(Keys=addition_2, ValuesValuesA=point_23)  # -> Keys, ValuesValuesA
bpoints = Point(difference.E)
nfppoints = Point(difference.AA)
discontinuity_4 = Discontinuity(Curve=A_2, Level=1)  # -> Points, Parameters
point_list_10 = PointList(Points=point_21, Size=Slider(182, range=0..1000))
graft_tree = GraftTree(Tree=vector_2, IncludeEmptyLists=True, IncludeNullItems=True)
panel_33 = Panel(point_23)
param_viewer = ParamViewer(region_union)
param_viewer_2 = ParamViewer(panel_22)  # disabled
panel_34 = Panel(curve_23)
region_intersection = RegionIntersection(CurvesA=region_union, CurvesB=curve_23)
list_item_32 = ListItem(List=sort_list_2.ValuesValuesA, Index=Slider(0, range=0..100), Wrap=True)  # -> flatten(Item)
minkowski_difference_2 = MinkowskiDifference(A=cull_index_5, B=shift_list_2, Plane=list_item_32, Tolerance=0.001)

# ---- group: LowerLeft
deconstruct_2 = Deconstruct(Point=bpoints)  # -> XComponent, YComponent, ZComponent
addition_3 = Addition(A=deconstruct_2.XComponent, B=deconstruct_2.YComponent)
number_slider_11 = Slider(200, range=0..1000)
sort_list_3 = SortList(Keys=addition_3, ValuesValuesA=bpoints)  # -> Keys, ValuesValuesA
point_list_11 = PointList(Points=sort_list_3.ValuesValuesA, Size=number_slider_11)
list_item_33 = ListItem(List=sort_list_3.ValuesValuesA, Index=Slider(0, range=0..7), Wrap=True)

# ----
minkowski_sum_2 = MinkowskiSum(A=A_2, B=B_2, Plane=list_item_33, Tolerance=0.001)  # -> Sum, DisplacedSum
minkowski_difference_3 = MinkowskiDifference(A=B_2, B=A_2, Plane=list_item_33, Tolerance=0.001)
list_item_34 = ListItem(List=minkowski_difference_2, Index=0, Wrap=True)
point_list_12 = PointList(Points=sort_list_2.ValuesValuesA, Size=Slider(182, range=0..1000))
panel_35 = Panel(sort_list_2.ValuesValuesA)
evaluate = Evaluate(Expression="If(x=y, True, False)", x=panel_35, y=panel_30)
panel_36 = Panel(region_intersection)
point_list_13 = PointList(Points=bpoints, Size=number_slider_11)
list_item_35 = ListItem(List=bpoints, Index=0, Wrap=True)
panel_37 = Panel(evaluate)
panel_38 = Panel(list_item_34)
curve_curve = CurveCurve(CurveA=polyline, CurveB=polyline_2)  # -> Points, ParamsA, ParamsB

# ---- group: LowerLeft
deconstruct_3 = Deconstruct(Point=discontinuity_4.Points)  # -> XComponent, YComponent, ZComponent
addition_4 = Addition(A=deconstruct_3.XComponent, B=deconstruct_3.YComponent)
sort_list_4 = SortList(Keys=addition_4, ValuesValuesA=discontinuity_4.Points)  # -> Keys, ValuesValuesA
point_list_14 = PointList(Points=sort_list_4.ValuesValuesA, Size=Slider(200, range=0..1000))
list_item_36 = ListItem(List=sort_list_4.ValuesValuesA, Index=Slider(0, range=0..7), Wrap=True)

# ----
panel_39 = Panel(addition_2)
vector_2pt_13 = Vector2Pt(PointA=curve_curve.Points, PointB=point_17, Unitize=False)  # -> Vector, Length
vector_display_15 = VectorDisplay(Anchor=point_17, Vector=vector_2)
panel_40 = Panel(vector_2pt_13.Vector)

# ---- group: TranslationVectorsFromNFP
vector_2pt_14 = Vector2Pt(PointA=list_item_33, PointB=nfppoints, Unitize=False)  # -> Vector, Length
vector_display_16 = VectorDisplay(Anchor=list_item_33, Vector=vector_2pt_14.Vector)
move = Move(Geometry=B_2, Motion=vector_2pt_14.Vector)  # -> graft(Geometry), Transform

# ----
discontinuity_5 = Discontinuity(Curve=move.Geometry, Level=1)  # -> Points, Parameters
panel_41 = Panel(discontinuity_5.Points)

# ---- group: SortingTheBestPlacement
list_item_37 = ListItem(List=move.Geometry, Index=Slider(9, range=0..9), Wrap=True)
discontinuity_6 = Discontinuity(Curve=list_item_37, Level=1)  # -> Points, Parameters
apoints = Point(difference.D)
tree_statistics = TreeStatistics(Tree=discontinuity_6.Points)  # -> Paths, Length, Count
duplicate_data = DuplicateData(Data=apoints, Number=tree_statistics.Count, Order=True)
partition_list_7 = PartitionList(List=duplicate_data, Size=Slider(6, range=0..10))
path_mapper_2 = PathMapper(partition_list_7, source="{A;B;C;D;E;F}", target="{D;E;F;0}")
merge = Merge(Data1=path_mapper_2, Data2=discontinuity_6.Points)
convex_hull = ConvexHull(Points=merge, Plane=PlaneXY(0, 0, 0))  # -> flatten(Hull), HullZ, Indices
area_3 = Area(Geometry=convex_hull.Hull)  # -> Area, Centroid
sort_list_5 = SortList(Keys=area_3.Area, ValuesValuesA=convex_hull.Hull)  # -> Keys, ValuesValuesA
list_item_38 = ListItem(List=sort_list_5.ValuesValuesA, Index=0, Wrap=True)
curve_24 = Curve(list_item_38)

# ----
construct_path = ConstructPath()
tree_branch_4 = TreeBranch(MaintainPaths=True)
panel_42 = Panel(partition_list_7)
panel_43 = Panel(merge)
curve_25 = Curve([<curve referenced from the Rhino model> x3])
nesting = CSharpScript(x=curve_25, Reference="C:\Users\Paula\AppData\Roaming\Grasshopper\Libraries\ClipperTools.dll")  # -> out, A, B; inputs x: list of Polyline
# ---------- nesting: C# ----------
    List<Polyline> curve = AreaSorting(x);

    var treeOut = PointDataTree(curve);

    Polyline[] polys;

    var APoints = ConvexHullPoints(curve, treeOut, out polys);

    List<Polyline> polyFinal;

    var hullFinal = ConvexHull(APoints, polys, out polyFinal);

    A = polyFinal[0];

    //B = hullFinal[0];

    B = curve[x.Count - 1];
# ---------- nesting: C# additional code ----------
  public List<Polyline> AreaSorting(List<Polyline> x)
  {

    // We want to cast(change from one data type to another) our list of polylines to curves, so that
    // we can call the AreaMassProperties class and its method .Compute to get the area of the polygons
    // after that we can now create a List of KeyValuePair to assign the area of our polygons to our
    // polygons so that we can sort them later according to their areas.
    List<Curve> one = new List<Curve>();
    double[] areas = new Double[x.Count];
    var curves = new List<KeyValuePair<Polyline, double>>();

    for(int i = 0; i < x.Count; ++i)
    {

      one.Add(x.ElementAt(i).ToNurbsCurve());
      areas[i] = AreaMassProperties.Compute(one.ElementAt(i)).Area;
      curves.Add(new KeyValuePair<Polyline, double>(x.ElementAt(i), areas[i]));

    }

    // Here is where the sorting according to area values takes place.
    curves.Sort(Compare1);
    curves.Reverse();
    // We retrieve a list of curves from our List of KeyValuePairs
    List<Polyline> curve = (from kvp in curves select kvp.Key).Distinct().ToList();
    curve.Reverse();

    return curve;

  }

  public DataTree<Point3d> PointDataTree(List<Polyline> curve)
  {

    // We create and populate trees with the points of the curves, so that we can
    // sort each of the lower left points of each of the curves according to the
    // sum of their Xs and Ys positions.
    List<List<Point3d>> pts = new List<List<Point3d>>();
    DataTree<Point3d> tree = new DataTree<Point3d>();
    DataTree<double> treeSum = new DataTree<double>();
    var points = new DataTree<KeyValuePair<Point3d, double>>();
    var point = new List<Point3d>[curve.Count];
    DataTree<Point3d> treeLowerLeft = new DataTree<Point3d>();

    for(int i = 0; i < curve.Count; ++i)
    {

      pts.Add(curve[i].ToList());
      pts[i].RemoveAt(pts[i].Count - 1);
      GH_Path path = new GH_Path(i);

      for(int j = 0; j < pts[i].Count; ++j)
      {

        tree.Add(pts[i][j], path);
        treeSum.Add(pts[i][j].X + pts[i][j].Y, path);

        points.Add(new KeyValuePair<Point3d, double>(tree.Branch(i)[j], treeSum.Branch(i)[j]), path);

        points.Branch(i).Sort(Compare2);
        points.Branch(i).Reverse();
        point[i] = (from kvp in points.Branch(i) select kvp.Key).Distinct().ToList();
        point[i].Reverse();

      }

    }

    for(int i = 0; i < tree.BranchCount; ++i)
      for(int j = 0; j < tree.Branch(i).Count; ++j)
      {

        treeLowerLeft.Add(point[i][j], new GH_Path(i));

      }

    var treeOut = new DataTree<Point3d>();

    for(int i = 0; i < treeLowerLeft.BranchCount; ++i)
      for(int j = 0; j < treeLowerLeft.Branch(i).Count; ++j)
      {

        treeOut.Add(treeLowerLeft.Branch(i)[0], new GH_Path(i));

      }

    return treeOut;

  }

  public DataTree<Point3d> ConvexHullPoints(List<Polyline> curve, DataTree<Point3d> treeOut, out Polyline[] polys)
  {

    // No Fit Polygon from minkowsky difference using the clipper lib
    Polyline polyOne = curve[0];
    Polyline polyTwo = curve[curve.Count - 1];

    Point3d center = treeOut.Branch(0).ElementAt(0);
    Vector3d zAxis = Vector3d.ZAxis;
    Plane p = new Rhino.Geometry.Plane(center, zAxis);

    double tolerance = 0.001;
    List<Polyline> outCurves = new List<Polyline>();
    List<Polyline> outDisplacedCurves = new List<Polyline>();
    foreach(List<IntPoint> path in ClipperLib.Clipper.MinkowskiDiff(polyOne.ToPath2D(p, tolerance), polyTwo.ToPath2D(p, tolerance)))
    {

      Polyline plSum = path.ToPolyline(p, tolerance, true);
      outCurves.Add(plSum);

    }

    Polyline NFP = outCurves[0];

    List<Point3d> ptNFP;
    ptNFP = NFP.ToList();
    ptNFP.RemoveAt(0);

    List<Vector3d> vectors = new List<Vector3d>();
    for(int i = 0; i < ptNFP.Count; ++i)
    {

      vectors.Add(new Vector3d(ptNFP.ElementAt(i) - treeOut.Branch(0)[0]));

    }

    List<Curve> translated = new List<Curve>();
    polys = new Polyline[ptNFP.Count];
    List<List<Point3d>> polyPoint = new List<List<Point3d>>();

    List<Point3d> pointsA = new List<Point3d>();
    pointsA = polyTwo.ToList();
    pointsA.RemoveAt(pointsA.Count - 1);
    DataTree<Point3d> polyPoints = new DataTree<Point3d>();
    DataTree<Point3d> APoints = new DataTree<Point3d>();
    for(int i = 0; i < ptNFP.Count; ++i)
    {

      var path = new GH_Path(i);
      Curve oney = polyOne.ToNurbsCurve();
      oney.Translate(vectors.ElementAt(i));
      translated.Add(oney);
      translated.ElementAt(i).TryGetPolyline(out polys[i]);
      polyPoint.Add(polys[i].ToList());

      for(int j = 0; j < polyPoint[i].Count - 1; ++j)
      {

        polyPoints.Add(polyPoint[i][j], path);

      }

    }

    for(int i = 0; i < ptNFP.Count; ++i)
      for(int j = 0; j < pointsA.Count; ++j)
      {

        var path = new GH_Path(i);
        APoints.Add(pointsA[j], path);

      }

    for(int i = 0; i < polyPoints.BranchCount; ++i)
      for(int j = 0; j < polyPoints.Branch(i).Count; ++j)
      {

        APoints.Add(polyPoints.Branch(i)[j], new GH_Path(i));

      }

    return APoints;

  }

  public List<Polyline> ConvexHull(DataTree<Point3d> APoints, Polyline[] polys, out List<Polyline> polyFinal)
  {

    var list = new Grasshopper.Kernel.Geometry.Node2List[APoints.BranchCount];
    var polyLines = new Polyline[APoints.BranchCount];
    var curvesConvex = new Curve[APoints.BranchCount];
    var convexArea = new Double[APoints.BranchCount];
    var convexSort = new List<KeyValuePair<Polyline, double>>();
    var hullSort = new List<KeyValuePair<Polyline, double>>();

    for(int i = 0; i < APoints.BranchCount; ++i)
    {

      list[i] = new Grasshopper.Kernel.Geometry.Node2List(APoints.Branch(i));
      polyLines[i] = Grasshopper.Kernel.Geometry.ConvexHull.Solver.ComputeHull(list[i]);
      curvesConvex[i] = polyLines[i].ToNurbsCurve();
      convexArea[i] = AreaMassProperties.Compute(curvesConvex[i]).Area;
      convexSort.Add(new KeyValuePair<Polyline, double>(polys[i], convexArea[i]));
      hullSort.Add(new KeyValuePair<Polyline, double>(polyLines[i], convexArea[i]));

    }

    // Output the polygons with no convex hull
    // Here is where the sorting according to area values takes place.
    convexSort.Sort(Compare1);
    convexSort.Reverse();
    // We retrieve a list of polylines from our List of KeyValuePairs
    polyFinal = (from kvp in convexSort select kvp.Key).Distinct().ToList();
    polyFinal.Reverse();

    // Output the convex hull polygons
    // Here is where the sorting according to area values takes place.
    hullSort.Sort(Compare1);
    hullSort.Reverse();
    // We retrieve a list of polylines from our List of KeyValuePairs
    List<Polyline> hullFinal = (from kvp in hullSort select kvp.Key).Distinct().ToList();
    hullFinal.Reverse();

    return hullFinal;

  }

  static int Compare1(KeyValuePair<Polyline, double> a, KeyValuePair<Polyline, double> b)
  {

    return a.Value.CompareTo(b.Value);

  }

  static int Compare2(KeyValuePair<Point3d, double> a, KeyValuePair<Point3d, double> b)
  {

    return a.Value.CompareTo(b.Value);

  }
# ---------- end nesting ----------
curve_26 = Curve(nesting.A)
curve_27 = Curve(nesting.B)
discontinuity_7 = Discontinuity(Curve=curve_26, Level=1)  # -> Points, Parameters
deconstruct_brep_4 = DeconstructBrep(Brep=curve_27)  # -> Faces, Edges, Vertices
deconstruct_brep_5 = DeconstructBrep(Brep=curve_26)  # -> Faces, Edges, Vertices

# ---- group: NestingNoIFP
curve_28 = Curve([<curve referenced from the Rhino model> x6])
curve_to_polyline = CurveToPolyline(Curve=curve_28, ToleranceDistance=0, ToleranceAngle=Slider(0.1, range=0..1))  # -> Polyline, Segments
curve_29 = Curve(<curve referenced from the Rhino model>)
curve_30 = Curve([<curve referenced from the Rhino model> x2])
curve_31 = Curve([<curve referenced from the Rhino model> x2])
curve_32 = Curve([<curve referenced from the Rhino model> x4])
nestingreference = CSharpScript()  # -> out, A
# ---------- nestingreference: C# ----------
    /*
    curve = AreaSorting(curve);
    //curve.Reverse();
    var hullFinal = new List<Polyline>();
    var x = Nesting(curve, out hullFinal);
    var finalCurve = x[0];
    var finalHull = hullFinal[0];
    var oner = curve[curve.Count - 1];

    var outer = new List<Polyline>();
    outer.Add(finalCurve);
    outer.Add(oner);

    return outer;
    */

    /*
    curve = AreaSorting(curve);
    //curve.Reverse();
    var hullFinal = new List<Polyline>();
    var x = Nesting(curve, out hullFinal);
    var finalCurve = x[0];
    var finalHull = hullFinal[0];
    var oner = curve[curve.Count - 1];
    curve.RemoveAt(0);
    var hullFinali = new List<Polyline>();
    curve.Add(finalHull);
    var outOne = Nesting(curve, out hullFinali)[0];
    curve.Add(hullFinali[0]);
    var hullFinalTwo = new List<Polyline>();
    curve.RemoveAt(0);
    var outTwo = Nesting(curve, out hullFinalTwo)[0];
    var outer = new List<Polyline>();
    outer.Add(finalCurve);
    outer.Add(oner);
    outer.Add(outOne);
    outer.Add(outTwo);

    return outer;

    */


    /*
    curve = AreaSorting(curve);

    var hull = new List<Polyline>();
    var nest = new List<Polyline>();

    var tempNest = new List<Polyline>();
    var tempHull = new List<Polyline>();

    var crv = curve[curve.Count - 1];

    tempNest.Add(crv);

    nest = Nesting(curve, out hull);
    curve.Add(nest[0]);
    curve.Add(hull[0]);

    nest = Nesting(curve, out hull);

    tempNest.Add(nest[0]);

    return tempNest;
    */

    /*

    var outer = new List<Polyline>();

    for(int i = 0; i < curve.Count - 1; ++i)
    {

      //var path = new GH_Path(i);
      var hullFinal = new List<Polyline>();
      var nesting = Nesting(curve, out hullFinal);
      var finalCurve = nesting[0];
      var finalHull = hullFinal[0];
      var oner = curve[curve.Count - 1];
      outer.Add(finalCurve);
      outer.Add(oner);

      curve.RemoveAt(0);
      curve.RemoveAt(curve.Count - 1);

      var hullFinali = new List<Polyline>();

      curve.Add(finalHull);

      var outOne = Nesting(curve, out hullFinali)[0];

      //outer = AreaSorting(outer);

      //outer.RemoveAt(2);

      outer.Add(outOne);


    }

    //return tree.Branch(0)[0];

    outer = AreaSorting(outer);
    outer.RemoveAt(outer.Count - 1);
    outer.RemoveAt(outer.Count - 1);
    outer.RemoveAt(1);

    //outer.RemoveAt(2);


    //outer.RemoveAt(outer.Count - 1);

    return outer;

    */
# ---------- end nestingreference ----------
merge_2 = Merge(Data1=curve_to_polyline.Polyline, Data2=curve_32, Data3=curve_30)
panel_44 = Panel(merge_2)
nesting_2 = CSharpScript(x=merge_2, Reference="C:\Users\Paula\AppData\Roaming\Grasshopper\Libraries\ClipperTools.dll")  # -> out, A; inputs x: list of Polyline
# ---------- nesting_2: C# ----------
    A = NestingMultiple(x);
# ---------- nesting_2: C# additional code ----------
  public List<Polyline> NestingMultiple(List<Polyline> curve)
  {

    curve = AreaSorting(curve);
    var outer = new List<Polyline>();
    for(int i = 0; i < curve.Count - 1; ++i)
    {

      var hullFinal = new List<Polyline>();
      var x = Nesting(curve, out hullFinal);
      var finalCurve = x[0];
      var finalHull = hullFinal[0];
      var oner = curve[curve.Count - 1];
      curve.Add(finalHull);
      curve.RemoveAt(0);

      outer.Add(finalCurve);
      outer.Add(oner);
      outer = AreaSorting(outer);

    }

    for(int i = 2; i < outer.Count; ++i)
    {

      outer.RemoveAt(outer.Count - 1);

    }

    return outer;

  }

  public List<Polyline> Nesting(List<Polyline> curve, out List<Polyline> hullFinal)
  {

    var treeOut = PointDataTree(curve);

    Polyline[] polys;

    var APoints = ConvexHullPoints(curve, treeOut, out polys);

    List<Polyline> polyFinal;

    hullFinal = ConvexHull(APoints, polys, out polyFinal);

    return polyFinal;

  }

  public Polyline IFP(List<Polyline> curves)
  {

    var one = curves.ElementAt(0);
    var two = curves.ElementAt(curves.Count - 1);

    var points = PointDataTree(curves);

    // Inner Fit Polygon
    Point3d centerOne = points.Branch(0)[0];//ptB[ptB.Count - 1];
    Vector3d zAxis = Vector3d.ZAxis;
    Plane pO = new Rhino.Geometry.Plane(centerOne, zAxis);
    double tolerance = 0.0001;

    List<Polyline> outCurvesOne = new List<Polyline>();
    List<Polyline> outDisplacedCurvesOne = new List<Polyline>();
    foreach(List<IntPoint> path in ClipperLib.Clipper.MinkowskiDiff(one.ToPath2D(pO, tolerance), two.ToPath2D(pO, tolerance)))
    {

      Polyline plSum = path.ToPolyline(pO, tolerance, true);
      outCurvesOne.Add(plSum);

    }

    Polyline bin = outCurvesOne[1];

    return bin;

  }

  public List<Polyline> AreaSorting(List<Polyline> x)
  {

    // We want to cast(change from one data type to another) our list of polylines to curves, so that
    // we can call the AreaMassProperties class and its method .Compute to get the area of the polygons
    // after that we can now create a List of KeyValuePair to assign the area of our polygons to our
    // polygons so that we can sort them later according to their areas.
    List<Curve> one = new List<Curve>();
    double[] areas = new Double[x.Count];
    var curves = new List<KeyValuePair<Polyline, double>>();

    for(int i = 0; i < x.Count; ++i)
    {

      one.Add(x.ElementAt(i).ToNurbsCurve());
      areas[i] = AreaMassProperties.Compute(one.ElementAt(i)).Area;
      curves.Add(new KeyValuePair<Polyline, double>(x.ElementAt(i), areas[i]));

    }

    // Here is where the sorting according to area values takes place.
    curves.Sort(Compare1);
    curves.Reverse();
    // We retrieve a list of curves from our List of KeyValuePairs
    List<Polyline> curve = (from kvp in curves select kvp.Key).Distinct().ToList();
    curve.Reverse();

    return curve;

  }

  public DataTree<Point3d> PointDataTree(List<Polyline> curve)
  {

    // We create and populate trees with the points of the curves, so that we can
    // sort each of the lower left points of each of the curves according to the
    // sum of their Xs and Ys positions.
    List<List<Point3d>> pts = new List<List<Point3d>>();
    DataTree<Point3d> tree = new DataTree<Point3d>();
    DataTree<double> treeSum = new DataTree<double>();
    var points = new DataTree<KeyValuePair<Point3d, double>>();
    var point = new List<Point3d>[curve.Count];
    DataTree<Point3d> treeLowerLeft = new DataTree<Point3d>();

    for(int i = 0; i < curve.Count; ++i)
    {

      pts.Add(curve[i].ToList());
      pts[i].RemoveAt(pts[i].Count - 1);
      GH_Path path = new GH_Path(i);

      for(int j = 0; j < pts[i].Count; ++j)
      {

        tree.Add(pts[i][j], path);
        treeSum.Add(pts[i][j].X + pts[i][j].Y, path);

        points.Add(new KeyValuePair<Point3d, double>(tree.Branch(i)[j], treeSum.Branch(i)[j]), path);

        points.Branch(i).Sort(Compare2);
        points.Branch(i).Reverse();
        point[i] = (from kvp in points.Branch(i) select kvp.Key).Distinct().ToList();
        point[i].Reverse();

      }

    }

    for(int i = 0; i < tree.BranchCount; ++i)
      for(int j = 0; j < tree.Branch(i).Count; ++j)
      {

        treeLowerLeft.Add(point[i][j], new GH_Path(i));

      }

    var treeOut = new DataTree<Point3d>();

    for(int i = 0; i < treeLowerLeft.BranchCount; ++i)
      for(int j = 0; j < treeLowerLeft.Branch(i).Count; ++j)
      {

        treeOut.Add(treeLowerLeft.Branch(i)[0], new GH_Path(i));

      }

    return treeOut;

  }

  public DataTree<Point3d> ConvexHullPoints(List<Polyline> curve, DataTree<Point3d> treeOut, out Polyline[] polys)
  {

    // No Fit Polygon from minkowsky difference using the clipper lib
    Polyline polyOne = curve[0];
    Polyline polyTwo = curve[curve.Count - 1];

    Point3d center = treeOut.Branch(0).ElementAt(0);
    Vector3d zAxis = Vector3d.ZAxis;
    Plane p = new Rhino.Geometry.Plane(center, zAxis);

    double tolerance = 0.001;
    List<Polyline> outCurves = new List<Polyline>();
    List<Polyline> outDisplacedCurves = new List<Polyline>();
    foreach(List<IntPoint> path in ClipperLib.Clipper.MinkowskiDiff(polyOne.ToPath2D(p, tolerance), polyTwo.ToPath2D(p, tolerance)))
    {

      Polyline plSum = path.ToPolyline(p, tolerance, true);
      outCurves.Add(plSum);

    }

    Polyline NFP = outCurves[0];

    List<Point3d> ptNFP;
    ptNFP = NFP.ToList();
    ptNFP.RemoveAt(0);

    List<Vector3d> vectors = new List<Vector3d>();
    for(int i = 0; i < ptNFP.Count; ++i)
    {

      vectors.Add(new Vector3d(ptNFP.ElementAt(i) - treeOut.Branch(0)[0]));

    }

    List<Curve> translated = new List<Curve>();
    polys = new Polyline[ptNFP.Count];
    List<List<Point3d>> polyPoint = new List<List<Point3d>>();

    List<Point3d> pointsA = new List<Point3d>();
    pointsA = polyTwo.ToList();
    pointsA.RemoveAt(pointsA.Count - 1);
    DataTree<Point3d> polyPoints = new DataTree<Point3d>();
    DataTree<Point3d> APoints = new DataTree<Point3d>();
    for(int i = 0; i < ptNFP.Count; ++i)
    {

      var path = new GH_Path(i);
      Curve oney = polyOne.ToNurbsCurve();
      oney.Translate(vectors.ElementAt(i));
      translated.Add(oney);
      translated.ElementAt(i).TryGetPolyline(out polys[i]);
      polyPoint.Add(polys[i].ToList());

      for(int j = 0; j < polyPoint[i].Count - 1; ++j)
      {

        polyPoints.Add(polyPoint[i][j], path);

      }

    }

    for(int i = 0; i < ptNFP.Count; ++i)
      for(int j = 0; j < pointsA.Count; ++j)
      {

        var path = new GH_Path(i);
        APoints.Add(pointsA[j], path);

      }

    for(int i = 0; i < polyPoints.BranchCount; ++i)
      for(int j = 0; j < polyPoints.Branch(i).Count; ++j)
      {

        APoints.Add(polyPoints.Branch(i)[j], new GH_Path(i));

      }

    return APoints;

  }

  public List<Polyline> ConvexHull(DataTree<Point3d> APoints, Polyline[] polys, out List<Polyline> polyFinal)
  {

    var list = new Grasshopper.Kernel.Geometry.Node2List[APoints.BranchCount];
    var polyLines = new Polyline[APoints.BranchCount];
    var curvesConvex = new Curve[APoints.BranchCount];
    var convexArea = new Double[APoints.BranchCount];
    var convexSort = new List<KeyValuePair<Polyline, double>>();
    var hullSort = new List<KeyValuePair<Polyline, double>>();

    for(int i = 0; i < APoints.BranchCount; ++i)
    {

      list[i] = new Grasshopper.Kernel.Geometry.Node2List(APoints.Branch(i));
      polyLines[i] = Grasshopper.Kernel.Geometry.ConvexHull.Solver.ComputeHull(list[i]);
      curvesConvex[i] = polyLines[i].ToNurbsCurve();
      convexArea[i] = AreaMassProperties.Compute(curvesConvex[i]).Area;
      convexSort.Add(new KeyValuePair<Polyline, double>(polys[i], convexArea[i]));
      hullSort.Add(new KeyValuePair<Polyline, double>(polyLines[i], convexArea[i]));

    }

    // Output the polygons with no convex hull
    // Here is where the sorting according to area values takes place.
    convexSort.Sort(Compare1);
    convexSort.Reverse();
    // We retrieve a list of polylines from our List of KeyValuePairs
    polyFinal = (from kvp in convexSort select kvp.Key).Distinct().ToList();
    polyFinal.Reverse();

    // Output the convex hull polygons
    // Here is where the sorting according to area values takes place.
    hullSort.Sort(Compare1);
    hullSort.Reverse();
    // We retrieve a list of polylines from our List of KeyValuePairs
    List<Polyline> hullFinal = (from kvp in hullSort select kvp.Key).Distinct().ToList();
    hullFinal.Reverse();

    return hullFinal;

  }

  static int Compare1(KeyValuePair<Polyline, double> a, KeyValuePair<Polyline, double> b)
  {

    return a.Value.CompareTo(b.Value);

  }

  static int Compare2(KeyValuePair<Point3d, double> a, KeyValuePair<Point3d, double> b)
  {

    return a.Value.CompareTo(b.Value);

  }
# ---------- end nesting_2 ----------
curve_33 = Curve(nesting_2.A)

# ----
unit_x = UnitX(Factor=expr("-x", Slider(50, range=0..50)))
merge_3 = Merge(Data1=curve_26, Data2=curve_27)
list_item_39 = ListItem(List=curve_25, Index=Slider(1, range=0..3), Wrap=True)
list_item_40 = ListItem(List=curve_25, Index=Slider(3, range=0..3), Wrap=True)
boundary_surfaces = BoundarySurfaces(Edges=[deconstruct_brep_4.Edges, deconstruct_brep_5.Edges])
nestingtwoitems = CSharpScript(x=curve_25, Reference="C:\Users\Paula\AppData\Roaming\Grasshopper\Libraries\ClipperTools.dll")  # -> out, A, B; inputs x: list of Polyline
# ---------- nestingtwoitems: C# ----------
    // We want to cast(change from one data type to another) our list of polylines to curves, so that
    // we can call the AreaMassProperties class and its method .Compute to get the area of the polygons
    // after that we can now create a List of KeyValuePair to assign the area of our polygons to our
    // polygons so that we can sort them later according to their areas.
    List<Curve> one = new List<Curve>();
    double[] areas = new Double[x.Count];
    var curves = new List<KeyValuePair<Polyline, double>>();

    for(int i = 0; i < x.Count; ++i)
    {

      one.Add(x.ElementAt(i).ToNurbsCurve());
      areas[i] = AreaMassProperties.Compute(one.ElementAt(i)).Area;
      curves.Add(new KeyValuePair<Polyline, double>(x.ElementAt(i), areas[i]));

    }

    // Here is where the sorting according to area values takes place.
    curves.Sort(Compare1);
    curves.Reverse();
    // We retrieve a list of curves from our List of KeyValuePairs
    List<Polyline> curve = (from kvp in curves select kvp.Key).Distinct().ToList();
    curve.Reverse();

    // We create and populate trees with the points of the curves, so that we can
    // sort each of the lower left points of each of the curves according to the
    // sum of their Xs and Ys positions.
    List<List<Point3d>> pts = new List<List<Point3d>>();
    DataTree<Point3d> tree = new DataTree<Point3d>();
    DataTree<double> treeSum = new DataTree<double>();
    var points = new DataTree<KeyValuePair<Point3d, double>>();
    var point = new List<Point3d>[curve.Count];
    DataTree<Point3d> treeLowerLeft = new DataTree<Point3d>();

    for(int i = 0; i < curve.Count; ++i)
    {

      pts.Add(curve[i].ToList());
      pts[i].RemoveAt(pts[i].Count - 1);
      GH_Path path = new GH_Path(i);

      for(int j = 0; j < pts[i].Count; ++j)
      {

        tree.Add(pts[i][j], path);
        treeSum.Add(pts[i][j].X + pts[i][j].Y, path);

        points.Add(new KeyValuePair<Point3d, double>(tree.Branch(i)[j], treeSum.Branch(i)[j]), path);

        points.Branch(i).Sort(Compare2);
        points.Branch(i).Reverse();
        point[i] = (from kvp in points.Branch(i) select kvp.Key).Distinct().ToList();
        point[i].Reverse();

      }

    }

    for(int i = 0; i < tree.BranchCount; ++i)
      for(int j = 0; j < tree.Branch(i).Count; ++j)
      {

        treeLowerLeft.Add(point[i][j], new GH_Path(i));

      }

    var treeOut = new DataTree<Point3d>();

    for(int i = 0; i < treeLowerLeft.BranchCount; ++i)
      for(int j = 0; j < treeLowerLeft.Branch(i).Count; ++j)
      {

        treeOut.Add(treeLowerLeft.Branch(i)[0], new GH_Path(i));

      }

    /*
    // Create the data structures and initialize them
    DataTree<Point3d> points = new DataTree<Point3d>();
    List<List<Point3d>> lists = new List<List<Point3d>>();

    // Fill the nested list with the list of points
    for(int i = 0; i < x.Count; ++i)
    {

      lists.Add(x[i].ToList());

    }

    // Fill the data tree with the list of points
    for(int i = 0; i < lists.Count; ++i)
    {

      var path = new GH_Path(i);

      for(int j = 0; j < lists[i].Count; ++j )
      {

        points.Add(lists[i][j], path);

      }

    }
    */


    // No Fit Polygon from minkowsky difference using the clipper lib
    Polyline polyOne = curve[0];
    Polyline polyTwo = curve[curve.Count - 1];

    Point3d center = treeOut.Branch(0).ElementAt(0);
    Vector3d zAxis = Vector3d.ZAxis;
    Plane p = new Rhino.Geometry.Plane(center, zAxis);

    double tolerance = 0.001;
    List<Polyline> outCurves = new List<Polyline>();
    List<Polyline> outDisplacedCurves = new List<Polyline>();
    foreach(List<IntPoint> path in ClipperLib.Clipper.MinkowskiDiff(polyOne.ToPath2D(p, tolerance), polyTwo.ToPath2D(p, tolerance)))
    {

      Polyline plSum = path.ToPolyline(p, tolerance, true);
      outCurves.Add(plSum);

    }

    Polyline NFP = outCurves[0];

    List<Point3d> ptNFP;
    ptNFP = NFP.ToList();
    ptNFP.RemoveAt(0);

    List<Vector3d> vectors = new List<Vector3d>();
    for(int i = 0; i < ptNFP.Count; ++i)
    {

      vectors.Add(new Vector3d(ptNFP.ElementAt(i) - treeOut.Branch(0)[0]));

    }

    List<Curve> translated = new List<Curve>();
    Polyline[] polys = new Polyline[ptNFP.Count];
    List<List<Point3d>> polyPoint = new List<List<Point3d>>();

    List<Point3d> pointsA = new List<Point3d>();
    pointsA = polyTwo.ToList();
    pointsA.RemoveAt(pointsA.Count - 1);
    DataTree<Point3d> polyPoints = new DataTree<Point3d>();
    DataTree<Point3d> APoints = new DataTree<Point3d>();
    for(int i = 0; i < ptNFP.Count; ++i)
    {

      var path = new GH_Path(i);
      Curve oney = polyOne.ToNurbsCurve();
      oney.Translate(vectors.ElementAt(i));
      translated.Add(oney);
      translated.ElementAt(i).TryGetPolyline(out polys[i]);
      polyPoint.Add(polys[i].ToList());

      for(int j = 0; j < polyPoint[i].Count - 1; ++j)
      {

        polyPoints.Add(polyPoint[i][j], path);

      }

    }

    for(int i = 0; i < ptNFP.Count; ++i)
      for(int j = 0; j < pointsA.Count; ++j)
      {

        var path = new GH_Path(i);
        APoints.Add(pointsA[j], path);

      }

    for(int i = 0; i < polyPoints.BranchCount; ++i)
      for(int j = 0; j < polyPoints.Branch(i).Count; ++j)
      {

        APoints.Add(polyPoints.Branch(i)[j], new GH_Path(i));

      }

    var list = new Grasshopper.Kernel.Geometry.Node2List[APoints.BranchCount];
    var polyLines = new Polyline[APoints.BranchCount];
    var curvesConvex = new Curve[APoints.BranchCount];
    var convexArea = new Double[APoints.BranchCount];
    var convexSort = new List<KeyValuePair<Polyline, double>>();
    var hullSort = new List<KeyValuePair<Polyline, double>>();

    for(int i = 0; i < APoints.BranchCount; ++i)
    {

      list[i] = new Grasshopper.Kernel.Geometry.Node2List(APoints.Branch(i));
      polyLines[i] = Grasshopper.Kernel.Geometry.ConvexHull.Solver.ComputeHull(list[i]);
      curvesConvex[i] = polyLines[i].ToNurbsCurve();
      convexArea[i] = AreaMassProperties.Compute(curvesConvex[i]).Area;
      convexSort.Add(new KeyValuePair<Polyline, double>(polys[i], convexArea[i]));
      hullSort.Add(new KeyValuePair<Polyline, double>(polyLines[i], convexArea[i]));

    }

    // Output the polygons with no convex hull
    // Here is where the sorting according to area values takes place.
    convexSort.Sort(Compare1);
    convexSort.Reverse();
    // We retrieve a list of polylines from our List of KeyValuePairs
    List<Polyline> polyFinal = (from kvp in convexSort select kvp.Key).Distinct().ToList();
    polyFinal.Reverse();
    
    // Output the convex hull polygons
    // Here is where the sorting according to area values takes place.
    hullSort.Sort(Compare1);
    hullSort.Reverse();
    // We retrieve a list of polylines from our List of KeyValuePairs
    List<Polyline> hullFinal = (from kvp in hullSort select kvp.Key).Distinct().ToList();
    hullFinal.Reverse();

    A = polyFinal[0];

    B = hullFinal[0];

    /*
    Curve booleanUnionOne = polyFinal[0].ToNurbsCurve();
    Curve booleanUnionTwo = polyTwo.ToNurbsCurve();

    var listBoolean = new List<Curve>();

    listBoolean.Add(booleanUnionOne);
    listBoolean.Add(booleanUnionTwo);

    A = Curve.CreateBooleanUnion(listBoolean).ElementAt(1);
  */
# ---------- nestingtwoitems: C# additional code ----------
  static int Compare1(KeyValuePair<Polyline, double> a, KeyValuePair<Polyline, double> b)
  {

    return a.Value.CompareTo(b.Value);

  }

  static int Compare2(KeyValuePair<Point3d, double> a, KeyValuePair<Point3d, double> b)
  {

    return a.Value.CompareTo(b.Value);

  }
# ---------- end nestingtwoitems ----------
curve_34 = Curve(<curve referenced from the Rhino model>)
move_2 = Move(Geometry=curve_34, Motion=unit_x)  # -> Geometry, Transform
curve_35 = Curve(nestingtwoitems.B)
curve_36 = Curve(nestingtwoitems.A)
join_curves = JoinCurves(Curves=[list_item_40, curve_35], Preserve=False)
shift_list_3 = ShiftList(List=discontinuity_7.Points, Shift=Slider(1, range=0..3), Wrap=True)
deconstruct_brep_6 = DeconstructBrep(Brep=boundary_surfaces)  # -> Faces, Edges, Vertices
deconstruct_brep_7 = DeconstructBrep(Brep=[curve_36, list_item_39])  # -> Faces, Edges, flatten(Vertices)
c_script_7 = CSharpScript(x=merge_3)  # -> out, A; inputs x: list of Polyline
# ---------- c_script_7: C# ----------
    //Rhino.Geometry.PointCloudItem;
    var pA = new List<Point3d>();
    var pB = new List<Point3d>();
    var joined = new List<Point3d>();
    pA = x[0].ToList();
    pB = x[1].ToList();
    for(int i = 0; i < pA.Count; ++i)
    {

      joined.Add(pA.ElementAt(i));

    }
    joined.RemoveAt(pA.Count - 1);

    joined = shiftLeft(joined.ToArray(), 1);

/*
    for(int j = 0; j < pB.Count; ++j)
    {

      joined.Add(pB.ElementAt(j));

    }
    joined.RemoveAt((pA.Count - 1) + (pB.Count - 1));
  */

    A = joined;
# ---------- c_script_7: C# additional code ----------
  // https://stackoverflow.com/questions/21385066/shifting-array-elements-to-right/21385610#21385610
  // updated so that instead of shifting integers it shifts the Point3d[] list
  public List<Point3d> shiftLeft(Point3d[] arr, int size)
  {

    List<Point3d> fin = new List<Point3d>();

    Point3d[] demo = new Point3d[arr.Length];

    for (int i = 0; i < arr.Length - size; i++)
    {
      demo[i] = arr[i + size];
    }

    demo[demo.Length - size] = arr[0];

    fin = demo.ToList();

    return fin;
  }
# ---------- end c_script_7 ----------
flatten_tree = FlattenTree(Tree=deconstruct_brep_6.Vertices, Path="{0}")
curve_37 = Curve(<curve referenced from the Rhino model>)
panel_45 = Panel(deconstruct_brep_7.Vertices)
merge_4 = Merge(Data1=curve_29, Data2=curve_37, Data3=curve_34)
curve_38 = Curve([<curve referenced from the Rhino model> x2])
cull_index_6 = CullIndex(List=flatten_tree, Indices=0, Wrap=True)
list_item_41 = ListItem(List=flatten(deconstruct_brep_7.Vertices), Index=0, Wrap=True)  # -> Item, Item1, Item2, Item3, Item4, Item5, Item6, Item7
polyline_3 = PolyLine(Vertices=cull_index_6, Closed=True)  # -> flatten(Polyline)
polyline_4 = PolyLine(Vertices=c_script_7.A, Closed=False)
removeduplicatepts = RemoveDuplicatePts(Points=flatten(deconstruct_brep_7.Vertices), Tolerance=0.01)
cull_duplicates = CullDuplicates(Points=deconstruct_brep_7.Vertices, Tolerance=0.1, CullMode=3)  # -> Points, Indices, Valence
intersection_2 = CSharpScript(x=curve_38)  # -> out, A; inputs x: list of Polyline
# ---------- intersection_2: C# ----------
    //Curve[] curves = new Curve[x.Count];
    List<Curve> curves = new List<Curve>();

    for(int i = 0; i < x.Count; ++i)
    {

      //curves[i] = x[i].ToNurbsCurve();
      //curves.Remove(x.Count);
      curves.Add(x[i].ToNurbsCurve());

    }
    
    Curve one = curves[curves.Count - 1];

    Curve two = curves[0];

    A = one;
    Curve[] three = Curve.CreateBooleanUnion(curves);
    //Curve three = two[0];
    //A = Curve.CreateBooleanIntersection(one, two);
    A = three;
# ---------- end intersection_2 ----------
curve_39 = Curve(<curve referenced from the Rhino model>)
panel_46 = Panel(curve_33)
nestingtwoitems_2 = CSharpScript(x=join_curves, Reference="C:\Users\Paula\AppData\Roaming\Grasshopper\Libraries\ClipperTools.dll")  # -> out, A, B; inputs x: list of Polyline; same code as nestingtwoitems
innerfitpolygon = CSharpScript(x=merge_4, Reference="C:\Users\Paula\AppData\Roaming\Grasshopper\Libraries\ClipperTools.dll")  # -> out, A, B; inputs x: list of Polyline
# ---------- innerfitpolygon: C# ----------
    x = AreaSorting(x);
    
    var final = FirstPlacement(x)[FirstPlacement(x).Count - 1];
    
    A = final;
    
    x.RemoveAt(0);
    
    B = FirstPlacement(x)[FirstPlacement(x).Count - 1];
# ---------- innerfitpolygon: C# additional code ----------
  public List<Polyline> FirstPlacement(List<Polyline> x)
  {
  
    var innerFitPolygon = IFP(x)[1];

    List<Polyline> oner = new List<Polyline>();

    oner.Add(innerFitPolygon);
    oner.Add(x[0]);

    List<Polyline> two = new List<Polyline>();

    two.Add(innerFitPolygon);

    var fix = Translate(oner);

    for(int i = 0; i < fix.Length; ++i)
    {

      two.Add(fix.ElementAt(i));

    }

    two = AreaSorting(two);

    var a = two[two.Count - 1].ToNurbsCurve();

    two.RemoveAt(two.Count - 1);

    var array = new Curve[two.Count];

    Rhino.Geometry.Intersect.CurveIntersections ci;
    DataTree<Point3d> intPts = new DataTree<Point3d>();

    var numberOfIntersections = new Double[two.Count];

    var sortNumberOfIntersections = new List<KeyValuePair<Polyline, double>>();
    for(int i = 0; i < array.Length; ++i)
    {

      array[i] = two.ElementAt(i).ToNurbsCurve();


      ci = Rhino.Geometry.Intersect.Intersection.CurveCurve(a, array[i], 0.001, 0.001);

      for(int j = 0; j < ci.Count; j++)
      {

        intPts.Add(ci[j].PointA, new GH_Path(i));

        numberOfIntersections[i] = intPts.Branch(i).Count;

        sortNumberOfIntersections.Add(new KeyValuePair<Polyline, double>(two[i], numberOfIntersections[i]));

      }

    }

    sortNumberOfIntersections.Sort(Compare1);
    sortNumberOfIntersections.Reverse();

    List<Polyline> sortedPolys = (from kvp in sortNumberOfIntersections select kvp.Key).Distinct().ToList();
    sortedPolys.Reverse();

    return sortedPolys;
  
  }
  
  public Polyline[] Translate(List<Polyline> curve)
  {

    var treeOut = PointDataTree(curve);

    var polyTwo = curve[0];
    var polyOne = curve[curve.Count - 1];

    List<Point3d> ptNFP;
    ptNFP = polyTwo.ToList();
    ptNFP.RemoveAt(0);

    List<Vector3d> vectors = new List<Vector3d>();
    for(int i = 0; i < ptNFP.Count; ++i)
    {

      vectors.Add(new Vector3d(ptNFP.ElementAt(i) - treeOut.Branch(treeOut.BranchCount - 1)[0]));

    }

    List<Curve> translated = new List<Curve>();
    var polys = new Polyline[ptNFP.Count];
    List<List<Point3d>> polyPoint = new List<List<Point3d>>();

    List<Point3d> pointsA = new List<Point3d>();
    pointsA = polyTwo.ToList();
    pointsA.RemoveAt(pointsA.Count - 1);
    DataTree<Point3d> polyPoints = new DataTree<Point3d>();
    DataTree<Point3d> APoints = new DataTree<Point3d>();
    for(int i = 0; i < ptNFP.Count; ++i)
    {

      var path = new GH_Path(i);
      Curve oney = polyOne.ToNurbsCurve();
      oney.Translate(vectors.ElementAt(i));
      translated.Add(oney);
      translated.ElementAt(i).TryGetPolyline(out polys[i]);
      polyPoint.Add(polys[i].ToList());

    }

    return polys;

  }

  public List<Polyline> IFP(List<Polyline> curves)
  {

    curves = AreaSorting(curves);

    var one = curves.ElementAt(0);
    var two = curves.ElementAt(curves.Count - 1);

    var points = PointDataTree(curves);

    // Inner Fit Polygon
    Point3d centerOne = points.Branch(0)[0];//ptB[ptB.Count - 1];
    Vector3d zAxis = Vector3d.ZAxis;
    Plane pO = new Rhino.Geometry.Plane(centerOne, zAxis);
    double tolerance = 0.0001;

    List<Polyline> outCurvesOne = new List<Polyline>();
    List<Polyline> outDisplacedCurvesOne = new List<Polyline>();
    foreach(List<IntPoint> path in ClipperLib.Clipper.MinkowskiDiff(one.ToPath2D(pO, tolerance), two.ToPath2D(pO, tolerance)))
    {

      Polyline plSum = path.ToPolyline(pO, tolerance, true);
      outCurvesOne.Add(plSum);

    }

    Polyline bin = outCurvesOne[1];

    return outCurvesOne;

  }

  public List<Polyline> AreaSorting(List<Polyline> x)
  {

    // We want to cast(change from one data type to another) our list of polylines to curves, so that
    // we can call the AreaMassProperties class and its method .Compute to get the area of the polygons
    // after that we can now create a List of KeyValuePair to assign the area of our polygons to our
    // polygons so that we can sort them later according to their areas.
    List<Curve> one = new List<Curve>();
    double[] areas = new Double[x.Count];
    var curves = new List<KeyValuePair<Polyline, double>>();

    for(int i = 0; i < x.Count; ++i)
    {

      one.Add(x.ElementAt(i).ToNurbsCurve());
      areas[i] = AreaMassProperties.Compute(one.ElementAt(i)).Area;
      curves.Add(new KeyValuePair<Polyline, double>(x.ElementAt(i), areas[i]));

    }

    // Here is where the sorting according to area values takes place.
    curves.Sort(Compare1);
    curves.Reverse();
    // We retrieve a list of curves from our List of KeyValuePairs
    List<Polyline> curve = (from kvp in curves select kvp.Key).Distinct().ToList();
    curve.Reverse();

    return curve;

  }

  public DataTree<Point3d> PointDataTree(List<Polyline> curve)
  {

    // We create and populate trees with the points of the curves, so that we can
    // sort each of the lower left points of each of the curves according to the
    // sum of their Xs and Ys positions.
    List<List<Point3d>> pts = new List<List<Point3d>>();
    DataTree<Point3d> tree = new DataTree<Point3d>();
    DataTree<double> treeSum = new DataTree<double>();
    var points = new DataTree<KeyValuePair<Point3d, double>>();
    var point = new List<Point3d>[curve.Count];
    DataTree<Point3d> treeLowerLeft = new DataTree<Point3d>();

    for(int i = 0; i < curve.Count; ++i)
    {

      pts.Add(curve[i].ToList());
      pts[i].RemoveAt(pts[i].Count - 1);
      GH_Path path = new GH_Path(i);

      for(int j = 0; j < pts[i].Count; ++j)
      {

        tree.Add(pts[i][j], path);
        treeSum.Add(pts[i][j].X + pts[i][j].Y, path);

        points.Add(new KeyValuePair<Point3d, double>(tree.Branch(i)[j], treeSum.Branch(i)[j]), path);

        points.Branch(i).Sort(Compare2);
        points.Branch(i).Reverse();
        point[i] = (from kvp in points.Branch(i) select kvp.Key).Distinct().ToList();
        point[i].Reverse();

      }

    }

    for(int i = 0; i < tree.BranchCount; ++i)
      for(int j = 0; j < tree.Branch(i).Count; ++j)
      {

        treeLowerLeft.Add(point[i][j], new GH_Path(i));

      }

    var treeOut = new DataTree<Point3d>();

    for(int i = 0; i < treeLowerLeft.BranchCount; ++i)
      for(int j = 0; j < treeLowerLeft.Branch(i).Count; ++j)
      {

        treeOut.Add(treeLowerLeft.Branch(i)[0], new GH_Path(i));

      }

    return treeOut;

  }

  static int Compare1(KeyValuePair<Polyline, double> a, KeyValuePair<Polyline, double> b)
  {

    return a.Value.CompareTo(b.Value);

  }

  static int Compare2(KeyValuePair<Point3d, double> a, KeyValuePair<Point3d, double> b)
  {

    return a.Value.CompareTo(b.Value);

  }
# ---------- end innerfitpolygon ----------
innerfitpolygon_2 = CSharpScript(x=merge_4, Reference="C:\Users\Paula\AppData\Roaming\Grasshopper\Libraries\ClipperTools.dll")  # -> out, A, B, C; inputs x: list of Polyline
# ---------- innerfitpolygon_2: C# ----------
    var yeah = IFP(x)[1];

    x = AreaSorting(x);

    List<Polyline> oner = new List<Polyline>();

    oner.Add(IFP(x)[1]);
    oner.Add(x[0]);

    List<Polyline> two = new List<Polyline>();

    two.Add(yeah);

    var fix = Translate(oner);

    for(int i = 0; i < fix.Length; ++i)
    {

      two.Add(fix.ElementAt(i));

    }

    //A = Translate(oner);

    two = AreaSorting(two);

    B = two[two.Count - 1];
    
    two.RemoveAt(two.Count - 1);
    
    A = two;

    C = two.Count;
# ---------- innerfitpolygon_2: C# additional code ----------
  public Polyline[] Translate(List<Polyline> curve)
  {

    var treeOut = PointDataTree(curve);

    var polyTwo = curve[0];
    var polyOne = curve[curve.Count - 1];

    List<Point3d> ptNFP;
    ptNFP = polyTwo.ToList();
    ptNFP.RemoveAt(0);

    List<Vector3d> vectors = new List<Vector3d>();
    for(int i = 0; i < ptNFP.Count; ++i)
    {

      vectors.Add(new Vector3d(ptNFP.ElementAt(i) - treeOut.Branch(treeOut.BranchCount - 1)[0]));

    }

    List<Curve> translated = new List<Curve>();
    var polys = new Polyline[ptNFP.Count];
    List<List<Point3d>> polyPoint = new List<List<Point3d>>();

    List<Point3d> pointsA = new List<Point3d>();
    pointsA = polyTwo.ToList();
    pointsA.RemoveAt(pointsA.Count - 1);
    DataTree<Point3d> polyPoints = new DataTree<Point3d>();
    DataTree<Point3d> APoints = new DataTree<Point3d>();
    for(int i = 0; i < ptNFP.Count; ++i)
    {

      var path = new GH_Path(i);
      Curve oney = polyOne.ToNurbsCurve();
      oney.Translate(vectors.ElementAt(i));
      translated.Add(oney);
      translated.ElementAt(i).TryGetPolyline(out polys[i]);
      polyPoint.Add(polys[i].ToList());

    }

    return polys;

  }

  public List<Polyline> IFP(List<Polyline> curves)
  {

    curves = AreaSorting(curves);

    var one = curves.ElementAt(0);
    var two = curves.ElementAt(curves.Count - 1);

    var points = PointDataTree(curves);

    // Inner Fit Polygon
    Point3d centerOne = points.Branch(0)[0];//ptB[ptB.Count - 1];
    Vector3d zAxis = Vector3d.ZAxis;
    Plane pO = new Rhino.Geometry.Plane(centerOne, zAxis);
    double tolerance = 0.0001;

    List<Polyline> outCurvesOne = new List<Polyline>();
    List<Polyline> outDisplacedCurvesOne = new List<Polyline>();
    foreach(List<IntPoint> path in ClipperLib.Clipper.MinkowskiDiff(one.ToPath2D(pO, tolerance), two.ToPath2D(pO, tolerance)))
    {

      Polyline plSum = path.ToPolyline(pO, tolerance, true);
      outCurvesOne.Add(plSum);

    }

    Polyline bin = outCurvesOne[1];

    return outCurvesOne;

  }

  public List<Polyline> AreaSorting(List<Polyline> x)
  {

    // We want to cast(change from one data type to another) our list of polylines to curves, so that
    // we can call the AreaMassProperties class and its method .Compute to get the area of the polygons
    // after that we can now create a List of KeyValuePair to assign the area of our polygons to our
    // polygons so that we can sort them later according to their areas.
    List<Curve> one = new List<Curve>();
    double[] areas = new Double[x.Count];
    var curves = new List<KeyValuePair<Polyline, double>>();

    for(int i = 0; i < x.Count; ++i)
    {

      one.Add(x.ElementAt(i).ToNurbsCurve());
      areas[i] = AreaMassProperties.Compute(one.ElementAt(i)).Area;
      curves.Add(new KeyValuePair<Polyline, double>(x.ElementAt(i), areas[i]));

    }

    // Here is where the sorting according to area values takes place.
    curves.Sort(Compare1);
    curves.Reverse();
    // We retrieve a list of curves from our List of KeyValuePairs
    List<Polyline> curve = (from kvp in curves select kvp.Key).Distinct().ToList();
    curve.Reverse();

    return curve;

  }

  public DataTree<Point3d> PointDataTree(List<Polyline> curve)
  {

    // We create and populate trees with the points of the curves, so that we can
    // sort each of the lower left points of each of the curves according to the
    // sum of their Xs and Ys positions.
    List<List<Point3d>> pts = new List<List<Point3d>>();
    DataTree<Point3d> tree = new DataTree<Point3d>();
    DataTree<double> treeSum = new DataTree<double>();
    var points = new DataTree<KeyValuePair<Point3d, double>>();
    var point = new List<Point3d>[curve.Count];
    DataTree<Point3d> treeLowerLeft = new DataTree<Point3d>();

    for(int i = 0; i < curve.Count; ++i)
    {

      pts.Add(curve[i].ToList());
      pts[i].RemoveAt(pts[i].Count - 1);
      GH_Path path = new GH_Path(i);

      for(int j = 0; j < pts[i].Count; ++j)
      {

        tree.Add(pts[i][j], path);
        treeSum.Add(pts[i][j].X + pts[i][j].Y, path);

        points.Add(new KeyValuePair<Point3d, double>(tree.Branch(i)[j], treeSum.Branch(i)[j]), path);

        points.Branch(i).Sort(Compare2);
        points.Branch(i).Reverse();
        point[i] = (from kvp in points.Branch(i) select kvp.Key).Distinct().ToList();
        point[i].Reverse();

      }

    }

    for(int i = 0; i < tree.BranchCount; ++i)
      for(int j = 0; j < tree.Branch(i).Count; ++j)
      {

        treeLowerLeft.Add(point[i][j], new GH_Path(i));

      }

    var treeOut = new DataTree<Point3d>();

    for(int i = 0; i < treeLowerLeft.BranchCount; ++i)
      for(int j = 0; j < treeLowerLeft.Branch(i).Count; ++j)
      {

        treeOut.Add(treeLowerLeft.Branch(i)[0], new GH_Path(i));

      }

    return treeOut;

  }

  static int Compare1(KeyValuePair<Polyline, double> a, KeyValuePair<Polyline, double> b)
  {

    return a.Value.CompareTo(b.Value);

  }

  static int Compare2(KeyValuePair<Point3d, double> a, KeyValuePair<Point3d, double> b)
  {

    return a.Value.CompareTo(b.Value);

  }
# ---------- end innerfitpolygon_2 ----------
merge_5 = Merge(
    Data1=list_item_41.Item,
    Data2=list_item_41.Item2,
    Data3=list_item_41.Item1,
    Data4=list_item_41.Item3,
    Data5=list_item_41.Item4,
    Data6=list_item_41.Item5,
    Data7=list_item_41.Item6,
    Data8=list_item_41.Item7)
curve_40 = Curve(nestingtwoitems_2.A)
merge_6 = Merge(Data1=polyline_3, Data2=curve_39)
curve_41 = Curve(innerfitpolygon_2.B)
curve_42 = Curve(innerfitpolygon_2.A)
curve_43 = Curve(<curve referenced from the Rhino model>)
curve_44 = Curve(innerfitpolygon.B)
polyline_5 = PolyLine(Vertices=flatten(merge_5), Closed=True)
curve_45 = Curve(<curve referenced from the Rhino model>)
deconstruct_4 = Deconstruct(Point=cull_duplicates.Points)  # -> expr("x*10000", XComponent), YComponent, ZComponent
point_list_15 = PointList(Points=merge_5)
discontinuity_8 = Discontinuity(Curve=merge_6, Level=1)  # -> Points, Parameters
curve_curve_2 = CurveCurve(CurveA=curve_42, CurveB=curve_41)  # -> simplify(Points), ParamsA, ParamsB
merge_7 = Merge(Data1=curve_44, Data2=curve_43)
nesting_3 = CSharpScript(x=merge_6, Reference="C:\Users\Paula\AppData\Roaming\Grasshopper\Libraries\ClipperTools.dll")  # -> out, A, B; inputs x: list of Polyline; same code as nesting
addition_5 = Addition(A=deconstruct_4.XComponent, B=deconstruct_4.YComponent)
nesting_4 = CSharpScript(x=merge_7, Reference="C:\Users\Paula\AppData\Roaming\Grasshopper\Libraries\ClipperTools.dll")  # -> out, A; inputs x: list of Polyline; same code as nesting_2
list_length_4 = ListLength(List=curve_curve_2.Points)  # -> flatten(Length)
sort_list_6 = SortList(Keys=list_length_4, ValuesValuesA=curve_42)  # -> Keys, ValuesValuesA
area_4 = Area(Geometry=list_item_39)  # -> Area, Centroid
number_slider_12 = Slider(160, range=0..1000)
point_list_16 = PointList(Points=deconstruct_brep_6.Vertices, Size=number_slider_12)
point_list_17 = PointList(Points=shift_list_3, Size=number_slider_12)
point_list_18 = PointList(Points=c_script_7.A, Size=number_slider_12)
point_list_19 = PointList(Points=discontinuity_8.Points, Size=number_slider_12)
list_item_42 = ListItem(List=curve_to_polyline.Polyline, Index=0, Wrap=True)
curve_46 = Curve(nesting_3.A)
curve_47 = Curve(nesting_3.B)
curve_curve_3 = CurveCurve(CurveA=curve_46, CurveB=curve_47)  # -> Points, ParamsA, ParamsB
merge_8 = Merge(Data1=nesting_4.A, Data2=curve_29)
list_length_5 = ListLength(List=cull_duplicates.Points)
list_item_43 = ListItem(List=sort_list_6.ValuesValuesA, Index=0, Wrap=True)
sort_list_7 = SortList(Keys=addition_5, ValuesValuesA=cull_duplicates.Points)  # -> Keys, ValuesValuesA
join_curves_2 = JoinCurves(Curves=[curve_46, curve_47], Preserve=False)
surface_split = SurfaceSplit(Surface=curve_45, Curves=join_curves_2)
list_item_44 = ListItem(List=surface_split, Index=0, Wrap=True)
panel_47 = Panel(list_length_5)
c_script_8 = CSharpScript(x=cull_duplicates.Points, y=area_4.Centroid)  # -> out, A; inputs x: list of Point3d, y: Point3d
# ---------- c_script_8: C# ----------
    Point3d[] points = x.ToArray();
    double[] angles = new Double[x.Count];

    for(int i = 0; i < x.Count; ++i)
    {

      angles[i] = Math.Atan2(y.X + y.Y, points[i].Y);

    }

    Array.Sort(angles, points);

    //points.Reverse();

    A = points;
# ---------- end c_script_8 ----------
brep_wireframe = BrepWireframe(Brep=list_item_44, Density=-1)
panel_48 = Panel(curve_curve_2.Points)
intersection_3 = CSharpScript(x=merge_8)  # -> out, A; inputs x: list of Polyline
# ---------- intersection_3: C# ----------
    //Curve[] curves = new Curve[x.Count];
    List<Curve> curves = new List<Curve>();

    for(int i = 0; i < x.Count; ++i)
    {

      //curves[i] = x[i].ToNurbsCurve();
      //curves.Remove(x.Count);
      curves.Add(x[i].ToNurbsCurve());

    }

    Curve one = curves[x.Count - 1];

    curves.RemoveAt(x.Count - 1);

    //A = curves;
    Curve[] two = Curve.CreateBooleanUnion(curves);
    Curve three = two[0];
    A = Curve.CreateBooleanIntersection(three, one);
    //A = two.Length;
# ---------- end intersection_3 ----------
deconstruct_brep_8 = DeconstructBrep(Brep=curve_47)  # -> Faces, Edges, Vertices
cull_index_7 = CullIndex(List=sort_list_7.ValuesValuesA, Indices=list_length_5, Wrap=True)
deconstruct_brep_9 = DeconstructBrep(Brep=curve_46)  # -> Faces, Edges, Vertices
point_list_20 = PointList(Points=c_script_8.A)
polyline_6 = PolyLine(Vertices=c_script_8.A, Closed=True)
region_difference = RegionDifference(CurvesA=curve_29, CurvesB=intersection_3.A)
list_length_6 = ListLength(List=deconstruct_brep_8.Vertices)
evaluate_2 = Evaluate(Expression="If(x=y, True, False)", x=curve_curve_2.Points, y=innerfitpolygon.A)
point_list_21 = PointList(Points=flatten(deconstruct_brep_8.Vertices), Size=number_slider_12)
point_list_22 = PointList(Points=flatten(deconstruct_brep_9.Vertices), Size=number_slider_12)
join_curves_3 = JoinCurves(Curves=polyline_5, Preserve=False)
merge_9 = Merge(Data1=region_difference, Data2=list_item_43)  # -> flatten(Result)
shift_list_4 = ShiftList(List=deconstruct_brep_9.Vertices, Shift=expr("x-1", list_length_6), Wrap=True)
panel_49 = Panel(evaluate_2)
nestingtwoitems_3 = CSharpScript(x=join_curves_3, Reference="C:\Users\Paula\AppData\Roaming\Grasshopper\Libraries\ClipperTools.dll")  # -> out, A, B; inputs x: list of Polyline; same code as nestingtwoitems
innerfitpolygon_3 = CSharpScript(x=merge_9, Reference="C:\Users\Paula\AppData\Roaming\Grasshopper\Libraries\ClipperTools.dll")  # -> out, A; inputs x: list of Polyline
# ---------- innerfitpolygon_3: C# ----------
    //var innerFitPolygon = IFP(x);

    //A = innerFitPolygon[1];

    var final = FirstPlacement(x)[0];

    A = final;

    /*
    x.RemoveAt(0);

    B = FirstPlacement(x)[FirstPlacement(x).Count - 1];
    */
# ---------- innerfitpolygon_3: C# additional code ----------
  public List<Polyline> FirstPlacement(List<Polyline> x)
  {

    var innerFitPolygon = IFP(x)[1];

    List<Polyline> oner = new List<Polyline>();

    oner.Add(innerFitPolygon);
    oner.Add(x[0]);

    List<Polyline> two = new List<Polyline>();

    two.Add(innerFitPolygon);

    var fix = Translate(oner);

    for(int i = 0; i < fix.Length; ++i)
    {

      two.Add(fix.ElementAt(i));

    }

    two = AreaSorting(two);

    var a = two[two.Count - 1].ToNurbsCurve();

    two.RemoveAt(two.Count - 1);

    var array = new Curve[two.Count];

    Rhino.Geometry.Intersect.CurveIntersections ci;
    DataTree<Point3d> intPts = new DataTree<Point3d>();

    var numberOfIntersections = new Double[two.Count];

    var sortNumberOfIntersections = new List<KeyValuePair<Polyline, double>>();
    for(int i = 0; i < array.Length; ++i)
    {

      array[i] = two.ElementAt(i).ToNurbsCurve();


      ci = Rhino.Geometry.Intersect.Intersection.CurveCurve(a, array[i], 0.001, 0.001);

      for(int j = 0; j < ci.Count; j++)
      {

        intPts.Add(ci[j].PointA, new GH_Path(i));

        numberOfIntersections[i] = intPts.Branch(i).Count;

        sortNumberOfIntersections.Add(new KeyValuePair<Polyline, double>(two[i], numberOfIntersections[i]));

      }

    }

    sortNumberOfIntersections.Sort(Compare1);
    sortNumberOfIntersections.Reverse();

    List<Polyline> sortedPolys = (from kvp in sortNumberOfIntersections select kvp.Key).Distinct().ToList();
    sortedPolys.Reverse();

    return sortedPolys;

  }

  public Polyline[] Translate(List<Polyline> curve)
  {

    var treeOut = PointDataTree(curve);

    var polyTwo = curve[0];
    var polyOne = curve[curve.Count - 1];

    List<Point3d> ptNFP;
    ptNFP = polyTwo.ToList();
    ptNFP.RemoveAt(0);

    List<Vector3d> vectors = new List<Vector3d>();
    for(int i = 0; i < ptNFP.Count; ++i)
    {

      vectors.Add(new Vector3d(ptNFP.ElementAt(i) - treeOut.Branch(treeOut.BranchCount - 1)[0]));

    }

    List<Curve> translated = new List<Curve>();
    var polys = new Polyline[ptNFP.Count];
    List<List<Point3d>> polyPoint = new List<List<Point3d>>();

    List<Point3d> pointsA = new List<Point3d>();
    pointsA = polyTwo.ToList();
    pointsA.RemoveAt(pointsA.Count - 1);
    DataTree<Point3d> polyPoints = new DataTree<Point3d>();
    DataTree<Point3d> APoints = new DataTree<Point3d>();
    for(int i = 0; i < ptNFP.Count; ++i)
    {

      var path = new GH_Path(i);
      Curve oney = polyOne.ToNurbsCurve();
      oney.Translate(vectors.ElementAt(i));
      translated.Add(oney);
      translated.ElementAt(i).TryGetPolyline(out polys[i]);
      polyPoint.Add(polys[i].ToList());

    }

    return polys;

  }

  public List<Polyline> IFP(List<Polyline> curves)
  {

    curves = AreaSorting(curves);

    var one = curves.ElementAt(0);
    var two = curves.ElementAt(curves.Count - 1);

    var points = PointDataTree(curves);

    // Inner Fit Polygon
    Point3d centerOne = points.Branch(0)[0];//ptB[ptB.Count - 1];
    Vector3d zAxis = Vector3d.ZAxis;
    Plane pO = new Rhino.Geometry.Plane(centerOne, zAxis);
    double tolerance = 0.0001;

    List<Polyline> outCurvesOne = new List<Polyline>();
    List<Polyline> outDisplacedCurvesOne = new List<Polyline>();
    foreach(List<IntPoint> path in ClipperLib.Clipper.MinkowskiDiff(one.ToPath2D(pO, tolerance), two.ToPath2D(pO, tolerance)))
    {

      Polyline plSum = path.ToPolyline(pO, tolerance, true);
      outCurvesOne.Add(plSum);

    }

    Polyline bin = outCurvesOne[1];

    return outCurvesOne;

  }

  public List<Polyline> AreaSorting(List<Polyline> x)
  {

    // We want to cast(change from one data type to another) our list of polylines to curves, so that
    // we can call the AreaMassProperties class and its method .Compute to get the area of the polygons
    // after that we can now create a List of KeyValuePair to assign the area of our polygons to our
    // polygons so that we can sort them later according to their areas.
    List<Curve> one = new List<Curve>();
    double[] areas = new Double[x.Count];
    var curves = new List<KeyValuePair<Polyline, double>>();

    for(int i = 0; i < x.Count; ++i)
    {

      one.Add(x.ElementAt(i).ToNurbsCurve());
      areas[i] = AreaMassProperties.Compute(one.ElementAt(i)).Area;
      curves.Add(new KeyValuePair<Polyline, double>(x.ElementAt(i), areas[i]));

    }

    // Here is where the sorting according to area values takes place.
    curves.Sort(Compare1);
    curves.Reverse();
    // We retrieve a list of curves from our List of KeyValuePairs
    List<Polyline> curve = (from kvp in curves select kvp.Key).Distinct().ToList();
    curve.Reverse();

    return curve;

  }

  public DataTree<Point3d> PointDataTree(List<Polyline> curve)
  {

    // We create and populate trees with the points of the curves, so that we can
    // sort each of the lower left points of each of the curves according to the
    // sum of their Xs and Ys positions.
    List<List<Point3d>> pts = new List<List<Point3d>>();
    DataTree<Point3d> tree = new DataTree<Point3d>();
    DataTree<double> treeSum = new DataTree<double>();
    var points = new DataTree<KeyValuePair<Point3d, double>>();
    var point = new List<Point3d>[curve.Count];
    DataTree<Point3d> treeLowerLeft = new DataTree<Point3d>();

    for(int i = 0; i < curve.Count; ++i)
    {

      pts.Add(curve[i].ToList());
      pts[i].RemoveAt(pts[i].Count - 1);
      GH_Path path = new GH_Path(i);

      for(int j = 0; j < pts[i].Count; ++j)
      {

        tree.Add(pts[i][j], path);
        treeSum.Add(pts[i][j].X + pts[i][j].Y, path);

        points.Add(new KeyValuePair<Point3d, double>(tree.Branch(i)[j], treeSum.Branch(i)[j]), path);

        points.Branch(i).Sort(Compare2);
        points.Branch(i).Reverse();
        point[i] = (from kvp in points.Branch(i) select kvp.Key).Distinct().ToList();
        point[i].Reverse();

      }

    }

    for(int i = 0; i < tree.BranchCount; ++i)
      for(int j = 0; j < tree.Branch(i).Count; ++j)
      {

        treeLowerLeft.Add(point[i][j], new GH_Path(i));

      }

    var treeOut = new DataTree<Point3d>();

    for(int i = 0; i < treeLowerLeft.BranchCount; ++i)
      for(int j = 0; j < treeLowerLeft.Branch(i).Count; ++j)
      {

        treeOut.Add(treeLowerLeft.Branch(i)[0], new GH_Path(i));

      }

    return treeOut;

  }

  static int Compare1(KeyValuePair<Polyline, double> a, KeyValuePair<Polyline, double> b)
  {

    return a.Value.CompareTo(b.Value);

  }

  static int Compare2(KeyValuePair<Point3d, double> a, KeyValuePair<Point3d, double> b)
  {

    return a.Value.CompareTo(b.Value);

  }
# ---------- end innerfitpolygon_3 ----------
point_list_23 = PointList(Points=shift_list_4, Size=number_slider_12)
merge_10 = Merge(Data1=innerfitpolygon_3.A, Data2=region_difference)  # -> flatten(Result)
curve_48 = Curve(nestingtwoitems_3.A)
curve_49 = Curve([<curve referenced from the Rhino model> x2])
region_difference_2 = RegionDifference(CurvesB=region_difference)
merge_11 = Merge(Data1=curve_49, Data2=innerfitpolygon_3.A)
intersection_4 = CSharpScript()  # -> out, A; inputs x: list of Polyline
# ---------- intersection_4: C# ----------
    //Curve[] curves = new Curve[x.Count];
    List<Curve> curves = new List<Curve>();

    for(int i = 0; i < x.Count; ++i)
    {

      //curves[i] = x[i].ToNurbsCurve();
      //curves.Remove(x.Count);
      curves.Add(x[i].ToNurbsCurve());

    }

    Curve one = curves[x.Count - 1];

    curves.RemoveAt(x.Count - 1);

    //A = curves;
    Curve[] two = Curve.CreateBooleanUnion(curves);
    //A = curves;
    Curve three = two[0];
    A = Curve.CreateBooleanIntersection(one, three);
    //A = two.Length;
# ---------- end intersection_4 ----------
panel_50 = Panel(intersection_4.A)

# ---- group: vectorOrbit / vectorsBClockwise
B_3 = Curve(B_2)
panel_51 = Panel("""a
b
c
d
e
f
g
h
i
j
k
l
m
n
o
p
q
r
s
t
u
v
w
x
y
z""")
deconstruct_brep_10 = DeconstructBrep(Brep=B_3)  # -> Faces, Edges, Vertices
point_on_curve = PointOnCurve(deconstruct_brep_10.Edges, parameter=0.5)
list_length_7 = ListLength(List=deconstruct_brep_10.Edges)
length = Length(Curve=deconstruct_brep_10.Edges)
line_sdl_2 = LineSDL(Start=deconstruct_brep_10.Vertices, Direction=deconstruct_brep_10.Edges, Length=length)
amplitude = Amplitude(Vector=line_sdl_2, Amplitude=length)
vector_display_17 = VectorDisplay(Anchor=deconstruct_brep_10.Vertices, Vector=amplitude)
vector_4 = Vector(graft(line_sdl_2))
path_mapper_3 = PathMapper(vector_4, source="{A;B;C}", target="{A;B;6+C}")

# ---- group: vectorOrbit / verctorsAAnticlockwise
A_3 = Curve(A_2)
deconstruct_brep_11 = DeconstructBrep(Brep=A_3)  # -> Faces, Edges, Vertices
point_on_curve_2 = PointOnCurve(deconstruct_brep_11.Edges, parameter=0.5)
list_length_8 = ListLength(List=deconstruct_brep_11.Edges)
length_2 = Length(Curve=deconstruct_brep_11.Edges)
text_join = TextJoin(Text=panel_51)
sequence = Sequence(Count=list_length_8, CharPool=text_join, Format="{0}")
text_tag_3d = TextTag3D(Location=point_on_curve_2, Text=sequence, Size=Slider(200, range=0..1000), Justification=7)
line_sdl_3 = LineSDL(Start=deconstruct_brep_11.Vertices, Direction=deconstruct_brep_11.Edges, Length=length_2)
vector_display_18 = VectorDisplay(Anchor=deconstruct_brep_11.Vertices, Vector=line_sdl_3)
graft_tree_2 = GraftTree(Tree=sequence, IncludeEmptyLists=True, IncludeNullItems=True)
vector_5 = Vector(graft(line_sdl_3))
path_mapper_4 = PathMapper(graft_tree_2, source="{A;B;C;D}", target="{B;C;D}")

# ---- group: vectorOrbit / vectorsBClockwise (continued)
shift_list_5 = ShiftList(List=panel_51, Shift=list_length_8, Wrap=True)
text_join_2 = TextJoin(Text=shift_list_5)
sequence_2 = Sequence(Count=list_length_7, CharPool=text_join_2, Format="{0}")
text_tag_3d_2 = TextTag3D(Location=point_on_curve, Text=sequence_2, Size=Slider(200, range=0..1000), Justification=7)
graft_tree_3 = GraftTree(Tree=sequence_2, IncludeEmptyLists=True, IncludeNullItems=True)
path_mapper_5 = PathMapper(graft_tree_3, source="{A;B;C;D;E}", target="{C;D;(6+E)}")

# ----
graft_tree_4 = GraftTree(Tree=sequence_2, IncludeEmptyLists=True, IncludeNullItems=True)
tree_statistics_2 = TreeStatistics(Tree=path_mapper_3)  # -> Paths, Length, Count
deconstruct_path = DeconstructPath(Branch=tree_statistics_2.Paths)
panel_52 = Panel(tree_statistics_2.Paths)
list_item_45 = ListItem(List=deconstruct_path, Index=Slider(2, range=0..10), Wrap=True)
replace_paths = ReplacePaths(Data=path_mapper_3, Search=tree_statistics_2.Paths, Replace=flatten(list_item_45))
list_item_46 = ListItem(List=graft_tree_4, Index=0, Wrap=True)
panel_53 = Panel(list_item_45)
c_script_9 = CSharpScript(x=vector_5, y=vector_4)  # -> out, A; inputs x: tree of Vector3d, y: tree of Vector3d
# ---------- c_script_9: C# ----------
    DataTree<Vector3d> final = new DataTree<Vector3d>();
    
    for(int i = 0; i < y.BranchCount; ++i)
      for(int j = 0; j < y.Branch(i).Count; ++j)
      {
      
        var path = new GH_Path(0, 0, i + x.BranchCount);
        final.Add(y.Branch(i).ElementAt(j), path);
      
      }
    
    A = final;
# ---------- end c_script_9 ----------

# ---- group: vectorOrbit / slopeGraph
merge_12 = Merge(Data1=vector_5, Data2=c_script_9.A)
vector_length = VectorLength(Vector=merge_12)
point_24 = Point(<point referenced from the Rhino model>)
line_sdl_4 = LineSDL(Start=point_24, Direction=merge_12, Length=vector_length)
vector_display_19 = VectorDisplay(Anchor=point_24, Vector=merge_12)
point_on_curve_3 = PointOnCurve(line_sdl_4, parameter=0.464)
merge_13 = Merge(Data1=path_mapper_4, Data2=path_mapper_5)
text_tag_3d_3 = TextTag3D(Location=point_on_curve_3, Text=merge_13, Size=Slider(70, range=0..200), Justification=7)

# ----
vectormovimiento = Vector(merge_12)
panel_54 = Panel(c_script_9.A)
panel_55 = Panel(replace_paths)
panel_56 = Panel(graft_tree_4)
