# Grasshopper definition Nesting.gh (Grasshopper 0.9.76)

innerfitpolygonconvexsort = CSharpScript(Reference="C:\Users\Paula\AppData\Roaming\Grasshopper\Libraries\ClipperTools.dll")  # -> out, A, B; inputs x: list of Polyline
# ---------- innerfitpolygonconvexsort: C# ----------
    //x = AreaSorting(x);

    var final = FirstPlacement(x);

    final.Add(x[x.Count - 2]);

    var treeOut = PointDataTree(final);
    
    Polyline[] polys;

    var convex = ConvexHullPoints(final, treeOut, out polys);

    List<Polyline> polyFinal = new List<Polyline>();

    var convexFinal = ConvexHull(convex, polys, out polyFinal);

    A = convex;

    //B = polys;

    //A = polys[0];

    //x.RemoveAt(0);

    //B = FirstPlacement(x)[FirstPlacement(x).Count - 1];
# ---------- innerfitpolygonconvexsort: C# additional code ----------
  public List<Polyline> ConvexHull(DataTree<Point3d> APoints, Polyline[] polys, out List<Polyline> polyFinal)
  {

    var list = new Grasshopper.Kernel.Geometry.Node2List[APoints.BranchCount];
    var polyLines = new Polyline[APoints.BranchCount];
    var curvesConvex = new Curve[APoints.BranchCount];
    var convexArea = new Double[APoints.BranchCount];
    var convexSort = new List<KeyValuePair<Polyline, double>>();
    var hullSort = new List<KeyValuePair<Polyline, double>>();

    for(int i = 0; i < APoints.BranchCount; ++i)
    {

      list[i] = new Grasshopper.Kernel.Geometry.Node2List(APoints.Branch(i));
      polyLines[i] = Grasshopper.Kernel.Geometry.ConvexHull.Solver.ComputeHull(list[i]);
      curvesConvex[i] = polyLines[i].ToNurbsCurve();
      convexArea[i] = AreaMassProperties.Compute(curvesConvex[i]).Area;
      convexSort.Add(new KeyValuePair<Polyline, double>(polys[0], convexArea[i]));
      hullSort.Add(new KeyValuePair<Polyline, double>(polyLines[i], convexArea[i]));

    }

    // Output the polygons with no convex hull
    // Here is where the sorting according to area values takes place.
    convexSort.Sort(Compare1);
    convexSort.Reverse();
    // We retrieve a list of polylines from our List of KeyValuePairs
    polyFinal = (from kvp in convexSort select kvp.Key).Distinct().ToList();
    polyFinal.Reverse();

    // Output the convex hull polygons
    // Here is where the sorting according to area values takes place.
    hullSort.Sort(Compare1);
    hullSort.Reverse();
    // We retrieve a list of polylines from our List of KeyValuePairs
    List<Polyline> hullFinal = (from kvp in hullSort select kvp.Key).Distinct().ToList();
    hullFinal.Reverse();

    return hullFinal;

  }

  public DataTree<Point3d> ConvexHullPoints(List<Polyline> curve, DataTree<Point3d> treeOut, out Polyline[] polys)
  {

    DataTree<Point3d> APoints = new DataTree<Point3d>();

    var polyOut = curve[curve.Count - 1];
    
    curve.RemoveAt(curve.Count - 1);
    
    polys = curve.ToArray();

    List<Point3d> polyPoints = new List<Point3d>();

    polyPoints = polyOut.ToList();

    for(int i = 0; i < treeOut.BranchCount; ++i)
      for(int j = 0; j < treeOut.Branch(i).Count; ++j)
      {

        var path = new GH_Path(i);
        APoints.Add(treeOut.Branch(i)[j], path);

      }

    for(int i = 0; i < treeOut.BranchCount; ++i)
      for(int j = 0; j < polyPoints.Count; ++j)
      {

        APoints.Add(polyPoints[j], new GH_Path(i));

      }

    return APoints;

  }

  public List<Polyline> FirstPlacement(List<Polyline> x)
  {

    var innerFitPolygon = IFP(x)[1];

    List<Polyline> oner = new List<Polyline>();

    oner.Add(innerFitPolygon);
    oner.Add(x[0]);

    List<Polyline> two = new List<Polyline>();

    two.Add(innerFitPolygon);

    var fix = Translate(oner);

    for(int i = 0; i < fix.Length; ++i)
    {

      two.Add(fix.ElementAt(i));

    }

    two = AreaSorting(two);

    var a = two[two.Count - 1].ToNurbsCurve();

    two.RemoveAt(two.Count - 1);

    var array = new Curve[two.Count];

    Rhino.Geometry.Intersect.CurveIntersections ci;
    DataTree<Point3d> intPts = new DataTree<Point3d>();

    var numberOfIntersections = new Double[two.Count];

    var sortNumberOfIntersections = new List<KeyValuePair<Polyline, double>>();
    for(int i = 0; i < array.Length; ++i)
    {

      array[i] = two.ElementAt(i).ToNurbsCurve();


      ci = Rhino.Geometry.Intersect.Intersection.CurveCurve(a, array[i], 0.001, 0.001);

      for(int j = 0; j < ci.Count; j++)
      {

        intPts.Add(ci[j].PointA, new GH_Path(i));

        numberOfIntersections[i] = intPts.Branch(i).Count;

        sortNumberOfIntersections.Add(new KeyValuePair<Polyline, double>(two[i], numberOfIntersections[i]));

      }

    }

    sortNumberOfIntersections.Sort(Compare1);
    sortNumberOfIntersections.Reverse();

    List<Polyline> sortedPolys = (from kvp in sortNumberOfIntersections select kvp.Key).Distinct().ToList();
    sortedPolys.Reverse();

    return sortedPolys;

  }

  public Polyline[] Translate(List<Polyline> curve)
  {

    var treeOut = PointDataTree(curve);

    var polyTwo = curve[0];
    var polyOne = curve[curve.Count - 1];

    List<Point3d> ptNFP;
    ptNFP = polyTwo.ToList();
    ptNFP.RemoveAt(0);

    List<Vector3d> vectors = new List<Vector3d>();
    for(int i = 0; i < ptNFP.Count; ++i)
    {

      vectors.Add(new Vector3d(ptNFP.ElementAt(i) - treeOut.Branch(treeOut.BranchCount - 1)[0]));

    }

    List<Curve> translated = new List<Curve>();
    var polys = new Polyline[ptNFP.Count];
    List<List<Point3d>> polyPoint = new List<List<Point3d>>();

    List<Point3d> pointsA = new List<Point3d>();
    pointsA = polyTwo.ToList();
    pointsA.RemoveAt(pointsA.Count - 1);
    DataTree<Point3d> polyPoints = new DataTree<Point3d>();
    DataTree<Point3d> APoints = new DataTree<Point3d>();
    for(int i = 0; i < ptNFP.Count; ++i)
    {

      var path = new GH_Path(i);
      Curve oney = polyOne.ToNurbsCurve();
      oney.Translate(vectors.ElementAt(i));
      translated.Add(oney);
      translated.ElementAt(i).TryGetPolyline(out polys[i]);
      polyPoint.Add(polys[i].ToList());

    }

    return polys;

  }

  public List<Polyline> IFP(List<Polyline> curves)
  {

    curves = AreaSorting(curves);

    var one = curves.ElementAt(0);
    var two = curves.ElementAt(curves.Count - 1);

    var points = PointDataTree(curves);

    // Inner Fit Polygon
    Point3d centerOne = points.Branch(0)[0];//ptB[ptB.Count - 1];
    Vector3d zAxis = Vector3d.ZAxis;
    Plane pO = new Rhino.Geometry.Plane(centerOne, zAxis);
    double tolerance = 0.0001;

    List<Polyline> outCurvesOne = new List<Polyline>();
    List<Polyline> outDisplacedCurvesOne = new List<Polyline>();
    foreach(List<IntPoint> path in ClipperLib.Clipper.MinkowskiDiff(one.ToPath2D(pO, tolerance), two.ToPath2D(pO, tolerance)))
    {

      Polyline plSum = path.ToPolyline(pO, tolerance, true);
      outCurvesOne.Add(plSum);

    }

    Polyline bin = outCurvesOne[1];

    return outCurvesOne;

  }

  public List<Polyline> AreaSorting(List<Polyline> x)
  {

    // We want to cast(change from one data type to another) our list of polylines to curves, so that
    // we can call the AreaMassProperties class and its method .Compute to get the area of the polygons
    // after that we can now create a List of KeyValuePair to assign the area of our polygons to our
    // polygons so that we can sort them later according to their areas.
    List<Curve> one = new List<Curve>();
    double[] areas = new Double[x.Count];
    var curves = new List<KeyValuePair<Polyline, double>>();

    for(int i = 0; i < x.Count; ++i)
    {

      one.Add(x.ElementAt(i).ToNurbsCurve());
      areas[i] = AreaMassProperties.Compute(one.ElementAt(i)).Area;
      curves.Add(new KeyValuePair<Polyline, double>(x.ElementAt(i), areas[i]));

    }

    // Here is where the sorting according to area values takes place.
    curves.Sort(Compare1);
    curves.Reverse();
    // We retrieve a list of curves from our List of KeyValuePairs
    List<Polyline> curve = (from kvp in curves select kvp.Key).Distinct().ToList();
    curve.Reverse();

    return curve;

  }

  public DataTree<Point3d> PointDataTree(List<Polyline> curve)
  {

    // We create and populate trees with the points of the curves, so that we can
    // sort each of the lower left points of each of the curves according to the
    // sum of their Xs and Ys positions.
    List<List<Point3d>> pts = new List<List<Point3d>>();
    DataTree<Point3d> tree = new DataTree<Point3d>();
    DataTree<double> treeSum = new DataTree<double>();
    var points = new DataTree<KeyValuePair<Point3d, double>>();
    var point = new List<Point3d>[curve.Count];
    DataTree<Point3d> treeLowerLeft = new DataTree<Point3d>();

    for(int i = 0; i < curve.Count; ++i)
    {

      pts.Add(curve[i].ToList());
      pts[i].RemoveAt(pts[i].Count - 1);
      GH_Path path = new GH_Path(i);

      for(int j = 0; j < pts[i].Count; ++j)
      {

        tree.Add(pts[i][j], path);
        treeSum.Add(pts[i][j].X + pts[i][j].Y, path);

        points.Add(new KeyValuePair<Point3d, double>(tree.Branch(i)[j], treeSum.Branch(i)[j]), path);

        points.Branch(i).Sort(Compare2);
        points.Branch(i).Reverse();
        point[i] = (from kvp in points.Branch(i) select kvp.Key).Distinct().ToList();
        point[i].Reverse();

      }

    }

    for(int i = 0; i < tree.BranchCount; ++i)
      for(int j = 0; j < tree.Branch(i).Count; ++j)
      {

        treeLowerLeft.Add(point[i][j], new GH_Path(i));

      }

    var treeOut = new DataTree<Point3d>();

    for(int i = 0; i < treeLowerLeft.BranchCount; ++i)
      for(int j = 0; j < treeLowerLeft.Branch(i).Count; ++j)
      {

        treeOut.Add(treeLowerLeft.Branch(i)[j], new GH_Path(i));

      }

    return treeOut;

  }

  static int Compare1(KeyValuePair<Polyline, double> a, KeyValuePair<Polyline, double> b)
  {

    return a.Value.CompareTo(b.Value);

  }

  static int Compare2(KeyValuePair<Point3d, double> a, KeyValuePair<Point3d, double> b)
  {

    return a.Value.CompareTo(b.Value);

  }
# ---------- end innerfitpolygonconvexsort ----------
intersection = CSharpScript()  # -> out, A; inputs x: list of Polyline
# ---------- intersection: C# ----------
    //Curve[] curves = new Curve[x.Count];

    List<Curve> curves = new List<Curve>();

    for(int i = 0; i < x.Count; ++i)
    {

      //curves[i] = x[i].ToNurbsCurve();
      //curves.Remove(x.Count);
      curves.Add(x[i].ToNurbsCurve());

    }

    curves = AreaSorting(curves);

    Curve one = curves[x.Count - 1];

    curves.RemoveAt(x.Count - 1);

    //A = curves;
    Curve[] two = Curve.CreateBooleanUnion(curves);
    A = two;
    //Curve three = two[0];
    //A = Curve.CreateBooleanIntersection(three, one);
    //A = two.Length;
# ---------- intersection: C# additional code ----------
  public List<Curve> AreaSorting(List<Curve> x)
  {

    // We want to cast(change from one data type to another) our list of polylines to curves, so that
    // we can call the AreaMassProperties class and its method .Compute to get the area of the polygons
    // after that we can now create a List of KeyValuePair to assign the area of our polygons to our
    // polygons so that we can sort them later according to their areas.
    List<Curve> one = new List<Curve>();
    double[] areas = new Double[x.Count];
    var curves = new List<KeyValuePair<Curve, double>>();

    for(int i = 0; i < x.Count; ++i)
    {

      one.Add(x.ElementAt(i).ToNurbsCurve());
      areas[i] = AreaMassProperties.Compute(one.ElementAt(i)).Area;
      curves.Add(new KeyValuePair<Curve, double>(one.ElementAt(i), areas[i]));

    }

    // Here is where the sorting according to area values takes place.
    curves.Sort(Compare1);
    curves.Reverse();
    // We retrieve a list of curves from our List of KeyValuePairs
    List<Curve> curve = (from kvp in curves select kvp.Key).Distinct().ToList();
    curve.Reverse();

    return curve;

  }


  static int Compare1(KeyValuePair<Curve, double> a, KeyValuePair<Curve, double> b)
  {

    return a.Value.CompareTo(b.Value);

  }
# ---------- end intersection ----------
# Geometría de Base
polygona = Curve(<curve referenced from the Rhino model>)
sheet = Curve(<curve referenced from the Rhino model>)

# ----
# IFP(Inner Fit Polygon)
# El Inner Fit Polygon describe la moción
# de un polígono estacionario dentro de
# un polígono que lo orbita, resultando en
# todas las posibles posiciones del
# polígono a transladar sobre el estacionario
# sin que estos se yuxtapongan.
# Después de obtener el nuevo polígono
# construimos los vectores de translación
# entre los puntos del IFP y el punto de
# más a la izquierda y más abajo, en este
# caso usamos la primera translación de
# la lista pero cualquiera es aceptable.
# El componente escrito en C#, corre con
# una biblioteca externa llamada Clipper
# desarrollada por el usuario de github y
# food4rhino arendvw.
# El nodo computa la diferencia de
# Minkowski, la cual suma el polígono A
# o estacionario con el polígono B o
# orbital, se llama diferencia ya que la
# operación de vectores cambia la
# dirección del polígono B a contra el
# reloj. Éste computo nos otorga un
# tercer polígono que llamaremos IFP
merge = Merge(Data1=polygona, Data2=sheet)
innerfitpolygon = CSharpScript(x=merge, Reference="C:\Users\Paula\AppData\Roaming\Grasshopper\Libraries\ClipperTools.dll")  # -> out, A, B; inputs x: list of Polyline
# ---------- innerfitpolygon: C# ----------
    x = AreaSorting(x);

    var final = FirstPlacement(x)[0];

    /*
    var outPut = new List<Polyline>();
    
    outPut.Add(x[x.Count - 1]);
    outPut.Add(final);
    
    A = outPut;
    */
  
    A = final;
    
    B = x.ElementAt(x.Count - 1);

    //x.RemoveAt(0);

    //B = FirstPlacement(x)[FirstPlacement(x).Count - 1];
# ---------- innerfitpolygon: C# additional code ----------
  public List<Polyline> FirstPlacement(List<Polyline> x)
  {

    var innerFitPolygon = IFP(x)[1];

    List<Polyline> oner = new List<Polyline>();

    oner.Add(innerFitPolygon);
    oner.Add(x[0]);

    List<Polyline> two = new List<Polyline>();

    two.Add(innerFitPolygon);

    var fix = Translate(oner);

    for(int i = 0; i < fix.Length; ++i)
    {

      two.Add(fix.ElementAt(i));

    }

    two = AreaSorting(two);

    var a = two[two.Count - 1].ToNurbsCurve();

    two.RemoveAt(two.Count - 1);

    var array = new Curve[two.Count];

    Rhino.Geometry.Intersect.CurveIntersections ci;
    DataTree<Point3d> intPts = new DataTree<Point3d>();

    var numberOfIntersections = new Double[two.Count];

    var sortNumberOfIntersections = new List<KeyValuePair<Polyline, double>>();
    for(int i = 0; i < array.Length; ++i)
    {

      array[i] = two.ElementAt(i).ToNurbsCurve();


      ci = Rhino.Geometry.Intersect.Intersection.CurveCurve(a, array[i], 0.001, 0.001);

      for(int j = 0; j < ci.Count; j++)
      {

        intPts.Add(ci[j].PointA, new GH_Path(i));

        numberOfIntersections[i] = intPts.Branch(i).Count;

        sortNumberOfIntersections.Add(new KeyValuePair<Polyline, double>(two[i], numberOfIntersections[i]));

      }

    }

    sortNumberOfIntersections.Sort(Compare1);
    sortNumberOfIntersections.Reverse();

    List<Polyline> sortedPolys = (from kvp in sortNumberOfIntersections select kvp.Key).Distinct().ToList();
    sortedPolys.Reverse();

    return sortedPolys;

  }

  public Polyline[] Translate(List<Polyline> curve)
  {

    var treeOut = PointDataTree(curve);

    var polyTwo = curve[0];
    var polyOne = curve[curve.Count - 1];

    List<Point3d> ptNFP;
    ptNFP = polyTwo.ToList();
    ptNFP.RemoveAt(0);

    List<Vector3d> vectors = new List<Vector3d>();
    for(int i = 0; i < ptNFP.Count; ++i)
    {

      vectors.Add(new Vector3d(ptNFP.ElementAt(i) - treeOut.Branch(treeOut.BranchCount - 1)[0]));

    }

    List<Curve> translated = new List<Curve>();
    var polys = new Polyline[ptNFP.Count];
    List<List<Point3d>> polyPoint = new List<List<Point3d>>();

    List<Point3d> pointsA = new List<Point3d>();
    pointsA = polyTwo.ToList();
    pointsA.RemoveAt(pointsA.Count - 1);
    DataTree<Point3d> polyPoints = new DataTree<Point3d>();
    DataTree<Point3d> APoints = new DataTree<Point3d>();
    for(int i = 0; i < ptNFP.Count; ++i)
    {

      var path = new GH_Path(i);
      Curve oney = polyOne.ToNurbsCurve();
      oney.Translate(vectors.ElementAt(i));
      translated.Add(oney);
      translated.ElementAt(i).TryGetPolyline(out polys[i]);
      polyPoint.Add(polys[i].ToList());

    }

    return polys;

  }

  public List<Polyline> IFP(List<Polyline> curves)
  {

    curves = AreaSorting(curves);

    var one = curves.ElementAt(0);
    var two = curves.ElementAt(curves.Count - 1);

    var points = PointDataTree(curves);

    // Inner Fit Polygon
    Point3d centerOne = points.Branch(0)[0];//ptB[ptB.Count - 1];
    Vector3d zAxis = Vector3d.ZAxis;
    Plane pO = new Rhino.Geometry.Plane(centerOne, zAxis);
    double tolerance = 0.0001;

    List<Polyline> outCurvesOne = new List<Polyline>();
    List<Polyline> outDisplacedCurvesOne = new List<Polyline>();
    foreach(List<IntPoint> path in ClipperLib.Clipper.MinkowskiDiff(one.ToPath2D(pO, tolerance), two.ToPath2D(pO, tolerance)))
    {

      Polyline plSum = path.ToPolyline(pO, tolerance, true);
      outCurvesOne.Add(plSum);

    }

    Polyline bin = outCurvesOne[1];

    return outCurvesOne;

  }

  public List<Polyline> AreaSorting(List<Polyline> x)
  {

    // We want to cast(change from one data type to another) our list of polylines to curves, so that
    // we can call the AreaMassProperties class and its method .Compute to get the area of the polygons
    // after that we can now create a List of KeyValuePair to assign the area of our polygons to our
    // polygons so that we can sort them later according to their areas.
    List<Curve> one = new List<Curve>();
    double[] areas = new Double[x.Count];
    var curves = new List<KeyValuePair<Polyline, double>>();

    for(int i = 0; i < x.Count; ++i)
    {

      one.Add(x.ElementAt(i).ToNurbsCurve());
      areas[i] = AreaMassProperties.Compute(one.ElementAt(i)).Area;
      curves.Add(new KeyValuePair<Polyline, double>(x.ElementAt(i), areas[i]));

    }

    // Here is where the sorting according to area values takes place.
    curves.Sort(Compare1);
    curves.Reverse();
    // We retrieve a list of curves from our List of KeyValuePairs
    List<Polyline> curve = (from kvp in curves select kvp.Key).Distinct().ToList();
    curve.Reverse();

    return curve;

  }

  public DataTree<Point3d> PointDataTree(List<Polyline> curve)
  {

    // We create and populate trees with the points of the curves, so that we can
    // sort each of the lower left points of each of the curves according to the
    // sum of their Xs and Ys positions.
    List<List<Point3d>> pts = new List<List<Point3d>>();
    DataTree<Point3d> tree = new DataTree<Point3d>();
    DataTree<double> treeSum = new DataTree<double>();
    var points = new DataTree<KeyValuePair<Point3d, double>>();
    var point = new List<Point3d>[curve.Count];
    DataTree<Point3d> treeLowerLeft = new DataTree<Point3d>();

    for(int i = 0; i < curve.Count; ++i)
    {

      pts.Add(curve[i].ToList());
      pts[i].RemoveAt(pts[i].Count - 1);
      GH_Path path = new GH_Path(i);

      for(int j = 0; j < pts[i].Count; ++j)
      {

        tree.Add(pts[i][j], path);
        treeSum.Add(pts[i][j].X + pts[i][j].Y, path);

        points.Add(new KeyValuePair<Point3d, double>(tree.Branch(i)[j], treeSum.Branch(i)[j]), path);

        points.Branch(i).Sort(Compare2);
        points.Branch(i).Reverse();
        point[i] = (from kvp in points.Branch(i) select kvp.Key).Distinct().ToList();
        point[i].Reverse();

      }

    }

    for(int i = 0; i < tree.BranchCount; ++i)
      for(int j = 0; j < tree.Branch(i).Count; ++j)
      {

        treeLowerLeft.Add(point[i][j], new GH_Path(i));

      }

    var treeOut = new DataTree<Point3d>();

    for(int i = 0; i < treeLowerLeft.BranchCount; ++i)
      for(int j = 0; j < treeLowerLeft.Branch(i).Count; ++j)
      {

        treeOut.Add(treeLowerLeft.Branch(i)[0], new GH_Path(i));

      }

    return treeOut;

  }

  static int Compare1(KeyValuePair<Polyline, double> a, KeyValuePair<Polyline, double> b)
  {

    return a.Value.CompareTo(b.Value);

  }

  static int Compare2(KeyValuePair<Point3d, double> a, KeyValuePair<Point3d, double> b)
  {

    return a.Value.CompareTo(b.Value);

  }
# ---------- end innerfitpolygon ----------
placedpart = Curve(innerfitpolygon.A)

number_slider = Slider(0.1, range=0..0.1)  # disabled
curve = Curve(<curve referenced from the Rhino model>)  # disabled
curve_2 = Curve(<curve referenced from the Rhino model>)  # disabled
curve_3 = Curve(<curve referenced from the Rhino model>)  # disabled
curve_4 = Curve(<curve referenced from the Rhino model>)  # disabled
curve_5 = Curve(<curve referenced from the Rhino model>)  # disabled
curve_6 = Curve(<curve referenced from the Rhino model>)  # disabled
curve_to_polyline = CurveToPolyline(Curve=curve_4, ToleranceDistance=number_slider, ToleranceAngle=0)  # -> Polyline, Segments; disabled
curve_7 = Curve(<curve referenced from the Rhino model>)

# ----
# NFP(No Fit Polygon)
# Tenemos el contenedor(sheet/bin) y el
# primer poligono posicionado dentro del
# mismo. Ahora tenemos que encontrar
# las posibles posiciones del polígono
# que queremos agregar con respecto al
# ya posicionado anterior polígono. Con
# el No Fit Polygon podemos obtener las
# posibles translaciones.
# El proceso es similar al del IFP pero en
# este caso debemos tomar la órbita
# externa. Se repite un proceso similar al
# anterior, entre el punto de más abajo y
# más a la izquierda se crean vectores
# de translación con los puntos del No Fit
# Polygon.
parttobeplaced = Curve(<curve referenced from the Rhino model>)
merge_2 = Merge(Data1=parttobeplaced, Data2=placedpart)
nestingtwoitems = CSharpScript(x=merge_2, Reference="C:\Users\Paula\AppData\Roaming\Grasshopper\Libraries\ClipperTools.dll")  # -> out, A, B; inputs x: list of Polyline
# ---------- nestingtwoitems: C# ----------
    // We want to cast(change from one data type to another) our list of polylines to curves, so that
    // we can call the AreaMassProperties class and its method .Compute to get the area of the polygons
    // after that we can now create a List of KeyValuePair to assign the area of our polygons to our
    // polygons so that we can sort them later according to their areas.
    List<Curve> one = new List<Curve>();
    double[] areas = new Double[x.Count];
    var curves = new List<KeyValuePair<Polyline, double>>();

    for(int i = 0; i < x.Count; ++i)
    {

      one.Add(x.ElementAt(i).ToNurbsCurve());
      areas[i] = AreaMassProperties.Compute(one.ElementAt(i)).Area;
      curves.Add(new KeyValuePair<Polyline, double>(x.ElementAt(i), areas[i]));

    }

    // Here is where the sorting according to area values takes place.
    curves.Sort(Compare1);
    curves.Reverse();
    // We retrieve a list of curves from our List of KeyValuePairs
    List<Polyline> curve = (from kvp in curves select kvp.Key).Distinct().ToList();
    curve.Reverse();

    // We create and populate trees with the points of the curves, so that we can
    // sort each of the lower left points of each of the curves according to the
    // sum of their Xs and Ys positions.
    List<List<Point3d>> pts = new List<List<Point3d>>();
    DataTree<Point3d> tree = new DataTree<Point3d>();
    DataTree<double> treeSum = new DataTree<double>();
    var points = new DataTree<KeyValuePair<Point3d, double>>();
    var point = new List<Point3d>[curve.Count];
    DataTree<Point3d> treeLowerLeft = new DataTree<Point3d>();

    for(int i = 0; i < curve.Count; ++i)
    {

      pts.Add(curve[i].ToList());
      pts[i].RemoveAt(pts[i].Count - 1);
      GH_Path path = new GH_Path(i);

      for(int j = 0; j < pts[i].Count; ++j)
      {

        tree.Add(pts[i][j], path);
        treeSum.Add(pts[i][j].X + pts[i][j].Y, path);

        points.Add(new KeyValuePair<Point3d, double>(tree.Branch(i)[j], treeSum.Branch(i)[j]), path);

        points.Branch(i).Sort(Compare2);
        points.Branch(i).Reverse();
        point[i] = (from kvp in points.Branch(i) select kvp.Key).Distinct().ToList();
        point[i].Reverse();

      }

    }

    for(int i = 0; i < tree.BranchCount; ++i)
      for(int j = 0; j < tree.Branch(i).Count; ++j)
      {

        treeLowerLeft.Add(point[i][j], new GH_Path(i));

      }

    var treeOut = new DataTree<Point3d>();

    for(int i = 0; i < treeLowerLeft.BranchCount; ++i)
      for(int j = 0; j < treeLowerLeft.Branch(i).Count; ++j)
      {

        treeOut.Add(treeLowerLeft.Branch(i)[0], new GH_Path(i));

      }

    /*
    // Create the data structures and initialize them
    DataTree<Point3d> points = new DataTree<Point3d>();
    List<List<Point3d>> lists = new List<List<Point3d>>();

    // Fill the nested list with the list of points
    for(int i = 0; i < x.Count; ++i)
    {

      lists.Add(x[i].ToList());

    }

    // Fill the data tree with the list of points
    for(int i = 0; i < lists.Count; ++i)
    {

      var path = new GH_Path(i);

      for(int j = 0; j < lists[i].Count; ++j )
      {

        points.Add(lists[i][j], path);

      }

    }
    */


    // No Fit Polygon from minkowsky difference using the clipper lib
    Polyline polyOne = curve[0];
    Polyline polyTwo = curve[curve.Count - 1];

    Point3d center = treeOut.Branch(0).ElementAt(0);
    Vector3d zAxis = Vector3d.ZAxis;
    Plane p = new Rhino.Geometry.Plane(center, zAxis);

    double tolerance = 0.001;
    List<Polyline> outCurves = new List<Polyline>();
    List<Polyline> outDisplacedCurves = new List<Polyline>();
    foreach(List<IntPoint> path in ClipperLib.Clipper.MinkowskiDiff(polyOne.ToPath2D(p, tolerance), polyTwo.ToPath2D(p, tolerance)))
    {

      Polyline plSum = path.ToPolyline(p, tolerance, true);
      outCurves.Add(plSum);

    }

    Polyline NFP = outCurves[0];

    B = NFP;
    
    List<Point3d> ptNFP;
    ptNFP = NFP.ToList();
    ptNFP.RemoveAt(0);

    List<Vector3d> vectors = new List<Vector3d>();
    for(int i = 0; i < ptNFP.Count; ++i)
    {

      vectors.Add(new Vector3d(ptNFP.ElementAt(i) - treeOut.Branch(0)[0]));

    }

    List<Curve> translated = new List<Curve>();
    Polyline[] polys = new Polyline[ptNFP.Count];
    List<List<Point3d>> polyPoint = new List<List<Point3d>>();

    List<Point3d> pointsA = new List<Point3d>();
    pointsA = polyTwo.ToList();
    pointsA.RemoveAt(pointsA.Count - 1);
    DataTree<Point3d> polyPoints = new DataTree<Point3d>();
    DataTree<Point3d> APoints = new DataTree<Point3d>();
    for(int i = 0; i < ptNFP.Count; ++i)
    {

      var path = new GH_Path(i);
      Curve oney = polyOne.ToNurbsCurve();
      oney.Translate(vectors.ElementAt(i));
      translated.Add(oney);
      translated.ElementAt(i).TryGetPolyline(out polys[i]);
      polyPoint.Add(polys[i].ToList());

      for(int j = 0; j < polyPoint[i].Count - 1; ++j)
      {

        polyPoints.Add(polyPoint[i][j], path);

      }

    }

    for(int i = 0; i < ptNFP.Count; ++i)
      for(int j = 0; j < pointsA.Count; ++j)
      {

        var path = new GH_Path(i);
        APoints.Add(pointsA[j], path);

      }

    for(int i = 0; i < polyPoints.BranchCount; ++i)
      for(int j = 0; j < polyPoints.Branch(i).Count; ++j)
      {

        APoints.Add(polyPoints.Branch(i)[j], new GH_Path(i));

      }

    var list = new Grasshopper.Kernel.Geometry.Node2List[APoints.BranchCount];
    var polyLines = new Polyline[APoints.BranchCount];
    var curvesConvex = new Curve[APoints.BranchCount];
    var convexArea = new Double[APoints.BranchCount];
    var convexSort = new List<KeyValuePair<Polyline, double>>();
    var hullSort = new List<KeyValuePair<Polyline, double>>();

    for(int i = 0; i < APoints.BranchCount; ++i)
    {

      list[i] = new Grasshopper.Kernel.Geometry.Node2List(APoints.Branch(i));
      polyLines[i] = Grasshopper.Kernel.Geometry.ConvexHull.Solver.ComputeHull(list[i]);
      curvesConvex[i] = polyLines[i].ToNurbsCurve();
      convexArea[i] = AreaMassProperties.Compute(curvesConvex[i]).Area;
      convexSort.Add(new KeyValuePair<Polyline, double>(polys[i], convexArea[i]));
      hullSort.Add(new KeyValuePair<Polyline, double>(polyLines[i], convexArea[i]));

    }

    // Output the polygons with no convex hull
    // Here is where the sorting according to area values takes place.
    convexSort.Sort(Compare1);
    convexSort.Reverse();
    // We retrieve a list of polylines from our List of KeyValuePairs
    List<Polyline> polyFinal = (from kvp in convexSort select kvp.Key).Distinct().ToList();
    polyFinal.Reverse();

    // Output the convex hull polygons
    // Here is where the sorting according to area values takes place.
    hullSort.Sort(Compare1);
    hullSort.Reverse();
    // We retrieve a list of polylines from our List of KeyValuePairs
    List<Polyline> hullFinal = (from kvp in hullSort select kvp.Key).Distinct().ToList();
    hullFinal.Reverse();

    A = polyFinal;

    //B = hullFinal[0];

    /*
    Curve booleanUnionOne = polyFinal[0].ToNurbsCurve();
    Curve booleanUnionTwo = polyTwo.ToNurbsCurve();

    var listBoolean = new List<Curve>();

    listBoolean.Add(booleanUnionOne);
    listBoolean.Add(booleanUnionTwo);

    A = Curve.CreateBooleanUnion(listBoolean).ElementAt(1);
  */
# ---------- nestingtwoitems: C# additional code ----------
  static int Compare1(KeyValuePair<Polyline, double> a, KeyValuePair<Polyline, double> b)
  {

    return a.Value.CompareTo(b.Value);

  }

  static int Compare2(KeyValuePair<Point3d, double> a, KeyValuePair<Point3d, double> b)
  {

    return a.Value.CompareTo(b.Value);

  }
# ---------- end nestingtwoitems ----------
possibleplacements = Curve(nestingtwoitems.A)

area = Area(Geometry=curve_7)  # -> Area, Centroid

# ---- group: Test de Inclusión
# Estos nodos buscan encontrar de las
# previas posibles translaciones, las que
# se encuentren dentro del contenedor.
# El proceso es:
#     1.) Encontrar las intersecciones entre
#           los polígonos y el contenedor.
#     2.) Comparar el área del polígono que
#           vamos a posicionar y compararlo
#           con el área de los polígonos que
#           han sido sometidos a la
#           intersección. Seleccionar sólo los
#           polígonos cuyas áreas coinciden.
#     3.) Tomar la envolvente convexa del
#            polígono a posicionar y el ya
#            posicionado. Escoger el polígono
#            cuya área de envolvente convexa
#            sea la menor.
region_intersection = RegionIntersection(CurvesA=possibleplacements, CurvesB=sheet)
area_2 = Area(Geometry=parttobeplaced)  # -> Area, Centroid
area_3 = Area(Geometry=region_intersection)  # -> Area, Centroid
integer = Integer(area_2.Area)
integer_2 = Integer(area_3.Area)
evaluate = Evaluate(Expression="If(x=y, True, False)", x=integer, y=integer_2)
dispatch = Dispatch(List=region_intersection, DispatchPattern=evaluate)  # -> ListA, ListB
curve_8 = Curve(dispatch.ListA)
discontinuity = Discontinuity(Curve=placedpart, Level=1)  # -> Points, Parameters
graft_tree = GraftTree(Tree=curve_8, IncludeEmptyLists=True, IncludeNullItems=True)
discontinuity_2 = Discontinuity(Curve=graft_tree, Level=1)  # -> Points, Parameters
c_script = CSharpScript(x=simplify(discontinuity_2.Points), y=discontinuity.Points)  # -> out, A; inputs x: tree of Point3d, y: list of Point3d
# ---------- c_script: C# ----------
    if(x.BranchCount > 1 )
    {

      for(int i = 0; i < x.BranchCount; ++i)
        for(int j = 0; j < y.Count; ++j)
        {

          x.Add(y[j], new GH_Path(i));

        }

    }

    else
    {

      for(int i = 0; i < y.Count; ++i)
      {

        x.Add(y[i]);

      }

    }

    A = x;
# ---------- end c_script ----------
convex_hull = ConvexHull(Points=c_script.A, Plane=PlaneXY(0, 0, 0))  # -> flatten(Hull), HullZ, Indices
area_4 = Area(Geometry=convex_hull.Hull)  # -> Area, Centroid
sort_list = SortList(Keys=area_4.Area, ValuesValuesA=curve_8)  # -> Keys, ValuesValuesA
list_item = ListItem(List=sort_list.ValuesValuesA, Index=0, Wrap=True)

# ----
integer_3 = Integer(area.Area)
area_5 = Area(Geometry=curve)  # -> Area, Centroid; disabled
area_6 = Area(Geometry=curve_2)  # -> Area, Centroid; disabled
area_7 = Area(Geometry=curve_3)  # -> Area, Centroid; disabled
area_8 = Area(Geometry=curve_to_polyline.Polyline)  # -> Area, Centroid; disabled
area_9 = Area(Geometry=curve_5)  # -> Area, Centroid; disabled
area_10 = Area(Geometry=curve_6)  # -> Area, Centroid; disabled
panel = Panel(area_5.Area)  # disabled
panel_2 = Panel(area_6.Area)  # disabled
panel_3 = Panel(area_7.Area)  # disabled
panel_4 = Panel(area_9.Area)  # disabled
panel_5 = Panel(area_8.Area)  # disabled
panel_6 = Panel(area_10.Area)  # disabled
panel_7 = Panel(".")  # disabled
panel_8 = Panel(".")  # disabled
panel_9 = Panel(".")  # disabled
panel_10 = Panel(".")  # disabled
panel_11 = Panel(".")  # disabled
panel_12 = Panel(".")  # disabled
panel_13 = Panel(".")  # disabled
panel_14 = Panel(".")  # disabled
panel_15 = Panel(".")  # disabled
panel_16 = Panel(".")  # disabled
text_split = TextSplit(Text=panel, Separators=panel_9)  # disabled
text_split_2 = TextSplit(Text=panel_2, Separators=panel_11)  # disabled
text_split_3 = TextSplit(Text=panel_3, Separators=panel_14)  # disabled
text_split_4 = TextSplit(Text=panel_5, Separators=panel_16)  # disabled
text_split_5 = TextSplit(Text=panel_4, Separators=panel_15)  # disabled
panel_17 = Panel(text_split)  # disabled
panel_18 = Panel(text_split_2)  # disabled
panel_19 = Panel(text_split_3)  # disabled
panel_20 = Panel(text_split_5)  # disabled
panel_21 = Panel(text_split_4)  # disabled
list_item_2 = ListItem(List=panel_17, Index=0, Wrap=True)  # -> flatten(Item); disabled
list_item_3 = ListItem(List=panel_18, Index=0, Wrap=True)  # -> flatten(Item); disabled
list_item_4 = ListItem(List=panel_19, Index=0, Wrap=True)  # -> flatten(Item); disabled
list_item_5 = ListItem(List=panel_21, Index=0, Wrap=True)  # -> flatten(Item); disabled
list_item_6 = ListItem(List=panel_20, Index=0, Wrap=True)  # -> flatten(Item); disabled
panel_22 = Panel(list_item_2)  # disabled
panel_23 = Panel(list_item_3)  # disabled
panel_24 = Panel(list_item_4)  # disabled
panel_25 = Panel(list_item_6)  # disabled
panel_26 = Panel(list_item_5)  # disabled

# ---- group: Trabajo en Proceso
# Debemos encontrar la unión de los
# polígonos posicionados para poder
# repetir el proceso mencionado
# anteriormente. Pero la envolvente
# convexa produce pérdida de material,
# por lo tanto debemos producir un nuevo
# polígono entre las partes que sea más
# acorde a sus bordes externos.
discontinuity_3 = Discontinuity(Curve=[list_item, placedpart], Level=1)  # -> flatten(Points), Parameters
convex_hull_2 = ConvexHull(Points=discontinuity_3.Points, Plane=PlaneXY(0, 0, 0))  # -> Hull, HullZ, Indices

# ----
region_difference = RegionDifference(CurvesA=sheet, CurvesB=convex_hull_2.Hull)  # disabled
merge_3 = Merge(Data1=curve_6, Data2=convex_hull_2.Hull)  # -> flatten(Result); disabled
region_difference_2 = RegionDifference(CurvesA=sheet, CurvesB=convex_hull_2.Hull)
nestingtwoitems_2 = CSharpScript(x=merge_3, Reference="C:\Users\Paula\AppData\Roaming\Grasshopper\Libraries\ClipperTools.dll")  # -> out, A, B; inputs x: list of Polyline; disabled
# ---------- nestingtwoitems_2: C# ----------
    // We want to cast(change from one data type to another) our list of polylines to curves, so that
    // we can call the AreaMassProperties class and its method .Compute to get the area of the polygons
    // after that we can now create a List of KeyValuePair to assign the area of our polygons to our
    // polygons so that we can sort them later according to their areas.
    /*
    List<Curve> one = new List<Curve>();
    double[] areas = new Double[x.Count];
    var curves = new List<KeyValuePair<Polyline, double>>();

    for(int i = 0; i < x.Count; ++i)
    {

      one.Add(x.ElementAt(i).ToNurbsCurve());
      areas[i] = AreaMassProperties.Compute(one.ElementAt(i)).Area;
      curves.Add(new KeyValuePair<Polyline, double>(x.ElementAt(i), areas[i]));

    }

    // Here is where the sorting according to area values takes place.
    curves.Sort(Compare1);
    curves.Reverse();
    // We retrieve a list of curves from our List of KeyValuePairs
    List<Polyline> curve = (from kvp in curves select kvp.Key).Distinct().ToList();
    curve.Reverse();
    */

    List<Polyline> curve = x;
    
    // We create and populate trees with the points of the curves, so that we can
    // sort each of the lower left points of each of the curves according to the
    // sum of their Xs and Ys positions.
    List<List<Point3d>> pts = new List<List<Point3d>>();
    DataTree<Point3d> tree = new DataTree<Point3d>();
    DataTree<double> treeSum = new DataTree<double>();
    var points = new DataTree<KeyValuePair<Point3d, double>>();
    var point = new List<Point3d>[curve.Count];
    DataTree<Point3d> treeLowerLeft = new DataTree<Point3d>();

    for(int i = 0; i < curve.Count; ++i)
    {

      pts.Add(curve[i].ToList());
      pts[i].RemoveAt(pts[i].Count - 1);
      GH_Path path = new GH_Path(i);

      for(int j = 0; j < pts[i].Count; ++j)
      {

        tree.Add(pts[i][j], path);
        treeSum.Add(pts[i][j].X + pts[i][j].Y, path);

        points.Add(new KeyValuePair<Point3d, double>(tree.Branch(i)[j], treeSum.Branch(i)[j]), path);

        points.Branch(i).Sort(Compare2);
        points.Branch(i).Reverse();
        point[i] = (from kvp in points.Branch(i) select kvp.Key).Distinct().ToList();
        point[i].Reverse();

      }

    }

    for(int i = 0; i < tree.BranchCount; ++i)
      for(int j = 0; j < tree.Branch(i).Count; ++j)
      {

        treeLowerLeft.Add(point[i][j], new GH_Path(i));

      }

    var treeOut = new DataTree<Point3d>();

    for(int i = 0; i < treeLowerLeft.BranchCount; ++i)
      for(int j = 0; j < treeLowerLeft.Branch(i).Count; ++j)
      {

        treeOut.Add(treeLowerLeft.Branch(i)[0], new GH_Path(i));

      }

    /*
    // Create the data structures and initialize them
    DataTree<Point3d> points = new DataTree<Point3d>();
    List<List<Point3d>> lists = new List<List<Point3d>>();

    // Fill the nested list with the list of points
    for(int i = 0; i < x.Count; ++i)
    {

      lists.Add(x[i].ToList());

    }

    // Fill the data tree with the list of points
    for(int i = 0; i < lists.Count; ++i)
    {

      var path = new GH_Path(i);

      for(int j = 0; j < lists[i].Count; ++j )
      {

        points.Add(lists[i][j], path);

      }

    }
    */


    // No Fit Polygon from minkowsky difference using the clipper lib
    Polyline polyOne = curve[0];
    Polyline polyTwo = curve[curve.Count - 1];

    Point3d center = treeOut.Branch(0).ElementAt(0);
    Vector3d zAxis = Vector3d.ZAxis;
    Plane p = new Rhino.Geometry.Plane(center, zAxis);

    double tolerance = 0.001;
    List<Polyline> outCurves = new List<Polyline>();
    List<Polyline> outDisplacedCurves = new List<Polyline>();
    foreach(List<IntPoint> path in ClipperLib.Clipper.MinkowskiDiff(polyOne.ToPath2D(p, tolerance), polyTwo.ToPath2D(p, tolerance)))
    {

      Polyline plSum = path.ToPolyline(p, tolerance, true);
      outCurves.Add(plSum);

    }

    Polyline NFP = outCurves[0];

    B = NFP;

    List<Point3d> ptNFP;
    ptNFP = NFP.ToList();
    ptNFP.RemoveAt(0);

    List<Vector3d> vectors = new List<Vector3d>();
    for(int i = 0; i < ptNFP.Count; ++i)
    {

      vectors.Add(new Vector3d(ptNFP.ElementAt(i) - treeOut.Branch(0)[0]));

    }

    List<Curve> translated = new List<Curve>();
    Polyline[] polys = new Polyline[ptNFP.Count];
    List<List<Point3d>> polyPoint = new List<List<Point3d>>();

    List<Point3d> pointsA = new List<Point3d>();
    pointsA = polyTwo.ToList();
    pointsA.RemoveAt(pointsA.Count - 1);
    DataTree<Point3d> polyPoints = new DataTree<Point3d>();
    DataTree<Point3d> APoints = new DataTree<Point3d>();
    for(int i = 0; i < ptNFP.Count; ++i)
    {

      var path = new GH_Path(i);
      Curve oney = polyOne.ToNurbsCurve();
      oney.Translate(vectors.ElementAt(i));
      translated.Add(oney);
      translated.ElementAt(i).TryGetPolyline(out polys[i]);
      polyPoint.Add(polys[i].ToList());

      for(int j = 0; j < polyPoint[i].Count - 1; ++j)
      {

        polyPoints.Add(polyPoint[i][j], path);

      }

    }

    for(int i = 0; i < ptNFP.Count; ++i)
      for(int j = 0; j < pointsA.Count; ++j)
      {

        var path = new GH_Path(i);
        APoints.Add(pointsA[j], path);

      }

    for(int i = 0; i < polyPoints.BranchCount; ++i)
      for(int j = 0; j < polyPoints.Branch(i).Count; ++j)
      {

        APoints.Add(polyPoints.Branch(i)[j], new GH_Path(i));

      }

    var list = new Grasshopper.Kernel.Geometry.Node2List[APoints.BranchCount];
    var polyLines = new Polyline[APoints.BranchCount];
    var curvesConvex = new Curve[APoints.BranchCount];
    var convexArea = new Double[APoints.BranchCount];
    var convexSort = new List<KeyValuePair<Polyline, double>>();
    var hullSort = new List<KeyValuePair<Polyline, double>>();

    for(int i = 0; i < APoints.BranchCount; ++i)
    {

      list[i] = new Grasshopper.Kernel.Geometry.Node2List(APoints.Branch(i));
      polyLines[i] = Grasshopper.Kernel.Geometry.ConvexHull.Solver.ComputeHull(list[i]);
      curvesConvex[i] = polyLines[i].ToNurbsCurve();
      convexArea[i] = AreaMassProperties.Compute(curvesConvex[i]).Area;
      convexSort.Add(new KeyValuePair<Polyline, double>(polys[i], convexArea[i]));
      hullSort.Add(new KeyValuePair<Polyline, double>(polyLines[i], convexArea[i]));

    }

    // Output the polygons with no convex hull
    // Here is where the sorting according to area values takes place.
    convexSort.Sort(Compare1);
    convexSort.Reverse();
    // We retrieve a list of polylines from our List of KeyValuePairs
    List<Polyline> polyFinal = (from kvp in convexSort select kvp.Key).Distinct().ToList();
    polyFinal.Reverse();

    // Output the convex hull polygons
    // Here is where the sorting according to area values takes place.
    hullSort.Sort(Compare1);
    hullSort.Reverse();
    // We retrieve a list of polylines from our List of KeyValuePairs
    List<Polyline> hullFinal = (from kvp in hullSort select kvp.Key).Distinct().ToList();
    hullFinal.Reverse();

    A = polyFinal;

    //B = hullFinal[0];

    /*
    Curve booleanUnionOne = polyFinal[0].ToNurbsCurve();
    Curve booleanUnionTwo = polyTwo.ToNurbsCurve();

    var listBoolean = new List<Curve>();

    listBoolean.Add(booleanUnionOne);
    listBoolean.Add(booleanUnionTwo);

    A = Curve.CreateBooleanUnion(listBoolean).ElementAt(1);
    */
# ---------- nestingtwoitems_2: C# additional code ----------
  static int Compare1(KeyValuePair<Polyline, double> a, KeyValuePair<Polyline, double> b)
  {

    return a.Value.CompareTo(b.Value);

  }

  static int Compare2(KeyValuePair<Point3d, double> a, KeyValuePair<Point3d, double> b)
  {

    return a.Value.CompareTo(b.Value);

  }
# ---------- end nestingtwoitems_2 ----------
merge_4 = Merge(Data1=curve_7, Data2=convex_hull_2.Hull)  # -> flatten(Result)
curve_9 = Curve(nestingtwoitems_2.B)  # disabled
curve_10 = Curve(nestingtwoitems_2.A)  # disabled
nestingtwoitems_3 = CSharpScript(x=merge_4, Reference="C:\Users\Paula\AppData\Roaming\Grasshopper\Libraries\ClipperTools.dll")  # -> out, A, B; inputs x: list of Polyline; same code as nestingtwoitems_2
curve_11 = Curve(nestingtwoitems_3.B)
curve_12 = Curve(nestingtwoitems_3.A)
brep_brep = BrepBrep(BrepA=curve_10, BrepB=region_difference)  # -> flatten(Curves), Points; disabled
region_intersection_2 = RegionIntersection(CurvesA=curve_12, CurvesB=region_difference_2)
closed = Closed(Curve=brep_brep.Curves)  # -> Closed, Periodic; disabled
area_11 = Area(Geometry=region_intersection_2)  # -> Area, Centroid
cull_pattern = CullPattern(List=brep_brep.Curves, CullPattern=closed.Closed)  # disabled
integer_4 = Integer(area_11.Area)
curve_13 = Curve(cull_pattern)  # disabled
area_12 = Area(Geometry=curve_13)  # -> Area, Centroid; disabled
evaluate_2 = Evaluate(Expression="If(x=y, True, False)", x=integer_3, y=integer_4)
panel_27 = Panel(area_12.Area)  # disabled
panel_28 = Panel(integer_4)
dispatch_2 = Dispatch(List=curve_12, DispatchPattern=evaluate_2)  # -> ListA, ListB
evaluate_3 = Evaluate(Expression="If(x=y, True, False)", x=panel_6, y=panel_27)  # disabled
discontinuity_4 = Discontinuity(Curve=convex_hull_2.Hull, Level=1)  # -> Points, Parameters
curve_14 = Curve(dispatch_2.ListA)
dispatch_3 = Dispatch(List=curve_13, DispatchPattern=evaluate_3)  # -> ListA, ListB; disabled
discontinuity_5 = Discontinuity(Curve=convex_hull_2.Hull, Level=1)  # -> Points, Parameters; disabled
graft_tree_2 = GraftTree(Tree=curve_14, IncludeEmptyLists=True, IncludeNullItems=True)
curve_15 = Curve(dispatch_3.ListA)  # disabled
discontinuity_6 = Discontinuity(Curve=graft_tree_2, Level=1)  # -> Points, Parameters
graft_tree_3 = GraftTree(Tree=curve_15, IncludeEmptyLists=True, IncludeNullItems=True)  # disabled
discontinuity_7 = Discontinuity(Curve=graft_tree_3, Level=1)  # -> Points, Parameters; disabled
c_script_2 = CSharpScript(x=simplify(discontinuity_6.Points), y=discontinuity_4.Points)  # -> out, A; inputs x: tree of Point3d, y: list of Point3d; same code as c_script
convex_hull_3 = ConvexHull(Points=c_script_2.A, Plane=PlaneXY(0, 0, 0))  # -> flatten(Hull), HullZ, Indices
c_script_3 = CSharpScript(x=simplify(discontinuity_7.Points), y=discontinuity_5.Points)  # -> out, A; inputs x: tree of Point3d, y: list of Point3d; disabled
# ---------- c_script_3: C# ----------
    for(int i = 0; i < x.BranchCount; ++i)
      for(int j = 0; j < y.Count; ++j)
      {
      
        x.Add(y[j], new GH_Path(i));
        
      }
    
    A = x;
# ---------- end c_script_3 ----------
area_13 = Area(Geometry=convex_hull_3.Hull)  # -> Area, Centroid
convex_hull_4 = ConvexHull(Points=c_script_3.A, Plane=PlaneXY(0, 0, 0))  # -> flatten(Hull), HullZ, Indices; disabled
sort_list_2 = SortList(Keys=area_13.Area, ValuesValuesA=curve_14)  # -> Keys, ValuesValuesA
area_14 = Area(Geometry=convex_hull_4.Hull)  # -> Area, Centroid; disabled
list_item_7 = ListItem(List=sort_list_2.ValuesValuesA, Index=0, Wrap=True)
sort_list_3 = SortList(Keys=area_14.Area, ValuesValuesA=curve_15)  # -> Keys, ValuesValuesA; disabled
discontinuity_8 = Discontinuity(Curve=[list_item_7, convex_hull_2.Hull], Level=1)  # -> flatten(Points), Parameters
list_item_8 = ListItem(List=sort_list_3.ValuesValuesA, Index=0, Wrap=True)  # disabled
discontinuity_9 = Discontinuity(Curve=[list_item_8, convex_hull_2.Hull], Level=1)  # -> flatten(Points), Parameters; disabled
convex_hull_5 = ConvexHull(Points=discontinuity_8.Points, Plane=PlaneXY(0, 0, 0))  # -> Hull, HullZ, Indices
number_slider_2 = Slider(0, range=0..1)  # disabled
convex_hull_6 = ConvexHull(Points=discontinuity_9.Points, Plane=PlaneXY(0, 0, 0))  # -> Hull, HullZ, Indices; disabled
region_difference_3 = RegionDifference(CurvesA=region_difference, CurvesB=convex_hull_6.Hull)  # disabled
merge_5 = Merge(Data1=curve_5, Data2=convex_hull_6.Hull)  # -> flatten(Result); disabled
nestingtwoitems_4 = CSharpScript(x=merge_5, Reference="C:\Users\Paula\AppData\Roaming\Grasshopper\Libraries\ClipperTools.dll")  # -> out, A, B; inputs x: list of Polyline; disabled; same code as nestingtwoitems_2
curve_16 = Curve(nestingtwoitems_4.B)  # disabled
curve_17 = Curve(nestingtwoitems_4.A)  # disabled
brep_brep_2 = BrepBrep(BrepA=curve_17, BrepB=region_difference_3)  # -> flatten(Curves), Points; disabled
closed_2 = Closed(Curve=brep_brep_2.Curves)  # -> Closed, Periodic; disabled
cull_pattern_2 = CullPattern(List=brep_brep_2.Curves, CullPattern=closed_2.Closed)  # disabled
curve_18 = Curve(cull_pattern_2)  # disabled
area_15 = Area(Geometry=curve_18)  # -> Area, Centroid; disabled
panel_29 = Panel(area_15.Area)  # disabled
text_split_6 = TextSplit(Text=area_15.Area, Separators=panel_12)  # disabled
panel_30 = Panel(text_split_6)  # disabled
list_item_9 = ListItem(List=panel_30, Index=0, Wrap=True)  # -> flatten(Item); disabled
panel_31 = Panel(list_item_9)  # disabled
evaluate_4 = Evaluate(Expression="If(x=y, True, False)", x=panel_25, y=panel_31)  # disabled
dispatch_4 = Dispatch(List=curve_18, DispatchPattern=evaluate_4)  # -> ListA, ListB; disabled
discontinuity_10 = Discontinuity(Curve=convex_hull_6.Hull, Level=1)  # -> Points, Parameters; disabled
curve_19 = Curve(dispatch_4.ListA)  # disabled
graft_tree_4 = GraftTree(Tree=curve_19, IncludeEmptyLists=True, IncludeNullItems=True)  # disabled
discontinuity_11 = Discontinuity(Curve=graft_tree_4, Level=1)  # -> Points, Parameters; disabled
c_script_4 = CSharpScript(x=simplify(discontinuity_11.Points), y=discontinuity_10.Points)  # -> out, A; inputs x: tree of Point3d, y: list of Point3d; disabled; same code as c_script_3
convex_hull_7 = ConvexHull(Points=c_script_4.A, Plane=PlaneXY(0, 0, 0))  # -> flatten(Hull), HullZ, Indices; disabled
area_16 = Area(Geometry=convex_hull_7.Hull)  # -> Area, Centroid; disabled
sort_list_4 = SortList(Keys=area_16.Area, ValuesValuesA=curve_19)  # -> Keys, ValuesValuesA; disabled
list_item_10 = ListItem(List=sort_list_4.ValuesValuesA, Index=0, Wrap=True)  # disabled
discontinuity_12 = Discontinuity(Curve=[list_item_10, convex_hull_6.Hull], Level=1)  # -> flatten(Points), Parameters; disabled
number_slider_3 = Slider(1, range=0..1)  # disabled
convex_hull_8 = ConvexHull(Points=discontinuity_12.Points, Plane=PlaneXY(0, 0, 0))  # -> Hull, HullZ, Indices; disabled
region_difference_4 = RegionDifference(CurvesA=region_difference_3, CurvesB=convex_hull_8.Hull)  # disabled
merge_6 = Merge(Data1=curve_to_polyline.Polyline, Data2=convex_hull_8.Hull)  # -> flatten(Result); disabled
nestingtwoitems_5 = CSharpScript(x=merge_6, Reference="C:\Users\Paula\AppData\Roaming\Grasshopper\Libraries\ClipperTools.dll")  # -> out, A, B; inputs x: list of Polyline; disabled; same code as nestingtwoitems_2
curve_20 = Curve(nestingtwoitems_5.B)  # disabled
curve_21 = Curve(nestingtwoitems_5.A)  # disabled
brep_brep_3 = BrepBrep(BrepA=curve_21, BrepB=region_difference_4)  # -> flatten(Curves), Points; disabled
closed_3 = Closed(Curve=brep_brep_3.Curves)  # -> Closed, Periodic; disabled
cull_pattern_3 = CullPattern(List=brep_brep_3.Curves, CullPattern=closed_3.Closed)  # disabled
curve_22 = Curve(cull_pattern_3)  # disabled
area_17 = Area(Geometry=curve_22)  # -> Area, Centroid; disabled
panel_32 = Panel(area_17.Area)  # disabled
text_split_7 = TextSplit(Text=panel_32, Separators=panel_13)  # disabled
panel_33 = Panel(text_split_7)  # disabled
list_item_11 = ListItem(List=panel_33, Index=0, Wrap=True)  # -> flatten(Item); disabled
panel_34 = Panel(list_item_11)  # disabled
evaluate_5 = Evaluate(Expression="If(x=y, True, False)", x=panel_26, y=panel_34)  # disabled
dispatch_5 = Dispatch(List=curve_22, DispatchPattern=evaluate_5)  # -> ListA, ListB; disabled
discontinuity_13 = Discontinuity(Curve=convex_hull_8.Hull, Level=1)  # -> Points, Parameters; disabled
curve_23 = Curve(dispatch_5.ListA)  # disabled
graft_tree_5 = GraftTree(Tree=curve_23, IncludeEmptyLists=True, IncludeNullItems=True)  # disabled
discontinuity_14 = Discontinuity(Curve=graft_tree_5, Level=1)  # -> Points, Parameters; disabled
c_script_5 = CSharpScript(x=simplify(discontinuity_14.Points), y=discontinuity_13.Points)  # -> out, A; inputs x: tree of Point3d, y: list of Point3d; disabled; same code as c_script_3
convex_hull_9 = ConvexHull(Points=c_script_5.A, Plane=PlaneXY(0, 0, 0))  # -> flatten(Hull), HullZ, Indices; disabled
area_18 = Area(Geometry=convex_hull_9.Hull)  # -> Area, Centroid; disabled
sort_list_5 = SortList(Keys=area_18.Area, ValuesValuesA=curve_23)  # -> Keys, ValuesValuesA; disabled
list_item_12 = ListItem(List=sort_list_5.ValuesValuesA, Index=0, Wrap=True)  # disabled
discontinuity_15 = Discontinuity(Curve=[list_item_12, convex_hull_8.Hull], Level=1)  # -> flatten(Points), Parameters; disabled
convex_hull_10 = ConvexHull(Points=discontinuity_15.Points, Plane=PlaneXY(0, 0, 0))  # -> Hull, HullZ, Indices; disabled
region_difference_5 = RegionDifference(CurvesA=region_difference_4, CurvesB=convex_hull_10.Hull)  # disabled
merge_7 = Merge(Data1=curve_2, Data2=convex_hull_10.Hull)  # -> flatten(Result); disabled
nestingtwoitems_6 = CSharpScript(x=merge_7, Reference="C:\Users\Paula\AppData\Roaming\Grasshopper\Libraries\ClipperTools.dll")  # -> out, A, B; inputs x: list of Polyline; disabled; same code as nestingtwoitems_2
curve_24 = Curve(nestingtwoitems_6.B)  # disabled
curve_25 = Curve(nestingtwoitems_6.A)  # disabled
brep_brep_4 = BrepBrep(BrepA=curve_25, BrepB=region_difference_5)  # -> flatten(Curves), Points; disabled
closed_4 = Closed(Curve=brep_brep_4.Curves)  # -> Closed, Periodic; disabled
cull_pattern_4 = CullPattern(List=brep_brep_4.Curves, CullPattern=closed_4.Closed)  # disabled
curve_26 = Curve(cull_pattern_4)  # disabled
area_19 = Area(Geometry=curve_26)  # -> Area, Centroid; disabled
panel_35 = Panel(area_19.Area)  # disabled
text_split_8 = TextSplit(Text=panel_35, Separators=panel_8)  # disabled
panel_36 = Panel(text_split_8)  # disabled
list_item_13 = ListItem(List=panel_36, Index=0, Wrap=True)  # -> flatten(Item); disabled
panel_37 = Panel(list_item_13)  # disabled
evaluate_6 = Evaluate(Expression="If(x=y, True, False)", x=panel_23, y=panel_37)  # disabled
dispatch_6 = Dispatch(List=curve_26, DispatchPattern=evaluate_6)  # -> ListA, ListB; disabled
discontinuity_16 = Discontinuity(Curve=convex_hull_10.Hull, Level=1)  # -> Points, Parameters; disabled
curve_27 = Curve(dispatch_6.ListA)  # disabled
graft_tree_6 = GraftTree(Tree=curve_27, IncludeEmptyLists=True, IncludeNullItems=True)  # disabled
discontinuity_17 = Discontinuity(Curve=graft_tree_6, Level=1)  # -> Points, Parameters; disabled
c_script_6 = CSharpScript(x=simplify(discontinuity_17.Points), y=discontinuity_16.Points)  # -> out, A; inputs x: tree of Point3d, y: list of Point3d; disabled; same code as c_script_3
convex_hull_11 = ConvexHull(Points=c_script_6.A, Plane=PlaneXY(0, 0, 0))  # -> flatten(Hull), HullZ, Indices; disabled
area_20 = Area(Geometry=convex_hull_11.Hull)  # -> Area, Centroid; disabled
sort_list_6 = SortList(Keys=area_20.Area, ValuesValuesA=curve_27)  # -> Keys, ValuesValuesA; disabled
list_item_14 = ListItem(List=sort_list_6.ValuesValuesA, Index=0, Wrap=True)  # disabled
discontinuity_18 = Discontinuity(Curve=[list_item_14, convex_hull_10.Hull], Level=1)  # -> flatten(Points), Parameters; disabled
convex_hull_12 = ConvexHull(Points=discontinuity_18.Points, Plane=PlaneXY(0, 0, 0))  # -> Hull, HullZ, Indices; disabled
region_difference_6 = RegionDifference(CurvesA=region_difference_5, CurvesB=convex_hull_12.Hull)  # disabled
merge_8 = Merge(Data1=curve, Data2=convex_hull_12.Hull)  # -> flatten(Result); disabled
nestingtwoitems_7 = CSharpScript(x=merge_8, Reference="C:\Users\Paula\AppData\Roaming\Grasshopper\Libraries\ClipperTools.dll")  # -> out, A, B; inputs x: list of Polyline; disabled; same code as nestingtwoitems_2
curve_28 = Curve(nestingtwoitems_7.B)  # disabled
curve_29 = Curve(nestingtwoitems_7.A)  # disabled
brep_brep_5 = BrepBrep(BrepA=curve_29, BrepB=region_difference_6)  # -> flatten(Curves), Points; disabled
closed_5 = Closed(Curve=brep_brep_5.Curves)  # -> Closed, Periodic; disabled
cull_pattern_5 = CullPattern(List=brep_brep_5.Curves, CullPattern=closed_5.Closed)  # disabled
curve_30 = Curve(cull_pattern_5)  # disabled
area_21 = Area(Geometry=curve_30)  # -> Area, Centroid; disabled
panel_38 = Panel(area_21.Area)  # disabled
text_split_9 = TextSplit(Text=panel_38, Separators=panel_7)  # disabled
panel_39 = Panel(text_split_9)  # disabled
list_item_15 = ListItem(List=panel_39, Index=0, Wrap=True)  # -> flatten(Item); disabled
panel_40 = Panel(list_item_15)  # disabled
evaluate_7 = Evaluate(Expression="If(x=y, True, False)", x=panel_22, y=panel_40)  # disabled
dispatch_7 = Dispatch(List=curve_30, DispatchPattern=evaluate_7)  # -> ListA, ListB; disabled
discontinuity_19 = Discontinuity(Curve=convex_hull_12.Hull, Level=1)  # -> Points, Parameters; disabled
curve_31 = Curve(dispatch_7.ListA)  # disabled
graft_tree_7 = GraftTree(Tree=curve_31, IncludeEmptyLists=True, IncludeNullItems=True)  # disabled
discontinuity_20 = Discontinuity(Curve=graft_tree_7, Level=1)  # -> Points, Parameters; disabled
c_script_7 = CSharpScript(x=simplify(discontinuity_20.Points), y=discontinuity_19.Points)  # -> out, A; inputs x: tree of Point3d, y: list of Point3d; disabled; same code as c_script
convex_hull_13 = ConvexHull(Points=c_script_7.A, Plane=PlaneXY(0, 0, 0))  # -> flatten(Hull), HullZ, Indices; disabled
area_22 = Area(Geometry=convex_hull_13.Hull)  # -> Area, Centroid; disabled
sort_list_7 = SortList(Keys=area_22.Area, ValuesValuesA=curve_31)  # -> Keys, ValuesValuesA; disabled
list_item_16 = ListItem(List=sort_list_7.ValuesValuesA, Index=0, Wrap=True)  # disabled
discontinuity_21 = Discontinuity(Curve=[list_item_16, convex_hull_12.Hull], Level=1)  # -> flatten(Points), Parameters; disabled
convex_hull_14 = ConvexHull(Points=discontinuity_21.Points, Plane=PlaneXY(0, 0, 0))  # -> Hull, HullZ, Indices; disabled
region_difference_7 = RegionDifference(CurvesA=region_difference_6, CurvesB=convex_hull_14.Hull)  # disabled
merge_9 = Merge(Data1=curve_3, Data2=convex_hull_14.Hull)  # -> flatten(Result); disabled
nestingtwoitems_8 = CSharpScript(x=merge_9, Reference="C:\Users\Paula\AppData\Roaming\Grasshopper\Libraries\ClipperTools.dll")  # -> out, A, B; inputs x: list of Polyline; disabled; same code as nestingtwoitems_2
curve_32 = Curve(nestingtwoitems_8.B)  # disabled
curve_33 = Curve(nestingtwoitems_8.A)  # disabled
brep_brep_6 = BrepBrep(BrepA=curve_33, BrepB=region_difference_7)  # -> flatten(Curves), Points; disabled
closed_6 = Closed(Curve=brep_brep_6.Curves)  # -> Closed, Periodic; disabled
cull_pattern_6 = CullPattern(List=brep_brep_6.Curves, CullPattern=closed_6.Closed)  # disabled
curve_34 = Curve(cull_pattern_6)  # disabled
area_23 = Area(Geometry=curve_34)  # -> Area, Centroid; disabled
panel_41 = Panel(area_23.Area)  # disabled
text_split_10 = TextSplit(Text=panel_41, Separators=panel_10)  # disabled
panel_42 = Panel(text_split_10)  # disabled
list_item_17 = ListItem(List=panel_42, Index=0, Wrap=True)  # -> flatten(Item); disabled
panel_43 = Panel(list_item_17)  # disabled
evaluate_8 = Evaluate(Expression="If(x=y, True, False)", x=panel_24, y=panel_43)  # disabled
dispatch_8 = Dispatch(List=curve_34, DispatchPattern=evaluate_8)  # -> ListA, ListB; disabled
discontinuity_22 = Discontinuity(Curve=convex_hull_14.Hull, Level=1)  # -> Points, Parameters; disabled
curve_35 = Curve(dispatch_8.ListA)  # disabled
graft_tree_8 = GraftTree(Tree=curve_35, IncludeEmptyLists=True, IncludeNullItems=True)  # disabled
discontinuity_23 = Discontinuity(Curve=graft_tree_8, Level=1)  # -> Points, Parameters; disabled
c_script_8 = CSharpScript(x=simplify(discontinuity_23.Points), y=discontinuity_22.Points)  # -> out, A; inputs x: tree of Point3d, y: list of Point3d; disabled; same code as c_script
convex_hull_15 = ConvexHull(Points=c_script_8.A, Plane=PlaneXY(0, 0, 0))  # -> flatten(Hull), HullZ, Indices; disabled
area_24 = Area(Geometry=convex_hull_15.Hull)  # -> Area, Centroid; disabled
sort_list_8 = SortList(Keys=area_24.Area, ValuesValuesA=curve_35)  # -> Keys, ValuesValuesA; disabled
list_item_18 = ListItem(List=sort_list_8.ValuesValuesA, Index=0, Wrap=True)  # disabled
discontinuity_24 = Discontinuity(Curve=[convex_hull_14.Hull, list_item_18], Level=1)  # -> flatten(Points), Parameters; disabled
convex_hull_16 = ConvexHull(Points=discontinuity_24.Points, Plane=PlaneXY(0, 0, 0))  # -> Hull, HullZ, Indices; disabled
merge_10 = Merge(
    Data1=sheet,
    Data2=placedpart,
    Data3=list_item,
    Data4=list_item_8,
    Data5=list_item_10,
    Data6=list_item_12,
    Data7=list_item_14,
    Data8=list_item_16,
    Data9=list_item_18)
merge_11 = Merge(
    Data1=placedpart,
    Data2=list_item,
    Data3=list_item_8,
    Data4=list_item_10,
    Data5=list_item_12,
    Data6=list_item_14,
    Data7=list_item_16,
    Data8=list_item_18)

# ---- group: NestingNoIFP
curve_36 = Curve([<curve referenced from the Rhino model> x6])
curve_to_polyline_2 = CurveToPolyline(Curve=curve_36, ToleranceDistance=0, ToleranceAngle=Slider(0.1, range=0..1))  # -> Polyline, Segments
curve_37 = Curve(<curve referenced from the Rhino model>)
curve_38 = Curve([<curve referenced from the Rhino model> x2])
curve_39 = Curve([<curve referenced from the Rhino model> x2])
curve_40 = Curve([<curve referenced from the Rhino model> x4])
nestingreference = CSharpScript()  # -> out, A
# ---------- nestingreference: C# ----------
    /*
    curve = AreaSorting(curve);
    //curve.Reverse();
    var hullFinal = new List<Polyline>();
    var x = Nesting(curve, out hullFinal);
    var finalCurve = x[0];
    var finalHull = hullFinal[0];
    var oner = curve[curve.Count - 1];

    var outer = new List<Polyline>();
    outer.Add(finalCurve);
    outer.Add(oner);

    return outer;
    */

    /*
    curve = AreaSorting(curve);
    //curve.Reverse();
    var hullFinal = new List<Polyline>();
    var x = Nesting(curve, out hullFinal);
    var finalCurve = x[0];
    var finalHull = hullFinal[0];
    var oner = curve[curve.Count - 1];
    curve.RemoveAt(0);
    var hullFinali = new List<Polyline>();
    curve.Add(finalHull);
    var outOne = Nesting(curve, out hullFinali)[0];
    curve.Add(hullFinali[0]);
    var hullFinalTwo = new List<Polyline>();
    curve.RemoveAt(0);
    var outTwo = Nesting(curve, out hullFinalTwo)[0];
    var outer = new List<Polyline>();
    outer.Add(finalCurve);
    outer.Add(oner);
    outer.Add(outOne);
    outer.Add(outTwo);

    return outer;

    */


    /*
    curve = AreaSorting(curve);

    var hull = new List<Polyline>();
    var nest = new List<Polyline>();

    var tempNest = new List<Polyline>();
    var tempHull = new List<Polyline>();

    var crv = curve[curve.Count - 1];

    tempNest.Add(crv);

    nest = Nesting(curve, out hull);
    curve.Add(nest[0]);
    curve.Add(hull[0]);

    nest = Nesting(curve, out hull);

    tempNest.Add(nest[0]);

    return tempNest;
    */

    /*

    var outer = new List<Polyline>();

    for(int i = 0; i < curve.Count - 1; ++i)
    {

      //var path = new GH_Path(i);
      var hullFinal = new List<Polyline>();
      var nesting = Nesting(curve, out hullFinal);
      var finalCurve = nesting[0];
      var finalHull = hullFinal[0];
      var oner = curve[curve.Count - 1];
      outer.Add(finalCurve);
      outer.Add(oner);

      curve.RemoveAt(0);
      curve.RemoveAt(curve.Count - 1);

      var hullFinali = new List<Polyline>();

      curve.Add(finalHull);

      var outOne = Nesting(curve, out hullFinali)[0];

      //outer = AreaSorting(outer);

      //outer.RemoveAt(2);

      outer.Add(outOne);


    }

    //return tree.Branch(0)[0];

    outer = AreaSorting(outer);
    outer.RemoveAt(outer.Count - 1);
    outer.RemoveAt(outer.Count - 1);
    outer.RemoveAt(1);

    //outer.RemoveAt(2);


    //outer.RemoveAt(outer.Count - 1);

    return outer;

    */
# ---------- end nestingreference ----------
merge_12 = Merge(Data1=curve_to_polyline_2.Polyline, Data2=curve_40, Data3=curve_38, Data4=curve_39)
panel_44 = Panel(merge_12)
nesting = CSharpScript(x=merge_12, Reference="C:\Users\Paula\AppData\Roaming\Grasshopper\Libraries\ClipperTools.dll")  # -> out, A; inputs x: list of Polyline
# ---------- nesting: C# ----------
    A = NestingMultiple(x);
# ---------- nesting: C# additional code ----------
  public List<Polyline> NestingMultiple(List<Polyline> curve)
  {

    curve = AreaSorting(curve);
    curve.Reverse();
    var outer = new List<Polyline>();
    for(int i = 0; i < curve.Count - 1; ++i)
    {

      var hullFinal = new List<Polyline>();
      var x = Nesting(curve, out hullFinal);
      var finalCurve = x[0];
      var finalHull = hullFinal[0];
      var oner = curve[curve.Count - 1];
      curve.Add(finalHull);
      curve.RemoveAt(0);

      outer.Add(finalCurve);
      outer.Add(oner);
      outer = AreaSorting(outer);

    }

    for(int i = 2; i < outer.Count; ++i)
    {

      outer.RemoveAt(outer.Count - 1);

    }

    return outer;

  }

  public List<Polyline> Nesting(List<Polyline> curve, out List<Polyline> hullFinal)
  {

    var treeOut = PointDataTree(curve);

    Polyline[] polys;

    var APoints = ConvexHullPoints(curve, treeOut, out polys);

    List<Polyline> polyFinal;

    hullFinal = ConvexHull(APoints, polys, out polyFinal);

    return polyFinal;

  }

  public Polyline IFP(List<Polyline> curves)
  {

    var one = curves.ElementAt(0);
    var two = curves.ElementAt(curves.Count - 1);

    var points = PointDataTree(curves);

    // Inner Fit Polygon
    Point3d centerOne = points.Branch(0)[0];//ptB[ptB.Count - 1];
    Vector3d zAxis = Vector3d.ZAxis;
    Plane pO = new Rhino.Geometry.Plane(centerOne, zAxis);
    double tolerance = 0.0001;

    List<Polyline> outCurvesOne = new List<Polyline>();
    List<Polyline> outDisplacedCurvesOne = new List<Polyline>();
    foreach(List<IntPoint> path in ClipperLib.Clipper.MinkowskiDiff(one.ToPath2D(pO, tolerance), two.ToPath2D(pO, tolerance)))
    {

      Polyline plSum = path.ToPolyline(pO, tolerance, true);
      outCurvesOne.Add(plSum);

    }

    Polyline bin = outCurvesOne[1];

    return bin;

  }

  public List<Polyline> AreaSorting(List<Polyline> x)
  {

    // We want to cast(change from one data type to another) our list of polylines to curves, so that
    // we can call the AreaMassProperties class and its method .Compute to get the area of the polygons
    // after that we can now create a List of KeyValuePair to assign the area of our polygons to our
    // polygons so that we can sort them later according to their areas.
    List<Curve> one = new List<Curve>();
    double[] areas = new Double[x.Count];
    var curves = new List<KeyValuePair<Polyline, double>>();

    for(int i = 0; i < x.Count; ++i)
    {

      one.Add(x.ElementAt(i).ToNurbsCurve());
      areas[i] = AreaMassProperties.Compute(one.ElementAt(i)).Area;
      curves.Add(new KeyValuePair<Polyline, double>(x.ElementAt(i), areas[i]));

    }

    // Here is where the sorting according to area values takes place.
    curves.Sort(Compare1);
    curves.Reverse();
    // We retrieve a list of curves from our List of KeyValuePairs
    List<Polyline> curve = (from kvp in curves select kvp.Key).Distinct().ToList();
    curve.Reverse();

    return curve;

  }

  public DataTree<Point3d> PointDataTree(List<Polyline> curve)
  {

    // We create and populate trees with the points of the curves, so that we can
    // sort each of the lower left points of each of the curves according to the
    // sum of their Xs and Ys positions.
    List<List<Point3d>> pts = new List<List<Point3d>>();
    DataTree<Point3d> tree = new DataTree<Point3d>();
    DataTree<double> treeSum = new DataTree<double>();
    var points = new DataTree<KeyValuePair<Point3d, double>>();
    var point = new List<Point3d>[curve.Count];
    DataTree<Point3d> treeLowerLeft = new DataTree<Point3d>();

    for(int i = 0; i < curve.Count; ++i)
    {

      pts.Add(curve[i].ToList());
      pts[i].RemoveAt(pts[i].Count - 1);
      GH_Path path = new GH_Path(i);

      for(int j = 0; j < pts[i].Count; ++j)
      {

        tree.Add(pts[i][j], path);
        treeSum.Add(pts[i][j].X + pts[i][j].Y, path);

        points.Add(new KeyValuePair<Point3d, double>(tree.Branch(i)[j], treeSum.Branch(i)[j]), path);

        points.Branch(i).Sort(Compare2);
        points.Branch(i).Reverse();
        point[i] = (from kvp in points.Branch(i) select kvp.Key).Distinct().ToList();
        point[i].Reverse();

      }

    }

    for(int i = 0; i < tree.BranchCount; ++i)
      for(int j = 0; j < tree.Branch(i).Count; ++j)
      {

        treeLowerLeft.Add(point[i][j], new GH_Path(i));

      }

    var treeOut = new DataTree<Point3d>();

    for(int i = 0; i < treeLowerLeft.BranchCount; ++i)
      for(int j = 0; j < treeLowerLeft.Branch(i).Count; ++j)
      {

        treeOut.Add(treeLowerLeft.Branch(i)[0], new GH_Path(i));

      }

    return treeOut;

  }

  public DataTree<Point3d> ConvexHullPoints(List<Polyline> curve, DataTree<Point3d> treeOut, out Polyline[] polys)
  {

    // No Fit Polygon from minkowsky difference using the clipper lib
    Polyline polyOne = curve[0];
    Polyline polyTwo = curve[curve.Count - 1];

    Point3d center = treeOut.Branch(0).ElementAt(0);
    Vector3d zAxis = Vector3d.ZAxis;
    Plane p = new Rhino.Geometry.Plane(center, zAxis);

    double tolerance = 0.001;
    List<Polyline> outCurves = new List<Polyline>();
    List<Polyline> outDisplacedCurves = new List<Polyline>();
    foreach(List<IntPoint> path in ClipperLib.Clipper.MinkowskiDiff(polyOne.ToPath2D(p, tolerance), polyTwo.ToPath2D(p, tolerance)))
    {

      Polyline plSum = path.ToPolyline(p, tolerance, true);
      outCurves.Add(plSum);

    }

    Polyline NFP = outCurves[0];

    List<Point3d> ptNFP;
    ptNFP = NFP.ToList();
    ptNFP.RemoveAt(0);

    List<Vector3d> vectors = new List<Vector3d>();
    for(int i = 0; i < ptNFP.Count; ++i)
    {

      vectors.Add(new Vector3d(ptNFP.ElementAt(i) - treeOut.Branch(0)[0]));

    }

    List<Curve> translated = new List<Curve>();
    polys = new Polyline[ptNFP.Count];
    List<List<Point3d>> polyPoint = new List<List<Point3d>>();

    List<Point3d> pointsA = new List<Point3d>();
    pointsA = polyTwo.ToList();
    pointsA.RemoveAt(pointsA.Count - 1);
    DataTree<Point3d> polyPoints = new DataTree<Point3d>();
    DataTree<Point3d> APoints = new DataTree<Point3d>();
    for(int i = 0; i < ptNFP.Count; ++i)
    {

      var path = new GH_Path(i);
      Curve oney = polyOne.ToNurbsCurve();
      oney.Translate(vectors.ElementAt(i));
      translated.Add(oney);
      translated.ElementAt(i).TryGetPolyline(out polys[i]);
      polyPoint.Add(polys[i].ToList());

      for(int j = 0; j < polyPoint[i].Count - 1; ++j)
      {

        polyPoints.Add(polyPoint[i][j], path);

      }

    }

    for(int i = 0; i < ptNFP.Count; ++i)
      for(int j = 0; j < pointsA.Count; ++j)
      {

        var path = new GH_Path(i);
        APoints.Add(pointsA[j], path);

      }

    for(int i = 0; i < polyPoints.BranchCount; ++i)
      for(int j = 0; j < polyPoints.Branch(i).Count; ++j)
      {

        APoints.Add(polyPoints.Branch(i)[j], new GH_Path(i));

      }

    return APoints;

  }

  public List<Polyline> ConvexHull(DataTree<Point3d> APoints, Polyline[] polys, out List<Polyline> polyFinal)
  {

    var list = new Grasshopper.Kernel.Geometry.Node2List[APoints.BranchCount];
    var polyLines = new Polyline[APoints.BranchCount];
    var curvesConvex = new Curve[APoints.BranchCount];
    var convexArea = new Double[APoints.BranchCount];
    var convexSort = new List<KeyValuePair<Polyline, double>>();
    var hullSort = new List<KeyValuePair<Polyline, double>>();

    for(int i = 0; i < APoints.BranchCount; ++i)
    {

      list[i] = new Grasshopper.Kernel.Geometry.Node2List(APoints.Branch(i));
      polyLines[i] = Grasshopper.Kernel.Geometry.ConvexHull.Solver.ComputeHull(list[i]);
      curvesConvex[i] = polyLines[i].ToNurbsCurve();
      convexArea[i] = AreaMassProperties.Compute(curvesConvex[i]).Area;
      convexSort.Add(new KeyValuePair<Polyline, double>(polys[i], convexArea[i]));
      hullSort.Add(new KeyValuePair<Polyline, double>(polyLines[i], convexArea[i]));

    }

    // Output the polygons with no convex hull
    // Here is where the sorting according to area values takes place.
    convexSort.Sort(Compare1);
    convexSort.Reverse();
    // We retrieve a list of polylines from our List of KeyValuePairs
    polyFinal = (from kvp in convexSort select kvp.Key).Distinct().ToList();
    polyFinal.Reverse();

    // Output the convex hull polygons
    // Here is where the sorting according to area values takes place.
    hullSort.Sort(Compare1);
    hullSort.Reverse();
    // We retrieve a list of polylines from our List of KeyValuePairs
    List<Polyline> hullFinal = (from kvp in hullSort select kvp.Key).Distinct().ToList();
    hullFinal.Reverse();

    return hullFinal;

  }

  static int Compare1(KeyValuePair<Polyline, double> a, KeyValuePair<Polyline, double> b)
  {

    return a.Value.CompareTo(b.Value);

  }

  static int Compare2(KeyValuePair<Point3d, double> a, KeyValuePair<Point3d, double> b)
  {

    return a.Value.CompareTo(b.Value);

  }
# ---------- end nesting ----------
curve_41 = Curve(nesting.A)

# ----
nesting_2 = CSharpScript(x=merge_12, Reference="C:\Users\Paula\AppData\Roaming\Grasshopper\Libraries\ClipperTools.dll")  # -> out, A; inputs x: list of Polyline
# ---------- nesting_2: C# ----------
    A = NestingMultiple(x);
# ---------- nesting_2: C# additional code ----------
  public List<Polyline> NestingMultiple(List<Polyline> curve)
  {

    curve = AreaSorting(curve);
    //curve.Reverse();
    var outer = new List<Polyline>();
    for(int i = 0; i < curve.Count - 1; ++i)
    {

      var hullFinal = new List<Polyline>();
      var x = Nesting(curve, out hullFinal);
      var finalCurve = x[0];
      var finalHull = hullFinal[0];
      var oner = curve[curve.Count - 1];
      curve.Add(finalHull);
      curve.RemoveAt(0);

      outer.Add(finalCurve);
      outer.Add(oner);
      outer = AreaSorting(outer);

    }

    for(int i = 2; i < outer.Count; ++i)
    {

      outer.RemoveAt(outer.Count - 1);

    }

    return outer;

  }

  public List<Polyline> Nesting(List<Polyline> curve, out List<Polyline> hullFinal)
  {

    var treeOut = PointDataTree(curve);

    Polyline[] polys;

    var APoints = ConvexHullPoints(curve, treeOut, out polys);

    List<Polyline> polyFinal;

    hullFinal = ConvexHull(APoints, polys, out polyFinal);

    return polyFinal;

  }

  public Polyline IFP(List<Polyline> curves)
  {

    var one = curves.ElementAt(0);
    var two = curves.ElementAt(curves.Count - 1);

    var points = PointDataTree(curves);

    // Inner Fit Polygon
    Point3d centerOne = points.Branch(0)[0];//ptB[ptB.Count - 1];
    Vector3d zAxis = Vector3d.ZAxis;
    Plane pO = new Rhino.Geometry.Plane(centerOne, zAxis);
    double tolerance = 0.0001;

    List<Polyline> outCurvesOne = new List<Polyline>();
    List<Polyline> outDisplacedCurvesOne = new List<Polyline>();
    foreach(List<IntPoint> path in ClipperLib.Clipper.MinkowskiDiff(one.ToPath2D(pO, tolerance), two.ToPath2D(pO, tolerance)))
    {

      Polyline plSum = path.ToPolyline(pO, tolerance, true);
      outCurvesOne.Add(plSum);

    }

    Polyline bin = outCurvesOne[1];

    return bin;

  }

  public List<Polyline> AreaSorting(List<Polyline> x)
  {

    // We want to cast(change from one data type to another) our list of polylines to curves, so that
    // we can call the AreaMassProperties class and its method .Compute to get the area of the polygons
    // after that we can now create a List of KeyValuePair to assign the area of our polygons to our
    // polygons so that we can sort them later according to their areas.
    List<Curve> one = new List<Curve>();
    double[] areas = new Double[x.Count];
    var curves = new List<KeyValuePair<Polyline, double>>();

    for(int i = 0; i < x.Count; ++i)
    {

      one.Add(x.ElementAt(i).ToNurbsCurve());
      areas[i] = AreaMassProperties.Compute(one.ElementAt(i)).Area;
      curves.Add(new KeyValuePair<Polyline, double>(x.ElementAt(i), areas[i]));

    }

    // Here is where the sorting according to area values takes place.
    curves.Sort(Compare1);
    curves.Reverse();
    // We retrieve a list of curves from our List of KeyValuePairs
    List<Polyline> curve = (from kvp in curves select kvp.Key).Distinct().ToList();
    curve.Reverse();

    return curve;

  }

  public DataTree<Point3d> PointDataTree(List<Polyline> curve)
  {

    // We create and populate trees with the points of the curves, so that we can
    // sort each of the lower left points of each of the curves according to the
    // sum of their Xs and Ys positions.
    List<List<Point3d>> pts = new List<List<Point3d>>();
    DataTree<Point3d> tree = new DataTree<Point3d>();
    DataTree<double> treeSum = new DataTree<double>();
    var points = new DataTree<KeyValuePair<Point3d, double>>();
    var point = new List<Point3d>[curve.Count];
    DataTree<Point3d> treeLowerLeft = new DataTree<Point3d>();

    for(int i = 0; i < curve.Count; ++i)
    {

      pts.Add(curve[i].ToList());
      pts[i].RemoveAt(pts[i].Count - 1);
      GH_Path path = new GH_Path(i);

      for(int j = 0; j < pts[i].Count; ++j)
      {

        tree.Add(pts[i][j], path);
        treeSum.Add(pts[i][j].X + pts[i][j].Y, path);

        points.Add(new KeyValuePair<Point3d, double>(tree.Branch(i)[j], treeSum.Branch(i)[j]), path);

        points.Branch(i).Sort(Compare2);
        points.Branch(i).Reverse();
        point[i] = (from kvp in points.Branch(i) select kvp.Key).Distinct().ToList();
        point[i].Reverse();

      }

    }

    for(int i = 0; i < tree.BranchCount; ++i)
      for(int j = 0; j < tree.Branch(i).Count; ++j)
      {

        treeLowerLeft.Add(point[i][j], new GH_Path(i));

      }

    var treeOut = new DataTree<Point3d>();

    for(int i = 0; i < treeLowerLeft.BranchCount; ++i)
      for(int j = 0; j < treeLowerLeft.Branch(i).Count; ++j)
      {

        treeOut.Add(treeLowerLeft.Branch(i)[0], new GH_Path(i));

      }

    return treeOut;

  }

  public DataTree<Point3d> ConvexHullPoints(List<Polyline> curve, DataTree<Point3d> treeOut, out Polyline[] polys)
  {

    // No Fit Polygon from minkowsky difference using the clipper lib
    Polyline polyOne = curve[0];
    Polyline polyTwo = curve[curve.Count - 1];

    Point3d center = treeOut.Branch(0).ElementAt(0);
    Vector3d zAxis = Vector3d.ZAxis;
    Plane p = new Rhino.Geometry.Plane(center, zAxis);

    double tolerance = 0.001;
    List<Polyline> outCurves = new List<Polyline>();
    List<Polyline> outDisplacedCurves = new List<Polyline>();
    foreach(List<IntPoint> path in ClipperLib.Clipper.MinkowskiDiff(polyOne.ToPath2D(p, tolerance), polyTwo.ToPath2D(p, tolerance)))
    {

      Polyline plSum = path.ToPolyline(p, tolerance, true);
      outCurves.Add(plSum);

    }

    Polyline NFP = outCurves[0];

    List<Point3d> ptNFP;
    ptNFP = NFP.ToList();
    ptNFP.RemoveAt(0);

    List<Vector3d> vectors = new List<Vector3d>();
    for(int i = 0; i < ptNFP.Count; ++i)
    {

      vectors.Add(new Vector3d(ptNFP.ElementAt(i) - treeOut.Branch(0)[0]));

    }

    List<Curve> translated = new List<Curve>();
    polys = new Polyline[ptNFP.Count];
    List<List<Point3d>> polyPoint = new List<List<Point3d>>();

    List<Point3d> pointsA = new List<Point3d>();
    pointsA = polyTwo.ToList();
    pointsA.RemoveAt(pointsA.Count - 1);
    DataTree<Point3d> polyPoints = new DataTree<Point3d>();
    DataTree<Point3d> APoints = new DataTree<Point3d>();
    for(int i = 0; i < ptNFP.Count; ++i)
    {

      var path = new GH_Path(i);
      Curve oney = polyOne.ToNurbsCurve();
      oney.Translate(vectors.ElementAt(i));
      translated.Add(oney);
      translated.ElementAt(i).TryGetPolyline(out polys[i]);
      polyPoint.Add(polys[i].ToList());

      for(int j = 0; j < polyPoint[i].Count - 1; ++j)
      {

        polyPoints.Add(polyPoint[i][j], path);

      }

    }

    for(int i = 0; i < ptNFP.Count; ++i)
      for(int j = 0; j < pointsA.Count; ++j)
      {

        var path = new GH_Path(i);
        APoints.Add(pointsA[j], path);

      }

    for(int i = 0; i < polyPoints.BranchCount; ++i)
      for(int j = 0; j < polyPoints.Branch(i).Count; ++j)
      {

        APoints.Add(polyPoints.Branch(i)[j], new GH_Path(i));

      }

    return APoints;

  }

  public List<Polyline> ConvexHull(DataTree<Point3d> APoints, Polyline[] polys, out List<Polyline> polyFinal)
  {

    var list = new Grasshopper.Kernel.Geometry.Node2List[APoints.BranchCount];
    var polyLines = new Polyline[APoints.BranchCount];
    var curvesConvex = new Curve[APoints.BranchCount];
    var convexArea = new Double[APoints.BranchCount];
    var convexSort = new List<KeyValuePair<Polyline, double>>();
    var hullSort = new List<KeyValuePair<Polyline, double>>();

    for(int i = 0; i < APoints.BranchCount; ++i)
    {

      list[i] = new Grasshopper.Kernel.Geometry.Node2List(APoints.Branch(i));
      polyLines[i] = Grasshopper.Kernel.Geometry.ConvexHull.Solver.ComputeHull(list[i]);
      curvesConvex[i] = polyLines[i].ToNurbsCurve();
      convexArea[i] = AreaMassProperties.Compute(curvesConvex[i]).Area;
      convexSort.Add(new KeyValuePair<Polyline, double>(polys[i], convexArea[i]));
      hullSort.Add(new KeyValuePair<Polyline, double>(polyLines[i], convexArea[i]));

    }

    // Output the polygons with no convex hull
    // Here is where the sorting according to area values takes place.
    convexSort.Sort(Compare1);
    convexSort.Reverse();
    // We retrieve a list of polylines from our List of KeyValuePairs
    polyFinal = (from kvp in convexSort select kvp.Key).Distinct().ToList();
    polyFinal.Reverse();

    // Output the convex hull polygons
    // Here is where the sorting according to area values takes place.
    hullSort.Sort(Compare1);
    hullSort.Reverse();
    // We retrieve a list of polylines from our List of KeyValuePairs
    List<Polyline> hullFinal = (from kvp in hullSort select kvp.Key).Distinct().ToList();
    hullFinal.Reverse();

    return hullFinal;

  }

  static int Compare1(KeyValuePair<Polyline, double> a, KeyValuePair<Polyline, double> b)
  {

    return a.Value.CompareTo(b.Value);

  }

  static int Compare2(KeyValuePair<Point3d, double> a, KeyValuePair<Point3d, double> b)
  {

    return a.Value.CompareTo(b.Value);

  }
# ---------- end nesting_2 ----------
panel_45 = Panel(curve_41)
