# Grasshopper definition NestingClean (1).gh (Grasshopper 0.9.76)
# plug-ins: AlphaShape, ClipperComponents, onScreen

curve = Curve(<curve referenced from the Rhino model>)
polygona = Curve(<curve referenced from the Rhino model>)
sheet = Curve(<curve referenced from the Rhino model>)
merge = Merge(Data1=polygona, Data2=sheet)
# IFP(Inner Fit Polygon)
innerfitpolygon = CSharpScript(
    x=merge,
    y=Slider(0, range=0..3),
    Reference="C:\PROGRAM FILES\COMMON FILES\MCNEEL\RHINOCEROS\5.0\PLUG-INS\CLIPPERPLUGIN (BAE0724C-D28B-4D54-9B02-806B19D157C2)\0.0.2.1\CLIPPER-0.2.2\ClipperTools.dll")  # -> out, A, B, C; inputs x: list of Polyline, y: Int32
# ---------- innerfitpolygon: C# ----------
    x = AreaSorting(x);

    var final = FirstPlacement(x)[y];

    /*
    var outPut = new List<Polyline>();

    outPut.Add(x[x.Count - 1]);
    outPut.Add(final);

    A = outPut;
    */

    A = final;

    B = x.ElementAt(x.Count - 1);
    
    C = IFP(x);

    //x.RemoveAt(0);

    //B = FirstPlacement(x)[FirstPlacement(x).Count - 1];
# ---------- innerfitpolygon: C# additional code ----------
  public List<Polyline> FirstPlacement(List<Polyline> x)
  {

    var innerFitPolygon = IFP(x)[1];

    List<Polyline> oner = new List<Polyline>();

    oner.Add(innerFitPolygon);
    oner.Add(x[0]);

    List<Polyline> two = new List<Polyline>();

    two.Add(innerFitPolygon);

    var fix = Translate(oner);

    for(int i = 0; i < fix.Length; ++i)
    {

      two.Add(fix.ElementAt(i));

    }

    two = AreaSorting(two);

    var a = two[two.Count - 1].ToNurbsCurve();

    two.RemoveAt(two.Count - 1);

    var array = new Curve[two.Count];

    Rhino.Geometry.Intersect.CurveIntersections ci;
    DataTree<Point3d> intPts = new DataTree<Point3d>();

    var numberOfIntersections = new Double[two.Count];

    var sortNumberOfIntersections = new List<KeyValuePair<Polyline, double>>();
    for(int i = 0; i < array.Length; ++i)
    {

      array[i] = two.ElementAt(i).ToNurbsCurve();


      ci = Rhino.Geometry.Intersect.Intersection.CurveCurve(a, array[i], 0.001, 0.001);

      for(int j = 0; j < ci.Count; j++)
      {

        intPts.Add(ci[j].PointA, new GH_Path(i));

        numberOfIntersections[i] = intPts.Branch(i).Count;

        sortNumberOfIntersections.Add(new KeyValuePair<Polyline, double>(two[i], numberOfIntersections[i]));

      }

    }

    sortNumberOfIntersections.Sort(Compare1);
    sortNumberOfIntersections.Reverse();

    List<Polyline> sortedPolys = (from kvp in sortNumberOfIntersections select kvp.Key).Distinct().ToList();
    sortedPolys.Reverse();

    return sortedPolys;

  }

  public Polyline[] Translate(List<Polyline> curve)
  {

    var treeOut = PointDataTree(curve);

    var polyTwo = curve[0];
    var polyOne = curve[curve.Count - 1];

    List<Point3d> ptNFP;
    ptNFP = polyTwo.ToList();
    ptNFP.RemoveAt(0);

    List<Vector3d> vectors = new List<Vector3d>();
    for(int i = 0; i < ptNFP.Count; ++i)
    {

      vectors.Add(new Vector3d(ptNFP.ElementAt(i) - treeOut.Branch(treeOut.BranchCount - 1)[0]));

    }

    List<Curve> translated = new List<Curve>();
    var polys = new Polyline[ptNFP.Count];
    List<List<Point3d>> polyPoint = new List<List<Point3d>>();

    List<Point3d> pointsA = new List<Point3d>();
    pointsA = polyTwo.ToList();
    pointsA.RemoveAt(pointsA.Count - 1);
    DataTree<Point3d> polyPoints = new DataTree<Point3d>();
    DataTree<Point3d> APoints = new DataTree<Point3d>();
    for(int i = 0; i < ptNFP.Count; ++i)
    {

      var path = new GH_Path(i);
      Curve oney = polyOne.ToNurbsCurve();
      oney.Translate(vectors.ElementAt(i));
      translated.Add(oney);
      translated.ElementAt(i).TryGetPolyline(out polys[i]);
      polyPoint.Add(polys[i].ToList());

    }

    return polys;

  }

  public List<Polyline> IFP(List<Polyline> curves)
  {

    curves = AreaSorting(curves);

    var one = curves.ElementAt(0);
    var two = curves.ElementAt(curves.Count - 1);

    var points = PointDataTree(curves);

    // Inner Fit Polygon
    Point3d centerOne = points.Branch(0)[0];//ptB[ptB.Count - 1];
    Vector3d zAxis = Vector3d.ZAxis;
    Plane pO = new Rhino.Geometry.Plane(centerOne, zAxis);
    double tolerance = 0.0001;

    List<Polyline> outCurvesOne = new List<Polyline>();
    List<Polyline> outDisplacedCurvesOne = new List<Polyline>();
    foreach(List<IntPoint> path in ClipperLib.Clipper.MinkowskiDiff(one.ToPath2D(pO, tolerance), two.ToPath2D(pO, tolerance)))
    {

      Polyline plSum = path.ToPolyline(pO, tolerance, true);
      outCurvesOne.Add(plSum);

    }

    Polyline bin = outCurvesOne[1];

    return outCurvesOne;

  }

  public List<Polyline> AreaSorting(List<Polyline> x)
  {

    // We want to cast(change from one data type to another) our list of polylines to curves, so that
    // we can call the AreaMassProperties class and its method .Compute to get the area of the polygons
    // after that we can now create a List of KeyValuePair to assign the area of our polygons to our
    // polygons so that we can sort them later according to their areas.
    List<Curve> one = new List<Curve>();
    double[] areas = new Double[x.Count];
    var curves = new List<KeyValuePair<Polyline, double>>();

    for(int i = 0; i < x.Count; ++i)
    {

      one.Add(x.ElementAt(i).ToNurbsCurve());
      areas[i] = AreaMassProperties.Compute(one.ElementAt(i)).Area;
      curves.Add(new KeyValuePair<Polyline, double>(x.ElementAt(i), areas[i]));

    }

    // Here is where the sorting according to area values takes place.
    curves.Sort(Compare1);
    curves.Reverse();
    // We retrieve a list of curves from our List of KeyValuePairs
    List<Polyline> curve = (from kvp in curves select kvp.Key).Distinct().ToList();
    curve.Reverse();

    return curve;

  }

  public DataTree<Point3d> PointDataTree(List<Polyline> curve)
  {

    // We create and populate trees with the points of the curves, so that we can
    // sort each of the lower left points of each of the curves according to the
    // sum of their Xs and Ys positions.
    List<List<Point3d>> pts = new List<List<Point3d>>();
    DataTree<Point3d> tree = new DataTree<Point3d>();
    DataTree<double> treeSum = new DataTree<double>();
    var points = new DataTree<KeyValuePair<Point3d, double>>();
    var point = new List<Point3d>[curve.Count];
    DataTree<Point3d> treeLowerLeft = new DataTree<Point3d>();

    for(int i = 0; i < curve.Count; ++i)
    {

      pts.Add(curve[i].ToList());
      pts[i].RemoveAt(pts[i].Count - 1);
      GH_Path path = new GH_Path(i);

      for(int j = 0; j < pts[i].Count; ++j)
      {

        tree.Add(pts[i][j], path);
        treeSum.Add(pts[i][j].X + pts[i][j].Y, path);

        points.Add(new KeyValuePair<Point3d, double>(tree.Branch(i)[j], treeSum.Branch(i)[j]), path);

        points.Branch(i).Sort(Compare2);
        points.Branch(i).Reverse();
        point[i] = (from kvp in points.Branch(i) select kvp.Key).Distinct().ToList();
        point[i].Reverse();

      }

    }

    for(int i = 0; i < tree.BranchCount; ++i)
      for(int j = 0; j < tree.Branch(i).Count; ++j)
      {

        treeLowerLeft.Add(point[i][j], new GH_Path(i));

      }

    var treeOut = new DataTree<Point3d>();

    for(int i = 0; i < treeLowerLeft.BranchCount; ++i)
      for(int j = 0; j < treeLowerLeft.Branch(i).Count; ++j)
      {

        treeOut.Add(treeLowerLeft.Branch(i)[0], new GH_Path(i));

      }

    return treeOut;

  }

  static int Compare1(KeyValuePair<Polyline, double> a, KeyValuePair<Polyline, double> b)
  {

    return a.Value.CompareTo(b.Value);

  }

  static int Compare2(KeyValuePair<Point3d, double> a, KeyValuePair<Point3d, double> b)
  {

    return a.Value.CompareTo(b.Value);

  }
# ---------- end innerfitpolygon ----------
placedpart = Curve(innerfitpolygon.A)
# NFP(No Fit Polygon)
parttobeplaced = Curve(<curve referenced from the Rhino model>)
merge_2 = Merge(Data1=parttobeplaced, Data2=placedpart)
nestingtwoitems = CSharpScript(
    x=merge_2,
    Reference="C:\PROGRAM FILES\COMMON FILES\MCNEEL\RHINOCEROS\5.0\PLUG-INS\CLIPPERPLUGIN (BAE0724C-D28B-4D54-9B02-806B19D157C2)\0.0.2.1\CLIPPER-0.2.2\ClipperTools.dll")  # -> out, A, B; inputs x: list of Polyline
# ---------- nestingtwoitems: C# ----------
    // We want to cast(change from one data type to another) our list of polylines to curves, so that
    // we can call the AreaMassProperties class and its method .Compute to get the area of the polygons
    // after that we can now create a List of KeyValuePair to assign the area of our polygons to our
    // polygons so that we can sort them later according to their areas.
    List<Curve> one = new List<Curve>();
    double[] areas = new Double[x.Count];
    var curves = new List<KeyValuePair<Polyline, double>>();

    for(int i = 0; i < x.Count; ++i)
    {

      one.Add(x.ElementAt(i).ToNurbsCurve());
      areas[i] = AreaMassProperties.Compute(one.ElementAt(i)).Area;
      curves.Add(new KeyValuePair<Polyline, double>(x.ElementAt(i), areas[i]));

    }

    // Here is where the sorting according to area values takes place.
    curves.Sort(Compare1);
    curves.Reverse();
    // We retrieve a list of curves from our List of KeyValuePairs
    List<Polyline> curve = (from kvp in curves select kvp.Key).Distinct().ToList();
    curve.Reverse();

    // We create and populate trees with the points of the curves, so that we can
    // sort each of the lower left points of each of the curves according to the
    // sum of their Xs and Ys positions.
    List<List<Point3d>> pts = new List<List<Point3d>>();
    DataTree<Point3d> tree = new DataTree<Point3d>();
    DataTree<double> treeSum = new DataTree<double>();
    var points = new DataTree<KeyValuePair<Point3d, double>>();
    var point = new List<Point3d>[curve.Count];
    DataTree<Point3d> treeLowerLeft = new DataTree<Point3d>();

    for(int i = 0; i < curve.Count; ++i)
    {

      pts.Add(curve[i].ToList());
      pts[i].RemoveAt(pts[i].Count - 1);
      GH_Path path = new GH_Path(i);

      for(int j = 0; j < pts[i].Count; ++j)
      {

        tree.Add(pts[i][j], path);
        treeSum.Add(pts[i][j].X + pts[i][j].Y, path);

        points.Add(new KeyValuePair<Point3d, double>(tree.Branch(i)[j], treeSum.Branch(i)[j]), path);

        points.Branch(i).Sort(Compare2);
        points.Branch(i).Reverse();
        point[i] = (from kvp in points.Branch(i) select kvp.Key).Distinct().ToList();
        point[i].Reverse();

      }

    }

    for(int i = 0; i < tree.BranchCount; ++i)
      for(int j = 0; j < tree.Branch(i).Count; ++j)
      {

        treeLowerLeft.Add(point[i][j], new GH_Path(i));

      }

    var treeOut = new DataTree<Point3d>();

    for(int i = 0; i < treeLowerLeft.BranchCount; ++i)
      for(int j = 0; j < treeLowerLeft.Branch(i).Count; ++j)
      {

        treeOut.Add(treeLowerLeft.Branch(i)[0], new GH_Path(i));

      }

    /*
    // Create the data structures and initialize them
    DataTree<Point3d> points = new DataTree<Point3d>();
    List<List<Point3d>> lists = new List<List<Point3d>>();

    // Fill the nested list with the list of points
    for(int i = 0; i < x.Count; ++i)
    {

      lists.Add(x[i].ToList());

    }

    // Fill the data tree with the list of points
    for(int i = 0; i < lists.Count; ++i)
    {

      var path = new GH_Path(i);

      for(int j = 0; j < lists[i].Count; ++j )
      {

        points.Add(lists[i][j], path);

      }

    }
    */


    // No Fit Polygon from minkowsky difference using the clipper lib
    Polyline polyOne = curve[0];
    Polyline polyTwo = curve[curve.Count - 1];

    Point3d center = treeOut.Branch(0).ElementAt(0);
    Vector3d zAxis = Vector3d.ZAxis;
    Plane p = new Rhino.Geometry.Plane(center, zAxis);

    double tolerance = 0.001;
    List<Polyline> outCurves = new List<Polyline>();
    List<Polyline> outDisplacedCurves = new List<Polyline>();
    foreach(List<IntPoint> path in ClipperLib.Clipper.MinkowskiDiff(polyOne.ToPath2D(p, tolerance), polyTwo.ToPath2D(p, tolerance)))
    {

      Polyline plSum = path.ToPolyline(p, tolerance, true);
      outCurves.Add(plSum);

    }

    Polyline NFP = outCurves[0];

    B = NFP;
    
    List<Point3d> ptNFP;
    ptNFP = NFP.ToList();
    ptNFP.RemoveAt(0);

    List<Vector3d> vectors = new List<Vector3d>();
    for(int i = 0; i < ptNFP.Count; ++i)
    {

      vectors.Add(new Vector3d(ptNFP.ElementAt(i) - treeOut.Branch(0)[0]));

    }

    List<Curve> translated = new List<Curve>();
    Polyline[] polys = new Polyline[ptNFP.Count];
    List<List<Point3d>> polyPoint = new List<List<Point3d>>();

    List<Point3d> pointsA = new List<Point3d>();
    pointsA = polyTwo.ToList();
    pointsA.RemoveAt(pointsA.Count - 1);
    DataTree<Point3d> polyPoints = new DataTree<Point3d>();
    DataTree<Point3d> APoints = new DataTree<Point3d>();
    for(int i = 0; i < ptNFP.Count; ++i)
    {

      var path = new GH_Path(i);
      Curve oney = polyOne.ToNurbsCurve();
      oney.Translate(vectors.ElementAt(i));
      translated.Add(oney);
      translated.ElementAt(i).TryGetPolyline(out polys[i]);
      polyPoint.Add(polys[i].ToList());

      for(int j = 0; j < polyPoint[i].Count - 1; ++j)
      {

        polyPoints.Add(polyPoint[i][j], path);

      }

    }

    for(int i = 0; i < ptNFP.Count; ++i)
      for(int j = 0; j < pointsA.Count; ++j)
      {

        var path = new GH_Path(i);
        APoints.Add(pointsA[j], path);

      }

    for(int i = 0; i < polyPoints.BranchCount; ++i)
      for(int j = 0; j < polyPoints.Branch(i).Count; ++j)
      {

        APoints.Add(polyPoints.Branch(i)[j], new GH_Path(i));

      }

    var list = new Grasshopper.Kernel.Geometry.Node2List[APoints.BranchCount];
    var polyLines = new Polyline[APoints.BranchCount];
    var curvesConvex = new Curve[APoints.BranchCount];
    var convexArea = new Double[APoints.BranchCount];
    var convexSort = new List<KeyValuePair<Polyline, double>>();
    var hullSort = new List<KeyValuePair<Polyline, double>>();

    for(int i = 0; i < APoints.BranchCount; ++i)
    {

      list[i] = new Grasshopper.Kernel.Geometry.Node2List(APoints.Branch(i));
      polyLines[i] = Grasshopper.Kernel.Geometry.ConvexHull.Solver.ComputeHull(list[i]);
      curvesConvex[i] = polyLines[i].ToNurbsCurve();
      convexArea[i] = AreaMassProperties.Compute(curvesConvex[i]).Area;
      convexSort.Add(new KeyValuePair<Polyline, double>(polys[i], convexArea[i]));
      hullSort.Add(new KeyValuePair<Polyline, double>(polyLines[i], convexArea[i]));

    }

    // Output the polygons with no convex hull
    // Here is where the sorting according to area values takes place.
    convexSort.Sort(Compare1);
    convexSort.Reverse();
    // We retrieve a list of polylines from our List of KeyValuePairs
    List<Polyline> polyFinal = (from kvp in convexSort select kvp.Key).Distinct().ToList();
    polyFinal.Reverse();

    // Output the convex hull polygons
    // Here is where the sorting according to area values takes place.
    hullSort.Sort(Compare1);
    hullSort.Reverse();
    // We retrieve a list of polylines from our List of KeyValuePairs
    List<Polyline> hullFinal = (from kvp in hullSort select kvp.Key).Distinct().ToList();
    hullFinal.Reverse();

    A = polyFinal;

    //B = hullFinal[0];

    /*
    Curve booleanUnionOne = polyFinal[0].ToNurbsCurve();
    Curve booleanUnionTwo = polyTwo.ToNurbsCurve();

    var listBoolean = new List<Curve>();

    listBoolean.Add(booleanUnionOne);
    listBoolean.Add(booleanUnionTwo);

    A = Curve.CreateBooleanUnion(listBoolean).ElementAt(1);
  */
# ---------- nestingtwoitems: C# additional code ----------
  static int Compare1(KeyValuePair<Polyline, double> a, KeyValuePair<Polyline, double> b)
  {

    return a.Value.CompareTo(b.Value);

  }

  static int Compare2(KeyValuePair<Point3d, double> a, KeyValuePair<Point3d, double> b)
  {

    return a.Value.CompareTo(b.Value);

  }
# ---------- end nestingtwoitems ----------
possibleplacements = Curve(nestingtwoitems.A)
curve_2 = Curve(nestingtwoitems.B)
region_intersection = RegionIntersection(CurvesA=possibleplacements, CurvesB=sheet)
area = Area(Geometry=parttobeplaced)  # -> Area, Centroid
area_2 = Area(Geometry=region_intersection)  # -> Area, Centroid

# ---- group: NestingNoSheet / NestingNoIFP
# Ordenamiento sin lamina
number_slider = Slider(0.1, range=0..1)  # disabled
curve_3 = Curve([<curve referenced from the Rhino model> x6])  # disabled
# NestingWithNoSheet
curve_to_polyline = CurveToPolyline(Curve=curve_3, ToleranceDistance=0, ToleranceAngle=number_slider)  # -> Polyline, Segments; disabled
curve_4 = Curve(<curve referenced from the Rhino model>)  # disabled
curve_5 = Curve([<curve referenced from the Rhino model> x2])  # disabled
curve_6 = Curve([<curve referenced from the Rhino model> x2])  # disabled
curve_7 = Curve([<curve referenced from the Rhino model> x4])  # disabled
merge_3 = Merge(Data1=curve_7, Data2=curve_to_polyline.Polyline, Data3=curve_5, Data4=curve_6, Data5=curve_4)  # disabled
number_slider_2 = Slider(8, range=0..10)  # disabled
panel = Panel(merge_3)  # disabled
shift_list = ShiftList(List=merge_3, Shift=number_slider_2, Wrap=True)  # disabled
nesting = CSharpScript(
    x=shift_list,
    Reference="C:\PROGRAM FILES\COMMON FILES\MCNEEL\RHINOCEROS\5.0\PLUG-INS\CLIPPERPLUGIN (BAE0724C-D28B-4D54-9B02-806B19D157C2)\0.0.2.1\CLIPPER-0.2.2\ClipperTools.dll")  # -> out, A, B; inputs x: list of Polyline; disabled
# ---------- nesting: C# ----------
    var hulls = new List<Polyline>();
    A = NestingMultiple(x, out hulls);
    B = hulls;
# ---------- nesting: C# additional code ----------
  public List<Polyline> NestingMultiple(List<Polyline> curve, out List<Polyline> outHulls)
  {

    //curve = AreaSorting(curve);
    //curve.Reverse();
    var outer = new List<Polyline>();
    outHulls = new List<Polyline>();
    for(int i = 0; i < curve.Count - 1; ++i)
    {

      var hullFinal = new List<Polyline>();
      var x = Nesting(curve, out hullFinal);
      var finalCurve = x[0];
      var finalHull = hullFinal[0];
      var oner = curve[curve.Count - 1];
      curve.Add(finalHull);
      curve.RemoveAt(0);

      outer.Add(finalCurve);
      outer.Add(oner);
      //outer = AreaSorting(outer);
      outer.RemoveAt(i + 1);
      outHulls.Add(finalHull);

    }

    //curve = AreaSorting(curve);

    outer.Add(curve[0]);

    return outer;

  }

  public List<Polyline> Nesting(List<Polyline> curve, out List<Polyline> hullFinal)
  {

    var treeOut = PointDataTree(curve);

    Polyline[] polys;

    var APoints = ConvexHullPoints(curve, treeOut, out polys);

    List<Polyline> polyFinal;

    hullFinal = ConvexHull(APoints, polys, out polyFinal);

    return polyFinal;

  }

  public Polyline IFP(List<Polyline> curves)
  {

    var one = curves.ElementAt(0);
    var two = curves.ElementAt(curves.Count - 1);

    var points = PointDataTree(curves);

    // Inner Fit Polygon
    Point3d centerOne = points.Branch(0)[0];//ptB[ptB.Count - 1];
    Vector3d zAxis = Vector3d.ZAxis;
    Plane pO = new Rhino.Geometry.Plane(centerOne, zAxis);
    double tolerance = 0.0001;

    List<Polyline> outCurvesOne = new List<Polyline>();
    List<Polyline> outDisplacedCurvesOne = new List<Polyline>();
    foreach(List<IntPoint> path in ClipperLib.Clipper.MinkowskiDiff(one.ToPath2D(pO, tolerance), two.ToPath2D(pO, tolerance)))
    {

      Polyline plSum = path.ToPolyline(pO, tolerance, true);
      outCurvesOne.Add(plSum);

    }

    Polyline bin = outCurvesOne[1];

    return bin;

  }

  public List<Polyline> AreaSorting(List<Polyline> x)
  {

    // We want to cast(change from one data type to another) our list of polylines to curves, so that
    // we can call the AreaMassProperties class and its method .Compute to get the area of the polygons
    // after that we can now create a List of KeyValuePair to assign the area of our polygons to our
    // polygons so that we can sort them later according to their areas.
    List<Curve> one = new List<Curve>();
    double[] areas = new Double[x.Count];
    var curves = new List<KeyValuePair<Polyline, double>>();

    for(int i = 0; i < x.Count; ++i)
    {

      one.Add(x.ElementAt(i).ToNurbsCurve());
      areas[i] = AreaMassProperties.Compute(one.ElementAt(i)).Area;
      curves.Add(new KeyValuePair<Polyline, double>(x.ElementAt(i), areas[i]));

    }

    // Here is where the sorting according to area values takes place.
    curves.Sort(Compare1);
    curves.Reverse();
    // We retrieve a list of curves from our List of KeyValuePairs
    List<Polyline> curve = (from kvp in curves select kvp.Key).Distinct().ToList();
    curve.Reverse();

    return curve;

  }

  public DataTree<Point3d> PointDataTree(List<Polyline> curve)
  {

    // We create and populate trees with the points of the curves, so that we can
    // sort each of the lower left points of each of the curves according to the
    // sum of their Xs and Ys positions.
    List<List<Point3d>> pts = new List<List<Point3d>>();
    DataTree<Point3d> tree = new DataTree<Point3d>();
    DataTree<double> treeSum = new DataTree<double>();
    var points = new DataTree<KeyValuePair<Point3d, double>>();
    var point = new List<Point3d>[curve.Count];
    DataTree<Point3d> treeLowerLeft = new DataTree<Point3d>();

    for(int i = 0; i < curve.Count; ++i)
    {

      pts.Add(curve[i].ToList());
      pts[i].RemoveAt(pts[i].Count - 1);
      GH_Path path = new GH_Path(i);

      for(int j = 0; j < pts[i].Count; ++j)
      {

        tree.Add(pts[i][j], path);
        treeSum.Add(pts[i][j].X + pts[i][j].Y, path);

        points.Add(new KeyValuePair<Point3d, double>(tree.Branch(i)[j], treeSum.Branch(i)[j]), path);

        points.Branch(i).Sort(Compare2);
        points.Branch(i).Reverse();
        point[i] = (from kvp in points.Branch(i) select kvp.Key).Distinct().ToList();
        point[i].Reverse();

      }

    }

    for(int i = 0; i < tree.BranchCount; ++i)
      for(int j = 0; j < tree.Branch(i).Count; ++j)
      {

        treeLowerLeft.Add(point[i][j], new GH_Path(i));

      }

    var treeOut = new DataTree<Point3d>();

    for(int i = 0; i < treeLowerLeft.BranchCount; ++i)
      for(int j = 0; j < treeLowerLeft.Branch(i).Count; ++j)
      {

        treeOut.Add(treeLowerLeft.Branch(i)[0], new GH_Path(i));

      }

    return treeOut;

  }

  public DataTree<Point3d> ConvexHullPoints(List<Polyline> curve, DataTree<Point3d> treeOut, out Polyline[] polys)
  {

    // No Fit Polygon from minkowsky difference using the clipper lib
    Polyline polyOne = curve[0];
    Polyline polyTwo = curve[curve.Count - 1];

    Point3d center = treeOut.Branch(0).ElementAt(0);
    Vector3d zAxis = Vector3d.ZAxis;
    Plane p = new Rhino.Geometry.Plane(center, zAxis);

    double tolerance = 0.001;
    List<Polyline> outCurves = new List<Polyline>();
    List<Polyline> outDisplacedCurves = new List<Polyline>();
    foreach(List<IntPoint> path in ClipperLib.Clipper.MinkowskiDiff(polyOne.ToPath2D(p, tolerance), polyTwo.ToPath2D(p, tolerance)))
    {

      Polyline plSum = path.ToPolyline(p, tolerance, true);
      outCurves.Add(plSum);

    }

    Polyline NFP = outCurves[0];

    List<Point3d> ptNFP;
    ptNFP = NFP.ToList();
    ptNFP.RemoveAt(0);

    List<Vector3d> vectors = new List<Vector3d>();
    for(int i = 0; i < ptNFP.Count; ++i)
    {

      vectors.Add(new Vector3d(ptNFP.ElementAt(i) - treeOut.Branch(0)[0]));

    }

    List<Curve> translated = new List<Curve>();
    polys = new Polyline[ptNFP.Count];
    List<List<Point3d>> polyPoint = new List<List<Point3d>>();

    List<Point3d> pointsA = new List<Point3d>();
    pointsA = polyTwo.ToList();
    pointsA.RemoveAt(pointsA.Count - 1);
    DataTree<Point3d> polyPoints = new DataTree<Point3d>();
    DataTree<Point3d> APoints = new DataTree<Point3d>();
    for(int i = 0; i < ptNFP.Count; ++i)
    {

      var path = new GH_Path(i);
      Curve oney = polyOne.ToNurbsCurve();
      oney.Translate(vectors.ElementAt(i));
      translated.Add(oney);
      translated.ElementAt(i).TryGetPolyline(out polys[i]);
      polyPoint.Add(polys[i].ToList());

      for(int j = 0; j < polyPoint[i].Count - 1; ++j)
      {

        polyPoints.Add(polyPoint[i][j], path);

      }

    }

    for(int i = 0; i < ptNFP.Count; ++i)
      for(int j = 0; j < pointsA.Count; ++j)
      {

        var path = new GH_Path(i);
        APoints.Add(pointsA[j], path);

      }

    for(int i = 0; i < polyPoints.BranchCount; ++i)
      for(int j = 0; j < polyPoints.Branch(i).Count; ++j)
      {

        APoints.Add(polyPoints.Branch(i)[j], new GH_Path(i));

      }

    return APoints;

  }

  public List<Polyline> ConvexHull(DataTree<Point3d> APoints, Polyline[] polys, out List<Polyline> polyFinal)
  {

    var list = new Grasshopper.Kernel.Geometry.Node2List[APoints.BranchCount];
    var polyLines = new Polyline[APoints.BranchCount];
    var curvesConvex = new Curve[APoints.BranchCount];
    var convexArea = new Double[APoints.BranchCount];
    var convexSort = new List<KeyValuePair<Polyline, double>>();
    var hullSort = new List<KeyValuePair<Polyline, double>>();

    for(int i = 0; i < APoints.BranchCount; ++i)
    {

      list[i] = new Grasshopper.Kernel.Geometry.Node2List(APoints.Branch(i));
      polyLines[i] = Grasshopper.Kernel.Geometry.ConvexHull.Solver.ComputeHull(list[i]);
      curvesConvex[i] = polyLines[i].ToNurbsCurve();
      convexArea[i] = AreaMassProperties.Compute(curvesConvex[i]).Area;
      convexSort.Add(new KeyValuePair<Polyline, double>(polys[i], convexArea[i]));
      hullSort.Add(new KeyValuePair<Polyline, double>(polyLines[i], convexArea[i]));

    }

    // Output the polygons with no convex hull
    // Here is where the sorting according to area values takes place.
    convexSort.Sort(Compare1);
    convexSort.Reverse();
    // We retrieve a list of polylines from our List of KeyValuePairs
    polyFinal = (from kvp in convexSort select kvp.Key).Distinct().ToList();
    polyFinal.Reverse();

    // Output the convex hull polygons
    // Here is where the sorting according to area values takes place.
    hullSort.Sort(Compare1);
    hullSort.Reverse();
    // We retrieve a list of polylines from our List of KeyValuePairs
    List<Polyline> hullFinal = (from kvp in hullSort select kvp.Key).Distinct().ToList();
    hullFinal.Reverse();

    return hullFinal;

  }

  static int Compare1(KeyValuePair<Polyline, double> a, KeyValuePair<Polyline, double> b)
  {

    return a.Value.CompareTo(b.Value);

  }

  static int Compare2(KeyValuePair<Point3d, double> a, KeyValuePair<Point3d, double> b)
  {

    return a.Value.CompareTo(b.Value);

  }
# ---------- end nesting ----------
outputconvexhulls = Curve(nesting.B)  # disabled
outputcurves = Curve(nesting.A)  # disabled

# ----
integer = Integer(area.Area)
integer_2 = Integer(area_2.Area)
evaluate = Evaluate(Expression="If(x=y, True, False)", x=integer, y=integer_2)
# Test de Inclusión
dispatch = Dispatch(List=region_intersection, DispatchPattern=evaluate)  # -> ListA, ListB
curve_8 = Curve(dispatch.ListA)
discontinuity = Discontinuity(Curve=placedpart, Level=1)  # -> Points, Parameters
graft_tree = GraftTree(Tree=curve_8, IncludeEmptyLists=True, IncludeNullItems=True)
discontinuity_2 = Discontinuity(Curve=graft_tree, Level=1)  # -> Points, Parameters
c_script = CSharpScript(x=simplify(discontinuity_2.Points), y=discontinuity.Points)  # -> out, A; inputs x: tree of Point3d, y: list of Point3d
# ---------- c_script: C# ----------
    if(x.BranchCount > 1 )
    {

      for(int i = 0; i < x.BranchCount; ++i)
        for(int j = 0; j < y.Count; ++j)
        {

          x.Add(y[j], new GH_Path(i));

        }

    }

    else
    {

      for(int i = 0; i < y.Count; ++i)
      {

        x.Add(y[i]);

      }

    }

    A = x;
# ---------- end c_script ----------
convex_hull = ConvexHull(Points=c_script.A, Plane=PlaneXY(0, 0, 0))  # -> flatten(Hull), HullZ, Indices
area_3 = Area(Geometry=convex_hull.Hull)  # -> Area, Centroid
number_slider_3 = Slider(0, range=0..2)
sort_list = SortList(Keys=area_3.Area, ValuesValuesA=curve_8)  # -> Keys, ValuesValuesA
sort_list_2 = SortList(Keys=area_3.Area, ValuesValuesA=convex_hull.Hull)  # -> Keys, ValuesValuesA
list_item = ListItem(List=sort_list.ValuesValuesA, Index=number_slider_3, Wrap=True)
list_item_2 = ListItem(List=sort_list_2.ValuesValuesA, Index=number_slider_3, Wrap=True)
# Trabajo en Proceso
number_slider_4 = Slider(27, range=0..100)
number_slider_5 = Slider(487, range=0..1000)
brep = Brep([list_item, placedpart])
discontinuity_3 = Discontinuity(Curve=brep, Level=1)  # -> flatten(Points), Parameters
divide_curve = DivideCurve(Curve=brep, Count=Slider(75, range=0..100), Kinks=False)  # -> flatten(Points), Tangents, Parameters
sdivide = DivideSurface(Surface=brep, UCount=number_slider_4, VCount=number_slider_4)  # -> flatten(Points), Normals, Parameters
pt = Point([sdivide.Points, discontinuity_3.Points, divide_curve.Points])
concave_hull_from_delaunay = ConcaveHullFromDelaunay(PointsIn=pt, Attrition=Slider(1.1, range=0..5))
convex_hull_2 = ConvexHull(Points=pt, Plane=PlaneXY(0, 0, 0))  # -> Hull, HullZ, Indices
list_length = ListLength(List=concave_hull_from_delaunay)
list_item_3 = ListItem(List=concave_hull_from_delaunay, Index=list_length, Wrap=True)
region_difference = RegionDifference(CurvesA=sheet, CurvesB=list_item_3)
curve_9 = Curve(<curve referenced from the Rhino model>)
curve_10 = Curve(<curve referenced from the Rhino model>)
curve_to_polyline_2 = CurveToPolyline(Curve=curve_9, ToleranceDistance=0.1, ToleranceAngle=0)  # -> Polyline, Segments
crv = Curve(<curve referenced from the Rhino model>)
curve_11 = Curve(<curve referenced from the Rhino model>)
merge_4 = Merge(Data1=curve_11, Data2=list_item_3)  # -> flatten(Result)
nestingtwoitems_2 = CSharpScript(
    x=merge_4,
    Reference="C:\PROGRAM FILES\COMMON FILES\MCNEEL\RHINOCEROS\5.0\PLUG-INS\CLIPPERPLUGIN (BAE0724C-D28B-4D54-9B02-806B19D157C2)\0.0.2.1\CLIPPER-0.2.2\ClipperTools.dll")  # -> out, A, B; inputs x: list of Polyline
# ---------- nestingtwoitems_2: C# ----------
    // We want to cast(change from one data type to another) our list of polylines to curves, so that
    // we can call the AreaMassProperties class and its method .Compute to get the area of the polygons
    // after that we can now create a List of KeyValuePair to assign the area of our polygons to our
    // polygons so that we can sort them later according to their areas.
    /*
    List<Curve> one = new List<Curve>();
    double[] areas = new Double[x.Count];
    var curves = new List<KeyValuePair<Polyline, double>>();

    for(int i = 0; i < x.Count; ++i)
    {

    one.Add(x.ElementAt(i).ToNurbsCurve());
    areas[i] = AreaMassProperties.Compute(one.ElementAt(i)).Area;
    curves.Add(new KeyValuePair<Polyline, double>(x.ElementAt(i), areas[i]));

    }

    // Here is where the sorting according to area values takes place.
    curves.Sort(Compare1);
    curves.Reverse();
    // We retrieve a list of curves from our List of KeyValuePairs
    List<Polyline> curve = (from kvp in curves select kvp.Key).Distinct().ToList();
    curve.Reverse();
    */

    List<Polyline> curve = x;

    /*
    // We create and populate trees with the points of the curves, so that we can
    // sort each of the lower left points of each of the curves according to the
    // sum of their Xs and Ys positions.
    List<List<Point3d>> pts = new List<List<Point3d>>();
    DataTree<Point3d> tree = new DataTree<Point3d>();
    DataTree<double> treeSum = new DataTree<double>();
    var points = new DataTree<KeyValuePair<Point3d, double>>();
    var point = new List<Point3d>[curve.Count];
    DataTree<Point3d> treeLowerLeft = new DataTree<Point3d>();

    for(int i = 0; i < curve.Count; ++i)
    {

      pts.Add(curve[i].ToList());
      pts[i].RemoveAt(pts[i].Count - 1);
      GH_Path path = new GH_Path(i);

      for(int j = 0; j < pts[i].Count; ++j)
      {

        tree.Add(pts[i][j], path);
        treeSum.Add(pts[i][j].X + pts[i][j].Y, path);

        points.Add(new KeyValuePair<Point3d, double>(tree.Branch(i)[j], treeSum.Branch(i)[j]), path);

        points.Branch(i).Sort(Compare2);
        points.Branch(i).Reverse();
        point[i] = (from kvp in points.Branch(i) select kvp.Key).Distinct().ToList();
        point[i].Reverse();

      }

    }

    for(int i = 0; i < tree.BranchCount; ++i)
      for(int j = 0; j < tree.Branch(i).Count; ++j)
      {

        treeLowerLeft.Add(point[i][j], new GH_Path(i));

      }

    var treeOut = new DataTree<Point3d>();

    for(int i = 0; i < treeLowerLeft.BranchCount; ++i)
      for(int j = 0; j < treeLowerLeft.Branch(i).Count; ++j)
      {

        treeOut.Add(treeLowerLeft.Branch(i)[0], new GH_Path(i));

      }

    /*
    // Create the data structures and initialize them
    DataTree<Point3d> points = new DataTree<Point3d>();
    List<List<Point3d>> lists = new List<List<Point3d>>();

    // Fill the nested list with the list of points
    for(int i = 0; i < x.Count; ++i)
    {

      lists.Add(x[i].ToList());

    }

    // Fill the data tree with the list of points
    for(int i = 0; i < lists.Count; ++i)
    {

      var path = new GH_Path(i);

      for(int j = 0; j < lists[i].Count; ++j )
      {

        points.Add(lists[i][j], path);

      }

    }
    */

    // No Fit Polygon from minkowsky difference using the clipper lib
    Polyline polyOne = curve[0];
    Polyline polyTwo = curve[curve.Count - 1];

    Point3d center = LowerLeftPoint(polyOne);
    Vector3d zAxis = Vector3d.ZAxis;
    Plane p = new Rhino.Geometry.Plane(center, zAxis);

    double tolerance = 0.001;
    List<Polyline> outCurves = new List<Polyline>();
    List<Polyline> outDisplacedCurves = new List<Polyline>();
    foreach(List<IntPoint> path in ClipperLib.Clipper.MinkowskiDiff(polyOne.ToPath2D(p, tolerance), polyTwo.ToPath2D(p, tolerance)))
    {

      Polyline plSum = path.ToPolyline(p, tolerance, true);
      outCurves.Add(plSum);

    }

    Polyline NFP = outCurves[0];

    B = NFP;

    List<Point3d> ptNFP;
    ptNFP = NFP.ToList();
    ptNFP.RemoveAt(0);

    List<Vector3d> vectors = new List<Vector3d>();
    for(int i = 0; i < ptNFP.Count; ++i)
    {

      vectors.Add(new Vector3d(ptNFP.ElementAt(i) - center));

    }

    List<Curve> translated = new List<Curve>();
    Polyline[] polys = new Polyline[ptNFP.Count];
    List<List<Point3d>> polyPoint = new List<List<Point3d>>();

    List<Point3d> pointsA = new List<Point3d>();
    pointsA = polyTwo.ToList();
    pointsA.RemoveAt(pointsA.Count - 1);
    DataTree<Point3d> polyPoints = new DataTree<Point3d>();
    DataTree<Point3d> APoints = new DataTree<Point3d>();
    for(int i = 0; i < ptNFP.Count; ++i)
    {

      var path = new GH_Path(i);
      Curve oney = polyOne.ToNurbsCurve();
      oney.Translate(vectors.ElementAt(i));
      translated.Add(oney);
      translated.ElementAt(i).TryGetPolyline(out polys[i]);
      polyPoint.Add(polys[i].ToList());

      for(int j = 0; j < polyPoint[i].Count - 1; ++j)
      {

        polyPoints.Add(polyPoint[i][j], path);

      }

    }

    for(int i = 0; i < ptNFP.Count; ++i)
      for(int j = 0; j < pointsA.Count; ++j)
      {

        var path = new GH_Path(i);
        APoints.Add(pointsA[j], path);

      }

    for(int i = 0; i < polyPoints.BranchCount; ++i)
      for(int j = 0; j < polyPoints.Branch(i).Count; ++j)
      {

        APoints.Add(polyPoints.Branch(i)[j], new GH_Path(i));

      }

    var list = new Grasshopper.Kernel.Geometry.Node2List[APoints.BranchCount];
    var polyLines = new Polyline[APoints.BranchCount];
    var curvesConvex = new Curve[APoints.BranchCount];
    var convexArea = new Double[APoints.BranchCount];
    var convexSort = new List<KeyValuePair<Polyline, double>>();
    var hullSort = new List<KeyValuePair<Polyline, double>>();

    for(int i = 0; i < APoints.BranchCount; ++i)
    {

      list[i] = new Grasshopper.Kernel.Geometry.Node2List(APoints.Branch(i));
      polyLines[i] = Grasshopper.Kernel.Geometry.ConvexHull.Solver.ComputeHull(list[i]);
      curvesConvex[i] = polyLines[i].ToNurbsCurve();
      convexArea[i] = AreaMassProperties.Compute(curvesConvex[i]).Area;
      convexSort.Add(new KeyValuePair<Polyline, double>(polys[i], convexArea[i]));
      hullSort.Add(new KeyValuePair<Polyline, double>(polyLines[i], convexArea[i]));

    }

    // Output the polygons with no convex hull
    // Here is where the sorting according to area values takes place.
    convexSort.Sort(Compare1);
    convexSort.Reverse();
    // We retrieve a list of polylines from our List of KeyValuePairs
    List<Polyline> polyFinal = (from kvp in convexSort select kvp.Key).Distinct().ToList();
    polyFinal.Reverse();

    // Output the convex hull polygons
    // Here is where the sorting according to area values takes place.
    hullSort.Sort(Compare1);
    hullSort.Reverse();
    // We retrieve a list of polylines from our List of KeyValuePairs
    List<Polyline> hullFinal = (from kvp in hullSort select kvp.Key).Distinct().ToList();
    hullFinal.Reverse();

    A = polyFinal;

    //B = hullFinal[0];

    /*
    Curve booleanUnionOne = polyFinal[0].ToNurbsCurve();
    Curve booleanUnionTwo = polyTwo.ToNurbsCurve();

    var listBoolean = new List<Curve>();

    listBoolean.Add(booleanUnionOne);
    listBoolean.Add(booleanUnionTwo);

    A = Curve.CreateBooleanUnion(listBoolean).ElementAt(1);
    */
# ---------- nestingtwoitems_2: C# additional code ----------
  private Point3d LowerLeftPoint(Polyline poly)
  {

    // We need the on the lower left corner to produce the NFP of the bin and the first placement
    List<Point3d> pointsList = new List<Point3d>();
    pointsList = poly.ToList();
    pointsList.RemoveAt(pointsList.Count - 1);

    Point3d[] points = pointsList.ToArray();
    double[] keys = new Double[points.Length];

    for (int i = 0; i < points.Length; ++i)
    {

      keys[i] = points[i].X + points[i].Y;

    }

    Array.Sort(keys, points);

    return points[0];

  }

  static int Compare1(KeyValuePair<Polyline, double> a, KeyValuePair<Polyline, double> b)
  {

    return a.Value.CompareTo(b.Value);

  }

  static int Compare2(KeyValuePair<Point3d, double> a, KeyValuePair<Point3d, double> b)
  {

    return a.Value.CompareTo(b.Value);

  }
# ---------- end nestingtwoitems_2 ----------
possibleplacements_2 = Curve(nestingtwoitems_2.A)
nofitpolygon = Curve(nestingtwoitems_2.B)
curve_12 = Curve()
brep_brep = BrepBrep(BrepA=possibleplacements_2, BrepB=region_difference)  # -> flatten(Curves), Points
number_slider_6 = Slider(0, range=0..500)
closed = Closed(Curve=brep_brep.Curves)  # -> Closed, Periodic
rad = Radians(Degrees=expr("-x", number_slider_6))
cull_pattern = CullPattern(List=brep_brep.Curves, CullPattern=closed.Closed)
curve_13 = Curve(cull_pattern)
area_4 = Area(Geometry=crv)  # -> Area, Centroid
area_5 = Area(Geometry=curve_to_polyline_2.Polyline)  # -> Area, Centroid
area_6 = Area(Geometry=curve_13)  # -> Area, Centroid
area_7 = Area(Geometry=curve_11)  # -> Area, Centroid
area_8 = Area(Geometry=curve_10)  # -> Area, Centroid
panel_2 = Panel(area_4.Area)
panel_3 = Panel(area_5.Area)
panel_4 = Panel(area_7.Area)
panel_5 = Panel(area_6.Area)
panel_6 = Panel(area_8.Area)
evaluate_2 = Evaluate(Expression="If(x=y, True, False)", x=panel_4, y=panel_5)
text_split = TextSplit(Text=panel_3, Separators=".")
dispatch_2 = Dispatch(List=curve_13, DispatchPattern=evaluate_2)  # -> ListA, ListB
text_split_2 = TextSplit(Text=panel_6, Separators=".")
panel_7 = Panel(text_split)
curve_14 = Curve(dispatch_2.ListA)
panel_8 = Panel(text_split_2)
list_item_4 = ListItem(List=panel_7, Index=0, Wrap=True)  # -> flatten(Item)
list_item_5 = ListItem(List=panel_8, Index=0, Wrap=True)  # -> flatten(Item)
panel_9 = Panel(list_item_4)
panel_10 = Panel(list_item_5)
graft_tree_2 = GraftTree(Tree=curve_14, IncludeEmptyLists=True, IncludeNullItems=True)
face_circles = FaceCircles()  # -> Centers, Ratio
discontinuity_4 = Discontinuity(Curve=list_item_3, Level=1)  # -> Points, Parameters
discontinuity_5 = Discontinuity(Curve=graft_tree_2, Level=1)  # -> Points, Parameters
number_slider_7 = Slider(0, range=0..1)  # disabled
pointtree = CSharpScript(x=simplify(discontinuity_5.Points), y=discontinuity_4.Points)  # -> out, A; inputs x: tree of Point3d, y: list of Point3d
# ---------- pointtree: C# ----------
    for(int i = 0; i < x.BranchCount; ++i)
      for(int j = 0; j < y.Count; ++j)
      {
      
        x.Add(y[j], new GH_Path(i));
        
      }
    
    A = x;
# ---------- end pointtree ----------
convex_hull_3 = ConvexHull(Points=pointtree.A, Plane=PlaneXY(0, 0, 0))  # -> flatten(Hull), HullZ, Indices
area_9 = Area(Geometry=convex_hull_3.Hull)  # -> Area, Centroid
sort_list_3 = SortList(Keys=area_9.Area, ValuesValuesA=curve_14)  # -> Keys, ValuesValuesA
sort_list_4 = SortList(Keys=area_9.Area, ValuesValuesA=convex_hull_3.Hull)  # -> Keys, ValuesValuesA
list_item_6 = ListItem(List=sort_list_4.ValuesValuesA, Index=0, Wrap=True)
list_item_7 = ListItem(List=sort_list_3.ValuesValuesA, Index=0, Wrap=True)
number_slider_8 = Slider(19, range=0..100)
crv_2 = Curve([placedpart, list_item, list_item_7])
number_slider_9 = Slider(15, range=0..100)
brep_2 = Brep([list_item_7, list_item_3])
number_slider_10 = Slider(21, range=0..100)
number_slider_11 = Slider(421, range=0..1000)
number_slider_12 = Slider(30, range=0..100)
divide_curve_2 = DivideCurve(Curve=brep_2, Count=Slider(100, range=0..100), Kinks=False)  # -> flatten(Points), Tangents, Parameters
discontinuity_6 = Discontinuity(Curve=brep_2, Level=1)  # -> flatten(Points), Parameters
sdivide_2 = DivideSurface(Surface=brep_2, UCount=number_slider_12, VCount=number_slider_12)  # -> flatten(Points), Normals, Parameters
mesh_edges = MeshEdges()  # -> NakedEdges, InteriorEdges, NonManifoldEdges
mesh_edges_2 = MeshEdges()  # -> NakedEdges, InteriorEdges, NonManifoldEdges
concave_hull_from_delaunay_2 = ConcaveHullFromDelaunay(PointsIn=[sdivide_2.Points, discontinuity_6.Points, divide_curve_2.Points], Attrition=Slider(1.1, range=0..5))  # -> reverse(ConcaveHullOut)
pt_2 = Point([discontinuity_6.Points, divide_curve_2.Points, sdivide_2.Points])
list_length_2 = ListLength(List=concave_hull_from_delaunay_2)
convex_hull_4 = ConvexHull(Plane=PlaneXY(0, 0, 0))  # -> Hull, HullZ, Indices
brep_3 = Brep()
brep_4 = Brep()
list_item_8 = ListItem(List=concave_hull_from_delaunay_2, Index=list_length_2, Wrap=True)
region_difference_2 = RegionDifference(CurvesA=region_difference, CurvesB=list_item_8)
merge_5 = Merge(Data1=curve_10, Data2=list_item_8)  # -> flatten(Result)
nestingtwoitems_3 = CSharpScript(
    x=merge_5,
    Reference="C:\PROGRAM FILES\COMMON FILES\MCNEEL\RHINOCEROS\5.0\PLUG-INS\CLIPPERPLUGIN (BAE0724C-D28B-4D54-9B02-806B19D157C2)\0.0.2.1\CLIPPER-0.2.2\ClipperTools.dll")  # -> out, A, B; inputs x: list of Polyline; same code as nestingtwoitems_2
curve_15 = Curve(nestingtwoitems_3.A)
region_intersection_2 = RegionIntersection(CurvesA=curve_15, CurvesB=region_difference_2)
area_10 = Area(Geometry=region_intersection_2)  # -> Area, Centroid
panel_11 = Panel(area_10.Area)
text_split_3 = TextSplit(Text=area_10.Area, Separators=".")
panel_12 = Panel(text_split_3)
list_item_9 = ListItem(List=panel_12, Index=0, Wrap=True)  # -> flatten(Item)
panel_13 = Panel(list_item_9)
evaluate_3 = Evaluate(Expression="If(x=y, True, False)", x=panel_10, y=panel_13)
dispatch_3 = Dispatch(List=region_intersection_2, DispatchPattern=evaluate_3)  # -> ListA, ListB
discontinuity_7 = Discontinuity(Curve=list_item_8, Level=1)  # -> Points, Parameters
curve_16 = Curve(dispatch_3.ListA)
graft_tree_3 = GraftTree(Tree=curve_16, IncludeEmptyLists=True, IncludeNullItems=True)
discontinuity_8 = Discontinuity(Curve=graft_tree_3, Level=1)  # -> Points, Parameters
c_script_2 = CSharpScript(x=simplify(discontinuity_8.Points), y=discontinuity_7.Points)  # -> out, A; inputs x: tree of Point3d, y: list of Point3d; same code as pointtree
convex_hull_5 = ConvexHull(Points=c_script_2.A, Plane=PlaneXY(0, 0, 0))  # -> flatten(Hull), HullZ, Indices
area_11 = Area(Geometry=convex_hull_5.Hull)  # -> Area, Centroid
sort_list_5 = SortList(Keys=area_11.Area, ValuesValuesA=curve_16)  # -> Keys, ValuesValuesA
list_item_10 = ListItem(List=sort_list_5.ValuesValuesA, Index=0, Wrap=True)
brep_5 = Brep([list_item_8, list_item_10])
discontinuity_9 = Discontinuity(Curve=brep_5, Level=1)  # -> flatten(Points), Parameters
divide_curve_3 = DivideCurve(Curve=brep_5, Count=Slider(62, range=0..100), Kinks=False)  # -> flatten(Points), Tangents, Parameters
sdivide_3 = DivideSurface(Surface=brep_5, UCount=number_slider_10, VCount=number_slider_10)  # -> flatten(Points), Normals, Parameters
concave_hull_from_delaunay_3 = ConcaveHullFromDelaunay(PointsIn=[sdivide_3.Points, discontinuity_9.Points, divide_curve_3.Points], Attrition=Slider(1.1, range=0..5))
list_length_3 = ListLength(List=concave_hull_from_delaunay_3)
list_item_11 = ListItem(List=concave_hull_from_delaunay_3, Index=list_length_3, Wrap=True)
region_difference_3 = RegionDifference(CurvesA=region_difference_2, CurvesB=list_item_11)
merge_6 = Merge(Data1=curve_to_polyline_2.Polyline, Data2=list_item_11)  # -> flatten(Result)
nestingtwoitems_4 = CSharpScript(
    x=merge_6,
    Reference="C:\PROGRAM FILES\COMMON FILES\MCNEEL\RHINOCEROS\5.0\PLUG-INS\CLIPPERPLUGIN (BAE0724C-D28B-4D54-9B02-806B19D157C2)\0.0.2.1\CLIPPER-0.2.2\ClipperTools.dll")  # -> out, A, B; inputs x: list of Polyline; same code as nestingtwoitems_2
curve_17 = Curve(nestingtwoitems_4.A)
region_intersection_3 = RegionIntersection(CurvesA=curve_17, CurvesB=region_difference_3)
area_12 = Area(Geometry=region_intersection_3)  # -> Area, Centroid
panel_14 = Panel(area_12.Area)
text_split_4 = TextSplit(Text=area_12.Area, Separators=".")
panel_15 = Panel(text_split_4)
list_item_12 = ListItem(List=panel_15, Index=0, Wrap=True)  # -> flatten(Item)
panel_16 = Panel(list_item_12)
evaluate_4 = Evaluate(Expression="If(x=y, True, False)", x=panel_3, y=panel_14)
dispatch_4 = Dispatch(List=region_intersection_3, DispatchPattern=evaluate_4)  # -> ListA, ListB
discontinuity_10 = Discontinuity(Curve=list_item_11, Level=1)  # -> Points, Parameters; disabled
curve_18 = Curve(dispatch_4.ListA)
graft_tree_4 = GraftTree(Tree=curve_18, IncludeEmptyLists=True, IncludeNullItems=True)
discontinuity_11 = Discontinuity(Curve=graft_tree_4, Level=1)  # -> Points, Parameters
c_script_3 = CSharpScript(x=simplify(discontinuity_11.Points), y=discontinuity_10.Points)  # -> out, A; inputs x: tree of Point3d, y: list of Point3d; same code as pointtree
convex_hull_6 = ConvexHull(Points=c_script_3.A, Plane=PlaneXY(0, 0, 0))  # -> flatten(Hull), HullZ, Indices
area_13 = Area(Geometry=convex_hull_6.Hull)  # -> Area, Centroid
sort_list_6 = SortList(Keys=area_13.Area, ValuesValuesA=curve_18)  # -> Keys, ValuesValuesA
list_item_13 = ListItem(List=sort_list_6.ValuesValuesA, Index=0, Wrap=True)
brep_6 = Brep([list_item_11, list_item_13])
discontinuity_12 = Discontinuity(Curve=brep_6, Level=1)  # -> flatten(Points), Parameters
divide_curve_4 = DivideCurve(Curve=brep_6, Count=Slider(68, range=0..100), Kinks=False)  # -> flatten(Points), Tangents, Parameters
sdivide_4 = DivideSurface(Surface=brep_6, UCount=number_slider_9, VCount=number_slider_9)  # -> flatten(Points), Normals, Parameters
point = Point([discontinuity_12.Points, divide_curve_4.Points, sdivide_4.Points])
concave_hull_from_delaunay_4 = ConcaveHullFromDelaunay(PointsIn=point, Attrition=Slider(1.1, range=0..5))  # -> reverse(ConcaveHullOut)
region_difference_4 = RegionDifference(CurvesA=region_difference_2, CurvesB=concave_hull_from_delaunay_4)
merge_7 = Merge(Data1=crv, Data2=concave_hull_from_delaunay_4)  # -> flatten(Result)
nestingtwoitems_5 = CSharpScript(
    x=merge_7,
    Reference="C:\PROGRAM FILES\COMMON FILES\MCNEEL\RHINOCEROS\5.0\PLUG-INS\CLIPPERPLUGIN (BAE0724C-D28B-4D54-9B02-806B19D157C2)\0.0.2.1\CLIPPER-0.2.2\ClipperTools.dll")  # -> out, A, B; inputs x: list of Polyline
# ---------- nestingtwoitems_5: C# ----------
    // We want to cast(change from one data type to another) our list of polylines to curves, so that
    // we can call the AreaMassProperties class and its method .Compute to get the area of the polygons
    // after that we can now create a List of KeyValuePair to assign the area of our polygons to our
    // polygons so that we can sort them later according to their areas.
    /*
    List<Curve> one = new List<Curve>();
    double[] areas = new Double[x.Count];
    var curves = new List<KeyValuePair<Polyline, double>>();

    for(int i = 0; i < x.Count; ++i)
    {

    one.Add(x.ElementAt(i).ToNurbsCurve());
    areas[i] = AreaMassProperties.Compute(one.ElementAt(i)).Area;
    curves.Add(new KeyValuePair<Polyline, double>(x.ElementAt(i), areas[i]));

    }

    // Here is where the sorting according to area values takes place.
    curves.Sort(Compare1);
    curves.Reverse();
    // We retrieve a list of curves from our List of KeyValuePairs
    List<Polyline> curve = (from kvp in curves select kvp.Key).Distinct().ToList();
    curve.Reverse();
    */

    List<Polyline> curve = x;

    /*
    // We create and populate trees with the points of the curves, so that we can
    // sort each of the lower left points of each of the curves according to the
    // sum of their Xs and Ys positions.
    List<List<Point3d>> pts = new List<List<Point3d>>();
    DataTree<Point3d> tree = new DataTree<Point3d>();
    DataTree<double> treeSum = new DataTree<double>();
    var points = new DataTree<KeyValuePair<Point3d, double>>();
    var point = new List<Point3d>[curve.Count];
    DataTree<Point3d> treeLowerLeft = new DataTree<Point3d>();

    for(int i = 0; i < curve.Count; ++i)
    {

      pts.Add(curve[i].ToList());
      pts[i].RemoveAt(pts[i].Count - 1);
      GH_Path path = new GH_Path(i);

      for(int j = 0; j < pts[i].Count; ++j)
      {

        tree.Add(pts[i][j], path);
        treeSum.Add(pts[i][j].X + pts[i][j].Y, path);

        points.Add(new KeyValuePair<Point3d, double>(tree.Branch(i)[j], treeSum.Branch(i)[j]), path);

        points.Branch(i).Sort(Compare2);
        points.Branch(i).Reverse();
        point[i] = (from kvp in points.Branch(i) select kvp.Key).Distinct().ToList();
        point[i].Reverse();

      }

    }

    for(int i = 0; i < tree.BranchCount; ++i)
      for(int j = 0; j < tree.Branch(i).Count; ++j)
      {

        treeLowerLeft.Add(point[i][j], new GH_Path(i));

      }

    var treeOut = new DataTree<Point3d>();

    for(int i = 0; i < treeLowerLeft.BranchCount; ++i)
      for(int j = 0; j < treeLowerLeft.Branch(i).Count; ++j)
      {

        treeOut.Add(treeLowerLeft.Branch(i)[0], new GH_Path(i));

      }

    /*
    // Create the data structures and initialize them
    DataTree<Point3d> points = new DataTree<Point3d>();
    List<List<Point3d>> lists = new List<List<Point3d>>();

    // Fill the nested list with the list of points
    for(int i = 0; i < x.Count; ++i)
    {

      lists.Add(x[i].ToList());

    }

    // Fill the data tree with the list of points
    for(int i = 0; i < lists.Count; ++i)
    {

      var path = new GH_Path(i);

      for(int j = 0; j < lists[i].Count; ++j )
      {

        points.Add(lists[i][j], path);

      }

    }
    */

    // No Fit Polygon from minkowsky difference using the clipper lib
    Polyline polyOne = curve[0];
    Polyline polyTwo = curve[curve.Count - 1];

    Point3d center = LowerLeftPoint(polyOne);
    Vector3d zAxis = Vector3d.ZAxis;
    Plane p = new Rhino.Geometry.Plane(center, zAxis);

    double tolerance = 0.00001;
    List<Polyline> outCurves = new List<Polyline>();
    List<Polyline> outDisplacedCurves = new List<Polyline>();
    foreach(List<IntPoint> path in ClipperLib.Clipper.MinkowskiDiff(polyOne.ToPath2D(p, tolerance), polyTwo.ToPath2D(p, tolerance)))
    {

      Polyline plSum = path.ToPolyline(p, tolerance, true);
      outCurves.Add(plSum);

    }

    Polyline NFP = outCurves[0];

    B = NFP;

    List<Point3d> ptNFP;
    ptNFP = NFP.ToList();
    ptNFP.RemoveAt(0);

    List<Vector3d> vectors = new List<Vector3d>();
    for(int i = 0; i < ptNFP.Count; ++i)
    {

      vectors.Add(new Vector3d(ptNFP.ElementAt(i) - center));

    }

    List<Curve> translated = new List<Curve>();
    Polyline[] polys = new Polyline[ptNFP.Count];
    List<List<Point3d>> polyPoint = new List<List<Point3d>>();

    List<Point3d> pointsA = new List<Point3d>();
    pointsA = polyTwo.ToList();
    pointsA.RemoveAt(pointsA.Count - 1);
    DataTree<Point3d> polyPoints = new DataTree<Point3d>();
    DataTree<Point3d> APoints = new DataTree<Point3d>();
    for(int i = 0; i < ptNFP.Count; ++i)
    {

      var path = new GH_Path(i);
      Curve oney = polyOne.ToNurbsCurve();
      oney.Translate(vectors.ElementAt(i));
      translated.Add(oney);
      translated.ElementAt(i).TryGetPolyline(out polys[i]);
      polyPoint.Add(polys[i].ToList());

      for(int j = 0; j < polyPoint[i].Count - 1; ++j)
      {

        polyPoints.Add(polyPoint[i][j], path);

      }

    }

    for(int i = 0; i < ptNFP.Count; ++i)
      for(int j = 0; j < pointsA.Count; ++j)
      {

        var path = new GH_Path(i);
        APoints.Add(pointsA[j], path);

      }

    for(int i = 0; i < polyPoints.BranchCount; ++i)
      for(int j = 0; j < polyPoints.Branch(i).Count; ++j)
      {

        APoints.Add(polyPoints.Branch(i)[j], new GH_Path(i));

      }

    var list = new Grasshopper.Kernel.Geometry.Node2List[APoints.BranchCount];
    var polyLines = new Polyline[APoints.BranchCount];
    var curvesConvex = new Curve[APoints.BranchCount];
    var convexArea = new Double[APoints.BranchCount];
    var convexSort = new List<KeyValuePair<Polyline, double>>();
    var hullSort = new List<KeyValuePair<Polyline, double>>();

    for(int i = 0; i < APoints.BranchCount; ++i)
    {

      list[i] = new Grasshopper.Kernel.Geometry.Node2List(APoints.Branch(i));
      polyLines[i] = Grasshopper.Kernel.Geometry.ConvexHull.Solver.ComputeHull(list[i]);
      curvesConvex[i] = polyLines[i].ToNurbsCurve();
      convexArea[i] = AreaMassProperties.Compute(curvesConvex[i]).Area;
      convexSort.Add(new KeyValuePair<Polyline, double>(polys[i], convexArea[i]));
      hullSort.Add(new KeyValuePair<Polyline, double>(polyLines[i], convexArea[i]));

    }

    // Output the polygons with no convex hull
    // Here is where the sorting according to area values takes place.
    convexSort.Sort(Compare1);
    convexSort.Reverse();
    // We retrieve a list of polylines from our List of KeyValuePairs
    List<Polyline> polyFinal = (from kvp in convexSort select kvp.Key).Distinct().ToList();
    polyFinal.Reverse();

    // Output the convex hull polygons
    // Here is where the sorting according to area values takes place.
    hullSort.Sort(Compare1);
    hullSort.Reverse();
    // We retrieve a list of polylines from our List of KeyValuePairs
    List<Polyline> hullFinal = (from kvp in hullSort select kvp.Key).Distinct().ToList();
    hullFinal.Reverse();

    A = polyFinal;

    //B = hullFinal[0];

    /*
    Curve booleanUnionOne = polyFinal[0].ToNurbsCurve();
    Curve booleanUnionTwo = polyTwo.ToNurbsCurve();

    var listBoolean = new List<Curve>();

    listBoolean.Add(booleanUnionOne);
    listBoolean.Add(booleanUnionTwo);

    A = Curve.CreateBooleanUnion(listBoolean).ElementAt(1);
    */
# ---------- nestingtwoitems_5: C# additional code ----------
  private Point3d LowerLeftPoint(Polyline poly)
  {

    // We need the on the lower left corner to produce the NFP of the bin and the first placement
    List<Point3d> pointsList = new List<Point3d>();
    pointsList = poly.ToList();
    pointsList.RemoveAt(pointsList.Count - 1);

    Point3d[] points = pointsList.ToArray();
    double[] keys = new Double[points.Length];

    for (int i = 0; i < points.Length; ++i)
    {

      keys[i] = points[i].X + points[i].Y;

    }

    Array.Sort(keys, points);

    return points[0];

  }

  static int Compare1(KeyValuePair<Polyline, double> a, KeyValuePair<Polyline, double> b)
  {

    return a.Value.CompareTo(b.Value);

  }

  static int Compare2(KeyValuePair<Point3d, double> a, KeyValuePair<Point3d, double> b)
  {

    return a.Value.CompareTo(b.Value);

  }
# ---------- end nestingtwoitems_5 ----------
curve_19 = Curve(nestingtwoitems_5.A)
disc = Discontinuity(Curve=curve_19, Level=1)  # -> Points, Parameters
pdecon = Deconstruct(Point=disc.Points)  # -> XComponent, YComponent, ZComponent
addition = Addition(A=pdecon.XComponent, B=pdecon.YComponent)
sort = SortList(Keys=addition, ValuesA=disc.Points)  # -> Keys, ValuesA
item = ListItem(List=sort.ValuesA, Index=0, Wrap=True)  # -> flatten(Item)
rotate = Rotate(Geometry=curve_19, Angle=rad, Plane=item)  # -> Geometry, Transform
region_intersection_4 = RegionIntersection(CurvesA=rotate.Geometry, CurvesB=region_difference_4)
area_14 = Area(Geometry=region_intersection_4)  # -> Area, Centroid
panel_17 = Panel(area_14.Area)
evaluate_5 = Evaluate(Expression="If(x=y, True, False)", x=panel_2, y=panel_17)
dispatch_5 = Dispatch(List=region_intersection_4, DispatchPattern=evaluate_5)  # -> ListA, ListB
discontinuity_13 = Discontinuity(Curve=concave_hull_from_delaunay_4, Level=1)  # -> Points, Parameters
curve_20 = Curve(dispatch_5.ListA)
graft_tree_5 = GraftTree(Tree=curve_20, IncludeEmptyLists=True, IncludeNullItems=True)
discontinuity_14 = Discontinuity(Curve=graft_tree_5, Level=1)  # -> Points, Parameters
c_script_4 = CSharpScript(x=simplify(discontinuity_14.Points), y=discontinuity_13.Points)  # -> out, A; inputs x: tree of Point3d, y: list of Point3d; same code as c_script
convex_hull_7 = ConvexHull(Points=c_script_4.A, Plane=PlaneXY(0, 0, 0))  # -> flatten(Hull), HullZ, Indices
area_15 = Area(Geometry=convex_hull_7.Hull)  # -> Area, Centroid
sort_list_7 = SortList(Keys=area_15.Area, ValuesValuesA=curve_20)  # -> Keys, ValuesValuesA
list_item_14 = ListItem(List=sort_list_7.ValuesValuesA, Index=0, Wrap=True)
brep_7 = Brep([concave_hull_from_delaunay_4, list_item_14])
discontinuity_15 = Discontinuity(Curve=brep_7, Level=1)  # -> flatten(Points), Parameters
populate_geometry = PopulateGeometry(Geometry=brep_7, Count=100, Seed=1)  # -> flatten(Population)
divide_curve_5 = DivideCurve(Curve=brep_7, Count=Slider(52, range=0..100), Kinks=False)  # -> flatten(Points), Tangents, Parameters
sdivide_5 = DivideSurface(Surface=brep_7, UCount=number_slider_8, VCount=number_slider_8)  # -> flatten(Points), Normals, Parameters
point_2 = Point([discontinuity_15.Points, divide_curve_5.Points, sdivide_5.Points])
concave_hull_from_delaunay_5 = ConcaveHullFromDelaunay(PointsIn=point_2, Attrition=Slider(1.1, range=0..5))  # -> reverse(ConcaveHullOut)
list_length_4 = ListLength(List=concave_hull_from_delaunay_5)
list_length_5 = ListLength(List=concave_hull_from_delaunay_4)
list_item_15 = ListItem(List=concave_hull_from_delaunay_5, Index=list_length_4, Wrap=True)
list_item_16 = ListItem(List=concave_hull_from_delaunay_4, Index=list_length_5, Wrap=True)
area_16 = Area(Geometry=list_item_15)  # -> Area, Centroid
galapagos = Galapagos(fitness=area_16, gene=number_slider_6)
merge_8 = Merge(Data2=placedpart, Data3=list_item, Data4=list_item_7, Data5=list_item_10, Data6=list_item_13, Data7=list_item_14)
discontinuity_16 = Discontinuity(Curve=merge_8, Level=1)  # -> flatten(Points), Parameters; disabled
convex_hull_8 = ConvexHull(Points=discontinuity_16.Points, Plane=PlaneXY(0, 0, 0))  # -> Hull, HullZ, Indices; disabled
area_17 = Area(Geometry=convex_hull_8.Hull)  # -> Area, Centroid; disabled

# ----
# Diferencia de Minkowski:
# Poligono Que No Entra(No Fit Polygon)
# The upper one works but not only we
# have to manually adjust the parameter
# Attrition, but we end up getting a
# ConvexHull! Paul's works better but its
# too slow to use it inside the nesting algo
# maybe we can find a way to optimize
# Diferencia de Minkowski:
# Poligono Que Entra
# (Inner Fit Polygon)
# Geometría de Base
polygona_2 = Curve(<curve referenced from the Rhino model>)  # disabled
sheet_2 = Curve(<curve referenced from the Rhino model>)  # disabled
number_slider_13 = Slider(0, range=0..3)  # disabled
number_slider_14 = Slider(0, range=0..1)  # disabled
number_slider_15 = Slider(1, range=0..1)  # disabled

# ----
# IFP(Inner Fit Polygon)
# El Inner Fit Polygon describe la moción
# de un polígono estacionario dentro de
# un polígono que lo orbita, resultando en
# todas las posibles posiciones del
# polígono a transladar sobre el estacionario
# sin que estos se yuxtapongan.
# Después de obtener el nuevo polígono
# construimos los vectores de translación
# entre los puntos del IFP y el punto de
# más a la izquierda y más abajo, en este
# caso usamos la primera translación de
# la lista pero cualquiera es aceptable.
# El componente escrito en C#, corre con
# una biblioteca externa llamada Clipper
# desarrollada por el usuario de github y
# food4rhino arendvw.
# El nodo computa la diferencia de
# Minkowski, la cual suma el polígono A
# o estacionario con el polígono B o
# orbital, se llama diferencia ya que la
# operación de vectores cambia la
# dirección del polígono B a contra el
# reloj. Éste computo nos otorga un
# tercer polígono que llamaremos IFP
merge_9 = Merge(Data1=polygona_2, Data2=sheet_2)  # disabled
innerfitpolygon_2 = CSharpScript(
    x=merge_9,
    y=number_slider_13,
    Reference="C:\PROGRAM FILES\COMMON FILES\MCNEEL\RHINOCEROS\5.0\PLUG-INS\CLIPPERPLUGIN (BAE0724C-D28B-4D54-9B02-806B19D157C2)\0.0.2.1\CLIPPER-0.2.2\ClipperTools.dll")  # -> out, A, B, C; inputs x: list of Polyline, y: Int32; disabled; same code as innerfitpolygon
placedpart_2 = Curve(innerfitpolygon_2.A)  # disabled

# ----
# NFP(No Fit Polygon)
# Tenemos el contenedor(sheet/bin) y el
# primer poligono posicionado dentro del
# mismo. Ahora tenemos que encontrar
# las posibles posiciones del polígono
# que queremos agregar con respecto al
# ya posicionado anterior polígono. Con
# el No Fit Polygon podemos obtener las
# posibles translaciones.
# El proceso es similar al del IFP pero en
# este caso debemos tomar la órbita
# externa. Se repite un proceso similar al
# anterior, entre el punto de más abajo y
# más a la izquierda se crean vectores
# de translación con los puntos del No Fit
# Polygon.
parttobeplaced_2 = Curve(<curve referenced from the Rhino model>)  # disabled
merge_10 = Merge(Data1=parttobeplaced_2, Data2=placedpart_2)  # disabled
nestingtwoitems_6 = CSharpScript(
    x=merge_10,
    Reference="C:\Program Files\Common Files\McNeel\Rhinoceros\5.0\Plug-ins\ClipperPlugin (bae0724c-d28b-4d54-9b02-806b19d157c2)\0.0.2.1\clipper-0.2.2\ClipperTools.dll")  # -> out, A, B; inputs x: list of Polyline; disabled; same code as nestingtwoitems
possibleplacements_3 = Curve(nestingtwoitems_6.A)  # disabled
curve_21 = Curve(nestingtwoitems_6.B)  # disabled
# ---- group: Test de Inclusión
# Estos nodos buscan encontrar de las
# previas posibles translaciones, las que
# se encuentren dentro del contenedor.
# El proceso es:
#     1.) Encontrar las intersecciones entre
#           los polígonos y el contenedor.
#     2.) Comparar el área del polígono que
#           vamos a posicionar y compararlo
#           con el área de los polígonos que
#           han sido sometidos a la
#           intersección. Seleccionar sólo los
#           polígonos cuyas áreas coinciden.
#     3.) Tomar la envolvente convexa del
#            polígono a posicionar y el ya
#            posicionado. Escoger el polígono
#            cuya área de envolvente convexa
#            sea la menor.
region_intersection_5 = RegionIntersection(CurvesA=possibleplacements_3, CurvesB=sheet_2)  # disabled
area_18 = Area(Geometry=parttobeplaced_2)  # -> Area, Centroid; disabled
area_19 = Area(Geometry=region_intersection_5)  # -> Area, Centroid; disabled
integer_3 = Integer(area_18.Area)  # disabled
integer_4 = Integer(area_19.Area)  # disabled
evaluate_6 = Evaluate(Expression="If(x=y, True, False)", x=integer_3, y=integer_4)  # disabled
dispatch_6 = Dispatch(List=region_intersection_5, DispatchPattern=evaluate_6)  # -> ListA, ListB; disabled
curve_22 = Curve(dispatch_6.ListA)  # disabled
discontinuity_17 = Discontinuity(Curve=placedpart_2, Level=1)  # -> Points, Parameters; disabled
graft_tree_6 = GraftTree(Tree=curve_22, IncludeEmptyLists=True, IncludeNullItems=True)  # disabled
discontinuity_18 = Discontinuity(Curve=graft_tree_6, Level=1)  # -> Points, Parameters; disabled
c_script_5 = CSharpScript(x=simplify(discontinuity_18.Points), y=discontinuity_17.Points)  # -> out, A; inputs x: tree of Point3d, y: list of Point3d; disabled; same code as c_script
convex_hull_9 = ConvexHull(Points=c_script_5.A, Plane=PlaneXY(0, 0, 0))  # -> flatten(Hull), HullZ, Indices; disabled
area_20 = Area(Geometry=convex_hull_9.Hull)  # -> Area, Centroid; disabled
number_slider_16 = Slider(0, range=0..2)  # disabled
sort_list_8 = SortList(Keys=area_20.Area, ValuesValuesA=curve_22)  # -> Keys, ValuesValuesA; disabled
list_item_17 = ListItem(List=sort_list_8.ValuesValuesA, Index=number_slider_16, Wrap=True)  # disabled

# ----
sort_list_9 = SortList(Keys=area_20.Area, ValuesValuesA=convex_hull_9.Hull)  # -> Keys, ValuesValuesA; disabled
list_item_18 = ListItem(List=sort_list_9.ValuesValuesA, Index=number_slider_16, Wrap=True)  # disabled

# ---- group: Trabajo en Proceso
# Debemos encontrar la unión de los
# polígonos posicionados para poder
# repetir el proceso mencionado
# anteriormente. Pero la envolvente
# convexa produce pérdida de material,
# por lo tanto debemos producir un nuevo
# polígono entre las partes que sea más
# acorde a sus bordes externos.
discontinuity_19 = Discontinuity(Curve=[list_item_17, placedpart_2], Level=1)  # -> flatten(Points), Parameters; disabled
convex_hull_10 = ConvexHull(Points=discontinuity_19.Points, Plane=PlaneXY(0, 0, 0))  # -> Hull, HullZ, Indices; disabled

# ---- group: SheetMinusThe"Union"BetweenTheTwoPlacedParts
region_difference_5 = RegionDifference(CurvesA=sheet_2, CurvesB=convex_hull_10.Hull)  # disabled

# ---- group: TheTwoPartsToRunThroughTheNoFitPolygonAlgorithm
curve_23 = Curve(<curve referenced from the Rhino model>)  # disabled
merge_11 = Merge(Data1=curve_23, Data2=convex_hull_10.Hull)  # -> flatten(Result); disabled

# ---- group: NoFitPolygonAndTheRespectiveTranslations
nestingtwoitems_7 = CSharpScript(
    x=merge_11,
    Reference="C:\PROGRAM FILES\COMMON FILES\MCNEEL\RHINOCEROS\5.0\PLUG-INS\CLIPPERPLUGIN (BAE0724C-D28B-4D54-9B02-806B19D157C2)\0.0.2.1\CLIPPER-0.2.2\ClipperTools.dll")  # -> out, A, B; inputs x: list of Polyline; disabled
# ---------- nestingtwoitems_7: C# ----------
    // We want to cast(change from one data type to another) our list of polylines to curves, so that
    // we can call the AreaMassProperties class and its method .Compute to get the area of the polygons
    // after that we can now create a List of KeyValuePair to assign the area of our polygons to our
    // polygons so that we can sort them later according to their areas.
    /*
    List<Curve> one = new List<Curve>();
    double[] areas = new Double[x.Count];
    var curves = new List<KeyValuePair<Polyline, double>>();

    for(int i = 0; i < x.Count; ++i)
    {

      one.Add(x.ElementAt(i).ToNurbsCurve());
      areas[i] = AreaMassProperties.Compute(one.ElementAt(i)).Area;
      curves.Add(new KeyValuePair<Polyline, double>(x.ElementAt(i), areas[i]));

    }

    // Here is where the sorting according to area values takes place.
    curves.Sort(Compare1);
    curves.Reverse();
    // We retrieve a list of curves from our List of KeyValuePairs
    List<Polyline> curve = (from kvp in curves select kvp.Key).Distinct().ToList();
    curve.Reverse();
    */

    List<Polyline> curve = x;
    
    // We create and populate trees with the points of the curves, so that we can
    // sort each of the lower left points of each of the curves according to the
    // sum of their Xs and Ys positions.
    List<List<Point3d>> pts = new List<List<Point3d>>();
    DataTree<Point3d> tree = new DataTree<Point3d>();
    DataTree<double> treeSum = new DataTree<double>();
    var points = new DataTree<KeyValuePair<Point3d, double>>();
    var point = new List<Point3d>[curve.Count];
    DataTree<Point3d> treeLowerLeft = new DataTree<Point3d>();

    for(int i = 0; i < curve.Count; ++i)
    {

      pts.Add(curve[i].ToList());
      pts[i].RemoveAt(pts[i].Count - 1);
      GH_Path path = new GH_Path(i);

      for(int j = 0; j < pts[i].Count; ++j)
      {

        tree.Add(pts[i][j], path);
        treeSum.Add(pts[i][j].X + pts[i][j].Y, path);

        points.Add(new KeyValuePair<Point3d, double>(tree.Branch(i)[j], treeSum.Branch(i)[j]), path);

        points.Branch(i).Sort(Compare2);
        points.Branch(i).Reverse();
        point[i] = (from kvp in points.Branch(i) select kvp.Key).Distinct().ToList();
        point[i].Reverse();

      }

    }

    for(int i = 0; i < tree.BranchCount; ++i)
      for(int j = 0; j < tree.Branch(i).Count; ++j)
      {

        treeLowerLeft.Add(point[i][j], new GH_Path(i));

      }

    var treeOut = new DataTree<Point3d>();

    for(int i = 0; i < treeLowerLeft.BranchCount; ++i)
      for(int j = 0; j < treeLowerLeft.Branch(i).Count; ++j)
      {

        treeOut.Add(treeLowerLeft.Branch(i)[0], new GH_Path(i));

      }

    /*
    // Create the data structures and initialize them
    DataTree<Point3d> points = new DataTree<Point3d>();
    List<List<Point3d>> lists = new List<List<Point3d>>();

    // Fill the nested list with the list of points
    for(int i = 0; i < x.Count; ++i)
    {

      lists.Add(x[i].ToList());

    }

    // Fill the data tree with the list of points
    for(int i = 0; i < lists.Count; ++i)
    {

      var path = new GH_Path(i);

      for(int j = 0; j < lists[i].Count; ++j )
      {

        points.Add(lists[i][j], path);

      }

    }
    */


    // No Fit Polygon from minkowsky difference using the clipper lib
    Polyline polyOne = curve[0];
    Polyline polyTwo = curve[curve.Count - 1];

    Point3d center = treeOut.Branch(0).ElementAt(0);
    Vector3d zAxis = Vector3d.ZAxis;
    Plane p = new Rhino.Geometry.Plane(center, zAxis);

    double tolerance = 0.001;
    List<Polyline> outCurves = new List<Polyline>();
    List<Polyline> outDisplacedCurves = new List<Polyline>();
    foreach(List<IntPoint> path in ClipperLib.Clipper.MinkowskiDiff(polyOne.ToPath2D(p, tolerance), polyTwo.ToPath2D(p, tolerance)))
    {

      Polyline plSum = path.ToPolyline(p, tolerance, true);
      outCurves.Add(plSum);

    }

    Polyline NFP = outCurves[0];

    B = NFP;

    List<Point3d> ptNFP;
    ptNFP = NFP.ToList();
    ptNFP.RemoveAt(0);

    List<Vector3d> vectors = new List<Vector3d>();
    for(int i = 0; i < ptNFP.Count; ++i)
    {

      vectors.Add(new Vector3d(ptNFP.ElementAt(i) - treeOut.Branch(0)[0]));

    }

    List<Curve> translated = new List<Curve>();
    Polyline[] polys = new Polyline[ptNFP.Count];
    List<List<Point3d>> polyPoint = new List<List<Point3d>>();

    List<Point3d> pointsA = new List<Point3d>();
    pointsA = polyTwo.ToList();
    pointsA.RemoveAt(pointsA.Count - 1);
    DataTree<Point3d> polyPoints = new DataTree<Point3d>();
    DataTree<Point3d> APoints = new DataTree<Point3d>();
    for(int i = 0; i < ptNFP.Count; ++i)
    {

      var path = new GH_Path(i);
      Curve oney = polyOne.ToNurbsCurve();
      oney.Translate(vectors.ElementAt(i));
      translated.Add(oney);
      translated.ElementAt(i).TryGetPolyline(out polys[i]);
      polyPoint.Add(polys[i].ToList());

      for(int j = 0; j < polyPoint[i].Count - 1; ++j)
      {

        polyPoints.Add(polyPoint[i][j], path);

      }

    }

    for(int i = 0; i < ptNFP.Count; ++i)
      for(int j = 0; j < pointsA.Count; ++j)
      {

        var path = new GH_Path(i);
        APoints.Add(pointsA[j], path);

      }

    for(int i = 0; i < polyPoints.BranchCount; ++i)
      for(int j = 0; j < polyPoints.Branch(i).Count; ++j)
      {

        APoints.Add(polyPoints.Branch(i)[j], new GH_Path(i));

      }

    var list = new Grasshopper.Kernel.Geometry.Node2List[APoints.BranchCount];
    var polyLines = new Polyline[APoints.BranchCount];
    var curvesConvex = new Curve[APoints.BranchCount];
    var convexArea = new Double[APoints.BranchCount];
    var convexSort = new List<KeyValuePair<Polyline, double>>();
    var hullSort = new List<KeyValuePair<Polyline, double>>();

    for(int i = 0; i < APoints.BranchCount; ++i)
    {

      list[i] = new Grasshopper.Kernel.Geometry.Node2List(APoints.Branch(i));
      polyLines[i] = Grasshopper.Kernel.Geometry.ConvexHull.Solver.ComputeHull(list[i]);
      curvesConvex[i] = polyLines[i].ToNurbsCurve();
      convexArea[i] = AreaMassProperties.Compute(curvesConvex[i]).Area;
      convexSort.Add(new KeyValuePair<Polyline, double>(polys[i], convexArea[i]));
      hullSort.Add(new KeyValuePair<Polyline, double>(polyLines[i], convexArea[i]));

    }

    // Output the polygons with no convex hull
    // Here is where the sorting according to area values takes place.
    convexSort.Sort(Compare1);
    convexSort.Reverse();
    // We retrieve a list of polylines from our List of KeyValuePairs
    List<Polyline> polyFinal = (from kvp in convexSort select kvp.Key).Distinct().ToList();
    polyFinal.Reverse();

    // Output the convex hull polygons
    // Here is where the sorting according to area values takes place.
    hullSort.Sort(Compare1);
    hullSort.Reverse();
    // We retrieve a list of polylines from our List of KeyValuePairs
    List<Polyline> hullFinal = (from kvp in hullSort select kvp.Key).Distinct().ToList();
    hullFinal.Reverse();

    A = polyFinal;

    //B = hullFinal[0];

    /*
    Curve booleanUnionOne = polyFinal[0].ToNurbsCurve();
    Curve booleanUnionTwo = polyTwo.ToNurbsCurve();

    var listBoolean = new List<Curve>();

    listBoolean.Add(booleanUnionOne);
    listBoolean.Add(booleanUnionTwo);

    A = Curve.CreateBooleanUnion(listBoolean).ElementAt(1);
    */
# ---------- nestingtwoitems_7: C# additional code ----------
  static int Compare1(KeyValuePair<Polyline, double> a, KeyValuePair<Polyline, double> b)
  {

    return a.Value.CompareTo(b.Value);

  }

  static int Compare2(KeyValuePair<Point3d, double> a, KeyValuePair<Point3d, double> b)
  {

    return a.Value.CompareTo(b.Value);

  }
# ---------- end nestingtwoitems_7 ----------
possibleplacements_4 = Curve(nestingtwoitems_7.A)  # disabled
nofitpolygon_2 = Curve(nestingtwoitems_7.B)  # disabled

# ---- group: InclusionTest
muchmoresuccintinclusiontest = CSharpScript(Sheet=region_difference_5, PossiblePlacements=possibleplacements_4)  # -> out, InsideTheSheetWithNoOverlapping; inputs Sheet: Polyline, PossiblePlacements: list of Polyline; disabled
# ---------- muchmoresuccintinclusiontest: C# ----------
    // On deconstruit une des curves pour obtenir des points qui la font, il fallait pour
    // la construction du plan
    var points = new List<Point3d>();
    points = Sheet.ToList();
    // Il faut avoir d'un plan pour la function d'inclusion
    Plane plane = new Plane(points[0], Vector3d.ZAxis);

    // Malheureusement la function ne marche pas avec polyline donc on fait le cast a curve
    Curve sheetCurve = Sheet.ToNurbsCurve();

    // On doit faire une boucle car le input c'est une liste, il faut creer aussi la liste
    // avec les curves. De toute facon il faut d'en avoir le boucle ici car on va appeller
    // la function de inclusion avec chaque une des curves et le sheet
    var possiblePlacementsCurves = new List<Curve>();
    var testInclusion = new List<RegionContainment>();

    // Ici on initialize une collection(array) de polyline pour le remplir de la conversion
    // curve => polyline
    var polyOut = new Polyline[PossiblePlacements.Count];

    for(int i = 0; i < PossiblePlacements.Count; ++i)
    {

      // Transforme les polylines a curves
      possiblePlacementsCurves.Add(PossiblePlacements[i].ToNurbsCurve());

      // Test d'inclusion
      testInclusion.Add(Curve.PlanarClosedCurveRelationship(sheetCurve, possiblePlacementsCurves[i], plane, 0.0001));

      // On va trouver lesquelles curves se trouvent dedans le sheet et on va les transformer
      // en polylines, j'aime pas c'est method et j'imagine il y a une meilleure facon de le
      // faire mais je suis pas capable maintenant
      if(testInclusion[i] == Rhino.Geometry.RegionContainment.BInsideA)
      {

        possiblePlacementsCurves[i].TryGetPolyline(out polyOut[i]);

      }

    }

    // Eliminer les polylines qui sont nulls
    InsideTheSheetWithNoOverlapping = polyOut.Where(x => x != null).ToList();;
    //InsideTheSheetWithNoOverlapping = testInclusion;
# ---------- end muchmoresuccintinclusiontest ----------
panel_18 = Panel(muchmoresuccintinclusiontest.InsideTheSheetWithNoOverlapping)  # disabled

# ---- group: LongWayToGetWhichPartsAreInsideTheSheet
brep_brep_2 = BrepBrep(BrepA=possibleplacements_4, BrepB=region_difference_5)  # -> flatten(Curves), Points; disabled
closed_2 = Closed(Curve=brep_brep_2.Curves)  # -> Closed, Periodic; disabled
cull_pattern_2 = CullPattern(List=brep_brep_2.Curves, CullPattern=closed_2.Closed)  # disabled
curve_24 = Curve(cull_pattern_2)  # disabled
area_21 = Area(Geometry=curve_24)  # -> Area, Centroid; disabled
area_22 = Area(Geometry=curve_23)  # -> Area, Centroid; disabled
panel_19 = Panel(area_22.Area)  # disabled
panel_20 = Panel(area_21.Area)  # disabled
evaluate_7 = Evaluate(Expression="If(x=y, True, False)", x=panel_19, y=panel_20)  # disabled
dispatch_7 = Dispatch(List=curve_24, DispatchPattern=evaluate_7)  # -> ListA, ListB; disabled
curve_25 = Curve(dispatch_7.ListA)  # disabled

# ---- group: CreateATreeWithAllThePlacementPointsAndThePolygonWeArePlacingNextTo
graft_tree_7 = GraftTree(Tree=curve_25, IncludeEmptyLists=True, IncludeNullItems=True)  # disabled
discontinuity_20 = Discontinuity(Curve=convex_hull_10.Hull, Level=1)  # -> Points, Parameters; disabled
discontinuity_21 = Discontinuity(Curve=graft_tree_7, Level=1)  # -> Points, Parameters; disabled
pointtree_2 = CSharpScript(x=simplify(discontinuity_21.Points), y=discontinuity_20.Points)  # -> out, A; inputs x: tree of Point3d, y: list of Point3d; disabled; same code as pointtree

# ---- group: ConvexHullAreaSortingThePlacement
convex_hull_11 = ConvexHull(Points=pointtree_2.A, Plane=PlaneXY(0, 0, 0))  # -> flatten(Hull), HullZ, Indices; disabled
area_23 = Area(Geometry=convex_hull_11.Hull)  # -> Area, Centroid; disabled
sort_list_10 = SortList(Keys=area_23.Area, ValuesValuesA=curve_25)  # -> Keys, ValuesValuesA; disabled
sort_list_11 = SortList(Keys=area_23.Area, ValuesValuesA=convex_hull_11.Hull)  # -> Keys, ValuesValuesA; disabled
list_item_19 = ListItem(List=sort_list_11.ValuesValuesA, Index=0, Wrap=True)  # disabled
list_item_20 = ListItem(List=sort_list_10.ValuesValuesA, Index=0, Wrap=True)  # disabled

# ---- group: TheHullMustBeExactSoWeTakeTwoMethodsOfDissectingThePolylineToBeSure
discontinuity_22 = Discontinuity(Curve=[list_item_20, convex_hull_10.Hull], Level=1)  # -> flatten(Points), Parameters; disabled
divide_curve_6 = DivideCurve(Curve=[list_item_20, convex_hull_10.Hull], Count=10, Kinks=False)  # -> flatten(Points), Tangents, Parameters; disabled
point_3 = Point([divide_curve_6.Points, discontinuity_22.Points])  # disabled
convex_hull_12 = ConvexHull(Points=point_3, Plane=PlaneXY(0, 0, 0))  # -> Hull, HullZ, Indices; disabled

# ---- group: ConcaveHull
number_slider_17 = Slider(1.7, range=0..10)  # disabled
number_slider_18 = Slider(1, range=0..1)  # disabled
concavehull = CSharpScript(
    Points=point_3,
    Attrition=number_slider_17,
    Reference=["C:\Program Files\Common Files\McNeel\Rhinoceros\5.0\Plug-ins\Grasshopper (b45a29b1-4343-4035-989e-044e8580d9cf)\0.9.76.0\Components\Surface.gha", "C:\Program Files\Common Files\McNeel\Rhinoceros\5.0\Plug-ins\Grasshopper (b45a29b1-4343-4035-989e-044e8580d9cf)\0.9.76.0\Components\Curve.gha"])  # -> ConcaveHull; inputs Points: list of Point3d, Attrition: Double; disabled
# ---------- concavehull: C# ----------
    var nodeTwoList = new Grasshopper.Kernel.Geometry.Node2List(Points);
    var delaunayFaces = Grasshopper.Kernel.Geometry.Delaunay.Solver.Solve_Faces(nodeTwoList, 1);
    var delaunayMesh = Grasshopper.Kernel.Geometry.Delaunay.Solver.Solve_Mesh(nodeTwoList, 1, ref delaunayFaces);
    delaunayMesh.Weld(Math.PI);

    var list = new List<object>();

    var circles = new SurfaceComponents.MeshComponents.Component_MeshFaceCircles();
    var param = circles.Params.Input[0] as Grasshopper.Kernel.GH_PersistentGeometryParam<Grasshopper.Kernel.Types.GH_Mesh>;
    param.PersistentData.ClearData();
    param.PersistentData.Append(new GH_Mesh(delaunayMesh));

    circles.ExpireSolution(true);

    //add to a dummy document so we can read outputs
    var doc = new Grasshopper.Kernel.GH_Document();
    doc.AddObject(circles, false);

    //read output circles
    circles.Params.Output[0].CollectData();
    var ratio = new double[circles.Params.Output[1].VolatileDataCount];
    for(int i = 0; i < circles.Params.Output[0].VolatileDataCount; ++i)
    {

      //ratio[i] = circles.Params.Output[1].VolatileData.get_Branch(0)[i];
      GH_Convert.ToDouble(circles.Params.Output[1].VolatileData.get_Branch(0)[i], out ratio[i], GH_Conversion.Both);
      list.Add(circles.Params.Output[0].VolatileData.get_Branch(0)[i]);

    }

    var arcsList = new double[list.Count];

    var arcs = new AnalysisComponents.Component_DeconstructArc();
    var arcParams = arcs.Params.Input[0] as Grasshopper.Kernel.GH_PersistentParam<Grasshopper.Kernel.Types.GH_Arc>;
    arcParams.PersistentData.ClearData();
    var circle = new Arc[delaunayMesh.Faces.Count];
    for(int i = 0; i < list.Count; ++i)
    {

      GH_Convert.ToArc(list[i], ref circle[i], GH_Conversion.Both);
      arcParams.PersistentData.Append(new GH_Arc(circle[i]));

    }

    arcs.ExpireSolution(true);
    var docOne = new Grasshopper.Kernel.GH_Document();
    docOne.AddObject(arcs, false);

    arcs.Params.Output[0].CollectData();
    for(int i = 0; i < arcs.Params.Output[1].VolatileDataCount; ++i)
    {

      GH_Convert.ToDouble(arcs.Params.Output[1].VolatileData.get_Branch(0)[i], out arcsList[i], GH_Conversion.Both);
      //arcsList.Add(arcs.Params.Output[1].VolatileData.get_Branch(0)[i]);

    }

    var faceMesh = new List<object>();
    var verticesMesh = new List<object>();

    var deMesh = new SurfaceComponents.MeshComponents.Component_DeconstructMesh();
    var meshParams = deMesh.Params.Input[0] as Grasshopper.Kernel.GH_PersistentParam<Grasshopper.Kernel.Types.GH_Mesh>;
    meshParams.PersistentData.ClearData();
    meshParams.PersistentData.Append(new GH_Mesh(delaunayMesh));

    deMesh.ExpireSolution(true);
    var docTwo = new Grasshopper.Kernel.GH_Document();
    docTwo.AddObject(deMesh, false);

    deMesh.Params.Output[0].CollectData();

    for(int i = 0; i < deMesh.Params.Output[0].VolatileDataCount; ++i)
    {

      verticesMesh.Add(deMesh.Params.Output[0].VolatileData.get_Branch(0)[i]);

    }

    for(int i = 0; i < deMesh.Params.Output[1].VolatileDataCount; ++i)
    {

      faceMesh.Add(deMesh.Params.Output[1].VolatileData.get_Branch(0)[i]);

    }

    var faceCullRadius = RadiusSorting(faceMesh, arcsList);

    Array.Sort(ratio);

    var splitListIndex = Convert.ToInt32((ratio[ratio.Length - 1] * faceMesh.Count) * Attrition);
    //var splitListIndex = Convert.ToInt32(Attrition);

    var splitList = SplitList(faceCullRadius, splitListIndex);

    var constructMesh = new Mesh();
    var meshPoints = new Point3d[verticesMesh.Count];
    for(int i = 0; i < verticesMesh.Count; ++i)
    {

      GH_Convert.ToPoint3d(verticesMesh[i], ref meshPoints[i], GH_Conversion.Both);
      constructMesh.Vertices.Add(meshPoints[i]);

    }

    var meshFaces = new Grasshopper.Kernel.Types.GH_MeshFace[splitList.Count];
    for(int i = 0; i < splitList.Count; ++i)
    {

      GH_Convert.ToGHMeshFace(splitList[i], GH_Conversion.Both, ref meshFaces[i]);
      constructMesh.Faces.AddFace(meshFaces[i].Value);

    }

    ConcaveHull = constructMesh.GetNakedEdges();
# ---------- concavehull: C# additional code ----------
  public List<object> RadiusSorting(List<object> x, double[] radius)
  {

    var compare = new List<KeyValuePair<double, object>>();

    for(int i = 0; i < x.Count; ++i)
    {

      compare.Add(new KeyValuePair<double, object>(radius[i], x.ElementAt(i)));

    }

    // Here is where the sorting according to radius takes place.
    compare.Sort(Compare1);
    compare.Reverse();
    // We retrieve a list of objects from our List of KeyValuePairs
    List<object> compared = (from kvp in compare select kvp.Value).Distinct().ToList();
    compared.Reverse();

    return compared;

  }

  static int Compare1(KeyValuePair<double, object> a, KeyValuePair<double, object> b)
  {

    return a.Key.CompareTo(b.Key);

  }

  private List<object> SplitList(List<object> list, int i)
  {

    var points = new List<object>();

    var chunk = Chunk(list, i, list.Count);

    foreach(var item in chunk)
    {

      points = item.ToList();

    }

    return points;

  }

  public static IEnumerable<IEnumerable<T>> Chunk<T> (IEnumerable<T> source, int chunksize, int count)
  {

    while (source.Any())
    {

      yield return source.Take(chunksize);
      source = source.Skip(chunksize + count);

    }

  }
# ---------- end concavehull ----------
alpha_shape = AlphaShape(Points=point_3, Radius=number_slider_18, Plane=PlaneXY(0, 0, 0))  # disabled

# ---- group: PaulsAlgo
number_slider_19 = Slider(0.562, range=0..10)  # disabled
number_slider_20 = Slider(0.966, range=0..2)  # disabled
crv_3 = Curve(flatten([list_item_20, convex_hull_10.Hull]))  # disabled
divlength = DivideLength(Curve=crv_3, Length=number_slider_19)  # -> Points, Tangents, Parameters; disabled
Z = UnitZ(Factor=1)  # disabled
lng = ListLength(List=divlength.Points)  # -> flatten(Length); disabled
divide = DivideCurve(Curve=crv_3, Count=lng, Kinks=True)  # -> Points, Tangents, Parameters; disabled
xprod = CrossProduct(VectorA=divide.Tangents, VectorB=Z, Unitize=False)  # -> Vector, Length; disabled
amp = Amplitude(Vector=xprod.Vector, Amplitude=number_slider_20)  # disabled
move = Move(Geometry=divide.Points, Motion=amp)  # -> Geometry, Transform; disabled
vdis = VectorDisplay(Anchor=divide.Points, Vector=amp)  # disabled
cir = Circle(Plane=move.Geometry, Radius=number_slider_20)  # -> graft(Circle); disabled
ccx = CurveCurve(CurveA=cir, CurveB=crv_3)  # -> simplify(Points), ParamsA, ParamsB; disabled
number_slider_21 = Slider(1, range=0..1)  # disabled
pshift = ShiftPaths(Data=ccx.Points, Offset=-1)  # disabled
lng_2 = ListLength(List=pshift)  # disabled
equals = Equality(FirstNumber=lng_2, SecondNumber=number_slider_21)  # -> Equality, Inequality; disabled
dispatch_8 = Dispatch(List=flatten(divide.Points), DispatchPattern=flatten(equals.Equality))  # -> ListA, ListB; disabled
pt_3 = Point(dispatch_8.ListA)  # disabled
c_script_6 = CSharpScript(pt=pt_3, t=number_slider_19)  # -> out, A, B; inputs pt: list of Point3d, t: Double; disabled
# ---------- c_script_6: C# ----------
    List<Point3d> PtOut = new List<Point3d>();
    Point3d temp = pt[0];
    int ind1 = pt.IndexOf(temp);
    PtOut.Add(temp);
    pt.RemoveAt(0);
    double d = new double();

    int N = pt.Count;

    for(int i = 0; i < N;i++){
      

      if(ind1 == pt.Count ){
        ind1 = 0;
      }
       
       

      d =temp.DistanceTo(pt[ind1]);

      if(d > 1.5*t){
        temp = Point3dList.ClosestPointInList(pt, temp);
        ind1 = pt.IndexOf(temp);
      }
      else{
        temp = pt[ind1];
      }

      PtOut.Add(temp);
      pt.Remove(temp);
    }
    PtOut.Add(PtOut[0]);
    Polyline Poly = new Polyline(PtOut);

    A = Poly;
    B = PtOut;
# ---------- end c_script_6 ----------
crv_4 = Curve(c_script_6.A)  # disabled

# ---- group: NestingNoSheet
curve_26 = Curve([<curve referenced from the Rhino model> x4])  # disabled
number_slider_22 = Slider(2, range=0..10)  # disabled
number_slider_23 = Slider(8, range=0..10)  # disabled
difference = CSharpScript(
    z=number_slider_22,
    u=curve_26,
    w=number_slider_23,
    Reference=["C:\PROGRAM FILES\COMMON FILES\MCNEEL\RHINOCEROS\5.0\PLUG-INS\CLIPPERPLUGIN (BAE0724C-D28B-4D54-9B02-806B19D157C2)\0.0.2.1\CLIPPER-0.2.2\ClipperTools.dll", "C:\Users\Paula\AppData\Roaming\Grasshopper\Libraries\PlanktonGh.dll", "C:\Users\Paula\AppData\Roaming\Grasshopper\Libraries\Plankton.dll"])  # -> out, A, B, C, D, E, F, AA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; inputs z: Int32, u: list of Polyline, w: Int32; disabled
# ---------- difference: C# ----------
    Polyline four = u[3];
    Polyline one = u[2];
    Polyline two = u[1];
    Polyline three = u[0];

    List<Point3d> ptA;
    ptA = one.ToList();
    ptA.RemoveAt(0);

    List<Point3d> ptB;
    ptB = two.ToList();
    ptB.RemoveAt(0);

    List<Point3d> ptC;
    ptC = three.ToList();
    ptC.RemoveAt(0);

    Point3d center = ptB[ptB.Count - 1];
    Vector3d zAxis = Vector3d.ZAxis;
    Plane p = new Rhino.Geometry.Plane(center, zAxis);

    // No Fit Polygon One
    double tolerance = 0.001;
    List<Polyline> outCurves = new List<Polyline>();
    List<Polyline> outDisplacedCurves = new List<Polyline>();
    foreach(List<IntPoint> path in ClipperLib.Clipper.MinkowskiDiff(two.ToPath2D(p, tolerance), one.ToPath2D(p, tolerance)))
    {

      Polyline plSum = path.ToPolyline(p, tolerance, true);
      outCurves.Add(plSum);

    }

    Polyline NFP = outCurves[0];

    List<Point3d> ptNFP;
    ptNFP = NFP.ToList();
    ptNFP.RemoveAt(0);

    // Inner Fit Polygon
    Point3d centerOne = ptB[ptB.Count - 1];
    Plane pO = new Rhino.Geometry.Plane(centerOne, zAxis);

    List<Polyline> outCurvesOne = new List<Polyline>();
    List<Polyline> outDisplacedCurvesOne = new List<Polyline>();
    foreach(List<IntPoint> path in ClipperLib.Clipper.MinkowskiDiff(two.ToPath2D(pO, tolerance), three.ToPath2D(pO, tolerance)))
    {

      Polyline plSum = path.ToPolyline(pO, tolerance, true);
      outCurvesOne.Add(plSum);

    }

    Polyline bin = outCurvesOne[1];

    // No Fit Polygon Two
    List<Polyline> outCurvesTwo = new List<Polyline>();
    List<Polyline> outDisplacedCurvesTwo = new List<Polyline>();
    foreach(List<IntPoint> path in ClipperLib.Clipper.MinkowskiDiff(two.ToPath2D(p, tolerance), four.ToPath2D(p, tolerance)))
    {

      Polyline plSum = path.ToPolyline(p, tolerance, true);
      outCurvesTwo.Add(plSum);

    }

    Polyline NFPOne = outCurvesTwo[0];


    Curve b = two.ToNurbsCurve();
    int[] iter = new int[5];
    int[] iterOne = new int[5];
    int[] iterTwo = new int[5];
    Vector3d[] vec = new Vector3d[ptA.Count];
    for(int i = 0; i < 5; ++i)
      for(int j = 0; j < 5 - 1; ++j)
      {

        iter[i] = i;
        iterOne[j] = j;
        //vec[i] = new Vector3d(i,i,i);

        if(iter[i] < iterOne[j])
        {

          iterTwo[i] = i;

        }
        else
        {

          iterTwo[j] = j;

        }

        AD = iter;
        AE = iterOne;
        AF = iterTwo;

      }

    //AD = vec;

    /*
    Vector3d[] vecOne = new Vector3d[ptB.Count];
    for(int i = 0; i < ptB.Count; ++i)
    {

    vecOne[i] = new Vector3d(ptB[i]);

    }
    //vec[0] = new Vector3d(ptA[1]) - new Vector3d(ptB[1]);
    //b.Translate(vec[0]);
    */
    /*for(int i = 0; i < ptA.Count; i++)
    for(int j = 0; j < ptB.Count; j++)
    {

    vec[0] = new Vector3d(ptA[0]) - new Vector3d(ptB[0]);
    b.Translate(vec[0]);

    }
    */

    A = one;

    B = two;

    C = outCurves;

    D = ptA;

    E = ptB;

    F = ptA.Count + ptB.Count;

    AA = ptNFP;

    AB = bin;

    AC = NFPOne;

    /*
    List<Polyline> outCurves = ClipperLib.Clipper.MinkowskiSum(

      u[0].ToPath2D(p, tolerance),
      u[1].ToPath2D(p, tolerance),
      true)
      .Select(path => path.ToPolyline(p, tolerance, true))
      .ToList();

    A = outCurves[0];

    B = pt[z];

    //C = ptO[w];

    AA = planeList;
    */
# ---------- end difference ----------
curve_27 = Curve(difference.AC)  # disabled
A = Curve(difference.A)  # disabled
B = Curve(difference.B)  # disabled
nfp = Curve(difference.C)  # disabled
list_item_21 = ListItem(List=nfp, Index=0, Wrap=True)  # disabled
point_4 = Point(difference.AA)  # disabled
bpoints = Point(difference.E)  # disabled
nfppoints = Point(difference.AA)  # disabled
discontinuity_23 = Discontinuity(Curve=A, Level=1)  # -> Points, Parameters; disabled
list_item_22 = ListItem(List=bpoints, Index=0, Wrap=True)  # disabled

# ---- group: NestingNoSheet / LowerLeft
deconstruct = Deconstruct(Point=bpoints)  # -> XComponent, YComponent, ZComponent; disabled
addition_2 = Addition(A=deconstruct.XComponent, B=deconstruct.YComponent)  # disabled
number_slider_24 = Slider(200, range=0..1000)  # disabled
sort_list_12 = SortList(Keys=addition_2, ValuesValuesA=bpoints)  # -> Keys, ValuesValuesA; disabled
point_list = PointList(Points=sort_list_12.ValuesValuesA, Size=number_slider_24)  # disabled
number_slider_25 = Slider(0, range=0..7)  # disabled
list_item_23 = ListItem(List=sort_list_12.ValuesValuesA, Index=number_slider_25, Wrap=True)  # disabled

deconstruct_2 = Deconstruct(Point=discontinuity_23.Points)  # -> XComponent, YComponent, ZComponent; disabled
addition_3 = Addition(A=deconstruct_2.XComponent, B=deconstruct_2.YComponent)  # disabled
number_slider_26 = Slider(200, range=0..1000)  # disabled
sort_list_13 = SortList(Keys=addition_3, ValuesValuesA=discontinuity_23.Points)  # -> Keys, ValuesValuesA; disabled
point_list_2 = PointList(Points=sort_list_13.ValuesValuesA, Size=number_slider_26)  # disabled
number_slider_27 = Slider(0, range=0..7)  # disabled
list_item_24 = ListItem(List=sort_list_13.ValuesValuesA, Index=number_slider_27, Wrap=True)  # disabled

# ---- group: NestingNoSheet / TranslationVectorsFromNFP
# NestingWithSheet
vector_2pt = Vector2Pt(PointA=list_item_23, PointB=nfppoints, Unitize=False)  # -> Vector, Length; disabled
vector_display = VectorDisplay(Anchor=list_item_23, Vector=vector_2pt.Vector)  # disabled
move_2 = Move(Geometry=B, Motion=vector_2pt.Vector)  # -> graft(Geometry), Transform; disabled

# ---- group: NestingNoSheet / SortingTheBestPlacement
number_slider_28 = Slider(9, range=0..9)  # disabled
list_item_25 = ListItem(List=move_2.Geometry, Index=number_slider_28, Wrap=True)  # disabled
discontinuity_24 = Discontinuity(Curve=list_item_25, Level=1)  # -> Points, Parameters; disabled
apoints = Point(difference.D)  # disabled
tree_statistics = TreeStatistics(Tree=discontinuity_24.Points)  # -> Paths, Length, Count; disabled
number_slider_29 = Slider(6, range=0..10)  # disabled
duplicate_data = DuplicateData(Data=apoints, Number=tree_statistics.Count, Order=True)  # disabled
partition_list = PartitionList(List=duplicate_data, Size=number_slider_29)  # disabled
path_mapper = PathMapper(partition_list, source="{A;B;C;D;E;F}", target="{D;E;F;0}")  # disabled
merge_12 = Merge(Data1=path_mapper, Data2=discontinuity_24.Points)  # disabled
convex_hull_13 = ConvexHull(Points=merge_12, Plane=PlaneXY(0, 0, 0))  # -> flatten(Hull), HullZ, Indices; disabled
area_24 = Area(Geometry=convex_hull_13.Hull)  # -> Area, Centroid; disabled
sort_list_14 = SortList(Keys=area_24.Area, ValuesValuesA=flatten(move_2.Geometry))  # -> Keys, ValuesValuesA; disabled
sort_list_15 = SortList(Keys=area_24.Area, ValuesValuesA=convex_hull_13.Hull)  # -> Keys, ValuesValuesA; disabled
list_item_26 = ListItem(List=sort_list_15.ValuesValuesA, Index=0, Wrap=True)  # disabled
list_item_27 = ListItem(List=sort_list_14.ValuesValuesA, Index=0, Wrap=True)  # disabled
curve_28 = Curve(list_item_27)  # disabled
curve_29 = Curve(list_item_26)  # disabled

# ---- group: NestingNoSheet (continued)
minkowski_sum = MinkowskiSum(A=A, B=B, Plane=list_item_23, Tolerance=0.001)  # -> Sum, DisplacedSum; disabled
minkowski_difference = MinkowskiDifference(A=B, B=A, Plane=list_item_23, Tolerance=0.001)  # disabled
point_list_3 = PointList(Points=bpoints, Size=number_slider_24)  # disabled
discontinuity_25 = Discontinuity(Curve=move_2.Geometry, Level=1)  # -> Points, Parameters; disabled
panel_21 = Panel(discontinuity_25.Points)  # disabled
panel_22 = Panel(path_mapper)  # disabled
panel_23 = Panel(merge_12)  # disabled

# ---- group: SheetMinusThe"Union"BetweenTheTwoPlacedParts
region_difference_6 = RegionDifference(CurvesA=region_difference_5, CurvesB=convex_hull_12.Hull)  # disabled

# ---- group: TheTwoPartsToRunThroughTheNoFitPolygonAlgorithm
number_slider_30 = Slider(0.1, range=0..0.1)  # disabled
curve_30 = Curve(<curve referenced from the Rhino model>)  # disabled
curve_31 = Curve(<curve referenced from the Rhino model>)  # disabled
curve_32 = Curve(<curve referenced from the Rhino model>)  # disabled
curve_33 = Curve(<curve referenced from the Rhino model>)  # disabled
curve_34 = Curve(<curve referenced from the Rhino model>)  # disabled
curve_to_polyline_3 = CurveToPolyline(Curve=curve_30, ToleranceDistance=number_slider_30, ToleranceAngle=0)  # -> Polyline, Segments; disabled
merge_13 = Merge(Data1=curve_32, Data2=convex_hull_12.Hull)  # -> flatten(Result); disabled

# ----
# And we are done with our process and
# can begin iterating!
# Partes sin ordenar dentro del contenedor.
merge_14 = Merge(
    Data1=polygona_2,
    Data2=sheet_2,
    Data3=parttobeplaced_2,
    Data4=curve_23,
    Data5=curve_32,
    Data6=curve_30,
    Data7=curve_31,
    Data8=curve_33,
    Data9=curve_34)  # disabled

# ---- group: NoFitPolygonAndTheRespectiveTranslations
nestingtwoitems_8 = CSharpScript(
    x=merge_13,
    Reference="C:\PROGRAM FILES\COMMON FILES\MCNEEL\RHINOCEROS\5.0\PLUG-INS\CLIPPERPLUGIN (BAE0724C-D28B-4D54-9B02-806B19D157C2)\0.0.2.1\CLIPPER-0.2.2\ClipperTools.dll")  # -> out, A, B; inputs x: list of Polyline; disabled; same code as nestingtwoitems_7
curve_35 = Curve(nestingtwoitems_8.B)  # disabled
curve_36 = Curve(nestingtwoitems_8.A)  # disabled

# ----
brep_brep_3 = BrepBrep(BrepA=curve_36, BrepB=region_difference_6)  # -> flatten(Curves), Points; disabled
closed_3 = Closed(Curve=brep_brep_3.Curves)  # -> Closed, Periodic; disabled
cull_pattern_3 = CullPattern(List=brep_brep_3.Curves, CullPattern=closed_3.Closed)  # disabled
curve_37 = Curve(cull_pattern_3)  # disabled
area_25 = Area(Geometry=curve_33)  # -> Area, Centroid; disabled
area_26 = Area(Geometry=curve_31)  # -> Area, Centroid; disabled
area_27 = Area(Geometry=curve_34)  # -> Area, Centroid; disabled
area_28 = Area(Geometry=curve_37)  # -> Area, Centroid; disabled
area_29 = Area(Geometry=curve_to_polyline_3.Polyline)  # -> Area, Centroid; disabled
area_30 = Area(Geometry=curve_32)  # -> Area, Centroid; disabled
panel_24 = Panel(area_25.Area)  # disabled
panel_25 = Panel(area_26.Area)  # disabled
panel_26 = Panel(area_27.Area)  # disabled
panel_27 = Panel(area_30.Area)  # disabled
panel_28 = Panel(area_29.Area)  # disabled
panel_29 = Panel(area_28.Area)  # disabled
panel_30 = Panel(".")  # disabled
panel_31 = Panel(".")  # disabled
panel_32 = Panel(".")  # disabled
panel_33 = Panel(".")  # disabled
panel_34 = Panel(".")  # disabled
panel_35 = Panel(".")  # disabled
panel_36 = Panel(".")  # disabled
panel_37 = Panel(".")  # disabled
panel_38 = Panel(".")  # disabled
panel_39 = Panel(".")  # disabled
text_split_5 = TextSplit(Text=panel_24, Separators=panel_32)  # disabled
text_split_6 = TextSplit(Text=panel_25, Separators=panel_34)  # disabled
text_split_7 = TextSplit(Text=area_28.Area, Separators=panel_35)  # disabled
text_split_8 = TextSplit(Text=panel_26, Separators=panel_37)  # disabled
text_split_9 = TextSplit(Text=panel_28, Separators=panel_39)  # disabled
text_split_10 = TextSplit(Text=panel_27, Separators=panel_38)  # disabled
panel_40 = Panel(text_split_5)  # disabled
panel_41 = Panel(text_split_6)  # disabled
panel_42 = Panel(text_split_7)  # disabled
panel_43 = Panel(text_split_8)  # disabled
panel_44 = Panel(text_split_10)  # disabled
panel_45 = Panel(text_split_9)  # disabled
list_item_28 = ListItem(List=panel_40, Index=0, Wrap=True)  # -> flatten(Item); disabled
list_item_29 = ListItem(List=panel_41, Index=0, Wrap=True)  # -> flatten(Item); disabled
list_item_30 = ListItem(List=panel_42, Index=0, Wrap=True)  # -> flatten(Item); disabled
list_item_31 = ListItem(List=panel_43, Index=0, Wrap=True)  # -> flatten(Item); disabled
list_item_32 = ListItem(List=panel_45, Index=0, Wrap=True)  # -> flatten(Item); disabled
list_item_33 = ListItem(List=panel_44, Index=0, Wrap=True)  # -> flatten(Item); disabled
panel_46 = Panel(list_item_28)  # disabled
panel_47 = Panel(list_item_29)  # disabled
panel_48 = Panel(list_item_30)  # disabled
panel_49 = Panel(list_item_31)  # disabled
panel_50 = Panel(list_item_33)  # disabled
panel_51 = Panel(list_item_32)  # disabled
evaluate_8 = Evaluate(Expression="If(x=y, True, False)", x=panel_50, y=panel_48)  # disabled
dispatch_9 = Dispatch(List=curve_37, DispatchPattern=evaluate_8)  # -> ListA, ListB; disabled
discontinuity_26 = Discontinuity(Curve=convex_hull_12.Hull, Level=1)  # -> Points, Parameters; disabled
curve_38 = Curve(dispatch_9.ListA)  # disabled

# ---- group: CreateATreeWithAllThePlacementPointsAndThePolygonWeArePlacingNextTo
graft_tree_8 = GraftTree(Tree=curve_38, IncludeEmptyLists=True, IncludeNullItems=True)  # disabled
discontinuity_27 = Discontinuity(Curve=graft_tree_8, Level=1)  # -> Points, Parameters; disabled
c_script_7 = CSharpScript(x=simplify(discontinuity_27.Points), y=discontinuity_26.Points)  # -> out, A; inputs x: tree of Point3d, y: list of Point3d; disabled; same code as pointtree

# ---- group: ConvexHullAreaSorting
convex_hull_14 = ConvexHull(Points=c_script_7.A, Plane=PlaneXY(0, 0, 0))  # -> flatten(Hull), HullZ, Indices; disabled
area_31 = Area(Geometry=convex_hull_14.Hull)  # -> Area, Centroid; disabled
sort_list_16 = SortList(Keys=area_31.Area, ValuesValuesA=curve_38)  # -> Keys, ValuesValuesA; disabled
list_item_34 = ListItem(List=sort_list_16.ValuesValuesA, Index=0, Wrap=True)  # disabled

# ---- group: ConvexHulls
discontinuity_28 = Discontinuity(Curve=[convex_hull_12.Hull, list_item_34], Level=1)  # -> flatten(Points), Parameters; disabled
convex_hull_15 = ConvexHull(Points=discontinuity_28.Points, Plane=PlaneXY(0, 0, 0))  # -> Hull, HullZ, Indices; disabled

# ---- group: SheetMinusThe"Union"BetweenTheTwoPlacedParts (continued)
region_difference_7 = RegionDifference(CurvesA=region_difference_6, CurvesB=convex_hull_15.Hull)  # disabled

# ---- group: TheTwoPartsToRunThroughTheNoFitPolygonAlgorithm (continued)
merge_15 = Merge(Data1=curve_to_polyline_3.Polyline, Data2=convex_hull_15.Hull)  # -> flatten(Result); disabled

# ---- group: NoFitPolygonAndTheRespectiveTranslations (continued)
nestingtwoitems_9 = CSharpScript(
    x=merge_15,
    Reference="C:\PROGRAM FILES\COMMON FILES\MCNEEL\RHINOCEROS\5.0\PLUG-INS\CLIPPERPLUGIN (BAE0724C-D28B-4D54-9B02-806B19D157C2)\0.0.2.1\CLIPPER-0.2.2\ClipperTools.dll")  # -> out, A, B; inputs x: list of Polyline; disabled; same code as nestingtwoitems_7
curve_39 = Curve(nestingtwoitems_9.B)  # disabled
curve_40 = Curve(nestingtwoitems_9.A)  # disabled

# ----
brep_brep_4 = BrepBrep(BrepA=curve_40, BrepB=region_difference_7)  # -> flatten(Curves), Points; disabled
closed_4 = Closed(Curve=brep_brep_4.Curves)  # -> Closed, Periodic; disabled
cull_pattern_4 = CullPattern(List=brep_brep_4.Curves, CullPattern=closed_4.Closed)  # disabled
curve_41 = Curve(cull_pattern_4)  # disabled
area_32 = Area(Geometry=curve_41)  # -> Area, Centroid; disabled
panel_52 = Panel(area_32.Area)  # disabled
text_split_11 = TextSplit(Text=panel_52, Separators=panel_36)  # disabled
panel_53 = Panel(text_split_11)  # disabled
list_item_35 = ListItem(List=panel_53, Index=0, Wrap=True)  # -> flatten(Item); disabled
panel_54 = Panel(list_item_35)  # disabled
evaluate_9 = Evaluate(Expression="If(x=y, True, False)", x=panel_51, y=panel_54)  # disabled
dispatch_10 = Dispatch(List=curve_41, DispatchPattern=evaluate_9)  # -> ListA, ListB; disabled
discontinuity_29 = Discontinuity(Curve=convex_hull_15.Hull, Level=1)  # -> Points, Parameters; disabled
curve_42 = Curve(dispatch_10.ListA)  # disabled

# ---- group: CreateATreeWithAllThePlacementPointsAndThePolygonWeArePlacingNextTo (continued)
graft_tree_9 = GraftTree(Tree=curve_42, IncludeEmptyLists=True, IncludeNullItems=True)  # disabled
discontinuity_30 = Discontinuity(Curve=graft_tree_9, Level=1)  # -> Points, Parameters; disabled
c_script_8 = CSharpScript(x=simplify(discontinuity_30.Points), y=discontinuity_29.Points)  # -> out, A; inputs x: tree of Point3d, y: list of Point3d; disabled; same code as pointtree

# ---- group: ConvexHullAreaSorting (continued)
convex_hull_16 = ConvexHull(Points=c_script_8.A, Plane=PlaneXY(0, 0, 0))  # -> flatten(Hull), HullZ, Indices; disabled
area_33 = Area(Geometry=convex_hull_16.Hull)  # -> Area, Centroid; disabled
sort_list_17 = SortList(Keys=area_33.Area, ValuesValuesA=curve_42)  # -> Keys, ValuesValuesA; disabled
list_item_36 = ListItem(List=sort_list_17.ValuesValuesA, Index=0, Wrap=True)  # disabled

# ---- group: ConvexHulls (continued)
discontinuity_31 = Discontinuity(Curve=[list_item_36, convex_hull_15.Hull], Level=1)  # -> flatten(Points), Parameters; disabled
convex_hull_17 = ConvexHull(Points=discontinuity_31.Points, Plane=PlaneXY(0, 0, 0))  # -> Hull, HullZ, Indices; disabled

# ---- group: SheetMinusThe"Union"BetweenTheTwoPlacedParts (continued)
region_difference_8 = RegionDifference(CurvesA=region_difference_7, CurvesB=convex_hull_17.Hull)  # disabled

# ---- group: TheTwoPartsToRunThroughTheNoFitPolygonAlgorithm (continued)
merge_16 = Merge(Data1=curve_31, Data2=convex_hull_17.Hull)  # -> flatten(Result); disabled

# ---- group: NoFitPolygonAndTheRespectiveTranslations (continued)
nestingtwoitems_10 = CSharpScript(
    x=merge_16,
    Reference="C:\PROGRAM FILES\COMMON FILES\MCNEEL\RHINOCEROS\5.0\PLUG-INS\CLIPPERPLUGIN (BAE0724C-D28B-4D54-9B02-806B19D157C2)\0.0.2.1\CLIPPER-0.2.2\ClipperTools.dll")  # -> out, A, B; inputs x: list of Polyline; disabled; same code as nestingtwoitems_7
curve_43 = Curve(nestingtwoitems_10.B)  # disabled
curve_44 = Curve(nestingtwoitems_10.A)  # disabled

# ----
brep_brep_5 = BrepBrep(BrepA=curve_44, BrepB=region_difference_8)  # -> flatten(Curves), Points; disabled
closed_5 = Closed(Curve=brep_brep_5.Curves)  # -> Closed, Periodic; disabled
cull_pattern_5 = CullPattern(List=brep_brep_5.Curves, CullPattern=closed_5.Closed)  # disabled
curve_45 = Curve(cull_pattern_5)  # disabled
area_34 = Area(Geometry=curve_45)  # -> Area, Centroid; disabled
panel_55 = Panel(area_34.Area)  # disabled
text_split_12 = TextSplit(Text=panel_55, Separators=panel_31)  # disabled
panel_56 = Panel(text_split_12)  # disabled
list_item_37 = ListItem(List=panel_56, Index=0, Wrap=True)  # -> flatten(Item); disabled
panel_57 = Panel(list_item_37)  # disabled
evaluate_10 = Evaluate(Expression="If(x=y, True, False)", x=panel_47, y=panel_57)  # disabled
dispatch_11 = Dispatch(List=curve_45, DispatchPattern=evaluate_10)  # -> ListA, ListB; disabled
discontinuity_32 = Discontinuity(Curve=convex_hull_17.Hull, Level=1)  # -> Points, Parameters; disabled
curve_46 = Curve(dispatch_11.ListA)  # disabled

# ---- group: CreateATreeWithAllThePlacementPointsAndThePolygonWeArePlacingNextTo (continued)
graft_tree_10 = GraftTree(Tree=curve_46, IncludeEmptyLists=True, IncludeNullItems=True)  # disabled
discontinuity_33 = Discontinuity(Curve=graft_tree_10, Level=1)  # -> Points, Parameters; disabled
c_script_9 = CSharpScript(x=simplify(discontinuity_33.Points), y=discontinuity_32.Points)  # -> out, A; inputs x: tree of Point3d, y: list of Point3d; disabled; same code as pointtree

# ---- group: ConvexHullAreaSorting (continued)
convex_hull_18 = ConvexHull(Points=c_script_9.A, Plane=PlaneXY(0, 0, 0))  # -> flatten(Hull), HullZ, Indices; disabled
area_35 = Area(Geometry=convex_hull_18.Hull)  # -> Area, Centroid; disabled
sort_list_18 = SortList(Keys=area_35.Area, ValuesValuesA=curve_46)  # -> Keys, ValuesValuesA; disabled
list_item_38 = ListItem(List=sort_list_18.ValuesValuesA, Index=0, Wrap=True)  # disabled

# ---- group: ConvexHulls (continued)
discontinuity_34 = Discontinuity(Curve=[list_item_38, convex_hull_17.Hull], Level=1)  # -> flatten(Points), Parameters; disabled
convex_hull_19 = ConvexHull(Points=discontinuity_34.Points, Plane=PlaneXY(0, 0, 0))  # -> Hull, HullZ, Indices; disabled

# ---- group: SheetMinusThe"Union"BetweenTheTwoPlacedParts (continued)
region_difference_9 = RegionDifference(CurvesA=region_difference_8, CurvesB=convex_hull_19.Hull)  # disabled

# ---- group: TheTwoPartsToRunThroughTheNoFitPolygonAlgorithm (continued)
merge_17 = Merge(Data1=curve_33, Data2=convex_hull_19.Hull)  # -> flatten(Result); disabled

# ---- group: NoFitPolygonAndTheRespectiveTranslations (continued)
nestingtwoitems_11 = CSharpScript(
    x=merge_17,
    Reference="C:\PROGRAM FILES\COMMON FILES\MCNEEL\RHINOCEROS\5.0\PLUG-INS\CLIPPERPLUGIN (BAE0724C-D28B-4D54-9B02-806B19D157C2)\0.0.2.1\CLIPPER-0.2.2\ClipperTools.dll")  # -> out, A, B; inputs x: list of Polyline; disabled; same code as nestingtwoitems_7
curve_47 = Curve(nestingtwoitems_11.B)  # disabled
curve_48 = Curve(nestingtwoitems_11.A)  # disabled

# ----
brep_brep_6 = BrepBrep(BrepA=curve_48, BrepB=region_difference_9)  # -> flatten(Curves), Points; disabled
closed_6 = Closed(Curve=brep_brep_6.Curves)  # -> Closed, Periodic; disabled
cull_pattern_6 = CullPattern(List=brep_brep_6.Curves, CullPattern=closed_6.Closed)  # disabled
curve_49 = Curve(cull_pattern_6)  # disabled
area_36 = Area(Geometry=curve_49)  # -> Area, Centroid; disabled
panel_58 = Panel(area_36.Area)  # disabled
text_split_13 = TextSplit(Text=panel_58, Separators=panel_30)  # disabled
panel_59 = Panel(text_split_13)  # disabled
list_item_39 = ListItem(List=panel_59, Index=0, Wrap=True)  # -> flatten(Item); disabled
panel_60 = Panel(list_item_39)  # disabled
evaluate_11 = Evaluate(Expression="If(x=y, True, False)", x=panel_46, y=panel_60)  # disabled
dispatch_12 = Dispatch(List=curve_49, DispatchPattern=evaluate_11)  # -> ListA, ListB; disabled
discontinuity_35 = Discontinuity(Curve=convex_hull_19.Hull, Level=1)  # -> Points, Parameters; disabled
curve_50 = Curve(dispatch_12.ListA)  # disabled

# ---- group: CreateATreeWithAllThePlacementPointsAndThePolygonWeArePlacingNextTo (continued)
graft_tree_11 = GraftTree(Tree=curve_50, IncludeEmptyLists=True, IncludeNullItems=True)  # disabled
discontinuity_36 = Discontinuity(Curve=graft_tree_11, Level=1)  # -> Points, Parameters; disabled
c_script_10 = CSharpScript(x=simplify(discontinuity_36.Points), y=discontinuity_35.Points)  # -> out, A; inputs x: tree of Point3d, y: list of Point3d; disabled; same code as c_script

# ---- group: ConvexHullAreaSorting (continued)
convex_hull_20 = ConvexHull(Points=c_script_10.A, Plane=PlaneXY(0, 0, 0))  # -> flatten(Hull), HullZ, Indices; disabled
area_37 = Area(Geometry=convex_hull_20.Hull)  # -> Area, Centroid; disabled
sort_list_19 = SortList(Keys=area_37.Area, ValuesValuesA=curve_50)  # -> Keys, ValuesValuesA; disabled
list_item_40 = ListItem(List=sort_list_19.ValuesValuesA, Index=0, Wrap=True)  # disabled

# ---- group: ConvexHulls (continued)
discontinuity_37 = Discontinuity(Curve=[list_item_40, convex_hull_19.Hull], Level=1)  # -> flatten(Points), Parameters; disabled
convex_hull_21 = ConvexHull(Points=discontinuity_37.Points, Plane=PlaneXY(0, 0, 0))  # -> Hull, HullZ, Indices; disabled

# ---- group: SheetMinusThe"Union"BetweenTheTwoPlacedParts (continued)
region_difference_10 = RegionDifference(CurvesA=region_difference_9, CurvesB=convex_hull_21.Hull)  # disabled

# ---- group: TheTwoPartsToRunThroughTheNoFitPolygonAlgorithm (continued)
merge_18 = Merge(Data1=curve_34, Data2=convex_hull_21.Hull)  # -> flatten(Result); disabled

# ---- group: NoFitPolygonAndTheRespectiveTranslations (continued)
nestingtwoitems_12 = CSharpScript(
    x=merge_18,
    Reference="C:\PROGRAM FILES\COMMON FILES\MCNEEL\RHINOCEROS\5.0\PLUG-INS\CLIPPERPLUGIN (BAE0724C-D28B-4D54-9B02-806B19D157C2)\0.0.2.1\CLIPPER-0.2.2\ClipperTools.dll")  # -> out, A, B; inputs x: list of Polyline; disabled; same code as nestingtwoitems_7
curve_51 = Curve(nestingtwoitems_12.B)  # disabled
curve_52 = Curve(nestingtwoitems_12.A)  # disabled

# ----
brep_brep_7 = BrepBrep(BrepA=curve_52, BrepB=region_difference_10)  # -> flatten(Curves), Points; disabled
closed_7 = Closed(Curve=brep_brep_7.Curves)  # -> Closed, Periodic; disabled
cull_pattern_7 = CullPattern(List=brep_brep_7.Curves, CullPattern=closed_7.Closed)  # disabled
curve_53 = Curve(cull_pattern_7)  # disabled
area_38 = Area(Geometry=curve_53)  # -> Area, Centroid; disabled
panel_61 = Panel(area_38.Area)  # disabled
text_split_14 = TextSplit(Text=panel_61, Separators=panel_33)  # disabled
panel_62 = Panel(text_split_14)  # disabled
list_item_41 = ListItem(List=panel_62, Index=0, Wrap=True)  # -> flatten(Item); disabled
panel_63 = Panel(list_item_41)  # disabled
evaluate_12 = Evaluate(Expression="If(x=y, True, False)", x=panel_49, y=panel_63)  # disabled
dispatch_13 = Dispatch(List=curve_53, DispatchPattern=evaluate_12)  # -> ListA, ListB; disabled
discontinuity_38 = Discontinuity(Curve=convex_hull_21.Hull, Level=1)  # -> Points, Parameters; disabled
curve_54 = Curve(dispatch_13.ListA)  # disabled

# ---- group: CreateATreeWithAllThePlacementPointsAndThePolygonWeArePlacingNextTo (continued)
graft_tree_12 = GraftTree(Tree=curve_54, IncludeEmptyLists=True, IncludeNullItems=True)  # disabled
discontinuity_39 = Discontinuity(Curve=graft_tree_12, Level=1)  # -> Points, Parameters; disabled
c_script_11 = CSharpScript(x=simplify(discontinuity_39.Points), y=discontinuity_38.Points)  # -> out, A; inputs x: tree of Point3d, y: list of Point3d; disabled; same code as c_script

# ---- group: ConvexHullAreaSorting (continued)
convex_hull_22 = ConvexHull(Points=c_script_11.A, Plane=PlaneXY(0, 0, 0))  # -> flatten(Hull), HullZ, Indices; disabled
area_39 = Area(Geometry=convex_hull_22.Hull)  # -> Area, Centroid; disabled
sort_list_20 = SortList(Keys=area_39.Area, ValuesValuesA=curve_54)  # -> Keys, ValuesValuesA; disabled
list_item_42 = ListItem(List=sort_list_20.ValuesValuesA, Index=0, Wrap=True)  # disabled

# ---- group: ConvexHulls (continued)
discontinuity_40 = Discontinuity(Curve=[convex_hull_21.Hull, list_item_42], Level=1)  # -> flatten(Points), Parameters; disabled
convex_hull_23 = ConvexHull(Points=discontinuity_40.Points, Plane=PlaneXY(0, 0, 0))  # -> Hull, HullZ, Indices; disabled

# ---- group: FinalOutPutNoSheet
merge_19 = Merge(
    Data1=placedpart_2,
    Data2=list_item_17,
    Data3=list_item_20,
    Data4=list_item_34,
    Data5=list_item_36,
    Data6=list_item_38,
    Data7=list_item_40,
    Data8=list_item_42)  # -> flatten(Result); disabled

# ----
# Partes ordenadas dentro del contenedor.
finaloutput = Merge(
    Data2=placedpart_2,
    Data3=list_item_17,
    Data4=list_item_20,
    Data5=list_item_34,
    Data6=list_item_36,
    Data7=list_item_38,
    Data8=list_item_40,
    Data9=list_item_42)  # disabled

# ---- group: Hulls
merge_20 = Merge(
    Data1=convex_hull_12.Hull,
    Data2=convex_hull_15.Hull,
    Data3=convex_hull_17.Hull,
    Data4=convex_hull_19.Hull,
    Data5=convex_hull_21.Hull,
    Data6=convex_hull_23.Hull)  # disabled

# ----
discontinuity_41 = Discontinuity(Curve=finaloutput, Level=1)  # -> flatten(Points), Parameters; disabled
convex_hull_24 = ConvexHull(Points=discontinuity_41.Points, Plane=PlaneXY(0, 0, 0))  # -> Hull, HullZ, Indices; disabled
area_40 = Area(Geometry=convex_hull_24.Hull)  # -> Area, Centroid; disabled
expression = Expression(x=area_40.Area, y=area_17.Area, Expression="If(x>y, True, False)")  # disabled
panel_64 = Panel(expression)  # disabled
