# Grasshopper definition NestingRhino6.gh (Grasshopper 1.0.7)
# plug-ins: ClipperComponents, PTComponentLibrary

curve = Curve(<curve referenced from the Rhino model>)
polygona = Curve(<curve referenced from the Rhino model>)
sheet = Curve(<curve referenced from the Rhino model>)
parttobeplaced = Curve(<curve referenced from the Rhino model>)  # disabled
discontinuity = Discontinuity(Curve=parttobeplaced, Level=1)  # -> Points, Parameters; disabled
polygona_2 = Curve(<curve referenced from the Rhino model>)  # disabled
number_slider = Slider(4, range=0..10)  # disabled
number_slider_2 = Slider(3, range=0..10)  # disabled
merge = Merge(Data1=polygona, Data2=sheet)
list_item = ListItem(List=discontinuity.Points, Index=number_slider_2, Wrap=True)  # disabled
# IFP(Inner Fit Polygon)
innerfitpolygon = CSharpScript(x=merge, y=Slider(0, range=0..3), Reference="C:\Users\Paula\AppData\Roaming\Grasshopper\Libraries\ClipperTools.dll")  # -> out, A, B, C; inputs x: list of Polyline, y: Int32
# ---------- innerfitpolygon: C# usings ----------
using System.IO;
using System.Linq;
using System.Data;
using System.Drawing;
using System.Reflection;
using System.Windows.Forms;
using System.Xml;
using System.Xml.Linq;
using System.Runtime.InteropServices;

using Rhino.DocObjects;
using Rhino.Collections;
using GH_IO;
using GH_IO.Serialization;
using StudioAvw.Geometry;
using ClipperLib;
# ---------- innerfitpolygon: C# ----------
    x = AreaSorting(x);

    var final = FirstPlacement(x)[y];

    /*
    var outPut = new List<Polyline>();

    outPut.Add(x[x.Count - 1]);
    outPut.Add(final);

    A = outPut;
    */

    A = final;

    B = x.ElementAt(x.Count - 1);

    C = IFP(x);

    //x.RemoveAt(0);

    //B = FirstPlacement(x)[FirstPlacement(x).Count - 1];
# ---------- innerfitpolygon: C# additional code ----------
  public List<Polyline> FirstPlacement(List<Polyline> x)
  {

    var innerFitPolygon = IFP(x)[1];

    List<Polyline> oner = new List<Polyline>();

    oner.Add(innerFitPolygon);
    oner.Add(x[0]);

    List<Polyline> two = new List<Polyline>();

    two.Add(innerFitPolygon);

    var fix = Translate(oner);

    for(int i = 0; i < fix.Length; ++i)
    {

      two.Add(fix.ElementAt(i));

    }

    two = AreaSorting(two);

    var a = two[two.Count - 1].ToNurbsCurve();

    two.RemoveAt(two.Count - 1);

    var array = new Curve[two.Count];

    Rhino.Geometry.Intersect.CurveIntersections ci;
    DataTree<Point3d> intPts = new DataTree<Point3d>();

    var numberOfIntersections = new Double[two.Count];

    var sortNumberOfIntersections = new List<KeyValuePair<Polyline, double>>();
    for(int i = 0; i < array.Length; ++i)
    {

      array[i] = two.ElementAt(i).ToNurbsCurve();


      ci = Rhino.Geometry.Intersect.Intersection.CurveCurve(a, array[i], 0.001, 0.001);

      for(int j = 0; j < ci.Count; j++)
      {

        intPts.Add(ci[j].PointA, new GH_Path(i));

        numberOfIntersections[i] = intPts.Branch(i).Count;

        sortNumberOfIntersections.Add(new KeyValuePair<Polyline, double>(two[i], numberOfIntersections[i]));

      }

    }

    sortNumberOfIntersections.Sort(Compare1);
    sortNumberOfIntersections.Reverse();

    List<Polyline> sortedPolys = (from kvp in sortNumberOfIntersections select kvp.Key).Distinct().ToList();
    sortedPolys.Reverse();

    return sortedPolys;

  }

  public Polyline[] Translate(List<Polyline> curve)
  {

    var treeOut = PointDataTree(curve);

    var polyTwo = curve[0];
    var polyOne = curve[curve.Count - 1];

    List<Point3d> ptNFP;
    ptNFP = polyTwo.ToList();
    ptNFP.RemoveAt(0);

    List<Vector3d> vectors = new List<Vector3d>();
    for(int i = 0; i < ptNFP.Count; ++i)
    {

      vectors.Add(new Vector3d(ptNFP.ElementAt(i) - treeOut.Branch(treeOut.BranchCount - 1)[0]));

    }

    List<Curve> translated = new List<Curve>();
    var polys = new Polyline[ptNFP.Count];
    List<List<Point3d>> polyPoint = new List<List<Point3d>>();

    List<Point3d> pointsA = new List<Point3d>();
    pointsA = polyTwo.ToList();
    pointsA.RemoveAt(pointsA.Count - 1);
    DataTree<Point3d> polyPoints = new DataTree<Point3d>();
    DataTree<Point3d> APoints = new DataTree<Point3d>();
    for(int i = 0; i < ptNFP.Count; ++i)
    {

      var path = new GH_Path(i);
      Curve oney = polyOne.ToNurbsCurve();
      oney.Translate(vectors.ElementAt(i));
      translated.Add(oney);
      translated.ElementAt(i).TryGetPolyline(out polys[i]);
      polyPoint.Add(polys[i].ToList());

    }

    return polys;

  }

  public List<Polyline> IFP(List<Polyline> curves)
  {

    curves = AreaSorting(curves);

    var one = curves.ElementAt(0);
    var two = curves.ElementAt(curves.Count - 1);

    var points = PointDataTree(curves);

    // Inner Fit Polygon
    Point3d centerOne = points.Branch(0)[0];//ptB[ptB.Count - 1];
    Vector3d zAxis = Vector3d.ZAxis;
    Plane pO = new Rhino.Geometry.Plane(centerOne, zAxis);
    double tolerance = 1e-8;

    List<Polyline> outCurvesOne = new List<Polyline>();
    List<Polyline> outDisplacedCurvesOne = new List<Polyline>();
    foreach(List<IntPoint> path in ClipperLib.Clipper.MinkowskiDiff(one.ToPath2D(pO, tolerance), two.ToPath2D(pO, tolerance)))
    {

      Polyline plSum = path.ToPolyline(pO, tolerance, true);
      outCurvesOne.Add(plSum);

    }

    Polyline bin = outCurvesOne[1];

    return outCurvesOne;

  }

  public List<Polyline> AreaSorting(List<Polyline> x)
  {

    // We want to cast(change from one data type to another) our list of polylines to curves, so that
    // we can call the AreaMassProperties class and its method .Compute to get the area of the polygons
    // after that we can now create a List of KeyValuePair to assign the area of our polygons to our
    // polygons so that we can sort them later according to their areas.
    List<Curve> one = new List<Curve>();
    double[] areas = new Double[x.Count];
    var curves = new List<KeyValuePair<Polyline, double>>();

    for(int i = 0; i < x.Count; ++i)
    {

      one.Add(x.ElementAt(i).ToNurbsCurve());
      areas[i] = AreaMassProperties.Compute(one.ElementAt(i)).Area;
      curves.Add(new KeyValuePair<Polyline, double>(x.ElementAt(i), areas[i]));

    }

    // Here is where the sorting according to area values takes place.
    curves.Sort(Compare1);
    curves.Reverse();
    // We retrieve a list of curves from our List of KeyValuePairs
    List<Polyline> curve = (from kvp in curves select kvp.Key).Distinct().ToList();
    curve.Reverse();

    return curve;

  }

  public DataTree<Point3d> PointDataTree(List<Polyline> curve)
  {

    // We create and populate trees with the points of the curves, so that we can
    // sort each of the lower left points of each of the curves according to the
    // sum of their Xs and Ys positions.
    List<List<Point3d>> pts = new List<List<Point3d>>();
    DataTree<Point3d> tree = new DataTree<Point3d>();
    DataTree<double> treeSum = new DataTree<double>();
    var points = new DataTree<KeyValuePair<Point3d, double>>();
    var point = new List<Point3d>[curve.Count];
    DataTree<Point3d> treeLowerLeft = new DataTree<Point3d>();

    for(int i = 0; i < curve.Count; ++i)
    {

      pts.Add(curve[i].ToList());
      pts[i].RemoveAt(pts[i].Count - 1);
      GH_Path path = new GH_Path(i);

      for(int j = 0; j < pts[i].Count; ++j)
      {

        tree.Add(pts[i][j], path);
        treeSum.Add(pts[i][j].X + pts[i][j].Y, path);

        points.Add(new KeyValuePair<Point3d, double>(tree.Branch(i)[j], treeSum.Branch(i)[j]), path);

        points.Branch(i).Sort(Compare2);
        points.Branch(i).Reverse();
        point[i] = (from kvp in points.Branch(i) select kvp.Key).Distinct().ToList();
        point[i].Reverse();

      }

    }

    for(int i = 0; i < tree.BranchCount; ++i)
      for(int j = 0; j < tree.Branch(i).Count; ++j)
      {

        treeLowerLeft.Add(point[i][j], new GH_Path(i));

      }

    var treeOut = new DataTree<Point3d>();

    for(int i = 0; i < treeLowerLeft.BranchCount; ++i)
      for(int j = 0; j < treeLowerLeft.Branch(i).Count; ++j)
      {

        treeOut.Add(treeLowerLeft.Branch(i)[0], new GH_Path(i));

      }

    return treeOut;

  }

  static int Compare1(KeyValuePair<Polyline, double> a, KeyValuePair<Polyline, double> b)
  {

    return a.Value.CompareTo(b.Value);

  }

  static int Compare2(KeyValuePair<Point3d, double> a, KeyValuePair<Point3d, double> b)
  {

    return a.Value.CompareTo(b.Value);

  }
# ---------- end innerfitpolygon ----------
minkowski_difference = MinkowskiDifference(A=parttobeplaced, B=polygona_2, Plane=list_item, Tolerance=0.001)  # disabled
number_slider_3 = Slider(1, range=0..1)  # disabled
number_slider_4 = Slider(0, range=0..1)  # disabled
list_item_2 = ListItem(List=minkowski_difference, Index=number_slider_4, Wrap=True)  # disabled
number_slider_5 = Slider(12, range=0..100)  # disabled
discontinuity_2 = Discontinuity(Curve=list_item_2, Level=1)  # -> Points, Parameters; disabled
vector_2pt = Vector2Pt(PointA=list_item, PointB=discontinuity_2.Points, Unitize=False)  # -> Vector, Length; disabled
vector_display = VectorDisplay(Anchor=list_item, Vector=vector_2pt.Vector)  # disabled
move = Move(Geometry=parttobeplaced, Motion=vector_2pt.Vector)  # -> Geometry, Transform; disabled
placedpart = Curve(innerfitpolygon.A)
list_item_3 = ListItem(List=move.Geometry, Index=number_slider_5, Wrap=True)  # disabled
discontinuity_3 = Discontinuity(Curve=[polygona_2, list_item_3], Level=1)  # -> flatten(Points), Parameters; disabled
convex_hull = ConvexHull(Points=discontinuity_3.Points, Plane=PlaneXY(0, 0, 0))  # -> Hull, HullZ, Indices; disabled
colour_swatch = ColourSwatch(SwatchColor=RGB(8, 96, 255))  # disabled
# NFP(No Fit Polygon)
parttobeplaced_2 = Curve(<curve referenced from the Rhino model>)
brep = Brep(list_item_3)  # disabled
merge_2 = Merge(Data1=parttobeplaced_2, Data2=placedpart)
custom_preview = CustomPreview(Geometry=brep, Shader=colour_swatch)  # disabled
nestingtwoitems = CSharpScript(x=merge_2, y=Slider(0, range=0..100), Reference="C:\Users\Paula\AppData\Roaming\Grasshopper\Libraries\ClipperTools.dll")  # -> out, A, B; inputs x: list of Polyline
# ---------- nestingtwoitems: C# ----------
    // We want to cast(change from one data type to another) our list of polylines to curves, so that
    // we can call the AreaMassProperties class and its method .Compute to get the area of the polygons
    // after that we can now create a List of KeyValuePair to assign the area of our polygons to our
    // polygons so that we can sort them later according to their areas.
    List<Curve> one = new List<Curve>();
    double[] areas = new Double[x.Count];
    var curves = new List<KeyValuePair<Polyline, double>>();

    for(int i = 0; i < x.Count; ++i)
    {

      one.Add(x.ElementAt(i).ToNurbsCurve());
      areas[i] = AreaMassProperties.Compute(one.ElementAt(i)).Area;
      curves.Add(new KeyValuePair<Polyline, double>(x.ElementAt(i), areas[i]));

    }

    // Here is where the sorting according to area values takes place.
    //curves.Sort(Compare1);
    curves.Reverse();
    // We retrieve a list of curves from our List of KeyValuePairs
    List<Polyline> curve = (from kvp in curves select kvp.Key).Distinct().ToList();
    curve.Reverse();

    // We create and populate trees with the points of the curves, so that we can
    // sort each of the lower left points of each of the curves according to the
    // sum of their Xs and Ys positions.
    List<List<Point3d>> pts = new List<List<Point3d>>();
    DataTree<Point3d> tree = new DataTree<Point3d>();
    DataTree<double> treeSum = new DataTree<double>();
    var points = new DataTree<KeyValuePair<Point3d, double>>();
    var point = new List<Point3d>[curve.Count];
    DataTree<Point3d> treeLowerLeft = new DataTree<Point3d>();

    for(int i = 0; i < curve.Count; ++i)
    {

      pts.Add(curve[i].ToList());
      pts[i].RemoveAt(pts[i].Count - 1);
      GH_Path path = new GH_Path(i);

      for(int j = 0; j < pts[i].Count; ++j)
      {

        tree.Add(pts[i][j], path);
        treeSum.Add(pts[i][j].X + pts[i][j].Y, path);

        points.Add(new KeyValuePair<Point3d, double>(tree.Branch(i)[j], treeSum.Branch(i)[j]), path);

        points.Branch(i).Sort(Compare2);
        points.Branch(i).Reverse();
        point[i] = (from kvp in points.Branch(i) select kvp.Key).Distinct().ToList();
        point[i].Reverse();

      }

    }

    for(int i = 0; i < tree.BranchCount; ++i)
      for(int j = 0; j < tree.Branch(i).Count; ++j)
      {

        treeLowerLeft.Add(point[i][j], new GH_Path(i));

      }

    var treeOut = new DataTree<Point3d>();

    for(int i = 0; i < treeLowerLeft.BranchCount; ++i)
      for(int j = 0; j < treeLowerLeft.Branch(i).Count; ++j)
      {

        treeOut.Add(treeLowerLeft.Branch(i)[0], new GH_Path(i));

      }

    /*
    // Create the data structures and initialize them
    DataTree<Point3d> points = new DataTree<Point3d>();
    List<List<Point3d>> lists = new List<List<Point3d>>();

    // Fill the nested list with the list of points
    for(int i = 0; i < x.Count; ++i)
    {

      lists.Add(x[i].ToList());

    }

    // Fill the data tree with the list of points
    for(int i = 0; i < lists.Count; ++i)
    {

      var path = new GH_Path(i);

      for(int j = 0; j < lists[i].Count; ++j )
      {

        points.Add(lists[i][j], path);

      }

    }
    */


    // No Fit Polygon from minkowsky difference using the clipper lib
    Polyline polyOne = curve[0];
    Polyline polyTwo = curve[curve.Count - 1];

    Point3d center = treeOut.Branch(0).ElementAt(0);
    Vector3d zAxis = Vector3d.ZAxis;
    Plane p = new Rhino.Geometry.Plane(center, zAxis);

    double tolerance = 1e-8;
    List<Polyline> outCurves = new List<Polyline>();
    List<Polyline> outDisplacedCurves = new List<Polyline>();
    foreach(List<IntPoint> path in ClipperLib.Clipper.MinkowskiDiff(polyOne.ToPath2D(p, tolerance), polyTwo.ToPath2D(p, tolerance)))
    {

      Polyline plSum = path.ToPolyline(p, tolerance, true);
      outCurves.Add(plSum);

    }

    Polyline NFP = outCurves[0];

    B = NFP;

    List<Point3d> ptNFP;
    ptNFP = NFP.ToList();
    ptNFP.RemoveAt(0);

    List<Vector3d> vectors = new List<Vector3d>();
    for(int i = 0; i < ptNFP.Count; ++i)
    {

      vectors.Add(new Vector3d(ptNFP.ElementAt(i) - treeOut.Branch(0)[0]));

    }

    List<Curve> translated = new List<Curve>();
    Polyline[] polys = new Polyline[ptNFP.Count];
    List<List<Point3d>> polyPoint = new List<List<Point3d>>();

    List<Point3d> pointsA = new List<Point3d>();
    pointsA = polyTwo.ToList();
    pointsA.RemoveAt(pointsA.Count - 1);
    DataTree<Point3d> polyPoints = new DataTree<Point3d>();
    DataTree<Point3d> APoints = new DataTree<Point3d>();
    for(int i = 0; i < ptNFP.Count; ++i)
    {

      var path = new GH_Path(i);
      Curve oney = polyOne.ToNurbsCurve();
      oney.Translate(vectors.ElementAt(i));
      translated.Add(oney);
      translated.ElementAt(i).TryGetPolyline(out polys[i]);
      polyPoint.Add(polys[i].ToList());

      for(int j = 0; j < polyPoint[i].Count - 1; ++j)
      {

        polyPoints.Add(polyPoint[i][j], path);

      }

    }

    for(int i = 0; i < ptNFP.Count; ++i)
      for(int j = 0; j < pointsA.Count; ++j)
      {

        var path = new GH_Path(i);
        APoints.Add(pointsA[j], path);

      }

    for(int i = 0; i < polyPoints.BranchCount; ++i)
      for(int j = 0; j < polyPoints.Branch(i).Count; ++j)
      {

        APoints.Add(polyPoints.Branch(i)[j], new GH_Path(i));

      }

    var list = new Grasshopper.Kernel.Geometry.Node2List[APoints.BranchCount];
    var polyLines = new Polyline[APoints.BranchCount];
    var curvesConvex = new Curve[APoints.BranchCount];
    var convexArea = new Double[APoints.BranchCount];
    var convexSort = new List<KeyValuePair<Polyline, double>>();
    var hullSort = new List<KeyValuePair<Polyline, double>>();

    for(int i = 0; i < APoints.BranchCount; ++i)
    {

      list[i] = new Grasshopper.Kernel.Geometry.Node2List(APoints.Branch(i));
      polyLines[i] = Grasshopper.Kernel.Geometry.ConvexHull.Solver.ComputeHull(list[i]);
      curvesConvex[i] = polyLines[i].ToNurbsCurve();
      convexArea[i] = AreaMassProperties.Compute(curvesConvex[i]).Area;
      convexSort.Add(new KeyValuePair<Polyline, double>(polys[i], convexArea[i]));
      hullSort.Add(new KeyValuePair<Polyline, double>(polyLines[i], convexArea[i]));

    }

    // Output the polygons with no convex hull
    // Here is where the sorting according to area values takes place.
    convexSort.Sort(Compare1);
    convexSort.Reverse();
    // We retrieve a list of polylines from our List of KeyValuePairs
    List<Polyline> polyFinal = (from kvp in convexSort select kvp.Key).Distinct().ToList();
    polyFinal.Reverse();

    // Output the convex hull polygons
    // Here is where the sorting according to area values takes place.
    hullSort.Sort(Compare1);
    hullSort.Reverse();
    // We retrieve a list of polylines from our List of KeyValuePairs
    List<Polyline> hullFinal = (from kvp in hullSort select kvp.Key).Distinct().ToList();
    hullFinal.Reverse();

    A = polyFinal;

    //B = hullFinal[0];

    /*
    Curve booleanUnionOne = polyFinal[0].ToNurbsCurve();
    Curve booleanUnionTwo = polyTwo.ToNurbsCurve();

    var listBoolean = new List<Curve>();

    listBoolean.Add(booleanUnionOne);
    listBoolean.Add(booleanUnionTwo);

    A = Curve.CreateBooleanUnion(listBoolean).ElementAt(1);
    */
# ---------- nestingtwoitems: C# additional code ----------
  static int Compare1(KeyValuePair<Polyline, double> a, KeyValuePair<Polyline, double> b)
  {

    return a.Value.CompareTo(b.Value);

  }

  static int Compare2(KeyValuePair<Point3d, double> a, KeyValuePair<Point3d, double> b)
  {

    return a.Value.CompareTo(b.Value);

  }
# ---------- end nestingtwoitems ----------
possibleplacements = Curve(nestingtwoitems.A)
curve_2 = Curve(nestingtwoitems.B)
region_intersection = RegionIntersection(CurvesA=possibleplacements, CurvesB=sheet)
area = Area(Geometry=parttobeplaced_2)  # -> Area, Centroid
area_2 = Area(Geometry=region_intersection)  # -> Area, Centroid

# ---- group: NestingNoSheet / NestingNoIFP
# Ordenamiento sin lamina
number_slider_6 = Slider(0.1, range=0..1)  # disabled
# NestingWithNoSheet
curve_3 = Curve([<curve referenced from the Rhino model> x6])  # disabled
curve_to_polyline = CurveToPolyline(Curve=curve_3, ToleranceDistance=0, ToleranceAngle=number_slider_6)  # -> Polyline, Segments; disabled
curve_4 = Curve(<curve referenced from the Rhino model>)  # disabled
curve_5 = Curve([<curve referenced from the Rhino model> x2])  # disabled
curve_6 = Curve([<curve referenced from the Rhino model> x2])  # disabled
curve_7 = Curve([<curve referenced from the Rhino model> x4])  # disabled
merge_3 = Merge(Data1=curve_7, Data2=curve_to_polyline.Polyline, Data3=curve_5, Data4=curve_6, Data5=curve_4)  # disabled
number_slider_7 = Slider(8, range=0..10)  # disabled
panel = Panel(merge_3)  # disabled
shift_list = ShiftList(List=merge_3, Shift=number_slider_7, Wrap=True)  # disabled
nesting = CSharpScript(x=shift_list, Reference="C:\Users\Paula\AppData\Roaming\Grasshopper\Libraries\ClipperTools.dll")  # -> out, A, B; inputs x: list of Polyline; disabled
# ---------- nesting: C# ----------
    var hulls = new List<Polyline>();
    A = NestingMultiple(x, out hulls);
    B = hulls;
# ---------- nesting: C# additional code ----------
  public List<Polyline> NestingMultiple(List<Polyline> curve, out List<Polyline> outHulls)
  {

    //curve = AreaSorting(curve);
    //curve.Reverse();
    var outer = new List<Polyline>();
    outHulls = new List<Polyline>();
    for(int i = 0; i < curve.Count - 1; ++i)
    {

      var hullFinal = new List<Polyline>();
      var x = Nesting(curve, out hullFinal);
      var finalCurve = x[0];
      var finalHull = hullFinal[0];
      var oner = curve[curve.Count - 1];
      curve.Add(finalHull);
      curve.RemoveAt(0);

      outer.Add(finalCurve);
      outer.Add(oner);
      //outer = AreaSorting(outer);
      outer.RemoveAt(i + 1);
      outHulls.Add(finalHull);

    }

    //curve = AreaSorting(curve);

    outer.Add(curve[0]);

    return outer;

  }

  public List<Polyline> Nesting(List<Polyline> curve, out List<Polyline> hullFinal)
  {

    var treeOut = PointDataTree(curve);

    Polyline[] polys;

    var APoints = ConvexHullPoints(curve, treeOut, out polys);

    List<Polyline> polyFinal;

    hullFinal = ConvexHull(APoints, polys, out polyFinal);

    return polyFinal;

  }

  public Polyline IFP(List<Polyline> curves)
  {

    var one = curves.ElementAt(0);
    var two = curves.ElementAt(curves.Count - 1);

    var points = PointDataTree(curves);

    // Inner Fit Polygon
    Point3d centerOne = points.Branch(0)[0];//ptB[ptB.Count - 1];
    Vector3d zAxis = Vector3d.ZAxis;
    Plane pO = new Rhino.Geometry.Plane(centerOne, zAxis);
    double tolerance = 0.0001;

    List<Polyline> outCurvesOne = new List<Polyline>();
    List<Polyline> outDisplacedCurvesOne = new List<Polyline>();
    foreach(List<IntPoint> path in ClipperLib.Clipper.MinkowskiDiff(one.ToPath2D(pO, tolerance), two.ToPath2D(pO, tolerance)))
    {

      Polyline plSum = path.ToPolyline(pO, tolerance, true);
      outCurvesOne.Add(plSum);

    }

    Polyline bin = outCurvesOne[1];

    return bin;

  }

  public List<Polyline> AreaSorting(List<Polyline> x)
  {

    // We want to cast(change from one data type to another) our list of polylines to curves, so that
    // we can call the AreaMassProperties class and its method .Compute to get the area of the polygons
    // after that we can now create a List of KeyValuePair to assign the area of our polygons to our
    // polygons so that we can sort them later according to their areas.
    List<Curve> one = new List<Curve>();
    double[] areas = new Double[x.Count];
    var curves = new List<KeyValuePair<Polyline, double>>();

    for(int i = 0; i < x.Count; ++i)
    {

      one.Add(x.ElementAt(i).ToNurbsCurve());
      areas[i] = AreaMassProperties.Compute(one.ElementAt(i)).Area;
      curves.Add(new KeyValuePair<Polyline, double>(x.ElementAt(i), areas[i]));

    }

    // Here is where the sorting according to area values takes place.
    curves.Sort(Compare1);
    curves.Reverse();
    // We retrieve a list of curves from our List of KeyValuePairs
    List<Polyline> curve = (from kvp in curves select kvp.Key).Distinct().ToList();
    curve.Reverse();

    return curve;

  }

  public DataTree<Point3d> PointDataTree(List<Polyline> curve)
  {

    // We create and populate trees with the points of the curves, so that we can
    // sort each of the lower left points of each of the curves according to the
    // sum of their Xs and Ys positions.
    List<List<Point3d>> pts = new List<List<Point3d>>();
    DataTree<Point3d> tree = new DataTree<Point3d>();
    DataTree<double> treeSum = new DataTree<double>();
    var points = new DataTree<KeyValuePair<Point3d, double>>();
    var point = new List<Point3d>[curve.Count];
    DataTree<Point3d> treeLowerLeft = new DataTree<Point3d>();

    for(int i = 0; i < curve.Count; ++i)
    {

      pts.Add(curve[i].ToList());
      pts[i].RemoveAt(pts[i].Count - 1);
      GH_Path path = new GH_Path(i);

      for(int j = 0; j < pts[i].Count; ++j)
      {

        tree.Add(pts[i][j], path);
        treeSum.Add(pts[i][j].X + pts[i][j].Y, path);

        points.Add(new KeyValuePair<Point3d, double>(tree.Branch(i)[j], treeSum.Branch(i)[j]), path);

        points.Branch(i).Sort(Compare2);
        points.Branch(i).Reverse();
        point[i] = (from kvp in points.Branch(i) select kvp.Key).Distinct().ToList();
        point[i].Reverse();

      }

    }

    for(int i = 0; i < tree.BranchCount; ++i)
      for(int j = 0; j < tree.Branch(i).Count; ++j)
      {

        treeLowerLeft.Add(point[i][j], new GH_Path(i));

      }

    var treeOut = new DataTree<Point3d>();

    for(int i = 0; i < treeLowerLeft.BranchCount; ++i)
      for(int j = 0; j < treeLowerLeft.Branch(i).Count; ++j)
      {

        treeOut.Add(treeLowerLeft.Branch(i)[0], new GH_Path(i));

      }

    return treeOut;

  }

  public DataTree<Point3d> ConvexHullPoints(List<Polyline> curve, DataTree<Point3d> treeOut, out Polyline[] polys)
  {

    // No Fit Polygon from minkowsky difference using the clipper lib
    Polyline polyOne = curve[0];
    Polyline polyTwo = curve[curve.Count - 1];

    Point3d center = treeOut.Branch(0).ElementAt(0);
    Vector3d zAxis = Vector3d.ZAxis;
    Plane p = new Rhino.Geometry.Plane(center, zAxis);

    double tolerance = 0.001;
    List<Polyline> outCurves = new List<Polyline>();
    List<Polyline> outDisplacedCurves = new List<Polyline>();
    foreach(List<IntPoint> path in ClipperLib.Clipper.MinkowskiDiff(polyOne.ToPath2D(p, tolerance), polyTwo.ToPath2D(p, tolerance)))
    {

      Polyline plSum = path.ToPolyline(p, tolerance, true);
      outCurves.Add(plSum);

    }

    Polyline NFP = outCurves[0];

    List<Point3d> ptNFP;
    ptNFP = NFP.ToList();
    ptNFP.RemoveAt(0);

    List<Vector3d> vectors = new List<Vector3d>();
    for(int i = 0; i < ptNFP.Count; ++i)
    {

      vectors.Add(new Vector3d(ptNFP.ElementAt(i) - treeOut.Branch(0)[0]));

    }

    List<Curve> translated = new List<Curve>();
    polys = new Polyline[ptNFP.Count];
    List<List<Point3d>> polyPoint = new List<List<Point3d>>();

    List<Point3d> pointsA = new List<Point3d>();
    pointsA = polyTwo.ToList();
    pointsA.RemoveAt(pointsA.Count - 1);
    DataTree<Point3d> polyPoints = new DataTree<Point3d>();
    DataTree<Point3d> APoints = new DataTree<Point3d>();
    for(int i = 0; i < ptNFP.Count; ++i)
    {

      var path = new GH_Path(i);
      Curve oney = polyOne.ToNurbsCurve();
      oney.Translate(vectors.ElementAt(i));
      translated.Add(oney);
      translated.ElementAt(i).TryGetPolyline(out polys[i]);
      polyPoint.Add(polys[i].ToList());

      for(int j = 0; j < polyPoint[i].Count - 1; ++j)
      {

        polyPoints.Add(polyPoint[i][j], path);

      }

    }

    for(int i = 0; i < ptNFP.Count; ++i)
      for(int j = 0; j < pointsA.Count; ++j)
      {

        var path = new GH_Path(i);
        APoints.Add(pointsA[j], path);

      }

    for(int i = 0; i < polyPoints.BranchCount; ++i)
      for(int j = 0; j < polyPoints.Branch(i).Count; ++j)
      {

        APoints.Add(polyPoints.Branch(i)[j], new GH_Path(i));

      }

    return APoints;

  }

  public List<Polyline> ConvexHull(DataTree<Point3d> APoints, Polyline[] polys, out List<Polyline> polyFinal)
  {

    var list = new Grasshopper.Kernel.Geometry.Node2List[APoints.BranchCount];
    var polyLines = new Polyline[APoints.BranchCount];
    var curvesConvex = new Curve[APoints.BranchCount];
    var convexArea = new Double[APoints.BranchCount];
    var convexSort = new List<KeyValuePair<Polyline, double>>();
    var hullSort = new List<KeyValuePair<Polyline, double>>();

    for(int i = 0; i < APoints.BranchCount; ++i)
    {

      list[i] = new Grasshopper.Kernel.Geometry.Node2List(APoints.Branch(i));
      polyLines[i] = Grasshopper.Kernel.Geometry.ConvexHull.Solver.ComputeHull(list[i]);
      curvesConvex[i] = polyLines[i].ToNurbsCurve();
      convexArea[i] = AreaMassProperties.Compute(curvesConvex[i]).Area;
      convexSort.Add(new KeyValuePair<Polyline, double>(polys[i], convexArea[i]));
      hullSort.Add(new KeyValuePair<Polyline, double>(polyLines[i], convexArea[i]));

    }

    // Output the polygons with no convex hull
    // Here is where the sorting according to area values takes place.
    convexSort.Sort(Compare1);
    convexSort.Reverse();
    // We retrieve a list of polylines from our List of KeyValuePairs
    polyFinal = (from kvp in convexSort select kvp.Key).Distinct().ToList();
    polyFinal.Reverse();

    // Output the convex hull polygons
    // Here is where the sorting according to area values takes place.
    hullSort.Sort(Compare1);
    hullSort.Reverse();
    // We retrieve a list of polylines from our List of KeyValuePairs
    List<Polyline> hullFinal = (from kvp in hullSort select kvp.Key).Distinct().ToList();
    hullFinal.Reverse();

    return hullFinal;

  }

  static int Compare1(KeyValuePair<Polyline, double> a, KeyValuePair<Polyline, double> b)
  {

    return a.Value.CompareTo(b.Value);

  }

  static int Compare2(KeyValuePair<Point3d, double> a, KeyValuePair<Point3d, double> b)
  {

    return a.Value.CompareTo(b.Value);

  }
# ---------- end nesting ----------
outputconvexhulls = Curve(nesting.B)  # disabled
outputcurves = Curve(nesting.A)  # disabled

# ----
integer = Integer(area.Area)
integer_2 = Integer(area_2.Area)
evaluate = Evaluate(Expression="If(x=y, True, False)", x=integer, y=integer_2)
# Test de Inclusión
dispatch = Dispatch(List=region_intersection, DispatchPattern=evaluate)  # -> ListA, ListB
curve_8 = Curve(dispatch.ListA)
discontinuity_4 = Discontinuity(Curve=placedpart, Level=1)  # -> Points, Parameters
graft_tree = GraftTree(Tree=curve_8, IncludeEmptyLists=True, IncludeNullItems=True)
discontinuity_5 = Discontinuity(Curve=graft_tree, Level=1)  # -> Points, Parameters
c_script = CSharpScript(x=simplify(discontinuity_5.Points), y=discontinuity_4.Points)  # -> out, A; inputs x: tree of Point3d, y: list of Point3d
# ---------- c_script: C# ----------
    if(x.BranchCount > 1 )
    {

      for(int i = 0; i < x.BranchCount; ++i)
        for(int j = 0; j < y.Count; ++j)
        {

          x.Add(y[j], new GH_Path(i));

        }

    }

    else
    {

      for(int i = 0; i < y.Count; ++i)
      {

        x.Add(y[i]);

      }

    }

    A = x;
# ---------- end c_script ----------
convex_hull_2 = ConvexHull(Points=c_script.A, Plane=PlaneXY(0, 0, 0))  # -> flatten(Hull), HullZ, Indices
area_3 = Area(Geometry=convex_hull_2.Hull)  # -> Area, Centroid
number_slider_8 = Slider(100, range=0..200)  # disabled
number_slider_9 = Slider(0, range=0..2)
sort_list = SortList(Keys=area_3.Area, ValuesValuesA=curve_8)  # -> Keys, ValuesValuesA
sort_list_2 = SortList(Keys=area_3.Area, ValuesValuesA=convex_hull_2.Hull)  # -> Keys, ValuesValuesA
list_item_4 = ListItem(List=sort_list.ValuesValuesA, Index=number_slider_9, Wrap=True)
curve_9 = Curve([placedpart, list_item_4])
list_item_5 = ListItem(List=sort_list_2.ValuesValuesA, Index=number_slider_9, Wrap=True)
number_slider_10 = Slider(14.15, range=0..50)  # disabled
number_slider_11 = Slider(11.2, range=0..50)  # disabled
# Trabajo en Proceso
number_slider_12 = Slider(2, range=0..10)
divide_length = DivideLength(Curve=[list_item_4, placedpart], Distance=number_slider_10, RoundUp=False, RoundDn=False)  # disabled
number_slider_13 = Slider(1, range=0..10)  # disabled
pauls = Pauls(crv=curve_9, L=Slider(1.39, range=0..10), A=number_slider_12)
area_4 = Area()  # -> Area, Centroid; disabled
number_slider_14 = Slider(1.1, range=0..5)  # disabled
curve_10 = Curve(pauls)
number_slider_15 = Slider(1, range=0..10)  # disabled
sort_list_3 = SortList(Keys=area_4.Area)  # -> Keys, reverse(ValuesValuesA); disabled
list_length = ListLength()  # disabled
closed = Closed()  # -> Closed, Periodic; disabled
list_item_6 = ListItem(List=sort_list_3.ValuesValuesA, Index=0, Wrap=True)  # disabled
list_item_7 = ListItem(Index=list_length, Wrap=True)  # disabled
cull_pattern = CullPattern(CullPattern=closed.Closed)  # disabled
curve_11 = Curve(<curve referenced from the Rhino model>)  # disabled
area_5 = Area(Geometry=cull_pattern)  # -> Area, Centroid; disabled
region_difference = RegionDifference(CurvesA=sheet, CurvesB=curve_10)
curve_12 = Curve()
curve_13 = Curve(<curve referenced from the Rhino model>)  # disabled
curve_14 = Curve()  # disabled
sort_list_4 = SortList(Keys=area_5.Area, ValuesValuesA=cull_pattern)  # -> Keys, reverse(ValuesValuesA); disabled
list_item_8 = ListItem(List=sort_list_4.ValuesValuesA, Index=0, Wrap=True)  # disabled
curve_15 = Curve(<curve referenced from the Rhino model>)
brep_2 = Brep(list_item_8)  # disabled
merge_4 = Merge(Data1=curve_15, Data2=curve_10)  # -> flatten(Result)
brep_wireframe = BrepWireframe(Brep=brep_2, Density=-1)  # disabled
nestingtwoitems_2 = CSharpScript(x=merge_4, Reference="C:\Users\Paula\AppData\Roaming\Grasshopper\Libraries\ClipperTools.dll")  # -> out, A, B; inputs x: list of Polyline
# ---------- nestingtwoitems_2: C# ----------
    // We want to cast(change from one data type to another) our list of polylines to curves, so that
    // we can call the AreaMassProperties class and its method .Compute to get the area of the polygons
    // after that we can now create a List of KeyValuePair to assign the area of our polygons to our
    // polygons so that we can sort them later according to their areas.
    /*
    List<Curve> one = new List<Curve>();
    double[] areas = new Double[x.Count];
    var curves = new List<KeyValuePair<Polyline, double>>();

    for(int i = 0; i < x.Count; ++i)
    {

    one.Add(x.ElementAt(i).ToNurbsCurve());
    areas[i] = AreaMassProperties.Compute(one.ElementAt(i)).Area;
    curves.Add(new KeyValuePair<Polyline, double>(x.ElementAt(i), areas[i]));

    }

    // Here is where the sorting according to area values takes place.
    curves.Sort(Compare1);
    curves.Reverse();
    // We retrieve a list of curves from our List of KeyValuePairs
    List<Polyline> curve = (from kvp in curves select kvp.Key).Distinct().ToList();
    curve.Reverse();
    */

    List<Polyline> curve = x;

    // We create and populate trees with the points of the curves, so that we can
    // sort each of the lower left points of each of the curves according to the
    // sum of their Xs and Ys positions.
    List<List<Point3d>> pts = new List<List<Point3d>>();
    DataTree<Point3d> tree = new DataTree<Point3d>();
    DataTree<double> treeSum = new DataTree<double>();
    var points = new DataTree<KeyValuePair<Point3d, double>>();
    var point = new List<Point3d>[curve.Count];
    DataTree<Point3d> treeLowerLeft = new DataTree<Point3d>();

    for(int i = 0; i < curve.Count; ++i)
    {

      pts.Add(curve[i].ToList());
      pts[i].RemoveAt(pts[i].Count - 1);
      GH_Path path = new GH_Path(i);

      for(int j = 0; j < pts[i].Count; ++j)
      {

        tree.Add(pts[i][j], path);
        treeSum.Add(pts[i][j].X + pts[i][j].Y, path);

        points.Add(new KeyValuePair<Point3d, double>(tree.Branch(i)[j], treeSum.Branch(i)[j]), path);

        points.Branch(i).Sort(Compare2);
        points.Branch(i).Reverse();
        point[i] = (from kvp in points.Branch(i) select kvp.Key).Distinct().ToList();
        point[i].Reverse();

      }

    }

    for(int i = 0; i < tree.BranchCount; ++i)
      for(int j = 0; j < tree.Branch(i).Count; ++j)
      {

        treeLowerLeft.Add(point[i][j], new GH_Path(i));

      }

    var treeOut = new DataTree<Point3d>();

    for(int i = 0; i < treeLowerLeft.BranchCount; ++i)
      for(int j = 0; j < treeLowerLeft.Branch(i).Count; ++j)
      {

        treeOut.Add(treeLowerLeft.Branch(i)[0], new GH_Path(i));

      }

    /*
    // Create the data structures and initialize them
    DataTree<Point3d> points = new DataTree<Point3d>();
    List<List<Point3d>> lists = new List<List<Point3d>>();

    // Fill the nested list with the list of points
    for(int i = 0; i < x.Count; ++i)
    {

      lists.Add(x[i].ToList());

    }

    // Fill the data tree with the list of points
    for(int i = 0; i < lists.Count; ++i)
    {

      var path = new GH_Path(i);

      for(int j = 0; j < lists[i].Count; ++j )
      {

        points.Add(lists[i][j], path);

      }

    }
    */


    // No Fit Polygon from minkowsky difference using the clipper lib
    Polyline polyOne = curve[0];
    Polyline polyTwo = curve[curve.Count - 1];

    Point3d center = treeOut.Branch(0).ElementAt(0);
    Vector3d zAxis = Vector3d.ZAxis;
    Plane p = new Rhino.Geometry.Plane(center, zAxis);

    double tolerance = 1e-8;
    List<Polyline> outCurves = new List<Polyline>();
    List<Polyline> outDisplacedCurves = new List<Polyline>();
    foreach(List<IntPoint> path in ClipperLib.Clipper.MinkowskiDiff(polyOne.ToPath2D(p, tolerance), polyTwo.ToPath2D(p, tolerance)))
    {

      Polyline plSum = path.ToPolyline(p, tolerance, true);
      outCurves.Add(plSum);

    }

    Polyline NFP = outCurves[0];

    B = NFP;

    List<Point3d> ptNFP;
    ptNFP = NFP.ToList();
    ptNFP.RemoveAt(0);

    List<Vector3d> vectors = new List<Vector3d>();
    for(int i = 0; i < ptNFP.Count; ++i)
    {

      vectors.Add(new Vector3d(ptNFP.ElementAt(i) - treeOut.Branch(0)[0]));

    }

    List<Curve> translated = new List<Curve>();
    Polyline[] polys = new Polyline[ptNFP.Count];
    List<List<Point3d>> polyPoint = new List<List<Point3d>>();

    List<Point3d> pointsA = new List<Point3d>();
    pointsA = polyTwo.ToList();
    pointsA.RemoveAt(pointsA.Count - 1);
    DataTree<Point3d> polyPoints = new DataTree<Point3d>();
    DataTree<Point3d> APoints = new DataTree<Point3d>();
    for(int i = 0; i < ptNFP.Count; ++i)
    {

      var path = new GH_Path(i);
      Curve oney = polyOne.ToNurbsCurve();
      oney.Translate(vectors.ElementAt(i));
      translated.Add(oney);
      translated.ElementAt(i).TryGetPolyline(out polys[i]);
      polyPoint.Add(polys[i].ToList());

      for(int j = 0; j < polyPoint[i].Count - 1; ++j)
      {

        polyPoints.Add(polyPoint[i][j], path);

      }

    }

    for(int i = 0; i < ptNFP.Count; ++i)
      for(int j = 0; j < pointsA.Count; ++j)
      {

        var path = new GH_Path(i);
        APoints.Add(pointsA[j], path);

      }

    for(int i = 0; i < polyPoints.BranchCount; ++i)
      for(int j = 0; j < polyPoints.Branch(i).Count; ++j)
      {

        APoints.Add(polyPoints.Branch(i)[j], new GH_Path(i));

      }

    var list = new Grasshopper.Kernel.Geometry.Node2List[APoints.BranchCount];
    var polyLines = new Polyline[APoints.BranchCount];
    var curvesConvex = new Curve[APoints.BranchCount];
    var convexArea = new Double[APoints.BranchCount];
    var convexSort = new List<KeyValuePair<Polyline, double>>();
    var hullSort = new List<KeyValuePair<Polyline, double>>();

    for(int i = 0; i < APoints.BranchCount; ++i)
    {

      list[i] = new Grasshopper.Kernel.Geometry.Node2List(APoints.Branch(i));
      polyLines[i] = Grasshopper.Kernel.Geometry.ConvexHull.Solver.ComputeHull(list[i]);
      curvesConvex[i] = polyLines[i].ToNurbsCurve();
      convexArea[i] = AreaMassProperties.Compute(curvesConvex[i]).Area;
      convexSort.Add(new KeyValuePair<Polyline, double>(polys[i], convexArea[i]));
      hullSort.Add(new KeyValuePair<Polyline, double>(polyLines[i], convexArea[i]));

    }

    // Output the polygons with no convex hull
    // Here is where the sorting according to area values takes place.
    convexSort.Sort(Compare1);
    convexSort.Reverse();
    // We retrieve a list of polylines from our List of KeyValuePairs
    List<Polyline> polyFinal = (from kvp in convexSort select kvp.Key).Distinct().ToList();
    polyFinal.Reverse();

    // Output the convex hull polygons
    // Here is where the sorting according to area values takes place.
    hullSort.Sort(Compare1);
    hullSort.Reverse();
    // We retrieve a list of polylines from our List of KeyValuePairs
    List<Polyline> hullFinal = (from kvp in hullSort select kvp.Key).Distinct().ToList();
    hullFinal.Reverse();

    A = polyFinal;

    //B = hullFinal[0];

    /*
    Curve booleanUnionOne = polyFinal[0].ToNurbsCurve();
    Curve booleanUnionTwo = polyTwo.ToNurbsCurve();

    var listBoolean = new List<Curve>();

    listBoolean.Add(booleanUnionOne);
    listBoolean.Add(booleanUnionTwo);

    A = Curve.CreateBooleanUnion(listBoolean).ElementAt(1);
    */
# ---------- nestingtwoitems_2: C# additional code ----------
  static int Compare1(KeyValuePair<Polyline, double> a, KeyValuePair<Polyline, double> b)
  {

    return a.Value.CompareTo(b.Value);

  }

  static int Compare2(KeyValuePair<Point3d, double> a, KeyValuePair<Point3d, double> b)
  {

    return a.Value.CompareTo(b.Value);

  }
# ---------- end nestingtwoitems_2 ----------
possibleplacements_2 = Curve(nestingtwoitems_2.A)
nofitpolygon = Curve(nestingtwoitems_2.B)
brep_brep = BrepBrep(BrepA=possibleplacements_2, BrepB=region_difference)  # -> flatten(Curves), Points
closed_2 = Closed(Curve=brep_brep.Curves)  # -> Closed, Periodic
cull_pattern_2 = CullPattern(List=brep_brep.Curves, CullPattern=closed_2.Closed)
area_6 = Area(Geometry=curve_11)  # -> Area, Centroid; disabled
panel_2 = Panel(area_6.Area)  # disabled
curve_16 = Curve(cull_pattern_2)
area_7 = Area(Geometry=curve_16)  # -> Area, Centroid
area_8 = Area(Geometry=curve_15)  # -> Area, Centroid
panel_3 = Panel(".")  # disabled
panel_4 = Panel(".")  # disabled
panel_5 = Panel(area_8.Area)
panel_6 = Panel(area_7.Area)
text_split = TextSplit(Text=panel_2, Separators=panel_4)  # disabled
evaluate_2 = Evaluate(Expression="If(x=y, True, False)", x=panel_5, y=panel_6)
panel_7 = Panel(text_split)  # disabled
dispatch_2 = Dispatch(List=curve_16, DispatchPattern=evaluate_2)  # -> ListA, ListB
list_item_9 = ListItem(List=panel_7, Index=0, Wrap=True)  # -> flatten(Item); disabled
curve_17 = Curve(dispatch_2.ListA)
panel_8 = Panel(list_item_9)  # disabled
graft_tree_2 = GraftTree(Tree=curve_17, IncludeEmptyLists=True, IncludeNullItems=True)
discontinuity_6 = Discontinuity(Curve=curve_10, Level=1)  # -> Points, Parameters
discontinuity_7 = Discontinuity(Curve=graft_tree_2, Level=1)  # -> Points, Parameters
pointtree = CSharpScript(x=simplify(discontinuity_7.Points), y=discontinuity_6.Points)  # -> out, A; inputs x: tree of Point3d, y: list of Point3d; same code as c_script
convex_hull_3 = ConvexHull(Points=pointtree.A, Plane=PlaneXY(0, 0, 0))  # -> flatten(Hull), HullZ, Indices
area_9 = Area(Geometry=convex_hull_3.Hull)  # -> Area, Centroid
number_slider_16 = Slider(1.39, range=0..10)  # disabled
number_slider_17 = Slider(2, range=0..10)  # disabled
sort_list_5 = SortList(Keys=area_9.Area, ValuesValuesA=curve_17)  # -> Keys, ValuesValuesA
sort_list_6 = SortList(Keys=area_9.Area, ValuesValuesA=convex_hull_3.Hull)  # -> Keys, ValuesValuesA
list_item_10 = ListItem(List=sort_list_6.ValuesValuesA, Index=0, Wrap=True)
list_item_11 = ListItem(List=sort_list_5.ValuesValuesA, Index=Slider(0, range=0..10), Wrap=True)
number_slider_18 = Slider(0.054, range=0..1)
curve_18 = Curve([list_item_11, curve_10])
curve_19 = Curve(curve_10)
number_slider_19 = Slider(1.5, range=0..10)  # disabled
number_slider_20 = Slider(1.39, range=0..10)  # disabled
number_slider_21 = Slider(4.457, range=0..10)  # disabled
offset_curve = OffsetCurve(Curve=curve_19, Distance=number_slider_18, Plane=PlaneXY(0, 0, 0), Corners=1)  # -> simplify(flatten(Curve))
pauls_2 = Pauls(crv=curve_18, L=number_slider_20, A=number_slider_21)  # disabled
curve_20 = Curve(pauls_2)  # disabled
region_union = RegionUnion(Curves=[offset_curve, list_item_11])
curve_21 = Curve(region_union)  # disabled
cluster = Cluster(sheet=curve_14, parttoplace=curve_13, previousconcavehull=curve_21, concavehullinput=curve_12)  # -> part_that_has_been_placed, concavehull, sheetout; disabled
curve_22 = Curve(cluster.part_that_has_been_placed)  # disabled
curve_23 = Curve(cluster.concavehull)  # disabled
curve_24 = Curve(curve_23)  # disabled
curve_25 = Curve(curve_23)  # disabled
curve_26 = Curve(curve_24)  # disabled
merge_5 = Merge(Data1=curve_11, Data2=curve_25)  # -> flatten(Result); disabled
nestingtwoitems_3 = CSharpScript(x=merge_5, Reference="C:\Users\Paula\AppData\Roaming\Grasshopper\Libraries\ClipperTools.dll")  # -> out, A, B; inputs x: list of Polyline; disabled; same code as nestingtwoitems
curve_27 = Curve(cluster.sheetout)  # disabled
curve_28 = Curve(curve_27)  # disabled
curve_29 = Curve(curve_28)  # disabled
region_difference_2 = RegionDifference(CurvesA=curve_29, CurvesB=curve_26)  # disabled
curve_30 = Curve(nestingtwoitems_3.A)  # disabled
brep_brep_2 = BrepBrep(BrepA=curve_27, BrepB=graft(curve_30), UseTasks=True)  # -> flatten(Curves), Points; disabled
closed_3 = Closed(Curve=brep_brep_2.Curves)  # -> Closed, Periodic; disabled
cull_pattern_3 = CullPattern(List=brep_brep_2.Curves, CullPattern=closed_3.Closed)  # disabled
area_10 = Area(Geometry=cull_pattern_3)  # -> Area, Centroid; disabled
panel_9 = Panel(area_10.Area)  # disabled
text_split_2 = TextSplit(Text=area_10.Area, Separators=panel_3)  # disabled
panel_10 = Panel(text_split_2)  # disabled
list_item_12 = ListItem(List=panel_10, Index=0, Wrap=True)  # -> flatten(Item); disabled
panel_11 = Panel(list_item_12)  # disabled
evaluate_3 = Evaluate(Expression="If(x=y, True, False)", x=panel_8, y=panel_11)  # disabled
dispatch_3 = Dispatch(List=cull_pattern_3, DispatchPattern=evaluate_3)  # -> ListA, ListB; disabled
discontinuity_8 = Discontinuity(Curve=curve_26, Level=1)  # -> Points, Parameters; disabled
curve_31 = Curve(dispatch_3.ListA)  # disabled
graft_tree_3 = GraftTree(Tree=curve_31, IncludeEmptyLists=True, IncludeNullItems=True)  # disabled
discontinuity_9 = Discontinuity(Curve=graft_tree_3, Level=1)  # -> Points, Parameters; disabled
c_script_2 = CSharpScript(x=simplify(discontinuity_9.Points), y=discontinuity_8.Points)  # -> out, A; inputs x: tree of Point3d, y: list of Point3d; disabled; same code as c_script
convex_hull_4 = ConvexHull(Points=c_script_2.A, Plane=PlaneXY(0, 0, 0))  # -> flatten(Hull), HullZ, Indices; disabled
area_11 = Area(Geometry=convex_hull_4.Hull)  # -> Area, Centroid; disabled
sort_list_7 = SortList(Keys=area_11.Area, ValuesValuesA=curve_31)  # -> Keys, ValuesValuesA; disabled
list_item_13 = ListItem(List=sort_list_7.ValuesValuesA, Index=0, Wrap=True)  # disabled
curve_32 = Curve([curve_26, list_item_13])  # disabled
pauls_3 = Pauls(crv=curve_32, L=number_slider_16, A=number_slider_17)  # disabled
curve_33 = Curve(pauls_3)  # disabled
region_difference_3 = RegionDifference(CurvesA=curve_27, CurvesB=curve_33)  # disabled
concavehull = ConcaveHull(curve_33)  # Concave hull from placed part and previous concave hull.; disabled
part_that_has_been_placed = PartThatHasBeenPlaced(list_item_13)  # Part that has already been placed.; disabled
sheetout = SheetOut(region_difference_3)  # Sheet output.; disabled
curve_34 = Curve(<curve referenced from the Rhino model>)
cluster_2 = Cluster_2(concavehullinput=region_union, sheetin=region_difference, parttoplace=curve_34, distance=number_slider_18)  # -> placed_part, concavehullout, sheetoutput
number_slider_22 = Slider(11.2, range=0..50)  # disabled
curve_35 = Curve(<curve referenced from the Rhino model>)
cluster_3 = Cluster_2(
    concavehullinput=cluster_2.concavehullout,
    sheetin=cluster_2.sheetoutput,
    parttoplace=curve_35,
    distance=number_slider_18)  # -> placed_part, concavehullout, sheetoutput
number_slider_23 = Slider(14.15, range=0..50)  # disabled
curve_36 = Curve(<curve referenced from the Rhino model>)
number_slider_24 = Slider(1, range=0..10)  # disabled
cluster_4 = Cluster_2(
    concavehullinput=cluster_3.concavehullout,
    sheetin=cluster_3.sheetoutput,
    parttoplace=curve_36,
    distance=number_slider_18)  # -> placed_part, concavehullout, sheetoutput
curve_37 = Curve(<curve referenced from the Rhino model>)
number_slider_25 = Slider(1.1, range=0..10)  # disabled
curve_38 = Curve(<curve referenced from the Rhino model>)
cluster_5 = Cluster_2(
    concavehullinput=cluster_4.concavehullout,
    sheetin=cluster_4.sheetoutput,
    parttoplace=curve_37,
    distance=number_slider_18)  # -> placed_part, concavehullout, sheetoutput
curve_39 = Curve(cluster_4.concavehullout)
area_12 = Area()  # -> Area, Centroid; disabled
cluster_6 = Cluster_2(
    concavehullinput=cluster_5.concavehullout,
    sheetin=cluster_5.sheetoutput,
    parttoplace=curve_38,
    distance=number_slider_18)  # -> placed_part, concavehullout, sheetoutput
sort_list_8 = SortList(Keys=area_12.Area)  # -> Keys, reverse(ValuesValuesA); disabled
merge_6 = Merge(
    Data1=sheet,
    Data2=placedpart,
    Data3=list_item_4,
    Data4=list_item_11,
    Data5=cluster_3.placed_part,
    Data6=cluster_4.placed_part,
    Data7=cluster_2.placed_part,
    Data8=cluster_5.placed_part,
    Data9=cluster_6.placed_part)
curve_40 = Curve(cluster_6.concavehullout)
area_13 = Area()  # -> Area, Centroid; disabled
list_item_14 = ListItem(List=sort_list_8.ValuesValuesA, Index=0, Wrap=True)  # disabled
sort_list_9 = SortList(Keys=area_13.Area)  # -> Keys, reverse(ValuesValuesA); disabled
list_item_15 = ListItem(List=sort_list_9.ValuesValuesA, Index=0, Wrap=True)  # disabled
brep_3 = Brep(list_item_15)  # disabled
discontinuity_10 = Discontinuity(Curve=merge_6, Level=1)  # -> flatten(Points), Parameters; disabled
convex_hull_5 = ConvexHull(Points=discontinuity_10.Points, Plane=PlaneXY(0, 0, 0))  # -> Hull, HullZ, Indices; disabled
area_14 = Area(Geometry=convex_hull_5.Hull)  # -> Area, Centroid; disabled

# ----
# Diferencia de Minkowski:
# Poligono Que No Entra(No Fit Polygon)
# The upper one works but not only we
# have to manually adjust the parameter
# Attrition, but we end up getting a
# ConvexHull! Paul's works better but its
# too slow to use it inside the nesting algo
# maybe we can find a way to optimize
# Diferencia de Minkowski:
# Poligono Que Entra
# (Inner Fit Polygon)
# Geometría de Base
polygona_3 = Curve(<curve referenced from the Rhino model>)  # disabled
sheet_2 = Curve(<curve referenced from the Rhino model>)  # disabled
number_slider_26 = Slider(0, range=0..3)  # disabled
number_slider_27 = Slider(0, range=0..1)  # disabled
number_slider_28 = Slider(1, range=0..1)  # disabled

discontinuity_11 = Discontinuity(Curve=polygona_3, Level=1)  # -> Points, Parameters; disabled
list_item_16 = ListItem(List=discontinuity_11.Points, Index=number_slider, Wrap=True)  # disabled

# ----
# IFP(Inner Fit Polygon)
# El Inner Fit Polygon describe la moción
# de un polígono estacionario dentro de
# un polígono que lo orbita, resultando en
# todas las posibles posiciones del
# polígono a transladar sobre el estacionario
# sin que estos se yuxtapongan.
# Después de obtener el nuevo polígono
# construimos los vectores de translación
# entre los puntos del IFP y el punto de
# más a la izquierda y más abajo, en este
# caso usamos la primera translación de
# la lista pero cualquiera es aceptable.
# El componente escrito en C#, corre con
# una biblioteca externa llamada Clipper
# desarrollada por el usuario de github y
# food4rhino arendvw.
# El nodo computa la diferencia de
# Minkowski, la cual suma el polígono A
# o estacionario con el polígono B o
# orbital, se llama diferencia ya que la
# operación de vectores cambia la
# dirección del polígono B a contra el
# reloj. Éste computo nos otorga un
# tercer polígono que llamaremos IFP
merge_7 = Merge(Data1=polygona_3, Data2=sheet_2)  # disabled
innerfitpolygon_2 = CSharpScript(x=merge_7, y=number_slider_26, Reference="C:\Users\Paula\AppData\Roaming\Grasshopper\Libraries\ClipperTools.dll")  # -> out, A, B, C; inputs x: list of Polyline, y: Int32; disabled
# ---------- innerfitpolygon_2: C# ----------
    x = AreaSorting(x);

    var final = FirstPlacement(x)[y];

    /*
    var outPut = new List<Polyline>();

    outPut.Add(x[x.Count - 1]);
    outPut.Add(final);

    A = outPut;
    */

    A = final;

    B = x.ElementAt(x.Count - 1);
    
    C = IFP(x);

    //x.RemoveAt(0);

    //B = FirstPlacement(x)[FirstPlacement(x).Count - 1];
# ---------- innerfitpolygon_2: C# additional code ----------
  public List<Polyline> FirstPlacement(List<Polyline> x)
  {

    var innerFitPolygon = IFP(x)[1];

    List<Polyline> oner = new List<Polyline>();

    oner.Add(innerFitPolygon);
    oner.Add(x[0]);

    List<Polyline> two = new List<Polyline>();

    two.Add(innerFitPolygon);

    var fix = Translate(oner);

    for(int i = 0; i < fix.Length; ++i)
    {

      two.Add(fix.ElementAt(i));

    }

    two = AreaSorting(two);

    var a = two[two.Count - 1].ToNurbsCurve();

    two.RemoveAt(two.Count - 1);

    var array = new Curve[two.Count];

    Rhino.Geometry.Intersect.CurveIntersections ci;
    DataTree<Point3d> intPts = new DataTree<Point3d>();

    var numberOfIntersections = new Double[two.Count];

    var sortNumberOfIntersections = new List<KeyValuePair<Polyline, double>>();
    for(int i = 0; i < array.Length; ++i)
    {

      array[i] = two.ElementAt(i).ToNurbsCurve();


      ci = Rhino.Geometry.Intersect.Intersection.CurveCurve(a, array[i], 0.001, 0.001);

      for(int j = 0; j < ci.Count; j++)
      {

        intPts.Add(ci[j].PointA, new GH_Path(i));

        numberOfIntersections[i] = intPts.Branch(i).Count;

        sortNumberOfIntersections.Add(new KeyValuePair<Polyline, double>(two[i], numberOfIntersections[i]));

      }

    }

    sortNumberOfIntersections.Sort(Compare1);
    sortNumberOfIntersections.Reverse();

    List<Polyline> sortedPolys = (from kvp in sortNumberOfIntersections select kvp.Key).Distinct().ToList();
    sortedPolys.Reverse();

    return sortedPolys;

  }

  public Polyline[] Translate(List<Polyline> curve)
  {

    var treeOut = PointDataTree(curve);

    var polyTwo = curve[0];
    var polyOne = curve[curve.Count - 1];

    List<Point3d> ptNFP;
    ptNFP = polyTwo.ToList();
    ptNFP.RemoveAt(0);

    List<Vector3d> vectors = new List<Vector3d>();
    for(int i = 0; i < ptNFP.Count; ++i)
    {

      vectors.Add(new Vector3d(ptNFP.ElementAt(i) - treeOut.Branch(treeOut.BranchCount - 1)[0]));

    }

    List<Curve> translated = new List<Curve>();
    var polys = new Polyline[ptNFP.Count];
    List<List<Point3d>> polyPoint = new List<List<Point3d>>();

    List<Point3d> pointsA = new List<Point3d>();
    pointsA = polyTwo.ToList();
    pointsA.RemoveAt(pointsA.Count - 1);
    DataTree<Point3d> polyPoints = new DataTree<Point3d>();
    DataTree<Point3d> APoints = new DataTree<Point3d>();
    for(int i = 0; i < ptNFP.Count; ++i)
    {

      var path = new GH_Path(i);
      Curve oney = polyOne.ToNurbsCurve();
      oney.Translate(vectors.ElementAt(i));
      translated.Add(oney);
      translated.ElementAt(i).TryGetPolyline(out polys[i]);
      polyPoint.Add(polys[i].ToList());

    }

    return polys;

  }

  public List<Polyline> IFP(List<Polyline> curves)
  {

    curves = AreaSorting(curves);

    var one = curves.ElementAt(0);
    var two = curves.ElementAt(curves.Count - 1);

    var points = PointDataTree(curves);

    // Inner Fit Polygon
    Point3d centerOne = points.Branch(0)[0];//ptB[ptB.Count - 1];
    Vector3d zAxis = Vector3d.ZAxis;
    Plane pO = new Rhino.Geometry.Plane(centerOne, zAxis);
    double tolerance = 0.0001;

    List<Polyline> outCurvesOne = new List<Polyline>();
    List<Polyline> outDisplacedCurvesOne = new List<Polyline>();
    foreach(List<IntPoint> path in ClipperLib.Clipper.MinkowskiDiff(one.ToPath2D(pO, tolerance), two.ToPath2D(pO, tolerance)))
    {

      Polyline plSum = path.ToPolyline(pO, tolerance, true);
      outCurvesOne.Add(plSum);

    }

    Polyline bin = outCurvesOne[1];

    return outCurvesOne;

  }

  public List<Polyline> AreaSorting(List<Polyline> x)
  {

    // We want to cast(change from one data type to another) our list of polylines to curves, so that
    // we can call the AreaMassProperties class and its method .Compute to get the area of the polygons
    // after that we can now create a List of KeyValuePair to assign the area of our polygons to our
    // polygons so that we can sort them later according to their areas.
    List<Curve> one = new List<Curve>();
    double[] areas = new Double[x.Count];
    var curves = new List<KeyValuePair<Polyline, double>>();

    for(int i = 0; i < x.Count; ++i)
    {

      one.Add(x.ElementAt(i).ToNurbsCurve());
      areas[i] = AreaMassProperties.Compute(one.ElementAt(i)).Area;
      curves.Add(new KeyValuePair<Polyline, double>(x.ElementAt(i), areas[i]));

    }

    // Here is where the sorting according to area values takes place.
    curves.Sort(Compare1);
    curves.Reverse();
    // We retrieve a list of curves from our List of KeyValuePairs
    List<Polyline> curve = (from kvp in curves select kvp.Key).Distinct().ToList();
    curve.Reverse();

    return curve;

  }

  public DataTree<Point3d> PointDataTree(List<Polyline> curve)
  {

    // We create and populate trees with the points of the curves, so that we can
    // sort each of the lower left points of each of the curves according to the
    // sum of their Xs and Ys positions.
    List<List<Point3d>> pts = new List<List<Point3d>>();
    DataTree<Point3d> tree = new DataTree<Point3d>();
    DataTree<double> treeSum = new DataTree<double>();
    var points = new DataTree<KeyValuePair<Point3d, double>>();
    var point = new List<Point3d>[curve.Count];
    DataTree<Point3d> treeLowerLeft = new DataTree<Point3d>();

    for(int i = 0; i < curve.Count; ++i)
    {

      pts.Add(curve[i].ToList());
      pts[i].RemoveAt(pts[i].Count - 1);
      GH_Path path = new GH_Path(i);

      for(int j = 0; j < pts[i].Count; ++j)
      {

        tree.Add(pts[i][j], path);
        treeSum.Add(pts[i][j].X + pts[i][j].Y, path);

        points.Add(new KeyValuePair<Point3d, double>(tree.Branch(i)[j], treeSum.Branch(i)[j]), path);

        points.Branch(i).Sort(Compare2);
        points.Branch(i).Reverse();
        point[i] = (from kvp in points.Branch(i) select kvp.Key).Distinct().ToList();
        point[i].Reverse();

      }

    }

    for(int i = 0; i < tree.BranchCount; ++i)
      for(int j = 0; j < tree.Branch(i).Count; ++j)
      {

        treeLowerLeft.Add(point[i][j], new GH_Path(i));

      }

    var treeOut = new DataTree<Point3d>();

    for(int i = 0; i < treeLowerLeft.BranchCount; ++i)
      for(int j = 0; j < treeLowerLeft.Branch(i).Count; ++j)
      {

        treeOut.Add(treeLowerLeft.Branch(i)[0], new GH_Path(i));

      }

    return treeOut;

  }

  static int Compare1(KeyValuePair<Polyline, double> a, KeyValuePair<Polyline, double> b)
  {

    return a.Value.CompareTo(b.Value);

  }

  static int Compare2(KeyValuePair<Point3d, double> a, KeyValuePair<Point3d, double> b)
  {

    return a.Value.CompareTo(b.Value);

  }
# ---------- end innerfitpolygon_2 ----------
placedpart_2 = Curve(innerfitpolygon_2.A)  # disabled

minkowski_difference_2 = MinkowskiDifference(A=polygona_3, B=sheet_2, Plane=list_item_16, Tolerance=0.001)  # disabled
list_item_17 = ListItem(List=minkowski_difference_2, Index=number_slider_3, Wrap=True)  # disabled
discontinuity_12 = Discontinuity(Curve=list_item_17, Level=1)  # -> Points, Parameters; disabled
vector_2pt_2 = Vector2Pt(PointA=list_item_16, PointB=discontinuity_12.Points, Unitize=False)  # -> Vector, Length; disabled
vector_display_2 = VectorDisplay(Anchor=list_item_16, Vector=vector_2pt_2.Vector)  # disabled
move_2 = Move(Geometry=polygona_3, Motion=vector_2pt_2.Vector)  # -> Geometry, Transform; disabled
list_item_18 = ListItem(List=move_2.Geometry, Index=0, Wrap=True)  # disabled

# ----
# NFP(No Fit Polygon)
# Tenemos el contenedor(sheet/bin) y el
# primer poligono posicionado dentro del
# mismo. Ahora tenemos que encontrar
# las posibles posiciones del polígono
# que queremos agregar con respecto al
# ya posicionado anterior polígono. Con
# el No Fit Polygon podemos obtener las
# posibles translaciones.
# El proceso es similar al del IFP pero en
# este caso debemos tomar la órbita
# externa. Se repite un proceso similar al
# anterior, entre el punto de más abajo y
# más a la izquierda se crean vectores
# de translación con los puntos del No Fit
# Polygon.
parttobeplaced_3 = Curve(<curve referenced from the Rhino model>)  # disabled
merge_8 = Merge(Data1=parttobeplaced_3, Data2=placedpart_2)  # disabled
nestingtwoitems_4 = CSharpScript(x=merge_8, Reference="C:\Users\Paula\AppData\Roaming\Grasshopper\Libraries\ClipperTools.dll")  # -> out, A, B; inputs x: list of Polyline; disabled
# ---------- nestingtwoitems_4: C# ----------
    // We want to cast(change from one data type to another) our list of polylines to curves, so that
    // we can call the AreaMassProperties class and its method .Compute to get the area of the polygons
    // after that we can now create a List of KeyValuePair to assign the area of our polygons to our
    // polygons so that we can sort them later according to their areas.
    List<Curve> one = new List<Curve>();
    double[] areas = new Double[x.Count];
    var curves = new List<KeyValuePair<Polyline, double>>();

    for(int i = 0; i < x.Count; ++i)
    {

      one.Add(x.ElementAt(i).ToNurbsCurve());
      areas[i] = AreaMassProperties.Compute(one.ElementAt(i)).Area;
      curves.Add(new KeyValuePair<Polyline, double>(x.ElementAt(i), areas[i]));

    }

    // Here is where the sorting according to area values takes place.
    curves.Sort(Compare1);
    curves.Reverse();
    // We retrieve a list of curves from our List of KeyValuePairs
    List<Polyline> curve = (from kvp in curves select kvp.Key).Distinct().ToList();
    curve.Reverse();

    // We create and populate trees with the points of the curves, so that we can
    // sort each of the lower left points of each of the curves according to the
    // sum of their Xs and Ys positions.
    List<List<Point3d>> pts = new List<List<Point3d>>();
    DataTree<Point3d> tree = new DataTree<Point3d>();
    DataTree<double> treeSum = new DataTree<double>();
    var points = new DataTree<KeyValuePair<Point3d, double>>();
    var point = new List<Point3d>[curve.Count];
    DataTree<Point3d> treeLowerLeft = new DataTree<Point3d>();

    for(int i = 0; i < curve.Count; ++i)
    {

      pts.Add(curve[i].ToList());
      pts[i].RemoveAt(pts[i].Count - 1);
      GH_Path path = new GH_Path(i);

      for(int j = 0; j < pts[i].Count; ++j)
      {

        tree.Add(pts[i][j], path);
        treeSum.Add(pts[i][j].X + pts[i][j].Y, path);

        points.Add(new KeyValuePair<Point3d, double>(tree.Branch(i)[j], treeSum.Branch(i)[j]), path);

        points.Branch(i).Sort(Compare2);
        points.Branch(i).Reverse();
        point[i] = (from kvp in points.Branch(i) select kvp.Key).Distinct().ToList();
        point[i].Reverse();

      }

    }

    for(int i = 0; i < tree.BranchCount; ++i)
      for(int j = 0; j < tree.Branch(i).Count; ++j)
      {

        treeLowerLeft.Add(point[i][j], new GH_Path(i));

      }

    var treeOut = new DataTree<Point3d>();

    for(int i = 0; i < treeLowerLeft.BranchCount; ++i)
      for(int j = 0; j < treeLowerLeft.Branch(i).Count; ++j)
      {

        treeOut.Add(treeLowerLeft.Branch(i)[0], new GH_Path(i));

      }

    /*
    // Create the data structures and initialize them
    DataTree<Point3d> points = new DataTree<Point3d>();
    List<List<Point3d>> lists = new List<List<Point3d>>();

    // Fill the nested list with the list of points
    for(int i = 0; i < x.Count; ++i)
    {

      lists.Add(x[i].ToList());

    }

    // Fill the data tree with the list of points
    for(int i = 0; i < lists.Count; ++i)
    {

      var path = new GH_Path(i);

      for(int j = 0; j < lists[i].Count; ++j )
      {

        points.Add(lists[i][j], path);

      }

    }
    */


    // No Fit Polygon from minkowsky difference using the clipper lib
    Polyline polyOne = curve[0];
    Polyline polyTwo = curve[curve.Count - 1];

    Point3d center = treeOut.Branch(0).ElementAt(0);
    Vector3d zAxis = Vector3d.ZAxis;
    Plane p = new Rhino.Geometry.Plane(center, zAxis);

    double tolerance = 0.001;
    List<Polyline> outCurves = new List<Polyline>();
    List<Polyline> outDisplacedCurves = new List<Polyline>();
    foreach(List<IntPoint> path in ClipperLib.Clipper.MinkowskiDiff(polyOne.ToPath2D(p, tolerance), polyTwo.ToPath2D(p, tolerance)))
    {

      Polyline plSum = path.ToPolyline(p, tolerance, true);
      outCurves.Add(plSum);

    }

    Polyline NFP = outCurves[0];

    B = NFP;
    
    List<Point3d> ptNFP;
    ptNFP = NFP.ToList();
    ptNFP.RemoveAt(0);

    List<Vector3d> vectors = new List<Vector3d>();
    for(int i = 0; i < ptNFP.Count; ++i)
    {

      vectors.Add(new Vector3d(ptNFP.ElementAt(i) - treeOut.Branch(0)[0]));

    }

    List<Curve> translated = new List<Curve>();
    Polyline[] polys = new Polyline[ptNFP.Count];
    List<List<Point3d>> polyPoint = new List<List<Point3d>>();

    List<Point3d> pointsA = new List<Point3d>();
    pointsA = polyTwo.ToList();
    pointsA.RemoveAt(pointsA.Count - 1);
    DataTree<Point3d> polyPoints = new DataTree<Point3d>();
    DataTree<Point3d> APoints = new DataTree<Point3d>();
    for(int i = 0; i < ptNFP.Count; ++i)
    {

      var path = new GH_Path(i);
      Curve oney = polyOne.ToNurbsCurve();
      oney.Translate(vectors.ElementAt(i));
      translated.Add(oney);
      translated.ElementAt(i).TryGetPolyline(out polys[i]);
      polyPoint.Add(polys[i].ToList());

      for(int j = 0; j < polyPoint[i].Count - 1; ++j)
      {

        polyPoints.Add(polyPoint[i][j], path);

      }

    }

    for(int i = 0; i < ptNFP.Count; ++i)
      for(int j = 0; j < pointsA.Count; ++j)
      {

        var path = new GH_Path(i);
        APoints.Add(pointsA[j], path);

      }

    for(int i = 0; i < polyPoints.BranchCount; ++i)
      for(int j = 0; j < polyPoints.Branch(i).Count; ++j)
      {

        APoints.Add(polyPoints.Branch(i)[j], new GH_Path(i));

      }

    var list = new Grasshopper.Kernel.Geometry.Node2List[APoints.BranchCount];
    var polyLines = new Polyline[APoints.BranchCount];
    var curvesConvex = new Curve[APoints.BranchCount];
    var convexArea = new Double[APoints.BranchCount];
    var convexSort = new List<KeyValuePair<Polyline, double>>();
    var hullSort = new List<KeyValuePair<Polyline, double>>();

    for(int i = 0; i < APoints.BranchCount; ++i)
    {

      list[i] = new Grasshopper.Kernel.Geometry.Node2List(APoints.Branch(i));
      polyLines[i] = Grasshopper.Kernel.Geometry.ConvexHull.Solver.ComputeHull(list[i]);
      curvesConvex[i] = polyLines[i].ToNurbsCurve();
      convexArea[i] = AreaMassProperties.Compute(curvesConvex[i]).Area;
      convexSort.Add(new KeyValuePair<Polyline, double>(polys[i], convexArea[i]));
      hullSort.Add(new KeyValuePair<Polyline, double>(polyLines[i], convexArea[i]));

    }

    // Output the polygons with no convex hull
    // Here is where the sorting according to area values takes place.
    convexSort.Sort(Compare1);
    convexSort.Reverse();
    // We retrieve a list of polylines from our List of KeyValuePairs
    List<Polyline> polyFinal = (from kvp in convexSort select kvp.Key).Distinct().ToList();
    polyFinal.Reverse();

    // Output the convex hull polygons
    // Here is where the sorting according to area values takes place.
    hullSort.Sort(Compare1);
    hullSort.Reverse();
    // We retrieve a list of polylines from our List of KeyValuePairs
    List<Polyline> hullFinal = (from kvp in hullSort select kvp.Key).Distinct().ToList();
    hullFinal.Reverse();

    A = polyFinal;

    //B = hullFinal[0];

    /*
    Curve booleanUnionOne = polyFinal[0].ToNurbsCurve();
    Curve booleanUnionTwo = polyTwo.ToNurbsCurve();

    var listBoolean = new List<Curve>();

    listBoolean.Add(booleanUnionOne);
    listBoolean.Add(booleanUnionTwo);

    A = Curve.CreateBooleanUnion(listBoolean).ElementAt(1);
  */
# ---------- nestingtwoitems_4: C# additional code ----------
  static int Compare1(KeyValuePair<Polyline, double> a, KeyValuePair<Polyline, double> b)
  {

    return a.Value.CompareTo(b.Value);

  }

  static int Compare2(KeyValuePair<Point3d, double> a, KeyValuePair<Point3d, double> b)
  {

    return a.Value.CompareTo(b.Value);

  }
# ---------- end nestingtwoitems_4 ----------
possibleplacements_3 = Curve(nestingtwoitems_4.A)  # disabled
curve_41 = Curve(nestingtwoitems_4.B)  # disabled

# ---- group: Test de Inclusión
# Estos nodos buscan encontrar de las
# previas posibles translaciones, las que
# se encuentren dentro del contenedor.
# El proceso es:
#     1.) Encontrar las intersecciones entre
#           los polígonos y el contenedor.
#     2.) Comparar el área del polígono que
#           vamos a posicionar y compararlo
#           con el área de los polígonos que
#           han sido sometidos a la
#           intersección. Seleccionar sólo los
#           polígonos cuyas áreas coinciden.
#     3.) Tomar la envolvente convexa del
#            polígono a posicionar y el ya
#            posicionado. Escoger el polígono
#            cuya área de envolvente convexa
#            sea la menor.
region_intersection_2 = RegionIntersection(CurvesA=possibleplacements_3, CurvesB=sheet_2)  # disabled
area_15 = Area(Geometry=parttobeplaced_3)  # -> Area, Centroid; disabled
area_16 = Area(Geometry=region_intersection_2)  # -> Area, Centroid; disabled
integer_3 = Integer(area_15.Area)  # disabled
integer_4 = Integer(area_16.Area)  # disabled
evaluate_4 = Evaluate(Expression="If(x=y, True, False)", x=integer_3, y=integer_4)  # disabled
dispatch_4 = Dispatch(List=region_intersection_2, DispatchPattern=evaluate_4)  # -> ListA, ListB; disabled
curve_42 = Curve(dispatch_4.ListA)  # disabled
discontinuity_13 = Discontinuity(Curve=placedpart_2, Level=1)  # -> Points, Parameters; disabled
graft_tree_4 = GraftTree(Tree=curve_42, IncludeEmptyLists=True, IncludeNullItems=True)  # disabled
discontinuity_14 = Discontinuity(Curve=graft_tree_4, Level=1)  # -> Points, Parameters; disabled
c_script_3 = CSharpScript(x=simplify(discontinuity_14.Points), y=discontinuity_13.Points)  # -> out, A; inputs x: tree of Point3d, y: list of Point3d; disabled; same code as c_script
convex_hull_6 = ConvexHull(Points=c_script_3.A, Plane=PlaneXY(0, 0, 0))  # -> flatten(Hull), HullZ, Indices; disabled
area_17 = Area(Geometry=convex_hull_6.Hull)  # -> Area, Centroid; disabled
number_slider_29 = Slider(0, range=0..2)  # disabled
sort_list_10 = SortList(Keys=area_17.Area, ValuesValuesA=curve_42)  # -> Keys, ValuesValuesA; disabled
list_item_19 = ListItem(List=sort_list_10.ValuesValuesA, Index=number_slider_29, Wrap=True)  # disabled

# ----
brep_4 = Brep(sheet_2)  # disabled

sort_list_11 = SortList(Keys=area_17.Area, ValuesValuesA=convex_hull_6.Hull)  # -> Keys, ValuesValuesA; disabled
list_item_20 = ListItem(List=sort_list_11.ValuesValuesA, Index=number_slider_29, Wrap=True)  # disabled

divide_surface = DivideSurface(Surface=brep_4, UCount=number_slider_8, VCount=number_slider_8)  # -> flatten(Points), Normals, Parameters; disabled
c_script_4 = CSharpScript(pts=divide_surface.Points, crv=placedpart)  # -> out, A, B; inputs pts: list of Point3d, crv: Polyline; disabled
# ---------- c_script_4: C# ----------
    var inside = new List<Point3d>();
    var outside = new List<Point3d>();

    foreach (Point3d pt in pts)
    {
      if(IsInside(pt, crv))
      {
        inside.Add(pt);
      }
      else outside.Add(pt);
    }
    A = inside;
    B = outside;
# ---------- c_script_4: C# additional code ----------
  bool IsInside (Point3d pt, Polyline crv)
  {
    Point3d pt1, pt2;
    bool oddNodes = false;

    for (int i = 0; i < crv.SegmentCount; i++) //for each contour line
    {

      pt1 = crv.SegmentAt(i).From; //get start and end pt
      pt2 = crv.SegmentAt(i).To;

      if ( (pt1[1] < pt[1] && pt2[1] >= pt[1] || pt2[1] < pt[1] && pt1[1] >= pt[1]) && (pt1[0] <= pt[0] || pt2[0] <= pt[0]) ) //if pt is between pts in y, and either of pts is before pt in x
        oddNodes ^= ( pt2[0] + (pt[1] - pt2[1]) * (pt1[0] - pt2[0]) / (pt1[1] - pt2[1]) < pt[0] ); //^= is xor
      //end.X + (pt-end).Y   * (start-end).X  /(start-end).Y   <   pt.X
    }


    if (!oddNodes)
    {
      double minDist = 1e10;
      for (int i = 0; i < crv.SegmentCount; i++) {
        Point3d cp = crv.SegmentAt(i).ClosestPoint(pt, true);
        //Point3d cp = mvContour[i].closestPoint(pt);
        //minDist = min(minDist, cp.distance(pt));
        minDist = Math.Min(minDist, cp.DistanceTo(pt));
      }
      if (minDist < 1e-10)
        return true;
    }

    if(oddNodes) return true;

    return false;
  }
# ---------- end c_script_4 ----------
c_script_5 = CSharpScript(pts=divide_surface.Points, crv=list_item_4)  # -> out, A, B; inputs pts: list of Point3d, crv: Polyline; disabled; same code as c_script_4

# ---- group: Trabajo en Proceso
# Debemos encontrar la unión de los
# polígonos posicionados para poder
# repetir el proceso mencionado
# anteriormente. Pero la envolvente
# convexa produce pérdida de material,
# por lo tanto debemos producir un nuevo
# polígono entre las partes que sea más
# acorde a sus bordes externos.
discontinuity_15 = Discontinuity(Curve=[list_item_19, placedpart_2], Level=1)  # -> flatten(Points), Parameters; disabled
convex_hull_7 = ConvexHull(Points=discontinuity_15.Points, Plane=PlaneXY(0, 0, 0))  # -> Hull, HullZ, Indices; disabled

# ----
c_script_6 = CSharpScript(pts=divide_surface.Points, crv=placedpart_2)  # -> out, A, B; inputs pts: list of Point3d, crv: Polyline; disabled; same code as c_script_4
c_script_7 = CSharpScript(pts=divide_surface.Points, crv=list_item_19)  # -> out, A, B; inputs pts: list of Point3d, crv: Polyline; disabled; same code as c_script_4
point = Point(c_script_5.A)  # disabled
point_2 = Point(c_script_4.A)  # disabled
divide_length_2 = DivideLength(Curve=[list_item_19, placedpart_2], Distance=number_slider_11, RoundUp=False, RoundDn=False)  # disabled
point_3 = Point(c_script_7.A)  # disabled
point_4 = Point(c_script_6.A)  # disabled
point_5 = Point(flatten([discontinuity_15.Points, point, point_2, divide_length]))  # disabled
point_6 = Point(flatten([discontinuity_15.Points, point_3, point_4, divide_length_2]))  # disabled

# ---- group: SheetMinusThe"Union"BetweenTheTwoPlacedParts
region_difference_4 = RegionDifference(CurvesA=sheet_2, CurvesB=convex_hull_7.Hull)  # disabled

# ---- group: TheTwoPartsToRunThroughTheNoFitPolygonAlgorithm
curve_43 = Curve(<curve referenced from the Rhino model>)  # disabled
merge_9 = Merge(Data1=curve_43, Data2=convex_hull_7.Hull)  # -> flatten(Result); disabled

# ---- group: NoFitPolygonAndTheRespectiveTranslations
nestingtwoitems_5 = CSharpScript(x=merge_9, Reference="C:\Users\Paula\AppData\Roaming\Grasshopper\Libraries\ClipperTools.dll")  # -> out, A, B; inputs x: list of Polyline; disabled; same code as nestingtwoitems
possibleplacements_4 = Curve(nestingtwoitems_5.A)  # disabled
nofitpolygon_2 = Curve()  # disabled

# ---- group: InclusionTest
muchmoresuccintinclusiontest = CSharpScript(Sheet=region_difference_4, PossiblePlacements=possibleplacements_4)  # -> out, InsideTheSheetWithNoOverlapping; inputs Sheet: Polyline, PossiblePlacements: list of Polyline; disabled
# ---------- muchmoresuccintinclusiontest: C# ----------
    // On deconstruit une des curves pour obtenir des points qui la font, il fallait pour
    // la construction du plan
    var points = new List<Point3d>();
    points = Sheet.ToList();
    // Il faut avoir d'un plan pour la function d'inclusion
    Plane plane = new Plane(points[0], Vector3d.ZAxis);

    // Malheureusement la function ne marche pas avec polyline donc on fait le cast a curve
    Curve sheetCurve = Sheet.ToNurbsCurve();

    // On doit faire une boucle car le input c'est une liste, il faut creer aussi la liste
    // avec les curves. De toute facon il faut d'en avoir le boucle ici car on va appeller
    // la function de inclusion avec chaque une des curves et le sheet
    var possiblePlacementsCurves = new List<Curve>();
    var testInclusion = new List<RegionContainment>();

    // Ici on initialize une collection(array) de polyline pour le remplir de la conversion
    // curve => polyline
    var polyOut = new Polyline[PossiblePlacements.Count];

    for(int i = 0; i < PossiblePlacements.Count; ++i)
    {

      // Transforme les polylines a curves
      possiblePlacementsCurves.Add(PossiblePlacements[i].ToNurbsCurve());

      // Test d'inclusion
      testInclusion.Add(Curve.PlanarClosedCurveRelationship(sheetCurve, possiblePlacementsCurves[i], plane, 0.0001));

      // On va trouver lesquelles curves se trouvent dedans le sheet et on va les transformer
      // en polylines, j'aime pas c'est method et j'imagine il y a une meilleure facon de le
      // faire mais je suis pas capable maintenant
      if(testInclusion[i] == Rhino.Geometry.RegionContainment.BInsideA)
      {

        possiblePlacementsCurves[i].TryGetPolyline(out polyOut[i]);

      }

    }

    // Eliminer les polylines qui sont nulls
    InsideTheSheetWithNoOverlapping = polyOut.Where(x => x != null).ToList();;
    //InsideTheSheetWithNoOverlapping = testInclusion;
# ---------- end muchmoresuccintinclusiontest ----------
panel_12 = Panel(muchmoresuccintinclusiontest.InsideTheSheetWithNoOverlapping)  # disabled

# ---- group: LongWayToGetWhichPartsAreInsideTheSheet
brep_brep_3 = BrepBrep(BrepA=possibleplacements_4, BrepB=region_difference_4)  # -> flatten(Curves), Points; disabled
closed_4 = Closed(Curve=brep_brep_3.Curves)  # -> Closed, Periodic; disabled
cull_pattern_4 = CullPattern(List=brep_brep_3.Curves, CullPattern=closed_4.Closed)  # disabled
curve_44 = Curve(cull_pattern_4)  # disabled
area_18 = Area(Geometry=curve_44)  # -> Area, Centroid; disabled
area_19 = Area(Geometry=curve_43)  # -> Area, Centroid; disabled
panel_13 = Panel(area_19.Area)  # disabled
panel_14 = Panel(area_18.Area)  # disabled
evaluate_5 = Evaluate(Expression="If(x=y, True, False)", x=panel_13, y=panel_14)  # disabled
dispatch_5 = Dispatch(List=curve_44, DispatchPattern=evaluate_5)  # -> ListA, ListB; disabled
curve_45 = Curve(dispatch_5.ListA)  # disabled

# ---- group: CreateATreeWithAllThePlacementPointsAndThePolygonWeArePlacingNextTo
graft_tree_5 = GraftTree(Tree=curve_45, IncludeEmptyLists=True, IncludeNullItems=True)  # disabled
discontinuity_16 = Discontinuity(Curve=convex_hull_7.Hull, Level=1)  # -> Points, Parameters; disabled
discontinuity_17 = Discontinuity(Curve=graft_tree_5, Level=1)  # -> Points, Parameters; disabled
pointtree_2 = CSharpScript(x=simplify(discontinuity_17.Points), y=discontinuity_16.Points)  # -> out, A; inputs x: tree of Point3d, y: list of Point3d; disabled; same code as c_script

# ---- group: ConvexHullAreaSortingThePlacement
convex_hull_8 = ConvexHull(Points=pointtree_2.A, Plane=PlaneXY(0, 0, 0))  # -> flatten(Hull), HullZ, Indices; disabled
area_20 = Area(Geometry=convex_hull_8.Hull)  # -> Area, Centroid; disabled
sort_list_12 = SortList(Keys=area_20.Area, ValuesValuesA=curve_45)  # -> Keys, ValuesValuesA; disabled
sort_list_13 = SortList(Keys=area_20.Area, ValuesValuesA=convex_hull_8.Hull)  # -> Keys, ValuesValuesA; disabled
list_item_21 = ListItem(List=sort_list_13.ValuesValuesA, Index=0, Wrap=True)  # disabled
list_item_22 = ListItem(List=sort_list_12.ValuesValuesA, Index=0, Wrap=True)  # disabled

# ---- group: TheHullMustBeExactSoWeTakeTwoMethodsOfDissectingThePolylineToBeSure
discontinuity_18 = Discontinuity(Curve=[list_item_22, convex_hull_7.Hull], Level=1)  # -> flatten(Points), Parameters; disabled
divide_curve = DivideCurve(Curve=[list_item_22, convex_hull_7.Hull], Count=10, Kinks=False)  # -> flatten(Points), Tangents, Parameters; disabled
point_7 = Point([divide_curve.Points, discontinuity_18.Points])  # disabled
convex_hull_9 = ConvexHull(Points=point_7, Plane=PlaneXY(0, 0, 0))  # -> Hull, HullZ, Indices; disabled

# ---- group: ConcaveHull
number_slider_30 = Slider(1.7, range=0..10)  # disabled
number_slider_31 = Slider(1, range=0..1)  # disabled
concavehull_2 = CSharpScript(
    Points=point_7,
    Attrition=number_slider_30,
    Reference=["C:\Program Files\Common Files\McNeel\Rhinoceros\5.0\Plug-ins\Grasshopper (b45a29b1-4343-4035-989e-044e8580d9cf)\0.9.76.0\Components\Surface.gha", "C:\Program Files\Common Files\McNeel\Rhinoceros\5.0\Plug-ins\Grasshopper (b45a29b1-4343-4035-989e-044e8580d9cf)\0.9.76.0\Components\Curve.gha"])  # -> ConcaveHull; inputs Points: list of Point3d, Attrition: Double; disabled
# ---------- concavehull_2: C# ----------
    var nodeTwoList = new Grasshopper.Kernel.Geometry.Node2List(Points);
    var delaunayFaces = Grasshopper.Kernel.Geometry.Delaunay.Solver.Solve_Faces(nodeTwoList, 1);
    var delaunayMesh = Grasshopper.Kernel.Geometry.Delaunay.Solver.Solve_Mesh(nodeTwoList, 1, ref delaunayFaces);
    delaunayMesh.Weld(Math.PI);

    var list = new List<object>();

    var circles = new SurfaceComponents.MeshComponents.Component_MeshFaceCircles();
    var param = circles.Params.Input[0] as Grasshopper.Kernel.GH_PersistentGeometryParam<Grasshopper.Kernel.Types.GH_Mesh>;
    param.PersistentData.ClearData();
    param.PersistentData.Append(new GH_Mesh(delaunayMesh));

    circles.ExpireSolution(true);

    //add to a dummy document so we can read outputs
    var doc = new Grasshopper.Kernel.GH_Document();
    doc.AddObject(circles, false);

    //read output circles
    circles.Params.Output[0].CollectData();
    var ratio = new double[circles.Params.Output[1].VolatileDataCount];
    for(int i = 0; i < circles.Params.Output[0].VolatileDataCount; ++i)
    {

      //ratio[i] = circles.Params.Output[1].VolatileData.get_Branch(0)[i];
      GH_Convert.ToDouble(circles.Params.Output[1].VolatileData.get_Branch(0)[i], out ratio[i], GH_Conversion.Both);
      list.Add(circles.Params.Output[0].VolatileData.get_Branch(0)[i]);

    }

    var arcsList = new double[list.Count];

    var arcs = new AnalysisComponents.Component_DeconstructArc();
    var arcParams = arcs.Params.Input[0] as Grasshopper.Kernel.GH_PersistentParam<Grasshopper.Kernel.Types.GH_Arc>;
    arcParams.PersistentData.ClearData();
    var circle = new Arc[delaunayMesh.Faces.Count];
    for(int i = 0; i < list.Count; ++i)
    {

      GH_Convert.ToArc(list[i], ref circle[i], GH_Conversion.Both);
      arcParams.PersistentData.Append(new GH_Arc(circle[i]));

    }

    arcs.ExpireSolution(true);
    var docOne = new Grasshopper.Kernel.GH_Document();
    docOne.AddObject(arcs, false);

    arcs.Params.Output[0].CollectData();
    for(int i = 0; i < arcs.Params.Output[1].VolatileDataCount; ++i)
    {

      GH_Convert.ToDouble(arcs.Params.Output[1].VolatileData.get_Branch(0)[i], out arcsList[i], GH_Conversion.Both);
      //arcsList.Add(arcs.Params.Output[1].VolatileData.get_Branch(0)[i]);

    }

    var faceMesh = new List<object>();
    var verticesMesh = new List<object>();

    var deMesh = new SurfaceComponents.MeshComponents.Component_DeconstructMesh();
    var meshParams = deMesh.Params.Input[0] as Grasshopper.Kernel.GH_PersistentParam<Grasshopper.Kernel.Types.GH_Mesh>;
    meshParams.PersistentData.ClearData();
    meshParams.PersistentData.Append(new GH_Mesh(delaunayMesh));

    deMesh.ExpireSolution(true);
    var docTwo = new Grasshopper.Kernel.GH_Document();
    docTwo.AddObject(deMesh, false);

    deMesh.Params.Output[0].CollectData();

    for(int i = 0; i < deMesh.Params.Output[0].VolatileDataCount; ++i)
    {

      verticesMesh.Add(deMesh.Params.Output[0].VolatileData.get_Branch(0)[i]);

    }

    for(int i = 0; i < deMesh.Params.Output[1].VolatileDataCount; ++i)
    {

      faceMesh.Add(deMesh.Params.Output[1].VolatileData.get_Branch(0)[i]);

    }

    var faceCullRadius = RadiusSorting(faceMesh, arcsList);

    Array.Sort(ratio);

    var splitListIndex = Convert.ToInt32((ratio[ratio.Length - 1] * faceMesh.Count) * Attrition);
    //var splitListIndex = Convert.ToInt32(Attrition);

    var splitList = SplitList(faceCullRadius, splitListIndex);

    var constructMesh = new Mesh();
    var meshPoints = new Point3d[verticesMesh.Count];
    for(int i = 0; i < verticesMesh.Count; ++i)
    {

      GH_Convert.ToPoint3d(verticesMesh[i], ref meshPoints[i], GH_Conversion.Both);
      constructMesh.Vertices.Add(meshPoints[i]);

    }

    var meshFaces = new Grasshopper.Kernel.Types.GH_MeshFace[splitList.Count];
    for(int i = 0; i < splitList.Count; ++i)
    {

      GH_Convert.ToGHMeshFace(splitList[i], GH_Conversion.Both, ref meshFaces[i]);
      constructMesh.Faces.AddFace(meshFaces[i].Value);

    }

    ConcaveHull = constructMesh.GetNakedEdges();
# ---------- concavehull_2: C# additional code ----------
  public List<object> RadiusSorting(List<object> x, double[] radius)
  {

    var compare = new List<KeyValuePair<double, object>>();

    for(int i = 0; i < x.Count; ++i)
    {

      compare.Add(new KeyValuePair<double, object>(radius[i], x.ElementAt(i)));

    }

    // Here is where the sorting according to radius takes place.
    compare.Sort(Compare1);
    compare.Reverse();
    // We retrieve a list of objects from our List of KeyValuePairs
    List<object> compared = (from kvp in compare select kvp.Value).Distinct().ToList();
    compared.Reverse();

    return compared;

  }

  static int Compare1(KeyValuePair<double, object> a, KeyValuePair<double, object> b)
  {

    return a.Key.CompareTo(b.Key);

  }

  private List<object> SplitList(List<object> list, int i)
  {

    var points = new List<object>();

    var chunk = Chunk(list, i, list.Count);

    foreach(var item in chunk)
    {

      points = item.ToList();

    }

    return points;

  }

  public static IEnumerable<IEnumerable<T>> Chunk<T> (IEnumerable<T> source, int chunksize, int count)
  {

    while (source.Any())
    {

      yield return source.Take(chunksize);
      source = source.Skip(chunksize + count);

    }

  }
# ---------- end concavehull_2 ----------
# ---- group: PaulsAlgo
number_slider_32 = Slider(0.562, range=0..10)  # disabled
number_slider_33 = Slider(0.966, range=0..2)  # disabled
crv = Curve(flatten([list_item_22, convex_hull_7.Hull]))  # disabled
divlength = DivideLength(Curve=crv, Length=number_slider_32)  # -> Points, Tangents, Parameters; disabled
Z = UnitZ(Factor=1)  # disabled
lng = ListLength(List=divlength.Points)  # -> flatten(Length); disabled
divide = DivideCurve(Curve=crv, Count=lng, Kinks=True)  # -> Points, Tangents, Parameters; disabled
xprod = CrossProduct(VectorA=divide.Tangents, VectorB=Z, Unitize=False)  # -> Vector, Length; disabled
amp = Amplitude(Vector=xprod.Vector, Amplitude=number_slider_33)  # disabled
move_3 = Move(Geometry=divide.Points, Motion=amp)  # -> Geometry, Transform; disabled
vdis = VectorDisplay(Anchor=divide.Points, Vector=amp)  # disabled
cir = Circle(Plane=move_3.Geometry, Radius=number_slider_33)  # -> graft(Circle); disabled
ccx = CurveCurve(CurveA=cir, CurveB=crv)  # -> simplify(Points), ParamsA, ParamsB; disabled
number_slider_34 = Slider(1, range=0..1)  # disabled
pshift = ShiftPaths(Data=ccx.Points, Offset=-1)  # disabled
lng_2 = ListLength(List=pshift)  # disabled
equals = Equality(FirstNumber=lng_2, SecondNumber=number_slider_34)  # -> Equality, Inequality; disabled
dispatch_6 = Dispatch(List=flatten(divide.Points), DispatchPattern=flatten(equals.Equality))  # -> ListA, ListB; disabled
pt = Point(dispatch_6.ListA)  # disabled
c_script_8 = CSharpScript(pt=pt, t=number_slider_32)  # -> out, A, B; inputs pt: list of Point3d, t: Double; disabled; same code as c_script
crv_2 = Curve(c_script_8.A)  # disabled

# ----
c_script_9 = CSharpScript(pts=divide_surface.Points, crv=convex_hull_7.Hull)  # -> out, A, B; inputs pts: list of Point3d, crv: Polyline; disabled; same code as c_script_4
c_script_10 = CSharpScript(pts=divide_surface.Points, crv=list_item_22)  # -> out, A, B; inputs pts: list of Point3d, crv: Polyline; disabled; same code as c_script_4
divide_length_3 = DivideLength(Curve=[convex_hull_7.Hull, list_item_22], Distance=number_slider_22, RoundUp=False, RoundDn=False)  # disabled
point_8 = Point(c_script_10.A)  # disabled
point_9 = Point(c_script_9.A)  # disabled
c_script_11 = CSharpScript(pts=divide_surface.Points, crv=convex_hull_7.Hull)  # -> out, A, B; inputs pts: list of Point3d, crv: Polyline; disabled; same code as c_script_4
c_script_12 = CSharpScript(pts=divide_surface.Points, crv=list_item_22)  # -> out, A, B; inputs pts: list of Point3d, crv: Polyline; disabled; same code as c_script_4
point_10 = Point(flatten([discontinuity_15.Points, point_8, point_9, divide_length_3]))  # disabled
divide_length_4 = DivideLength(Curve=[convex_hull_7.Hull, list_item_22], Distance=number_slider_23, RoundUp=False, RoundDn=False)  # disabled
point_11 = Point(c_script_12.A)  # disabled
point_12 = Point(c_script_11.A)  # disabled
point_13 = Point(flatten([discontinuity_15.Points, point_11, point_12, divide_length_4]))  # disabled

# ---- group: NestingNoSheet
curve_46 = Curve([<curve referenced from the Rhino model> x4])  # disabled
number_slider_35 = Slider(2, range=0..10)  # disabled
number_slider_36 = Slider(8, range=0..10)  # disabled
difference = CSharpScript(
    z=number_slider_35,
    u=curve_46,
    w=number_slider_36,
    Reference=["C:\PROGRAM FILES\COMMON FILES\MCNEEL\RHINOCEROS\5.0\PLUG-INS\CLIPPERPLUGIN (BAE0724C-D28B-4D54-9B02-806B19D157C2)\0.0.2.1\CLIPPER-0.2.2\ClipperTools.dll", "C:\Users\Paula\AppData\Roaming\Grasshopper\Libraries\PlanktonGh.dll", "C:\Users\Paula\AppData\Roaming\Grasshopper\Libraries\Plankton.dll"])  # -> out, A, B, C, D, E, F, AA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; inputs z: Int32, u: list of Polyline, w: Int32; disabled
# ---------- difference: C# ----------
    Polyline four = u[3];
    Polyline one = u[2];
    Polyline two = u[1];
    Polyline three = u[0];

    List<Point3d> ptA;
    ptA = one.ToList();
    ptA.RemoveAt(0);

    List<Point3d> ptB;
    ptB = two.ToList();
    ptB.RemoveAt(0);

    List<Point3d> ptC;
    ptC = three.ToList();
    ptC.RemoveAt(0);

    Point3d center = ptB[ptB.Count - 1];
    Vector3d zAxis = Vector3d.ZAxis;
    Plane p = new Rhino.Geometry.Plane(center, zAxis);

    // No Fit Polygon One
    double tolerance = 0.001;
    List<Polyline> outCurves = new List<Polyline>();
    List<Polyline> outDisplacedCurves = new List<Polyline>();
    foreach(List<IntPoint> path in ClipperLib.Clipper.MinkowskiDiff(two.ToPath2D(p, tolerance), one.ToPath2D(p, tolerance)))
    {

      Polyline plSum = path.ToPolyline(p, tolerance, true);
      outCurves.Add(plSum);

    }

    Polyline NFP = outCurves[0];

    List<Point3d> ptNFP;
    ptNFP = NFP.ToList();
    ptNFP.RemoveAt(0);

    // Inner Fit Polygon
    Point3d centerOne = ptB[ptB.Count - 1];
    Plane pO = new Rhino.Geometry.Plane(centerOne, zAxis);

    List<Polyline> outCurvesOne = new List<Polyline>();
    List<Polyline> outDisplacedCurvesOne = new List<Polyline>();
    foreach(List<IntPoint> path in ClipperLib.Clipper.MinkowskiDiff(two.ToPath2D(pO, tolerance), three.ToPath2D(pO, tolerance)))
    {

      Polyline plSum = path.ToPolyline(pO, tolerance, true);
      outCurvesOne.Add(plSum);

    }

    Polyline bin = outCurvesOne[1];

    // No Fit Polygon Two
    List<Polyline> outCurvesTwo = new List<Polyline>();
    List<Polyline> outDisplacedCurvesTwo = new List<Polyline>();
    foreach(List<IntPoint> path in ClipperLib.Clipper.MinkowskiDiff(two.ToPath2D(p, tolerance), four.ToPath2D(p, tolerance)))
    {

      Polyline plSum = path.ToPolyline(p, tolerance, true);
      outCurvesTwo.Add(plSum);

    }

    Polyline NFPOne = outCurvesTwo[0];


    Curve b = two.ToNurbsCurve();
    int[] iter = new int[5];
    int[] iterOne = new int[5];
    int[] iterTwo = new int[5];
    Vector3d[] vec = new Vector3d[ptA.Count];
    for(int i = 0; i < 5; ++i)
      for(int j = 0; j < 5 - 1; ++j)
      {

        iter[i] = i;
        iterOne[j] = j;
        //vec[i] = new Vector3d(i,i,i);

        if(iter[i] < iterOne[j])
        {

          iterTwo[i] = i;

        }
        else
        {

          iterTwo[j] = j;

        }

        AD = iter;
        AE = iterOne;
        AF = iterTwo;

      }

    //AD = vec;

    /*
    Vector3d[] vecOne = new Vector3d[ptB.Count];
    for(int i = 0; i < ptB.Count; ++i)
    {

    vecOne[i] = new Vector3d(ptB[i]);

    }
    //vec[0] = new Vector3d(ptA[1]) - new Vector3d(ptB[1]);
    //b.Translate(vec[0]);
    */
    /*for(int i = 0; i < ptA.Count; i++)
    for(int j = 0; j < ptB.Count; j++)
    {

    vec[0] = new Vector3d(ptA[0]) - new Vector3d(ptB[0]);
    b.Translate(vec[0]);

    }
    */

    A = one;

    B = two;

    C = outCurves;

    D = ptA;

    E = ptB;

    F = ptA.Count + ptB.Count;

    AA = ptNFP;

    AB = bin;

    AC = NFPOne;

    /*
    List<Polyline> outCurves = ClipperLib.Clipper.MinkowskiSum(

      u[0].ToPath2D(p, tolerance),
      u[1].ToPath2D(p, tolerance),
      true)
      .Select(path => path.ToPolyline(p, tolerance, true))
      .ToList();

    A = outCurves[0];

    B = pt[z];

    //C = ptO[w];

    AA = planeList;
    */
# ---------- end difference ----------
curve_47 = Curve(difference.AC)  # disabled
A = Curve(difference.A)  # disabled
B = Curve(difference.B)  # disabled
nfp = Curve(difference.C)  # disabled
list_item_23 = ListItem(List=nfp, Index=0, Wrap=True)  # disabled
point_14 = Point(difference.AA)  # disabled
bpoints = Point(difference.E)  # disabled
nfppoints = Point(difference.AA)  # disabled
discontinuity_19 = Discontinuity(Curve=A, Level=1)  # -> Points, Parameters; disabled
list_item_24 = ListItem(List=bpoints, Index=0, Wrap=True)  # disabled

# ---- group: NestingNoSheet / LowerLeft
deconstruct = Deconstruct(Point=bpoints)  # -> XComponent, YComponent, ZComponent; disabled
addition = Addition(A=deconstruct.XComponent, B=deconstruct.YComponent)  # disabled
number_slider_37 = Slider(200, range=0..1000)  # disabled
sort_list_14 = SortList(Keys=addition, ValuesValuesA=bpoints)  # -> Keys, ValuesValuesA; disabled
point_list = PointList(Points=sort_list_14.ValuesValuesA, Size=number_slider_37)  # disabled
number_slider_38 = Slider(0, range=0..7)  # disabled
list_item_25 = ListItem(List=sort_list_14.ValuesValuesA, Index=number_slider_38, Wrap=True)  # disabled

deconstruct_2 = Deconstruct(Point=discontinuity_19.Points)  # -> XComponent, YComponent, ZComponent; disabled
addition_2 = Addition(A=deconstruct_2.XComponent, B=deconstruct_2.YComponent)  # disabled
number_slider_39 = Slider(200, range=0..1000)  # disabled
sort_list_15 = SortList(Keys=addition_2, ValuesValuesA=discontinuity_19.Points)  # -> Keys, ValuesValuesA; disabled
point_list_2 = PointList(Points=sort_list_15.ValuesValuesA, Size=number_slider_39)  # disabled
number_slider_40 = Slider(0, range=0..7)  # disabled
list_item_26 = ListItem(List=sort_list_15.ValuesValuesA, Index=number_slider_40, Wrap=True)  # disabled

# ---- group: NestingNoSheet / TranslationVectorsFromNFP
# NestingWithSheet
vector_2pt_3 = Vector2Pt(PointA=list_item_25, PointB=nfppoints, Unitize=False)  # -> Vector, Length; disabled
vector_display_3 = VectorDisplay(Anchor=list_item_25, Vector=vector_2pt_3.Vector)  # disabled
move_4 = Move(Geometry=B, Motion=vector_2pt_3.Vector)  # -> graft(Geometry), Transform; disabled

# ---- group: NestingNoSheet / SortingTheBestPlacement
number_slider_41 = Slider(9, range=0..9)  # disabled
list_item_27 = ListItem(List=move_4.Geometry, Index=number_slider_41, Wrap=True)  # disabled
discontinuity_20 = Discontinuity(Curve=list_item_27, Level=1)  # -> Points, Parameters; disabled
apoints = Point(difference.D)  # disabled
tree_statistics = TreeStatistics(Tree=discontinuity_20.Points)  # -> Paths, Length, Count; disabled
number_slider_42 = Slider(6, range=0..10)  # disabled
duplicate_data = DuplicateData(Data=apoints, Number=tree_statistics.Count, Order=True)  # disabled
partition_list = PartitionList(List=duplicate_data, Size=number_slider_42)  # disabled
path_mapper = PathMapper(partition_list, source="{A;B;C;D;E;F}", target="{D;E;F;0}")  # disabled
merge_10 = Merge(Data1=path_mapper, Data2=discontinuity_20.Points)  # disabled
convex_hull_10 = ConvexHull(Points=merge_10, Plane=PlaneXY(0, 0, 0))  # -> flatten(Hull), HullZ, Indices; disabled
area_21 = Area(Geometry=convex_hull_10.Hull)  # -> Area, Centroid; disabled
sort_list_16 = SortList(Keys=area_21.Area, ValuesValuesA=flatten(move_4.Geometry))  # -> Keys, ValuesValuesA; disabled
sort_list_17 = SortList(Keys=area_21.Area, ValuesValuesA=convex_hull_10.Hull)  # -> Keys, ValuesValuesA; disabled
list_item_28 = ListItem(List=sort_list_17.ValuesValuesA, Index=0, Wrap=True)  # disabled
list_item_29 = ListItem(List=sort_list_16.ValuesValuesA, Index=0, Wrap=True)  # disabled
curve_48 = Curve(list_item_29)  # disabled
curve_49 = Curve(list_item_28)  # disabled

# ---- group: NestingNoSheet (continued)
minkowski_sum = MinkowskiSum(A=A, B=B, Plane=list_item_25, Tolerance=0.001)  # -> Sum, DisplacedSum; disabled
minkowski_difference_3 = MinkowskiDifference(A=B, B=A, Plane=list_item_25, Tolerance=0.001)  # disabled
point_list_3 = PointList(Points=bpoints, Size=number_slider_37)  # disabled
discontinuity_21 = Discontinuity(Curve=move_4.Geometry, Level=1)  # -> Points, Parameters; disabled
panel_15 = Panel(discontinuity_21.Points)  # disabled
panel_16 = Panel(path_mapper)  # disabled
panel_17 = Panel(merge_10)  # disabled

# ---- group: SheetMinusThe"Union"BetweenTheTwoPlacedParts
region_difference_5 = RegionDifference(CurvesA=region_difference_4, CurvesB=convex_hull_9.Hull)  # disabled

# ---- group: TheTwoPartsToRunThroughTheNoFitPolygonAlgorithm
number_slider_43 = Slider(0.1, range=0..0.1)  # disabled
curve_50 = Curve(<curve referenced from the Rhino model>)  # disabled
curve_51 = Curve(<curve referenced from the Rhino model>)  # disabled
curve_52 = Curve(<curve referenced from the Rhino model>)  # disabled
curve_53 = Curve(<curve referenced from the Rhino model>)  # disabled
curve_54 = Curve(<curve referenced from the Rhino model>)  # disabled
curve_to_polyline_2 = CurveToPolyline(Curve=curve_50, ToleranceDistance=number_slider_43, ToleranceAngle=0)  # -> Polyline, Segments; disabled
merge_11 = Merge(Data1=curve_52, Data2=convex_hull_9.Hull)  # -> flatten(Result); disabled

# ----
# And we are done with our process and
# can begin iterating!
# Partes sin ordenar dentro del contenedor.
merge_12 = Merge(
    Data1=polygona_3,
    Data2=sheet_2,
    Data3=parttobeplaced_3,
    Data4=curve_43,
    Data5=curve_52,
    Data6=curve_50,
    Data7=curve_51,
    Data8=curve_53,
    Data9=curve_54)  # disabled

# ---- group: NoFitPolygonAndTheRespectiveTranslations
nestingtwoitems_6 = CSharpScript(x=merge_11, Reference="C:\Users\Paula\AppData\Roaming\Grasshopper\Libraries\ClipperTools.dll")  # -> out, A, B; inputs x: list of Polyline; disabled
# ---------- nestingtwoitems_6: C# ----------
    // We want to cast(change from one data type to another) our list of polylines to curves, so that
    // we can call the AreaMassProperties class and its method .Compute to get the area of the polygons
    // after that we can now create a List of KeyValuePair to assign the area of our polygons to our
    // polygons so that we can sort them later according to their areas.
    /*
    List<Curve> one = new List<Curve>();
    double[] areas = new Double[x.Count];
    var curves = new List<KeyValuePair<Polyline, double>>();

    for(int i = 0; i < x.Count; ++i)
    {

      one.Add(x.ElementAt(i).ToNurbsCurve());
      areas[i] = AreaMassProperties.Compute(one.ElementAt(i)).Area;
      curves.Add(new KeyValuePair<Polyline, double>(x.ElementAt(i), areas[i]));

    }

    // Here is where the sorting according to area values takes place.
    curves.Sort(Compare1);
    curves.Reverse();
    // We retrieve a list of curves from our List of KeyValuePairs
    List<Polyline> curve = (from kvp in curves select kvp.Key).Distinct().ToList();
    curve.Reverse();
    */

    List<Polyline> curve = x;
    
    // We create and populate trees with the points of the curves, so that we can
    // sort each of the lower left points of each of the curves according to the
    // sum of their Xs and Ys positions.
    List<List<Point3d>> pts = new List<List<Point3d>>();
    DataTree<Point3d> tree = new DataTree<Point3d>();
    DataTree<double> treeSum = new DataTree<double>();
    var points = new DataTree<KeyValuePair<Point3d, double>>();
    var point = new List<Point3d>[curve.Count];
    DataTree<Point3d> treeLowerLeft = new DataTree<Point3d>();

    for(int i = 0; i < curve.Count; ++i)
    {

      pts.Add(curve[i].ToList());
      pts[i].RemoveAt(pts[i].Count - 1);
      GH_Path path = new GH_Path(i);

      for(int j = 0; j < pts[i].Count; ++j)
      {

        tree.Add(pts[i][j], path);
        treeSum.Add(pts[i][j].X + pts[i][j].Y, path);

        points.Add(new KeyValuePair<Point3d, double>(tree.Branch(i)[j], treeSum.Branch(i)[j]), path);

        points.Branch(i).Sort(Compare2);
        points.Branch(i).Reverse();
        point[i] = (from kvp in points.Branch(i) select kvp.Key).Distinct().ToList();
        point[i].Reverse();

      }

    }

    for(int i = 0; i < tree.BranchCount; ++i)
      for(int j = 0; j < tree.Branch(i).Count; ++j)
      {

        treeLowerLeft.Add(point[i][j], new GH_Path(i));

      }

    var treeOut = new DataTree<Point3d>();

    for(int i = 0; i < treeLowerLeft.BranchCount; ++i)
      for(int j = 0; j < treeLowerLeft.Branch(i).Count; ++j)
      {

        treeOut.Add(treeLowerLeft.Branch(i)[0], new GH_Path(i));

      }

    /*
    // Create the data structures and initialize them
    DataTree<Point3d> points = new DataTree<Point3d>();
    List<List<Point3d>> lists = new List<List<Point3d>>();

    // Fill the nested list with the list of points
    for(int i = 0; i < x.Count; ++i)
    {

      lists.Add(x[i].ToList());

    }

    // Fill the data tree with the list of points
    for(int i = 0; i < lists.Count; ++i)
    {

      var path = new GH_Path(i);

      for(int j = 0; j < lists[i].Count; ++j )
      {

        points.Add(lists[i][j], path);

      }

    }
    */


    // No Fit Polygon from minkowsky difference using the clipper lib
    Polyline polyOne = curve[0];
    Polyline polyTwo = curve[curve.Count - 1];

    Point3d center = treeOut.Branch(0).ElementAt(0);
    Vector3d zAxis = Vector3d.ZAxis;
    Plane p = new Rhino.Geometry.Plane(center, zAxis);

    double tolerance = 0.001;
    List<Polyline> outCurves = new List<Polyline>();
    List<Polyline> outDisplacedCurves = new List<Polyline>();
    foreach(List<IntPoint> path in ClipperLib.Clipper.MinkowskiDiff(polyOne.ToPath2D(p, tolerance), polyTwo.ToPath2D(p, tolerance)))
    {

      Polyline plSum = path.ToPolyline(p, tolerance, true);
      outCurves.Add(plSum);

    }

    Polyline NFP = outCurves[0];

    B = NFP;

    List<Point3d> ptNFP;
    ptNFP = NFP.ToList();
    ptNFP.RemoveAt(0);

    List<Vector3d> vectors = new List<Vector3d>();
    for(int i = 0; i < ptNFP.Count; ++i)
    {

      vectors.Add(new Vector3d(ptNFP.ElementAt(i) - treeOut.Branch(0)[0]));

    }

    List<Curve> translated = new List<Curve>();
    Polyline[] polys = new Polyline[ptNFP.Count];
    List<List<Point3d>> polyPoint = new List<List<Point3d>>();

    List<Point3d> pointsA = new List<Point3d>();
    pointsA = polyTwo.ToList();
    pointsA.RemoveAt(pointsA.Count - 1);
    DataTree<Point3d> polyPoints = new DataTree<Point3d>();
    DataTree<Point3d> APoints = new DataTree<Point3d>();
    for(int i = 0; i < ptNFP.Count; ++i)
    {

      var path = new GH_Path(i);
      Curve oney = polyOne.ToNurbsCurve();
      oney.Translate(vectors.ElementAt(i));
      translated.Add(oney);
      translated.ElementAt(i).TryGetPolyline(out polys[i]);
      polyPoint.Add(polys[i].ToList());

      for(int j = 0; j < polyPoint[i].Count - 1; ++j)
      {

        polyPoints.Add(polyPoint[i][j], path);

      }

    }

    for(int i = 0; i < ptNFP.Count; ++i)
      for(int j = 0; j < pointsA.Count; ++j)
      {

        var path = new GH_Path(i);
        APoints.Add(pointsA[j], path);

      }

    for(int i = 0; i < polyPoints.BranchCount; ++i)
      for(int j = 0; j < polyPoints.Branch(i).Count; ++j)
      {

        APoints.Add(polyPoints.Branch(i)[j], new GH_Path(i));

      }

    var list = new Grasshopper.Kernel.Geometry.Node2List[APoints.BranchCount];
    var polyLines = new Polyline[APoints.BranchCount];
    var curvesConvex = new Curve[APoints.BranchCount];
    var convexArea = new Double[APoints.BranchCount];
    var convexSort = new List<KeyValuePair<Polyline, double>>();
    var hullSort = new List<KeyValuePair<Polyline, double>>();

    for(int i = 0; i < APoints.BranchCount; ++i)
    {

      list[i] = new Grasshopper.Kernel.Geometry.Node2List(APoints.Branch(i));
      polyLines[i] = Grasshopper.Kernel.Geometry.ConvexHull.Solver.ComputeHull(list[i]);
      curvesConvex[i] = polyLines[i].ToNurbsCurve();
      convexArea[i] = AreaMassProperties.Compute(curvesConvex[i]).Area;
      convexSort.Add(new KeyValuePair<Polyline, double>(polys[i], convexArea[i]));
      hullSort.Add(new KeyValuePair<Polyline, double>(polyLines[i], convexArea[i]));

    }

    // Output the polygons with no convex hull
    // Here is where the sorting according to area values takes place.
    convexSort.Sort(Compare1);
    convexSort.Reverse();
    // We retrieve a list of polylines from our List of KeyValuePairs
    List<Polyline> polyFinal = (from kvp in convexSort select kvp.Key).Distinct().ToList();
    polyFinal.Reverse();

    // Output the convex hull polygons
    // Here is where the sorting according to area values takes place.
    hullSort.Sort(Compare1);
    hullSort.Reverse();
    // We retrieve a list of polylines from our List of KeyValuePairs
    List<Polyline> hullFinal = (from kvp in hullSort select kvp.Key).Distinct().ToList();
    hullFinal.Reverse();

    A = polyFinal;

    //B = hullFinal[0];

    /*
    Curve booleanUnionOne = polyFinal[0].ToNurbsCurve();
    Curve booleanUnionTwo = polyTwo.ToNurbsCurve();

    var listBoolean = new List<Curve>();

    listBoolean.Add(booleanUnionOne);
    listBoolean.Add(booleanUnionTwo);

    A = Curve.CreateBooleanUnion(listBoolean).ElementAt(1);
    */
# ---------- nestingtwoitems_6: C# additional code ----------
  static int Compare1(KeyValuePair<Polyline, double> a, KeyValuePair<Polyline, double> b)
  {

    return a.Value.CompareTo(b.Value);

  }

  static int Compare2(KeyValuePair<Point3d, double> a, KeyValuePair<Point3d, double> b)
  {

    return a.Value.CompareTo(b.Value);

  }
# ---------- end nestingtwoitems_6 ----------
curve_55 = Curve(nestingtwoitems_6.B)  # disabled
curve_56 = Curve(nestingtwoitems_6.A)  # disabled

# ----
brep_brep_4 = BrepBrep(BrepA=curve_56, BrepB=region_difference_5)  # -> flatten(Curves), Points; disabled
closed_5 = Closed(Curve=brep_brep_4.Curves)  # -> Closed, Periodic; disabled
cull_pattern_5 = CullPattern(List=brep_brep_4.Curves, CullPattern=closed_5.Closed)  # disabled
curve_57 = Curve(cull_pattern_5)  # disabled
area_22 = Area(Geometry=curve_53)  # -> Area, Centroid; disabled
area_23 = Area(Geometry=curve_51)  # -> Area, Centroid; disabled
area_24 = Area(Geometry=curve_54)  # -> Area, Centroid; disabled
area_25 = Area(Geometry=curve_57)  # -> Area, Centroid; disabled
area_26 = Area(Geometry=curve_to_polyline_2.Polyline)  # -> Area, Centroid; disabled
area_27 = Area(Geometry=curve_52)  # -> Area, Centroid; disabled
panel_18 = Panel(area_22.Area)  # disabled
panel_19 = Panel(area_23.Area)  # disabled
panel_20 = Panel(area_24.Area)  # disabled
panel_21 = Panel(area_27.Area)  # disabled
panel_22 = Panel(area_26.Area)  # disabled
panel_23 = Panel(area_25.Area)  # disabled
panel_24 = Panel(".")  # disabled
panel_25 = Panel(".")  # disabled
panel_26 = Panel(".")  # disabled
panel_27 = Panel(".")  # disabled
panel_28 = Panel(".")  # disabled
panel_29 = Panel(".")  # disabled
panel_30 = Panel(".")  # disabled
panel_31 = Panel(".")  # disabled
panel_32 = Panel(".")  # disabled
panel_33 = Panel(".")  # disabled
text_split_3 = TextSplit(Text=panel_18, Separators=panel_26)  # disabled
text_split_4 = TextSplit(Text=panel_19, Separators=panel_28)  # disabled
text_split_5 = TextSplit(Text=area_25.Area, Separators=panel_29)  # disabled
text_split_6 = TextSplit(Text=panel_20, Separators=panel_31)  # disabled
text_split_7 = TextSplit(Text=panel_22, Separators=panel_33)  # disabled
text_split_8 = TextSplit(Text=panel_21, Separators=panel_32)  # disabled
panel_34 = Panel(text_split_3)  # disabled
panel_35 = Panel(text_split_4)  # disabled
panel_36 = Panel(text_split_5)  # disabled
panel_37 = Panel(text_split_6)  # disabled
panel_38 = Panel(text_split_8)  # disabled
panel_39 = Panel(text_split_7)  # disabled
list_item_30 = ListItem(List=panel_34, Index=0, Wrap=True)  # -> flatten(Item); disabled
list_item_31 = ListItem(List=panel_35, Index=0, Wrap=True)  # -> flatten(Item); disabled
list_item_32 = ListItem(List=panel_36, Index=0, Wrap=True)  # -> flatten(Item); disabled
list_item_33 = ListItem(List=panel_37, Index=0, Wrap=True)  # -> flatten(Item); disabled
list_item_34 = ListItem(List=panel_39, Index=0, Wrap=True)  # -> flatten(Item); disabled
list_item_35 = ListItem(List=panel_38, Index=0, Wrap=True)  # -> flatten(Item); disabled
panel_40 = Panel(list_item_30)  # disabled
panel_41 = Panel(list_item_31)  # disabled
panel_42 = Panel(list_item_32)  # disabled
panel_43 = Panel(list_item_33)  # disabled
panel_44 = Panel(list_item_35)  # disabled
panel_45 = Panel(panel_22)  # disabled
evaluate_6 = Evaluate(Expression="If(x=y, True, False)", x=panel_44, y=panel_42)  # disabled
dispatch_7 = Dispatch(List=curve_57, DispatchPattern=evaluate_6)  # -> ListA, ListB; disabled
discontinuity_22 = Discontinuity(Curve=convex_hull_9.Hull, Level=1)  # -> Points, Parameters; disabled
curve_58 = Curve(dispatch_7.ListA)  # disabled

round = Round(Number=panel_22)  # -> Nearest, Floor, Ceiling; disabled

# ---- group: CreateATreeWithAllThePlacementPointsAndThePolygonWeArePlacingNextTo
graft_tree_6 = GraftTree(Tree=curve_58, IncludeEmptyLists=True, IncludeNullItems=True)  # disabled
discontinuity_23 = Discontinuity(Curve=graft_tree_6, Level=1)  # -> Points, Parameters; disabled
c_script_13 = CSharpScript(x=simplify(discontinuity_23.Points), y=discontinuity_22.Points)  # -> out, A; inputs x: tree of Point3d, y: list of Point3d; disabled; same code as c_script

# ---- group: ConvexHullAreaSorting
convex_hull_11 = ConvexHull(Points=c_script_13.A, Plane=PlaneXY(0, 0, 0))  # -> flatten(Hull), HullZ, Indices; disabled
area_28 = Area(Geometry=convex_hull_11.Hull)  # -> Area, Centroid; disabled
sort_list_18 = SortList(Keys=area_28.Area, ValuesValuesA=curve_58)  # -> Keys, ValuesValuesA; disabled
list_item_36 = ListItem(List=sort_list_18.ValuesValuesA, Index=0, Wrap=True)  # disabled

# ---- group: ConvexHulls
discontinuity_24 = Discontinuity(Curve=[convex_hull_9.Hull, list_item_36], Level=1)  # -> flatten(Points), Parameters; disabled
convex_hull_12 = ConvexHull(Points=discontinuity_24.Points, Plane=PlaneXY(0, 0, 0))  # -> Hull, HullZ, Indices; disabled

# ----
concavehull_3 = CSharpScript(
    Points=discontinuity_24.Points,
    Attrition=number_slider_19,
    Reference=["C:\Program Files\Common Files\McNeel\Rhinoceros\5.0\Plug-ins\Grasshopper (b45a29b1-4343-4035-989e-044e8580d9cf)\0.9.76.0\Components\Surface.gha", "C:\Program Files\Common Files\McNeel\Rhinoceros\5.0\Plug-ins\Grasshopper (b45a29b1-4343-4035-989e-044e8580d9cf)\0.9.76.0\Components\Curve.gha"])  # -> ConcaveHull; inputs Points: list of Point3d, Attrition: Double; disabled
# ---------- concavehull_3: C# usings ----------
using System.IO;
using System.Linq;
using System.Data;
using System.Drawing;
using System.Reflection;
using System.Windows.Forms;
using System.Xml;
using System.Xml.Linq;
using System.Runtime.InteropServices;

using Rhino.DocObjects;
using Rhino.Collections;
using GH_IO;
using GH_IO.Serialization;
using SurfaceComponents.SolidComponents;
using SurfaceComponents;
using SurfaceComponents.ShadingComponents;
using SurfaceComponents.SurfaceComponents;
using SurfaceComponents.MeshComponents;
using SurfaceComponents.PrimitiveComponents;
using SurfaceComponents.AnalysisComponents;
using AnalysisComponents;
using CurveComponents;
using CurveComponents.Colours;
using CurveComponents.ColourComponent;
using DimensionComponents;
using OtherComponents;
using CurveComponents.Offset;
# ---------- concavehull_3: C# ----------
    var nodeTwoList = new Grasshopper.Kernel.Geometry.Node2List(Points);
    var delaunayFaces = Grasshopper.Kernel.Geometry.Delaunay.Solver.Solve_Faces(nodeTwoList, 1);
    var delaunayMesh = Grasshopper.Kernel.Geometry.Delaunay.Solver.Solve_Mesh(nodeTwoList, 1, ref delaunayFaces);
    delaunayMesh.Weld(Math.PI);

    var list = new List<object>();

    var circles = new SurfaceComponents.MeshComponents.Component_MeshFaceCircles();
    var param = circles.Params.Input[0] as Grasshopper.Kernel.GH_PersistentGeometryParam<Grasshopper.Kernel.Types.GH_Mesh>;
    param.PersistentData.ClearData();
    param.PersistentData.Append(new GH_Mesh(delaunayMesh));

    circles.ExpireSolution(true);

    //add to a dummy document so we can read outputs
    var doc = new Grasshopper.Kernel.GH_Document();
    doc.AddObject(circles, false);

    //read output circles
    circles.Params.Output[0].CollectData();
    var ratio = new double[circles.Params.Output[1].VolatileDataCount];
    for(int i = 0; i < circles.Params.Output[0].VolatileDataCount; ++i)
    {

      //ratio[i] = circles.Params.Output[1].VolatileData.get_Branch(0)[i];
      GH_Convert.ToDouble(circles.Params.Output[1].VolatileData.get_Branch(0)[i], out ratio[i], GH_Conversion.Both);
      list.Add(circles.Params.Output[0].VolatileData.get_Branch(0)[i]);

    }

    var arcsList = new double[list.Count];

    var arcs = new AnalysisComponents.Component_DeconstructArc();
    var arcParams = arcs.Params.Input[0] as Grasshopper.Kernel.GH_PersistentParam<Grasshopper.Kernel.Types.GH_Arc>;
    arcParams.PersistentData.ClearData();
    var circle = new Arc[delaunayMesh.Faces.Count];
    for(int i = 0; i < list.Count; ++i)
    {

      GH_Convert.ToArc(list[i], ref circle[i], GH_Conversion.Both);
      arcParams.PersistentData.Append(new GH_Arc(circle[i]));

    }

    arcs.ExpireSolution(true);
    var docOne = new Grasshopper.Kernel.GH_Document();
    docOne.AddObject(arcs, false);

    arcs.Params.Output[0].CollectData();
    for(int i = 0; i < arcs.Params.Output[1].VolatileDataCount; ++i)
    {

      GH_Convert.ToDouble(arcs.Params.Output[1].VolatileData.get_Branch(0)[i], out arcsList[i], GH_Conversion.Both);
      //arcsList.Add(arcs.Params.Output[1].VolatileData.get_Branch(0)[i]);

    }

    var faceMesh = new List<object>();
    var verticesMesh = new List<object>();

    var deMesh = new SurfaceComponents.MeshComponents.Component_DeconstructMesh();
    var meshParams = deMesh.Params.Input[0] as Grasshopper.Kernel.GH_PersistentParam<Grasshopper.Kernel.Types.GH_Mesh>;
    meshParams.PersistentData.ClearData();
    meshParams.PersistentData.Append(new GH_Mesh(delaunayMesh));

    deMesh.ExpireSolution(true);
    var docTwo = new Grasshopper.Kernel.GH_Document();
    docTwo.AddObject(deMesh, false);

    deMesh.Params.Output[0].CollectData();

    for(int i = 0; i < deMesh.Params.Output[0].VolatileDataCount; ++i)
    {

      verticesMesh.Add(deMesh.Params.Output[0].VolatileData.get_Branch(0)[i]);

    }

    for(int i = 0; i < deMesh.Params.Output[1].VolatileDataCount; ++i)
    {

      faceMesh.Add(deMesh.Params.Output[1].VolatileData.get_Branch(0)[i]);

    }

    var faceCullRadius = RadiusSorting(faceMesh, arcsList);

    Array.Sort(ratio);

    var splitListIndex = Convert.ToInt32((ratio[ratio.Length - 1] * faceMesh.Count) * Attrition);
    //var splitListIndex = Convert.ToInt32(Attrition);

    var splitList = SplitList(faceCullRadius, splitListIndex);

    var constructMesh = new Mesh();
    var meshPoints = new Point3d[verticesMesh.Count];
    for(int i = 0; i < verticesMesh.Count; ++i)
    {

      GH_Convert.ToPoint3d(verticesMesh[i], ref meshPoints[i], GH_Conversion.Both);
      constructMesh.Vertices.Add(meshPoints[i]);

    }

    var meshFaces = new Grasshopper.Kernel.Types.GH_MeshFace[splitList.Count];
    for(int i = 0; i < splitList.Count; ++i)
    {

      GH_Convert.ToGHMeshFace(splitList[i], GH_Conversion.Both, ref meshFaces[i]);
      constructMesh.Faces.AddFace(meshFaces[i].Value);

    }

    ConcaveHull = constructMesh.GetNakedEdges();
# ---------- concavehull_3: C# additional code ----------
  public List<object> RadiusSorting(List<object> x, double[] radius)
  {

    var compare = new List<KeyValuePair<double, object>>();

    for(int i = 0; i < x.Count; ++i)
    {

      compare.Add(new KeyValuePair<double, object>(radius[i], x.ElementAt(i)));

    }

    // Here is where the sorting according to radius takes place.
    compare.Sort(Compare1);
    compare.Reverse();
    // We retrieve a list of objects from our List of KeyValuePairs
    List<object> compared = (from kvp in compare select kvp.Value).Distinct().ToList();
    compared.Reverse();

    return compared;

  }

  static int Compare1(KeyValuePair<double, object> a, KeyValuePair<double, object> b)
  {

    return a.Key.CompareTo(b.Key);

  }

  private List<object> SplitList(List<object> list, int i)
  {

    var points = new List<object>();

    var chunk = Chunk(list, i, list.Count);

    foreach(var item in chunk)
    {

      points = item.ToList();

    }

    return points;

  }

  public static IEnumerable<IEnumerable<T>> Chunk<T> (IEnumerable<T> source, int chunksize, int count)
  {

  while (source.Any())
  {

    yield return source.Take(chunksize);
    source = source.Skip(chunksize + count);

  }

}
# ---------- end concavehull_3 ----------

# ---- group: SheetMinusThe"Union"BetweenTheTwoPlacedParts (continued)
region_difference_6 = RegionDifference(CurvesA=region_difference_5, CurvesB=convex_hull_12.Hull)  # disabled

# ---- group: TheTwoPartsToRunThroughTheNoFitPolygonAlgorithm (continued)
merge_13 = Merge(Data1=curve_to_polyline_2.Polyline, Data2=convex_hull_12.Hull)  # -> flatten(Result); disabled

# ---- group: NoFitPolygonAndTheRespectiveTranslations (continued)
nestingtwoitems_7 = CSharpScript(x=merge_13, Reference="C:\Users\Paula\AppData\Roaming\Grasshopper\Libraries\ClipperTools.dll")  # -> out, A, B; inputs x: list of Polyline; disabled; same code as nestingtwoitems_6
curve_59 = Curve(nestingtwoitems_7.B)  # disabled
curve_60 = Curve(nestingtwoitems_7.A)  # disabled

# ----
brep_brep_5 = BrepBrep(BrepA=curve_60, BrepB=region_difference_6)  # -> flatten(Curves), Points; disabled
closed_6 = Closed(Curve=brep_brep_5.Curves)  # -> Closed, Periodic; disabled
cull_pattern_6 = CullPattern(List=brep_brep_5.Curves, CullPattern=closed_6.Closed)  # disabled
curve_61 = Curve(cull_pattern_6)  # disabled
area_29 = Area(Geometry=curve_61)  # -> Area, Centroid; disabled
panel_46 = Panel(area_29.Area)  # disabled
text_split_9 = TextSplit(Text=panel_46, Separators=panel_30)  # disabled
panel_47 = Panel(text_split_9)  # disabled
list_item_37 = ListItem(List=panel_47, Index=0, Wrap=True)  # -> flatten(Item); disabled
panel_48 = Panel(area_29.Area)  # disabled
discontinuity_25 = Discontinuity(Curve=convex_hull_12.Hull, Level=1)  # -> Points, Parameters; disabled

round_2 = Round(Number=panel_46)  # -> Nearest, Floor, Ceiling; disabled

evaluate_7 = Evaluate(Expression="If(x=y, True, False)", x=round.Floor, y=round_2.Floor)  # disabled
dispatch_8 = Dispatch(List=curve_61, DispatchPattern=evaluate_7)  # -> ListA, ListB; disabled
curve_62 = Curve(dispatch_8.ListA)  # disabled

# ---- group: CreateATreeWithAllThePlacementPointsAndThePolygonWeArePlacingNextTo (continued)
graft_tree_7 = GraftTree(Tree=curve_62, IncludeEmptyLists=True, IncludeNullItems=True)  # disabled
discontinuity_26 = Discontinuity(Curve=graft_tree_7, Level=1)  # -> Points, Parameters; disabled
c_script_14 = CSharpScript(x=simplify(discontinuity_26.Points), y=discontinuity_25.Points)  # -> out, A; inputs x: tree of Point3d, y: list of Point3d; disabled; same code as c_script

# ---- group: ConvexHullAreaSorting (continued)
convex_hull_13 = ConvexHull(Points=c_script_14.A, Plane=PlaneXY(0, 0, 0))  # -> flatten(Hull), HullZ, Indices; disabled
area_30 = Area(Geometry=convex_hull_13.Hull)  # -> Area, Centroid; disabled
sort_list_19 = SortList(Keys=area_30.Area, ValuesValuesA=curve_62)  # -> Keys, ValuesValuesA; disabled
list_item_38 = ListItem(List=sort_list_19.ValuesValuesA, Index=0, Wrap=True)  # disabled

# ---- group: ConvexHulls (continued)
discontinuity_27 = Discontinuity(Curve=[list_item_38, convex_hull_12.Hull], Level=1)  # -> flatten(Points), Parameters; disabled
convex_hull_14 = ConvexHull(Points=discontinuity_27.Points, Plane=PlaneXY(0, 0, 0))  # -> Hull, HullZ, Indices; disabled

# ---- group: SheetMinusThe"Union"BetweenTheTwoPlacedParts (continued)
region_difference_7 = RegionDifference(CurvesA=region_difference_6, CurvesB=convex_hull_14.Hull)  # disabled

# ---- group: TheTwoPartsToRunThroughTheNoFitPolygonAlgorithm (continued)
merge_14 = Merge(Data1=curve_51, Data2=convex_hull_14.Hull)  # -> flatten(Result); disabled

# ---- group: NoFitPolygonAndTheRespectiveTranslations (continued)
nestingtwoitems_8 = CSharpScript(x=merge_14, Reference="C:\Users\Paula\AppData\Roaming\Grasshopper\Libraries\ClipperTools.dll")  # -> out, A, B; inputs x: list of Polyline; disabled; same code as nestingtwoitems_6
curve_63 = Curve(nestingtwoitems_8.B)  # disabled
curve_64 = Curve(nestingtwoitems_8.A)  # disabled

# ----
brep_brep_6 = BrepBrep(BrepA=curve_64, BrepB=region_difference_7)  # -> flatten(Curves), Points; disabled
closed_7 = Closed(Curve=brep_brep_6.Curves)  # -> Closed, Periodic; disabled
cull_pattern_7 = CullPattern(List=brep_brep_6.Curves, CullPattern=closed_7.Closed)  # disabled
curve_65 = Curve(cull_pattern_7)  # disabled
area_31 = Area(Geometry=curve_65)  # -> Area, Centroid; disabled
panel_49 = Panel(area_31.Area)  # disabled
text_split_10 = TextSplit(Text=panel_49, Separators=panel_25)  # disabled
panel_50 = Panel(text_split_10)  # disabled
list_item_39 = ListItem(List=panel_50, Index=0, Wrap=True)  # -> flatten(Item); disabled
panel_51 = Panel(list_item_39)  # disabled
evaluate_8 = Evaluate(Expression="If(x=y, True, False)", x=panel_41, y=panel_51)  # disabled
dispatch_9 = Dispatch(List=curve_65, DispatchPattern=evaluate_8)  # -> ListA, ListB; disabled
discontinuity_28 = Discontinuity(Curve=convex_hull_14.Hull, Level=1)  # -> Points, Parameters; disabled
curve_66 = Curve(dispatch_9.ListA)  # disabled

# ---- group: CreateATreeWithAllThePlacementPointsAndThePolygonWeArePlacingNextTo (continued)
graft_tree_8 = GraftTree(Tree=curve_66, IncludeEmptyLists=True, IncludeNullItems=True)  # disabled
discontinuity_29 = Discontinuity(Curve=graft_tree_8, Level=1)  # -> Points, Parameters; disabled
c_script_15 = CSharpScript(x=simplify(discontinuity_29.Points), y=discontinuity_28.Points)  # -> out, A; inputs x: tree of Point3d, y: list of Point3d; disabled; same code as c_script

# ---- group: ConvexHullAreaSorting (continued)
convex_hull_15 = ConvexHull(Points=c_script_15.A, Plane=PlaneXY(0, 0, 0))  # -> flatten(Hull), HullZ, Indices; disabled
area_32 = Area(Geometry=convex_hull_15.Hull)  # -> Area, Centroid; disabled
sort_list_20 = SortList(Keys=area_32.Area, ValuesValuesA=curve_66)  # -> Keys, ValuesValuesA; disabled
list_item_40 = ListItem(List=sort_list_20.ValuesValuesA, Index=0, Wrap=True)  # disabled

# ---- group: ConvexHulls (continued)
discontinuity_30 = Discontinuity(Curve=[list_item_40, convex_hull_14.Hull], Level=1)  # -> flatten(Points), Parameters; disabled
convex_hull_16 = ConvexHull(Points=discontinuity_30.Points, Plane=PlaneXY(0, 0, 0))  # -> Hull, HullZ, Indices; disabled

# ---- group: SheetMinusThe"Union"BetweenTheTwoPlacedParts (continued)
region_difference_8 = RegionDifference(CurvesA=region_difference_7, CurvesB=convex_hull_16.Hull)  # disabled

# ---- group: TheTwoPartsToRunThroughTheNoFitPolygonAlgorithm (continued)
merge_15 = Merge(Data1=curve_53, Data2=convex_hull_16.Hull)  # -> flatten(Result); disabled

# ---- group: NoFitPolygonAndTheRespectiveTranslations (continued)
nestingtwoitems_9 = CSharpScript(x=merge_15, Reference="C:\Users\Paula\AppData\Roaming\Grasshopper\Libraries\ClipperTools.dll")  # -> out, A, B; inputs x: list of Polyline; disabled; same code as nestingtwoitems_6
curve_67 = Curve(nestingtwoitems_9.B)  # disabled
curve_68 = Curve(nestingtwoitems_9.A)  # disabled

# ----
brep_brep_7 = BrepBrep(BrepA=curve_68, BrepB=region_difference_8)  # -> flatten(Curves), Points; disabled
closed_8 = Closed(Curve=brep_brep_7.Curves)  # -> Closed, Periodic; disabled
cull_pattern_8 = CullPattern(List=brep_brep_7.Curves, CullPattern=closed_8.Closed)  # disabled
curve_69 = Curve(cull_pattern_8)  # disabled
area_33 = Area(Geometry=curve_69)  # -> Area, Centroid; disabled
panel_52 = Panel(area_33.Area)  # disabled
text_split_11 = TextSplit(Text=panel_52, Separators=panel_24)  # disabled
panel_53 = Panel(text_split_11)  # disabled
list_item_41 = ListItem(List=panel_53, Index=0, Wrap=True)  # -> flatten(Item); disabled
panel_54 = Panel(list_item_41)  # disabled
evaluate_9 = Evaluate(Expression="If(x=y, True, False)", x=panel_40, y=panel_54)  # disabled
dispatch_10 = Dispatch(List=curve_69, DispatchPattern=evaluate_9)  # -> ListA, ListB; disabled
discontinuity_31 = Discontinuity(Curve=convex_hull_16.Hull, Level=1)  # -> Points, Parameters; disabled
curve_70 = Curve(dispatch_10.ListA)  # disabled

# ---- group: CreateATreeWithAllThePlacementPointsAndThePolygonWeArePlacingNextTo (continued)
graft_tree_9 = GraftTree(Tree=curve_70, IncludeEmptyLists=True, IncludeNullItems=True)  # disabled
discontinuity_32 = Discontinuity(Curve=graft_tree_9, Level=1)  # -> Points, Parameters; disabled
c_script_16 = CSharpScript(x=simplify(discontinuity_32.Points), y=discontinuity_31.Points)  # -> out, A; inputs x: tree of Point3d, y: list of Point3d; disabled; same code as c_script

# ---- group: ConvexHullAreaSorting (continued)
convex_hull_17 = ConvexHull(Points=c_script_16.A, Plane=PlaneXY(0, 0, 0))  # -> flatten(Hull), HullZ, Indices; disabled
area_34 = Area(Geometry=convex_hull_17.Hull)  # -> Area, Centroid; disabled
sort_list_21 = SortList(Keys=area_34.Area, ValuesValuesA=curve_70)  # -> Keys, ValuesValuesA; disabled
list_item_42 = ListItem(List=sort_list_21.ValuesValuesA, Index=0, Wrap=True)  # disabled

# ---- group: ConvexHulls (continued)
discontinuity_33 = Discontinuity(Curve=[list_item_42, convex_hull_16.Hull], Level=1)  # -> flatten(Points), Parameters; disabled
convex_hull_18 = ConvexHull(Points=discontinuity_33.Points, Plane=PlaneXY(0, 0, 0))  # -> Hull, HullZ, Indices; disabled

# ---- group: SheetMinusThe"Union"BetweenTheTwoPlacedParts (continued)
region_difference_9 = RegionDifference(CurvesA=region_difference_8, CurvesB=convex_hull_18.Hull)  # disabled

# ---- group: TheTwoPartsToRunThroughTheNoFitPolygonAlgorithm (continued)
merge_16 = Merge(Data1=curve_54, Data2=convex_hull_18.Hull)  # -> flatten(Result); disabled

# ---- group: NoFitPolygonAndTheRespectiveTranslations (continued)
nestingtwoitems_10 = CSharpScript(x=merge_16, Reference="C:\Users\Paula\AppData\Roaming\Grasshopper\Libraries\ClipperTools.dll")  # -> out, A, B; inputs x: list of Polyline; disabled; same code as nestingtwoitems_6
curve_71 = Curve(nestingtwoitems_10.B)  # disabled
curve_72 = Curve(nestingtwoitems_10.A)  # disabled

# ----
brep_brep_8 = BrepBrep(BrepA=curve_72, BrepB=region_difference_9)  # -> flatten(Curves), Points; disabled
closed_9 = Closed(Curve=brep_brep_8.Curves)  # -> Closed, Periodic; disabled
cull_pattern_9 = CullPattern(List=brep_brep_8.Curves, CullPattern=closed_9.Closed)  # disabled
curve_73 = Curve(cull_pattern_9)  # disabled
area_35 = Area(Geometry=curve_73)  # -> Area, Centroid; disabled
panel_55 = Panel(area_35.Area)  # disabled
text_split_12 = TextSplit(Text=panel_55, Separators=panel_27)  # disabled
panel_56 = Panel(text_split_12)  # disabled
list_item_43 = ListItem(List=panel_56, Index=0, Wrap=True)  # -> flatten(Item); disabled
panel_57 = Panel(list_item_43)  # disabled
evaluate_10 = Evaluate(Expression="If(x=y, True, False)", x=panel_43, y=panel_57)  # disabled
dispatch_11 = Dispatch(List=curve_73, DispatchPattern=evaluate_10)  # -> ListA, ListB; disabled
discontinuity_34 = Discontinuity(Curve=convex_hull_18.Hull, Level=1)  # -> Points, Parameters; disabled
curve_74 = Curve(dispatch_11.ListA)  # disabled

# ---- group: CreateATreeWithAllThePlacementPointsAndThePolygonWeArePlacingNextTo (continued)
graft_tree_10 = GraftTree(Tree=curve_74, IncludeEmptyLists=True, IncludeNullItems=True)  # disabled
discontinuity_35 = Discontinuity(Curve=graft_tree_10, Level=1)  # -> Points, Parameters; disabled
c_script_17 = CSharpScript(x=simplify(discontinuity_35.Points), y=discontinuity_34.Points)  # -> out, A; inputs x: tree of Point3d, y: list of Point3d; disabled; same code as c_script

# ---- group: ConvexHullAreaSorting (continued)
convex_hull_19 = ConvexHull(Points=c_script_17.A, Plane=PlaneXY(0, 0, 0))  # -> flatten(Hull), HullZ, Indices; disabled
area_36 = Area(Geometry=convex_hull_19.Hull)  # -> Area, Centroid; disabled
sort_list_22 = SortList(Keys=area_36.Area, ValuesValuesA=curve_74)  # -> Keys, ValuesValuesA; disabled
list_item_44 = ListItem(List=sort_list_22.ValuesValuesA, Index=0, Wrap=True)  # disabled

# ---- group: ConvexHulls (continued)
discontinuity_36 = Discontinuity(Curve=[convex_hull_18.Hull, list_item_44], Level=1)  # -> flatten(Points), Parameters; disabled
convex_hull_20 = ConvexHull(Points=discontinuity_36.Points, Plane=PlaneXY(0, 0, 0))  # -> Hull, HullZ, Indices; disabled

# ---- group: FinalOutPutNoSheet
merge_17 = Merge(
    Data1=placedpart_2,
    Data2=list_item_19,
    Data3=list_item_22,
    Data4=list_item_36,
    Data5=list_item_38,
    Data6=list_item_40,
    Data7=list_item_42,
    Data8=list_item_44)  # -> flatten(Result); disabled

# ----
# Partes ordenadas dentro del contenedor.
finaloutput = Merge(
    Data1=sheet_2,
    Data2=placedpart_2,
    Data3=list_item_19,
    Data4=list_item_22,
    Data5=list_item_36,
    Data6=list_item_38,
    Data7=list_item_40,
    Data8=list_item_42,
    Data9=list_item_44)  # disabled

# ---- group: Hulls
merge_18 = Merge(
    Data1=convex_hull_9.Hull,
    Data2=convex_hull_12.Hull,
    Data3=convex_hull_14.Hull,
    Data4=convex_hull_16.Hull,
    Data5=convex_hull_18.Hull,
    Data6=convex_hull_20.Hull)  # disabled

# ----
discontinuity_37 = Discontinuity(Curve=finaloutput, Level=1)  # -> flatten(Points), Parameters; disabled
convex_hull_21 = ConvexHull(Points=discontinuity_37.Points, Plane=PlaneXY(0, 0, 0))  # -> Hull, HullZ, Indices; disabled
area_37 = Area(Geometry=convex_hull_21.Hull)  # -> Area, Centroid; disabled
expression = Expression(x=area_37.Area, y=area_14.Area, Expression="If(x>y, True, False)")  # disabled
panel_58 = Panel(expression)  # disabled

# ==== cluster Pauls
L = ClusterInput()
A = ClusterInput()
crv = ClusterInput()
crv_2 = Curve(flatten(crv))
divlength = DivideLength(Curve=crv_2, Length=L)  # -> Points, Tangents, Parameters
Z = UnitZ(Factor=1)
lng = ListLength(List=divlength.Points)  # -> flatten(Length)
divide = DivideCurve(Curve=crv_2, Count=lng, Kinks=True)  # -> Points, Tangents, Parameters
xprod = CrossProduct(VectorA=divide.Tangents, VectorB=Z, Unitize=False)  # -> Vector, Length
amp = Amplitude(Vector=xprod.Vector, Amplitude=A)
move = Move(Geometry=divide.Points, Motion=amp)  # -> Geometry, Transform
vdis = VectorDisplay(Anchor=divide.Points, Vector=amp)
cir = Circle(Plane=move.Geometry, Radius=A)  # -> graft(Circle)
ccx = CurveCurve(CurveA=cir, CurveB=crv_2)  # -> simplify(Points), ParamsA, ParamsB
pshift = ShiftPaths(Data=ccx.Points, Offset=-1)
lng_2 = ListLength(List=pshift)
equals = Equality(FirstNumber=lng_2, SecondNumber=Slider(1, range=0..4))  # -> Equality, Inequality
dispatch = Dispatch(List=flatten(divide.Points), DispatchPattern=flatten(equals.Equality))  # -> ListA, ListB
pt = Point(dispatch.ListA)
c_script = CSharpScript(pt=pt, t=L)  # -> out, A, B; inputs pt: list of Point3d, t: Double
# ---------- c_script: C# usings ----------
using System.IO;
using System.Linq;
using System.Data;
using System.Drawing;
using System.Reflection;
using System.Windows.Forms;
using System.Xml;
using System.Xml.Linq;
using System.Runtime.InteropServices;

using Rhino.DocObjects;
using Rhino.Collections;
using GH_IO;
using GH_IO.Serialization;
# ---------- c_script: C# ----------
    List<Point3d> PtOut = new List<Point3d>();
    Point3d temp = pt[0];
    int ind1 = pt.IndexOf(temp);
    PtOut.Add(temp);
    pt.RemoveAt(0);
    double d = new double();

    int N = pt.Count;

    for(int i = 0; i < N;i++){


      if(ind1 == pt.Count ){
        ind1 = 0;
      }



      d = temp.DistanceTo(pt[ind1]);

      if(d > 1.5 * t){
        temp = Point3dList.ClosestPointInList(pt, temp);
        ind1 = pt.IndexOf(temp);
      }
      else{
        temp = pt[ind1];
      }

      PtOut.Add(temp);
      pt.Remove(temp);
    }
    PtOut.Add(PtOut[0]);
    Polyline Poly = new Polyline(PtOut);

    A = Poly;
    B = PtOut;
# ---------- end c_script ----------
crv_3 = Curve(c_script.A)
crv_4 = ClusterOutput(crv_3)

# ==== cluster Cluster
sheet = ClusterInput()  # Sheet to place parts in.
previousconcavehull = ClusterInput()  # Previous concave hull.
concavehullinput = ClusterInput()  # Concave Hull to input.
curve = Curve(sheet)
curve_2 = Curve(previousconcavehull)
curve_3 = Curve(concavehullinput)
region_difference = RegionDifference(CurvesA=curve, CurvesB=curve_3)
parttoplace = ClusterInput()  # Part to place.
merge = Merge(Data1=parttoplace, Data2=curve_2)  # -> flatten(Result)
nestingtwoitems = CSharpScript(x=merge, Reference="C:\Users\Paula\AppData\Roaming\Grasshopper\Libraries\ClipperTools.dll")  # -> out, A, B; inputs x: list of Polyline
# ---------- nestingtwoitems: C# ----------
    // We want to cast(change from one data type to another) our list of polylines to curves, so that
    // we can call the AreaMassProperties class and its method .Compute to get the area of the polygons
    // after that we can now create a List of KeyValuePair to assign the area of our polygons to our
    // polygons so that we can sort them later according to their areas.
    /*
    List<Curve> one = new List<Curve>();
    double[] areas = new Double[x.Count];
    var curves = new List<KeyValuePair<Polyline, double>>();

    for(int i = 0; i < x.Count; ++i)
    {

    one.Add(x.ElementAt(i).ToNurbsCurve());
    areas[i] = AreaMassProperties.Compute(one.ElementAt(i)).Area;
    curves.Add(new KeyValuePair<Polyline, double>(x.ElementAt(i), areas[i]));

    }

    // Here is where the sorting according to area values takes place.
    curves.Sort(Compare1);
    curves.Reverse();
    // We retrieve a list of curves from our List of KeyValuePairs
    List<Polyline> curve = (from kvp in curves select kvp.Key).Distinct().ToList();
    curve.Reverse();
    */

    List<Polyline> curve = x;

    /*
    // We create and populate trees with the points of the curves, so that we can
    // sort each of the lower left points of each of the curves according to the
    // sum of their Xs and Ys positions.
    List<List<Point3d>> pts = new List<List<Point3d>>();
    DataTree<Point3d> tree = new DataTree<Point3d>();
    DataTree<double> treeSum = new DataTree<double>();
    var points = new DataTree<KeyValuePair<Point3d, double>>();
    var point = new List<Point3d>[curve.Count];
    DataTree<Point3d> treeLowerLeft = new DataTree<Point3d>();

    for(int i = 0; i < curve.Count; ++i)
    {

      pts.Add(curve[i].ToList());
      pts[i].RemoveAt(pts[i].Count - 1);
      GH_Path path = new GH_Path(i);

      for(int j = 0; j < pts[i].Count; ++j)
      {

        tree.Add(pts[i][j], path);
        treeSum.Add(pts[i][j].X + pts[i][j].Y, path);

        points.Add(new KeyValuePair<Point3d, double>(tree.Branch(i)[j], treeSum.Branch(i)[j]), path);

        points.Branch(i).Sort(Compare2);
        points.Branch(i).Reverse();
        point[i] = (from kvp in points.Branch(i) select kvp.Key).Distinct().ToList();
        point[i].Reverse();

      }

    }

    for(int i = 0; i < tree.BranchCount; ++i)
      for(int j = 0; j < tree.Branch(i).Count; ++j)
      {

        treeLowerLeft.Add(point[i][j], new GH_Path(i));

      }

    var treeOut = new DataTree<Point3d>();

    for(int i = 0; i < treeLowerLeft.BranchCount; ++i)
      for(int j = 0; j < treeLowerLeft.Branch(i).Count; ++j)
      {

        treeOut.Add(treeLowerLeft.Branch(i)[0], new GH_Path(i));

      }

    /*
    // Create the data structures and initialize them
    DataTree<Point3d> points = new DataTree<Point3d>();
    List<List<Point3d>> lists = new List<List<Point3d>>();

    // Fill the nested list with the list of points
    for(int i = 0; i < x.Count; ++i)
    {

      lists.Add(x[i].ToList());

    }

    // Fill the data tree with the list of points
    for(int i = 0; i < lists.Count; ++i)
    {

      var path = new GH_Path(i);

      for(int j = 0; j < lists[i].Count; ++j )
      {

        points.Add(lists[i][j], path);

      }

    }
    */

    // No Fit Polygon from minkowsky difference using the clipper lib
    Polyline polyOne = curve[0];
    Polyline polyTwo = curve[curve.Count - 1];

    Point3d center = LowerLeftPoint(polyOne);
    Vector3d zAxis = Vector3d.ZAxis;
    Plane p = new Rhino.Geometry.Plane(center, zAxis);

    double tolerance = 0.001;
    List<Polyline> outCurves = new List<Polyline>();
    List<Polyline> outDisplacedCurves = new List<Polyline>();
    foreach(List<IntPoint> path in ClipperLib.Clipper.MinkowskiDiff(polyOne.ToPath2D(p, tolerance), polyTwo.ToPath2D(p, tolerance)))
    {

      Polyline plSum = path.ToPolyline(p, tolerance, true);
      outCurves.Add(plSum);

    }

    Polyline NFP = outCurves[0];

    B = NFP;

    List<Point3d> ptNFP;
    ptNFP = NFP.ToList();
    ptNFP.RemoveAt(0);

    List<Vector3d> vectors = new List<Vector3d>();
    for(int i = 0; i < ptNFP.Count; ++i)
    {

      vectors.Add(new Vector3d(ptNFP.ElementAt(i) - center));

    }

    List<Curve> translated = new List<Curve>();
    Polyline[] polys = new Polyline[ptNFP.Count];
    List<List<Point3d>> polyPoint = new List<List<Point3d>>();

    List<Point3d> pointsA = new List<Point3d>();
    pointsA = polyTwo.ToList();
    pointsA.RemoveAt(pointsA.Count - 1);
    DataTree<Point3d> polyPoints = new DataTree<Point3d>();
    DataTree<Point3d> APoints = new DataTree<Point3d>();
    for(int i = 0; i < ptNFP.Count; ++i)
    {

      var path = new GH_Path(i);
      Curve oney = polyOne.ToNurbsCurve();
      oney.Translate(vectors.ElementAt(i));
      translated.Add(oney);
      translated.ElementAt(i).TryGetPolyline(out polys[i]);
      polyPoint.Add(polys[i].ToList());

      for(int j = 0; j < polyPoint[i].Count - 1; ++j)
      {

        polyPoints.Add(polyPoint[i][j], path);

      }

    }

    for(int i = 0; i < ptNFP.Count; ++i)
      for(int j = 0; j < pointsA.Count; ++j)
      {

        var path = new GH_Path(i);
        APoints.Add(pointsA[j], path);

      }

    for(int i = 0; i < polyPoints.BranchCount; ++i)
      for(int j = 0; j < polyPoints.Branch(i).Count; ++j)
      {

        APoints.Add(polyPoints.Branch(i)[j], new GH_Path(i));

      }

    var list = new Grasshopper.Kernel.Geometry.Node2List[APoints.BranchCount];
    var polyLines = new Polyline[APoints.BranchCount];
    var curvesConvex = new Curve[APoints.BranchCount];
    var convexArea = new Double[APoints.BranchCount];
    var convexSort = new List<KeyValuePair<Polyline, double>>();
    var hullSort = new List<KeyValuePair<Polyline, double>>();

    for(int i = 0; i < APoints.BranchCount; ++i)
    {

      list[i] = new Grasshopper.Kernel.Geometry.Node2List(APoints.Branch(i));
      polyLines[i] = Grasshopper.Kernel.Geometry.ConvexHull.Solver.ComputeHull(list[i]);
      curvesConvex[i] = polyLines[i].ToNurbsCurve();
      convexArea[i] = AreaMassProperties.Compute(curvesConvex[i]).Area;
      convexSort.Add(new KeyValuePair<Polyline, double>(polys[i], convexArea[i]));
      hullSort.Add(new KeyValuePair<Polyline, double>(polyLines[i], convexArea[i]));

    }

    // Output the polygons with no convex hull
    // Here is where the sorting according to area values takes place.
    convexSort.Sort(Compare1);
    convexSort.Reverse();
    // We retrieve a list of polylines from our List of KeyValuePairs
    List<Polyline> polyFinal = (from kvp in convexSort select kvp.Key).Distinct().ToList();
    polyFinal.Reverse();

    // Output the convex hull polygons
    // Here is where the sorting according to area values takes place.
    hullSort.Sort(Compare1);
    hullSort.Reverse();
    // We retrieve a list of polylines from our List of KeyValuePairs
    List<Polyline> hullFinal = (from kvp in hullSort select kvp.Key).Distinct().ToList();
    hullFinal.Reverse();

    A = polyFinal;

    //B = hullFinal[0];

    /*
    Curve booleanUnionOne = polyFinal[0].ToNurbsCurve();
    Curve booleanUnionTwo = polyTwo.ToNurbsCurve();

    var listBoolean = new List<Curve>();

    listBoolean.Add(booleanUnionOne);
    listBoolean.Add(booleanUnionTwo);

    A = Curve.CreateBooleanUnion(listBoolean).ElementAt(1);
    */
# ---------- nestingtwoitems: C# additional code ----------
  private Point3d LowerLeftPoint(Polyline poly)
  {

    // We need the on the lower left corner to produce the NFP of the bin and the first placement
    List<Point3d> pointsList = new List<Point3d>();
    pointsList = poly.ToList();
    pointsList.RemoveAt(pointsList.Count - 1);

    Point3d[] points = pointsList.ToArray();
    double[] keys = new Double[points.Length];

    for (int i = 0; i < points.Length; ++i)
    {

      keys[i] = points[i].X + points[i].Y;

    }

    Array.Sort(keys, points);

    return points[0];

  }

  static int Compare1(KeyValuePair<Polyline, double> a, KeyValuePair<Polyline, double> b)
  {

    return a.Value.CompareTo(b.Value);

  }

  static int Compare2(KeyValuePair<Point3d, double> a, KeyValuePair<Point3d, double> b)
  {

    return a.Value.CompareTo(b.Value);

  }
# ---------- end nestingtwoitems ----------
curve_4 = Curve(nestingtwoitems.A)
region_intersection = RegionIntersection(CurvesA=curve_4, CurvesB=region_difference)
area = Area(Geometry=region_intersection)  # -> Area, Centroid
area_2 = Area(Geometry=parttoplace)  # -> Area, Centroid
panel = Panel(area_2.Area)
panel_2 = Panel(area.Area)
text_split = TextSplit(Text=area.Area, Separators=".")
text_split_2 = TextSplit(Text=panel, Separators=".")
panel_3 = Panel(text_split)
panel_4 = Panel(text_split_2)
list_item = ListItem(List=panel_3, Index=0, Wrap=True)  # -> flatten(Item)
list_item_2 = ListItem(List=panel_4, Index=0, Wrap=True)  # -> flatten(Item)
panel_5 = Panel(list_item)
panel_6 = Panel(list_item_2)
evaluate = Evaluate(Expression="If(x=y, True, False)", x=panel_6, y=panel_5)
dispatch = Dispatch(List=region_intersection, DispatchPattern=evaluate)  # -> ListA, ListB
discontinuity = Discontinuity(Curve=curve_3, Level=1)  # -> Points, Parameters
curve_5 = Curve(dispatch.ListA)
graft_tree = GraftTree(Tree=curve_5, IncludeEmptyLists=True, IncludeNullItems=True)
discontinuity_2 = Discontinuity(Curve=graft_tree, Level=1)  # -> Points, Parameters
c_script = CSharpScript(x=simplify(discontinuity_2.Points), y=discontinuity.Points)  # -> out, A; inputs x: tree of Point3d, y: list of Point3d
# ---------- c_script: C# ----------
    for(int i = 0; i < x.BranchCount; ++i)
      for(int j = 0; j < y.Count; ++j)
      {
      
        x.Add(y[j], new GH_Path(i));
        
      }
    
    A = x;
# ---------- end c_script ----------
convex_hull = ConvexHull(Points=c_script.A, Plane=PlaneXY(0, 0, 0))  # -> flatten(Hull), HullZ, Indices
area_3 = Area(Geometry=convex_hull.Hull)  # -> Area, Centroid
sort_list = SortList(Keys=area_3.Area, ValuesValuesA=curve_5)  # -> Keys, ValuesValuesA
list_item_3 = ListItem(List=sort_list.ValuesValuesA, Index=0, Wrap=True)
curve_6 = Curve([curve_3, list_item_3])
pauls = Pauls_2(crv=curve_6, L=Slider(1.39, range=0..10), A=Slider(2, range=0..10))
curve_7 = Curve(pauls)
region_difference_2 = RegionDifference(CurvesA=region_difference, CurvesB=curve_7)
concavehull = ClusterOutput(curve_7)  # Concave hull from placed part and previous concave hull.
part_that_has_been_placed = ClusterOutput(list_item_3)  # Part that has already been placed.
sheetout = ClusterOutput(region_difference_2)  # Sheet output.

# ==== cluster Cluster_2
concavehullinput = ClusterInput()  # Input the concave hull from previews iteration.
sheetin = ClusterInput()  # Input the sheet minus the concave hull
curve = Curve(concavehullinput)
curve_2 = Curve(sheetin)
region_difference = RegionDifference(CurvesA=curve_2, CurvesB=curve)
parttoplace = ClusterInput()  # Part to be placed inside and nested the sheet.
curve_3 = Curve(parttoplace)
merge = Merge(Data1=curve_3, Data2=curve)  # -> flatten(Result)
nestingtwoitems = CSharpScript(x=merge, Reference="C:\Users\Paula\AppData\Roaming\Grasshopper\Libraries\ClipperTools.dll")  # -> out, A, B; inputs x: list of Polyline; same code as nestingtwoitems
curve_4 = Curve(nestingtwoitems.A)
brep_brep = BrepBrep(BrepA=curve_4, BrepB=region_difference)  # -> Curves, Points
closed = Closed(Curve=brep_brep.Curves)  # -> Closed, Periodic
cull_pattern = CullPattern(List=brep_brep.Curves, CullPattern=closed.Closed)  # -> flatten(List)
area = Area(Geometry=cull_pattern)  # -> Area, Centroid
area_2 = Area(Geometry=curve_3)  # -> Area, Centroid
round = Round(Number=area_2.Area)  # -> Nearest, Floor, Ceiling
round_2 = Round(Number=area.Area)  # -> Nearest, Floor, Ceiling
evaluate = Evaluate(Expression="If(x=y, True, False)", x=round.Nearest, y=round_2.Nearest)
dispatch = Dispatch(List=cull_pattern, DispatchPattern=evaluate)  # -> ListA, ListB
discontinuity = Discontinuity(Curve=curve, Level=1)  # -> Points, Parameters
curve_5 = Curve(dispatch.ListA)
graft_tree = GraftTree(Tree=curve_5, IncludeEmptyLists=True, IncludeNullItems=True)
discontinuity_2 = Discontinuity(Curve=graft_tree, Level=1)  # -> Points, Parameters
c_script = CSharpScript(x=simplify(discontinuity_2.Points), y=discontinuity.Points)  # -> out, A; inputs x: tree of Point3d, y: list of Point3d
# ---------- c_script: C# usings ----------
using System.IO;
using System.Linq;
using System.Data;
using System.Drawing;
using System.Reflection;
using System.Windows.Forms;
using System.Xml;
using System.Xml.Linq;
using System.Runtime.InteropServices;

using Rhino.DocObjects;
using Rhino.Collections;
using GH_IO;
using GH_IO.Serialization;
# ---------- c_script: C# ----------
    for(int i = 0; i < x.BranchCount; ++i)
      for(int j = 0; j < y.Count; ++j)
      {

        x.Add(y[j], new GH_Path(i));

      }

    A = x;
# ---------- end c_script ----------
convex_hull = ConvexHull(Points=c_script.A, Plane=PlaneXY(0, 0, 0))  # -> flatten(Hull), HullZ, Indices
area_3 = Area(Geometry=convex_hull.Hull)  # -> Area, Centroid
distance = ClusterInput()
sort_list = SortList(Keys=area_3.Area, ValuesValuesA=curve_5)  # -> Keys, ValuesValuesA
offset_curve = OffsetCurve(Curve=curve, Distance=distance, Plane=PlaneXY(0, 0, 0), Corners=1)  # -> simplify(flatten(Curve))
list_item = ListItem(List=sort_list.ValuesValuesA, Index=0, Wrap=True)
region_union = RegionUnion(Curves=[list_item, offset_curve])
region_difference_2 = RegionDifference(CurvesA=region_difference, CurvesB=region_union)
area_4 = Area(Geometry=region_union)  # -> Area, Centroid
sort_list_2 = SortList(Keys=area_4.Area, ValuesValuesA=region_union)  # -> Keys, reverse(ValuesValuesA)
list_item_2 = ListItem(List=sort_list_2.ValuesValuesA, Index=0, Wrap=True)
concavehullout = ClusterOutput(list_item_2)  # Outputs the concave hull for the next iteration.
sheetoutput = ClusterOutput(region_difference_2)  # Outputs the sheet minus the concave hull for the next iteration.
placed_part = ClusterOutput(list_item)  # Part that has been placed.

# ==== cluster Pauls_2
L = ClusterInput()
A = ClusterInput()
crv = ClusterInput()
crv_2 = Curve(flatten(crv))
divlength = DivideLength(Curve=crv_2, Length=L)  # -> Points, Tangents, Parameters
Z = UnitZ(Factor=1)
lng = ListLength(List=divlength.Points)  # -> flatten(Length)
divide = DivideCurve(Curve=crv_2, Count=lng, Kinks=True)  # -> Points, Tangents, Parameters
xprod = CrossProduct(VectorA=divide.Tangents, VectorB=Z, Unitize=False)  # -> Vector, Length
amp = Amplitude(Vector=xprod.Vector, Amplitude=A)
move = Move(Geometry=divide.Points, Motion=amp)  # -> Geometry, Transform
vdis = VectorDisplay(Anchor=divide.Points, Vector=amp)
cir = Circle(Plane=move.Geometry, Radius=A)  # -> graft(Circle)
ccx = CurveCurve(CurveA=cir, CurveB=crv_2)  # -> simplify(Points), ParamsA, ParamsB
pshift = ShiftPaths(Data=ccx.Points, Offset=-1)
lng_2 = ListLength(List=pshift)
equals = Equality(FirstNumber=lng_2, SecondNumber=Slider(1, range=0..1))  # -> Equality, Inequality
dispatch = Dispatch(List=flatten(divide.Points), DispatchPattern=flatten(equals.Equality))  # -> ListA, ListB
pt = Point(dispatch.ListA)
c_script = CSharpScript(pt=pt, t=L)  # -> out, A, B; inputs pt: list of Point3d, t: Double
# ---------- c_script: C# ----------
    List<Point3d> PtOut = new List<Point3d>();
    Point3d temp = pt[0];
    int ind1 = pt.IndexOf(temp);
    PtOut.Add(temp);
    pt.RemoveAt(0);
    double d = new double();

    int N = pt.Count;

    for(int i = 0; i < N;i++){
      

      if(ind1 == pt.Count ){
        ind1 = 0;
      }
       
       

      d =temp.DistanceTo(pt[ind1]);

      if(d > 1.5*t){
        temp = Point3dList.ClosestPointInList(pt, temp);
        ind1 = pt.IndexOf(temp);
      }
      else{
        temp = pt[ind1];
      }

      PtOut.Add(temp);
      pt.Remove(temp);
    }
    PtOut.Add(PtOut[0]);
    Polyline Poly = new Polyline(PtOut);

    A = Poly;
    B = PtOut;
# ---------- end c_script ----------
crv_3 = Curve(c_script.A)
crv_4 = ClusterOutput(crv_3)
