# Grasshopper definition alpha_shapes.gh (Grasshopper 0.9.76)
# plug-ins: onScreen

crv = Curve([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])
discontinuity = Discontinuity(Curve=crv, Level=1)  # -> Points, Parameters
number_slider = Slider(1.938, range=0..10)
number_slider_2 = Slider(1, range=0..1)
shatter = Shatter(Curve=crv, Parameters=discontinuity.Parameters)
divlength = DivideLength(Curve=crv, Length=number_slider)  # -> Points, Tangents, Parameters
Z = UnitZ(Factor=1)
crv_2 = Curve([<curve referenced from the Rhino model> x2])
lng = ListLength(List=divlength.Points)  # -> flatten(Length)
pt = Point([<point referenced from the Rhino model> x7])
crv_3 = Curve([<curve referenced from the Rhino model> x6])
srf = Surface(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)
crv_4 = Curve([<curve referenced from the Rhino model> x10])
crv_5 = Curve(crv_4)
divide = DivideCurve(Curve=crv, Count=lng, Kinks=True)  # -> Points, Tangents, Parameters
popgeo = PopulateGeometry(Geometry=srf, Count=100, Seed=1)
xprod = CrossProduct(VectorA=divide.Tangents, VectorB=Z, Unitize=False)  # -> Vector, Length
divide_2 = DivideCurve(Curve=crv_2, Count=Slider(100, range=0..100), Kinks=False)  # -> flatten(Points), Tangents, Parameters
del = DelaunayMesh(Points=divide_2.Points, Plane=PlaneXY(0, 0, 0))
alpha_shape = AlphaShape(Radius=0, Plane=PlaneXY(0, 0, 0))
weld = WeldMesh(Mesh=del, Angle=3.141592654)
panel = Panel(weld)
amp = Amplitude(Vector=xprod.Vector, Amplitude=number_slider_2)
number_slider_3 = Slider(8, range=0..10)
facec = FaceCircles(Mesh=weld)  # -> Centers, Ratio
attrition = Slider(0.9, range=0..1)
curve_proximity = CurveProximity()  # -> PointA, PointB, Distance
demesh = DeconstructMesh(Mesh=weld)  # -> Vertices, Faces, Colours, Normals
move = Move(Geometry=divide.Points, Motion=amp)  # -> Geometry, Transform
vdis = VectorDisplay(Anchor=divide.Points, Vector=amp)
sort_list = SortList(Keys=facec.Ratio, ValuesA=facec.Ratio)  # -> Keys, ValuesA
darc = DeconstructArc(Arc=facec.Centers)  # -> BasePlane, Radius, Angle
lng_2 = ListLength(List=demesh.Faces)
cir = Circle(Plane=move.Geometry, Radius=number_slider_2)  # -> graft(Circle)
sort = SortList(Keys=darc.Radius, ValuesA=demesh.Faces)  # -> Keys, ValuesA
reverse_list = ReverseList(List=sort_list.ValuesA)
multiplication = Multiplication(A=lng_2, B=attrition)
ccx = CurveCurve(CurveA=cir, CurveB=crv)  # -> simplify(Points), ParamsA, ParamsB
split = SplitList(List=sort.ValuesA, Index=multiplication)  # -> ListA, ListB
conmesh = ConstructMesh(Vertices=demesh.Vertices, Faces=split.ListA)
list_item = ListItem(List=reverse_list, Index=0, Wrap=True)
panel_2 = Panel(list_item)
c_script = CSharpScript(
    x=divide_2.Points,
    y=list_item,
    Reference=["C:\Program Files\Common Files\McNeel\Rhinoceros\5.0\Plug-ins\Grasshopper (b45a29b1-4343-4035-989e-044e8580d9cf)\0.9.76.0\Components\Surface.gha", "C:\Program Files\Common Files\McNeel\Rhinoceros\5.0\Plug-ins\Grasshopper (b45a29b1-4343-4035-989e-044e8580d9cf)\0.9.76.0\Components\Curve.gha"])  # -> out, A, B, C; inputs x: list of Point3d, y: Double
# ---------- c_script: C# ----------
    var nodeTwoList = new Grasshopper.Kernel.Geometry.Node2List(x);
    var delaunayFaces = Grasshopper.Kernel.Geometry.Delaunay.Solver.Solve_Faces(nodeTwoList, 1);
    var delaunayMesh = Grasshopper.Kernel.Geometry.Delaunay.Solver.Solve_Mesh(nodeTwoList, 1, ref delaunayFaces);
    delaunayMesh.Weld(Math.PI);

    var list = new List<object>();

    var circles = new SurfaceComponents.MeshComponents.Component_MeshFaceCircles();
    var param = circles.Params.Input[0] as Grasshopper.Kernel.GH_PersistentGeometryParam<Grasshopper.Kernel.Types.GH_Mesh>;
    param.PersistentData.ClearData();
    param.PersistentData.Append(new GH_Mesh(delaunayMesh));

    circles.ExpireSolution(true);

    //add to a dummy document so we can read outputs
    var doc = new Grasshopper.Kernel.GH_Document();
    doc.AddObject(circles, false);

    //read output circles
    circles.Params.Output[0].CollectData();
    var ratio = new double[circles.Params.Output[1].VolatileDataCount];
    for(int i = 0; i < circles.Params.Output[0].VolatileDataCount; ++i)
    {

      //ratio[i] = circles.Params.Output[1].VolatileData.get_Branch(0)[i];
      GH_Convert.ToDouble(circles.Params.Output[1].VolatileData.get_Branch(0)[i], out ratio[i], GH_Conversion.Both);
      list.Add(circles.Params.Output[0].VolatileData.get_Branch(0)[i]);

    }

    var arcsList = new double[list.Count];

    var arcs = new AnalysisComponents.Component_DeconstructArc();
    var arcParams = arcs.Params.Input[0] as Grasshopper.Kernel.GH_PersistentParam<Grasshopper.Kernel.Types.GH_Arc>;
    arcParams.PersistentData.ClearData();
    var circle = new Arc[delaunayMesh.Faces.Count];
    for(int i = 0; i < list.Count; ++i)
    {

      GH_Convert.ToArc(list[i], ref circle[i], GH_Conversion.Both);
      arcParams.PersistentData.Append(new GH_Arc(circle[i]));

    }

    arcs.ExpireSolution(true);
    var docOne = new Grasshopper.Kernel.GH_Document();
    docOne.AddObject(arcs, false);

    arcs.Params.Output[0].CollectData();
    for(int i = 0; i < arcs.Params.Output[1].VolatileDataCount; ++i)
    {

      GH_Convert.ToDouble(arcs.Params.Output[1].VolatileData.get_Branch(0)[i], out arcsList[i], GH_Conversion.Both);
      //arcsList.Add(arcs.Params.Output[1].VolatileData.get_Branch(0)[i]);

    }

    var faceMesh = new List<object>();
    var verticesMesh = new List<object>();

    var deMesh = new SurfaceComponents.MeshComponents.Component_DeconstructMesh();
    var meshParams = deMesh.Params.Input[0] as Grasshopper.Kernel.GH_PersistentParam<Grasshopper.Kernel.Types.GH_Mesh>;
    meshParams.PersistentData.ClearData();
    meshParams.PersistentData.Append(new GH_Mesh(delaunayMesh));

    deMesh.ExpireSolution(true);
    var docTwo = new Grasshopper.Kernel.GH_Document();
    docTwo.AddObject(deMesh, false);

    deMesh.Params.Output[0].CollectData();

    for(int i = 0; i < deMesh.Params.Output[0].VolatileDataCount; ++i)
    {

      verticesMesh.Add(deMesh.Params.Output[0].VolatileData.get_Branch(0)[i]);

    }

    for(int i = 0; i < deMesh.Params.Output[1].VolatileDataCount; ++i)
    {

      faceMesh.Add(deMesh.Params.Output[1].VolatileData.get_Branch(0)[i]);

    }

    var faceCullRadius = RadiusSorting(faceMesh, arcsList);

    Array.Sort(ratio);

    var splitListIndex = Convert.ToInt32(ratio[ratio.Length - 1] * faceMesh.Count);

    var splitList = SplitList(faceCullRadius, splitListIndex);

    var constructMesh = new Mesh();
    var meshPoints = new Point3d[verticesMesh.Count];
    for(int i = 0; i < verticesMesh.Count; ++i)
    {

      GH_Convert.ToPoint3d(verticesMesh[i], ref meshPoints[i], GH_Conversion.Both);
      constructMesh.Vertices.Add(meshPoints[i]);

    }

    var meshFaces = new Grasshopper.Kernel.Types.GH_MeshFace[faceMesh.Count];
    for(int i = 0; i < faceMesh.Count; ++i)
    {

      GH_Convert.ToGHMeshFace(faceMesh[i], GH_Conversion.Both, ref meshFaces[i]);
      //constructMesh.Faces.AddFace(meshFaces[i]);

    }

    A = meshFaces;

    //B = verticesMesh;
# ---------- c_script: C# additional code ----------
  public List<object> RadiusSorting(List<object> x, double[] radius)
  {

    var compare = new List<KeyValuePair<double, object>>();

    for(int i = 0; i < x.Count; ++i)
    {

      compare.Add(new KeyValuePair<double, object>(radius[i], x.ElementAt(i)));

    }

    // Here is where the sorting according to radius takes place.
    compare.Sort(Compare1);
    compare.Reverse();
    // We retrieve a list of objects from our List of KeyValuePairs
    List<object> compared = (from kvp in compare select kvp.Value).Distinct().ToList();
    compared.Reverse();

    return compared;

  }

  static int Compare1(KeyValuePair<double, object> a, KeyValuePair<double, object> b)
  {

    return a.Key.CompareTo(b.Key);

  }

  private List<object> SplitList(List<object> list, int i)
  {

    var points = new List<object>();

    var chunk = Chunk(list, i, list.Count);

    foreach(var item in chunk)
    {

      points = item.ToList();

    }

    return points;

  }

  public static IEnumerable<IEnumerable<T>> Chunk<T> (IEnumerable<T> source, int chunksize, int count)
  {

    while (source.Any())
    {

      yield return source.Take(chunksize);
      source = source.Skip(chunksize + count);

    }

  }
# ---------- end c_script ----------
pshift = ShiftPaths(Data=ccx.Points, Offset=-1)
conmesh_2 = ConstructMesh(Vertices=demesh.Vertices, Faces=split.ListA)
conmesh_3 = ConstructMesh(Vertices=[Point(0, 0, 0), Point(10, 0, 0), Point(10, 10, 0), Point(0, 10, 0)], Faces={A=0, B=1, C=2, D=3})
lng_3 = ListLength(List=pshift)
medges = MeshEdges(Mesh=conmesh_2)  # -> NakedEdges, InteriorEdges, NonManifoldEdges
medges_2 = MeshEdges(Mesh=conmesh_3)  # -> NakedEdges, InteriorEdges, NonManifoldEdges
equals = Equality(FirstNumber=lng_3, SecondNumber=Slider(1, range=0..1))  # -> Equality, Inequality
sortlist = CSharpScript()  # -> out, A; inputs x: list, y: list of Double
# ---------- sortlist: C# ----------
    A = RadiusSorting(x, y);
# ---------- sortlist: C# additional code ----------
  public List<object> RadiusSorting(List<object> x, List<double> radius)
  {
    var compare = new List<KeyValuePair<double, object>>();

    for(int i = 0; i < x.Count; ++i)
    {

      compare.Add(new KeyValuePair<double, object>(radius[i], x.ElementAt(i)));

    }

    // Here is where the sorting according to area values takes place.
    compare.Sort(Compare1);
    compare.Reverse();
    // We retrieve a list of curves from our List of KeyValuePairs
    List<object> compared = (from kvp in compare select kvp.Value).Distinct().ToList();
    compared.Reverse();

    return compared;

  }

  static int Compare1(KeyValuePair<double, object> a, KeyValuePair<double, object> b)
  {

    return a.Key.CompareTo(b.Key);

  }
# ---------- end sortlist ----------
join = JoinCurves(Curves=medges_2.NakedEdges, Preserve=False)
dispatch = Dispatch(List=flatten(divide.Points), DispatchPattern=flatten(equals.Equality))  # -> ListA, ListB
join_2 = JoinCurves(Curves=medges.NakedEdges, Preserve=False)
pt_2 = Point(dispatch.ListA)
c_script_2 = CSharpScript(pt=pt_2, t=number_slider)  # -> out, A, B; inputs pt: list of Point3d, t: Double
# ---------- c_script_2: C# ----------
    List<Point3d> PtOut = new List<Point3d>();
    Point3d temp = pt[0];
    int ind1 = pt.IndexOf(temp);
    PtOut.Add(temp);
    pt.RemoveAt(0);
    double d = new double();

    int N = pt.Count;

    for(int i = 0; i < N;i++){
      

      if(ind1 == pt.Count ){
        ind1 = 0;
      }
       
       

      d =temp.DistanceTo(pt[ind1]);

      if(d > 1.5*t){
        temp = Point3dList.ClosestPointInList(pt, temp);
        ind1 = pt.IndexOf(temp);
      }
      else{
        temp = pt[ind1];
      }

      PtOut.Add(temp);
      pt.Remove(temp);
    }
    PtOut.Add(PtOut[0]);
    Polyline Poly = new Polyline(PtOut);

    A = Poly;
    B = PtOut;
# ---------- end c_script_2 ----------
crv_6 = Curve(c_script_2.A)
panel_3 = Panel(c_script_2.out)
brep = Brep(crv_6)
